# Grasshopper definition TT-Base (Dashboard Port).gh (Grasshopper 1.0.7)
# plug-ins: Grasshopper-Archicad Live Connection built for Rhinoceros 7, Pufferfish, Swiftlet, Kangaroo2 Components, TT Toolbox

number_slider = Slider(17, range=15..25)
number_slider_2 = Slider(17, range=15..25)
list = ValueList({"Uno": 3, "Dos": 2, "Tres": 1, "Cuatro": 0}, selected="Cuatro")
number_slider_3 = Slider(20, range=10..20)
number_slider_4 = Slider(20, range=10..20)
number_slider_5 = Slider(20, range=10..20)
number_slider_6 = Slider(20, range=10..20)
number_slider_7 = Slider(15, range=15..20)
number_slider_8 = Slider(950, range=0..1000)
number_slider_9 = Slider(480, range=0..1000)
number_slider_10 = Slider(1000, range=0..1000)
number_slider_11 = Slider(950, range=0..1000)
tipo_de_calculo_planta = ValueList({"Por Offset": 0, "Por Unidad": 1}, selected="Por Unidad")
X = UnitX(Factor=1)
genes = GenePool(Decimals=6, Maximum=0.99, Minimum=0.01, Value=[0.53683, 0.37356, 0.23437, 0.5555, 0.39515, 0.59698, 0.57265, 0.23093])
Y = UnitY(Factor=1)
number_slider_12 = Slider(6000, range=0..10000)
num = Number(tipo_de_calculo_planta)
cluster = Cluster_128(
    A=number_slider_8,
    num=number_slider_3,
    A_2=number_slider_9,
    num_2=number_slider_4,
    A_3=number_slider_10,
    num_3=number_slider_5,
    A_4=number_slider_11,
    num_4=number_slider_6)  # -> I_4, I, I_2, I_3, R, num_9, R_2, num_10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
Y_2 = UnitY(Factor=Slider(236, range=0..1000))
merge = Merge(Data1=number_slider_8, Data2=number_slider_9, Data3=number_slider_10, Data4=number_slider_11)
panel = Panel("""{-35, 0, 0}
{-15, -25, 0}
{20, -5, 0}
{20, 15, 0}
{40, 20, 0}
{35, 50, 0}
{-15, 35, 0}
{-35, 0, 0}""")
lng = ListLength(List=merge)
rotation = Slider(114, range=0..180)
offset = Slider(7.093, range=2..12)
X_2 = Slider(9.052, range=2..12)
divide = Slider(12, range=4..12)
orient = Slider(9.5, range=6..12)
h1 = Slider(2.2, range=2..12)
Y_3 = Slider(7.005, range=2..12)
gap = Slider(7, range=2..8)
width = Slider(7.6, range=6..12)
lenght = Slider(8.3, range=6..12)
h1_2 = Slider(6.9, range=6..12)
subtraction = Subtraction(A=lng, B=list)
pt = Point(panel)
relay = Relay()
genes_2 = GenePool(Decimals=6, Maximum=0.99, Minimum=0.01, Value=[0.53154, 0.66202, 0.39182, 0.65381, 0.21039, 0.22441, 0.25068, 0.58884])
genes_3 = GenePool(Decimals=6, Maximum=0.99, Minimum=0.01, Value=[0.60104, 0.67944, 0.60368, 0.64764, 0.99, 0.33151, 0.82166, 0.32168])
series = Series(Start=0, Step=1, Count=subtraction)
pline = PolyLine(Vertices=pt, Closed=False)
item = ListItem(List=merge, Index=series, Wrap=True)
lng_2 = ListLength(List=series)
offset_2 = OffsetCurve(Curve=pline, Distance=expr("-x", offset), Corners=1)
num_2 = Number(rotation)
num_3 = Number(h1)
num_4 = Number(X_2)
num_5 = Number(Y_3)
num_6 = Number(orient)
num_7 = Number(width)
num_8 = Number(lenght)
num_9 = Number(h1_2)
cluster_2 = Cluster_129(K=genes_3)
cluster_3 = Cluster_130(K=genes_2)
cluster_4 = Cluster_129(K=genes_2)
crossref = CrossReference(ListA=cluster_3, ListB=cluster_2, CrossMode=1)  # -> ListA, ListB
boundary = BoundarySurfaces(Edges=offset_2)
area = Area(Geometry=offset_2)  # -> Area, Centroid
vec = VectorXYZ(XComponent=num_4, YComponent=num_5, ZComponent=0)  # -> Vector, Length
expression = Expression(x=gap, y=divide, z=Y_3, Expression="(x*1)+(y*0.4)+(z*0.2)")
X_3 = UnitX(Factor=1)
xy = XYPlane(Origin=area.Centroid)
number_slider_13 = Slider(274.999, range=0..300)
dom² = ConstructDomain²(DomainU=crossref.ListB, DomainV=crossref.ListA)
number_slider_14 = Slider(19, range=0..100)
move = Move(Geometry=xy, Motion=vec.Vector)  # -> Geometry, Transform
addition = Addition(A=gap, B=divide)
rotate = Rotate(Geometry=move.Geometry, Angle=degrees(num_2), Plane=move.Geometry)  # -> Geometry, Transform
deplane = DeconstructPlane(Plane=rotate.Geometry)  # -> Origin, XAxis, YAxis, ZAxis
galapagos = Galapagos(fitness=addition, gene=[divide, gap, rotation])
num_10 = Number(divide)
X_4 = UnitX(Factor=1)
num_11 = Number(gap)
xy_2 = XYPlane(Origin=Point(0, 0, 0))
rotate_2 = Rotate(Geometry=xy_2, Angle=num_6, Plane=xy_2)  # -> Geometry, Transform
dom = ConstructDomain(DomainStart=expr("-x/2", num_7), DomainEnd=expr("x/2", num_7))
dom_2 = ConstructDomain(DomainStart=expr("-x/2", num_8), DomainEnd=expr("x/2", num_8))
num_12 = Number(cluster.I_4)
num_13 = Number(cluster.I)
num_14 = Number(cluster.I_2)
num_15 = Number(cluster.I_3)
num_16 = Number(number_slider_3)
num_17 = Number(number_slider_4)
num_18 = Number(number_slider_5)
num_19 = Number(number_slider_6)
rectangle = Rectangle(Plane=rotate_2.Geometry, XSize=dom, YSize=dom_2, Radius=0)  # -> Rectangle, Length
crv = Curve(simplify(graft(rectangle.Rectangle)))
entwine = Entwine(Branch00=num_16, Branch01=num_17, Branch02=num_18, Branch03=num_19, FlattenInputs=True)  # -> simplify(Result)
explode = Explode(Curve=crv, Recursive=True)  # -> Segments, Vertices
item_2 = ListItem(List=explode.Segments, Index=0, Wrap=True)  # -> Item, Item1, Item2, Item3
eval = EvaluateCurve(Curve=reparameterize(explode.Segments), Parameter=Slider(0.5, range=0..1))  # -> Point, Tangent, Angle
vdis = VectorDisplay(Anchor=eval.Point, Vector=eval.Tangent)
flip = FlipCurve(Curve=item_2.Item3)  # -> Curve, Flag
flip_2 = FlipCurve(Curve=item_2.Item)  # -> Curve, Flag
relay_2 = Relay()
num_20 = Number(relay_2)
midpt = CurveMiddle(Curve=flip_2.Curve)
midpt_2 = CurveMiddle(Curve=item_2.Item2)
ln = Line(StartPoint=midpt, EndPoint=midpt_2)
Z = UnitZ(Factor=num_9)
Z_2 = UnitZ(Factor=num_3)
crv_2 = Curve(item_2.Item1)
move_2 = Move(Geometry=ln, Motion=Z)  # -> Geometry, Transform
move_3 = Move(Geometry=crv_2, Motion=Z_2)  # -> Geometry, Transform
move_4 = Move(Geometry=flip.Curve, Motion=Z_2)  # -> Geometry, Transform
merge_2 = Merge(Data1=flip.Curve, Data2=move_4.Geometry, Data3=move_2.Geometry, Data4=move_3.Geometry, Data5=crv_2)
loft = Loft(Curves=merge_2, Options={Adjust=False, Closed=False, LoftEnds=0, LoftSimp=0, LoftType=3, Rebuild=10, Refit=0.01})
galapagos_2 = Galapagos(
    fitness=num_47,
    gene=[number_slider_7, genes, number_slider, number_slider_2, genes_3, genes_2, number_slider_14, number_slider_13])
crv_3 = Curve()
item_3 = ListItem(List=flatten(crv_3), Index=0, Wrap=True)  # -> Item, Item1, Item2, Item3
panel_2 = Panel(crv_3)
# Direccion URL Proyecto Supabase: https://qbwaufbgnjqicixzifuu.supabase.co/rest/v1
version_id = Panel("81a7598a-3152-4d18-8613-2c6991df66a6")
clave_secreta = Panel("sb_secret_CoTrNisfxjVZcepN-5VZQA_-a6QKaJx")
pipeline = GeometryPipeline(
    GroupByLayer=True,
    GroupByType=False,
    IncludeHidden=True,
    IncludeLocked=True,
    LayerFilter="TRR-PLANTAS",
    NameFilter="*",
    SublayerFiltering=True,
    TypeFilter=4)
pipeline_2 = GeometryPipeline(
    GroupByLayer=True,
    GroupByType=False,
    IncludeHidden=True,
    IncludeLocked=True,
    LayerFilter="TRR-VACIOS",
    NameFilter="*",
    SublayerFiltering=True,
    TypeFilter=1073741848)
pipeline_3 = GeometryPipeline(
    GroupByLayer=True,
    GroupByType=False,
    IncludeHidden=True,
    IncludeLocked=True,
    LayerFilter="TRR-LINEA OFICIAL",
    NameFilter="*",
    SublayerFiltering=True,
    TypeFilter=4)
pipeline_4 = GeometryPipeline(
    GroupByLayer=True,
    GroupByType=False,
    IncludeHidden=True,
    IncludeLocked=True,
    LayerFilter="TRR-DESLINDES",
    NameFilter="*",
    SublayerFiltering=True,
    TypeFilter=4)
pipeline_5 = GeometryPipeline(
    GroupByLayer=True,
    GroupByType=False,
    IncludeHidden=True,
    IncludeLocked=True,
    LayerFilter="TRR-DESCUENTO SOMBRAS",
    NameFilter="*",
    SublayerFiltering=True,
    TypeFilter=4)
pipeline_6 = GeometryPipeline(
    GroupByLayer=True,
    GroupByType=False,
    IncludeHidden=True,
    IncludeLocked=True,
    LayerFilter="TRR-PODIO",
    NameFilter="*",
    SublayerFiltering=True,
    TypeFilter=4)
panel_3 = Panel("""Espacios comunes

ratio 0.3, 0.4""")
item_4 = ListItem(List=pipeline, Index=0, Wrap=True)  # -> Item, Item1, Item2, Item3
relay_3 = Relay()

# ---- group: Proyecto
# Vacíos
# (Crear solidos en Rhino)
# Volumen de Referencia
# (el de mayor
# constructibilidad)
# Calculo para Volumen Base
# Volumen 1
# Pisos
# (Proyeccion Manual)
# 
# Programa Principal
# 
# Programa Adicional
# 
# Pisos programa Adicional
# (desde base)
# Volumen 2
# Alturas del
# Volumen
# Pisos
# (Proyeccion Manual)
# 
# Programa Principal
# 
# Programa Adicional
# 
# Pisos programa Adicional
# (desde base)
# Volumen 3
# Alturas del
# Volumen
# Pisos
# (Proyeccion Manual)
# 
# Programa Principal
# 
# Programa Adicional
# 
# Pisos programa Adicional
# (desde base)
# Volumen 4
# Pisos
# (Proyeccion Manual)
# 
# Programa Principal
# 
# Programa Adicional
# 
# Pisos programa Adicional
# (desde base)
# Alturas del
# Volumen
# Podio
# Alturas del
# Volumen
# Programa Principal
# Subterraneo
# Programa
# Alturas del
# Volumen
# Programa Principal
# 
# Pisos Programa
list_2 = ValueList({"Volumen Referencial": 0, "Altura por Orientacion": 1, "Input de Pisos": 2}, selected="Volumen Referencial")
list_3 = ValueList({"Volumen 1": 0, "Volumen 2": 1, "Volumen 3": 2, "Volumen 4": 3}, selected="Volumen 2")
panel_4 = Panel("""3-5
9
14-17""")
panel_5 = Panel("""3,4
10-13""")
panel_6 = Panel("""9,11,13
15
18-20""")
crv_4 = Curve(item_4.Item)
panel_7 = Panel("30")
list_4 = ValueList({"Residencial": 0, "Oficinas": 1, "Retail": 2}, selected="Oficinas")
list_5 = ValueList({"Residencial": 0, "Oficinas": 1, "Retail": 2}, selected="Retail")
crv_5 = Curve(item_4.Item1)
list_6 = ValueList({"Residencial": 0, "Oficinas": 1, "Retail": 2}, selected="Retail")
crv_6 = Curve(item_4.Item2)
panel_8 = Panel("20")
list_7 = ValueList({"Residencial": 0, "Oficinas": 1, "Retail": 2}, selected="Oficinas")
list_8 = ValueList({"Residencial": 0, "Oficinas": 1, "Retail": 2}, selected="Retail")
crv_7 = Curve(item_4.Item3)
panel_9 = Panel("19")
list_9 = ValueList({"Residencial": 0, "Oficinas": 1, "Retail": 2}, selected="Oficinas")
list_10 = ValueList({"Residencial": 0, "Oficinas": 1, "Retail": 2}, selected="Retail")
list_11 = ValueList({"Sin Pisos": 0, "1", "2", "3", "4"}, selected="2")
panel_10 = Panel("")
list_12 = ValueList({"Residencial": 0, "Oficinas": 1, "Retail": 2}, selected="Retail")
list_13 = ValueList({"Residencial": 0, "Oficinas": 1, "Retail": 2}, selected="Retail")
panel_11 = Panel("19")
list_14 = ValueList({"Residencial": 0, "Oficinas": 1, "Retail": 2}, selected="Oficinas")
list_15 = ValueList({"Sin Pisos": 0, "1", "2", "3", "4"}, selected="3")
list_16 = ValueList({"Volumen 1": 0, "Volumen 2": 1, "Volumen 3": 2, "Volumen 4": 3}, selected="Volumen 1")
piso_retirado = BooleanToggle(False)
residencial = Panel("2.7")
oficinas = Panel("3.6")
retail = Panel("4.5")
residencial_2 = Panel("2.7")
oficinas_2 = Panel("3.6")
retail_2 = Panel("4.5")
residencial_3 = Panel("2.5")
oficinas_3 = Panel("3.5")
retail_3 = Panel("4.5")
residencial_4 = Panel("2.5")
oficinas_4 = Panel("4.2")
retail_4 = Panel("4.5")
residencial_5 = Panel("2.5")
oficinas_5 = Panel("3.6")
retail_5 = Panel("3.5")
residencial_6 = Panel("2.5")
oficinas_6 = Panel("3.6")
retail_6 = Panel("4.5")
num_21 = Number([residencial_3, oficinas_3, retail_3])
num_22 = Number([residencial_4, oficinas_4, retail_4])
num_23 = Number([residencial_5, oficinas_5, retail_5])
num_24 = Number([residencial_6, oficinas_6, retail_6])
num_25 = Number([residencial, oficinas, retail])
num_26 = Number([residencial_2, oficinas_2, retail_2])
num_27 = Number(list_12)
num_28 = Number([list_13, list_15])
list_17 = ValueList({"Sin Pisos": 0, "1", "2", "3", "4"}, selected="4")
list_18 = ValueList({"Sin Pisos": 0, "1", "2", "3", "4"}, selected="2")
list_19 = ValueList({"Sin Pisos": 0, "1", "2", "3", "4"}, selected="2")

# ---- group: Estacionamiento
# Estacionamientos (unidad/m2)
# Superficie Ratio
# Unidad/Superficie Programa m2
superficie_estacionamiento_ratio = Panel("38")
residencial_m2_unidad = Panel("100")
oficinas_m2_unidad = Panel("100")
retail_m2_unidad = Panel("35")
reducción_estacionamientos_1_3 = BooleanToggle(True)
altura_estacionamiento = Panel("3")

# ---- group: Input Normativa
# ¿Se contempla Volumen Podio?
# ¿La normativa contempla beneficio de
# constructibilidad por volumen placa?
# (solo ciertas columnas)
# Angulo Rasante según Zona (°)
list_20 = ValueList({"No": 0, "Si": 1}, selected="Si")
list_21 = ValueList({"No": 0, "Si": 1}, selected="Si")
list_22 = ValueList({"I a III + XV Región": 80, "IV a IX Región + RM": 70, "X a XII y XIV": 60}, selected="IV a IX Región + RM")

# ---- group: Postgre
# CONEXION A PostgreSQL (SUPABASE)
version_id_2 = Panel("81a7598a-3152-4d18-8613-2c6991df66a6")
direccion_url_proyecto_supabase = Panel("https://nulutxfhtandpiimltmr.supabase.co/rest/v1")
clave_secreta_2 = Panel("sb_secret_NVG15ya8gnf7q7tV7die6w_9w90Thfz")

# ---- group: Input Principal
# INPUT PRINCIPAL
# Área sin proyección sombra
# (Calles + Terreno + Terrenos Vecinos)
# Linea Oficial
# Deslindes
# Ejes de Calle
linea_oficial = Curve(pipeline_3)
linea_oficial_2 = Curve(pipeline_4)
linea_oficial_3 = Curve()
# Podio Manual
crv_8 = Curve(pipeline_6)

# ---- group: Archicad
# ArchiCAD, Seleccion Zonas según Programa
# Residencial
# Oficinas
# Retail
# Estacionamientos
zonecat = ZoneCategory()  # disabled
zonecat_2 = ZoneCategory()  # disabled
zonecat_3 = ZoneCategory()  # disabled
zonecat_4 = ZoneCategory()  # disabled

# ----
beneficio_eliminacion_estacionamientos = BooleanToggle(False)

# ---- group: Inputs
# INPUTS/CONTROLES VISUALIZACION
proyectar_sombras_teóricas = BooleanToggle(False)
proyectar_volumen_teórico = BooleanToggle(False)
dist_volúmenes_aislados = BooleanToggle(False)
volumenes_aislados = BooleanToggle(False)

# ----
cluster_5 = Cluster_183()
crv_9 = Curve(pipeline_5)
area_2 = Area(Geometry=crv_4)  # -> Area, Centroid
area_3 = Area(Geometry=crv_5)  # -> Area, Centroid
area_4 = Area(Geometry=crv_6)  # -> Area, Centroid
area_5 = Area(Geometry=crv_7)  # -> Area, Centroid
area_6 = Panel(area_2.Area)
area_7 = Panel(area_3.Area)
area_8 = Panel(area_4.Area)
area_9 = Panel(area_5.Area)
brep = Brep(pipeline_2)
cluster_6 = Cluster_183()
num_29 = Number([list_4, list_5, list_17])
num_30 = Number([list_9, list_10, list_11])
num_31 = Number([list_14, list_6, list_18])
num_32 = Number([list_7, list_8, list_19])
replace = ReplaceMembers(Set=reducción_estacionamientos_1_3, Find=[True, False], Replace=["Si", "No"])
nombre_proyecto = Panel("TAJAMAR")
cluster_7 = Cluster_60(num=num_26, R="2")
cluster_8 = Cluster_60(num=num_21, R="3")
cluster_9 = Cluster_60(num=num_22, R="4")
cluster_10 = Cluster_60(num=num_23, R="0")
# Indicaciones
# 1) Se recomienda dejar apagado (false) la exportación de zonas a AC
# y el envío de datos a Supabase cuando no se
# estén usando
# 2)No exportar al mismo tiempo la tabla de
# superficies y la de sombras, hacerlo por separado
exportación_zonas_archicad_a_supabase = Button()
cluster_11 = Cluster_60(num=num_25, R="1")

# ----
# Entregables
tabla_superficie_sombras = Button()
exportacion_zonas_a_archicad = BooleanToggle(True)
tabla_general_superficies = Button()

relay_4 = Relay()
linea_oficial_4 = Curve(crv_8)
join = JoinCurves(Curves=[linea_oficial, linea_oficial_2], Preserve=False)  # -> flatten(Curves)
linea_oficial_5 = Curve(linea_oficial)
linea_oficial_6 = Curve(linea_oficial_3)
linea_oficial_7 = Curve(linea_oficial_2)

# ---- group: Normativa CIP
# Normativa
# Altura Maxima
# Edificación
# Continua (m)
# Coeficiente
# Excavacion
# Piso -1
# Altura Maxima
# Edificación
# Aislada o
# Sobre suelo(m)
# Distanciamientos
# Antejardin
# Ed. Continua
# Antejardin
# Ed. Aislada
# Distanciamiento
# Minimo
# Coeficientes de Constructibilidad
# Coeficiente
# Ocupación
# Pisos Superiores
# Si existe beneficio por manzana.
# el Coeficiente de Ocupación de Suelo
# sera 1
# Coeficiente
# Ocupación
# Suelo
# Coeficiente
# Constructibilidad
panel_12 = Panel("74.38")
panel_13 = Panel("7")
panel_14 = Panel("8.75")
panel_15 = Panel("5")
panel_16 = Panel("8")
cluster_12 = Cluster(G=list_21, E=[linea_oficial, linea_oficial_7], _0="0.4", B="4.8")  # -> R_2, R
c_o_suelo = Panel(cluster_12.R_2)
constructibilidad = Panel(cluster_12.R)
panel_17 = Panel("0.7")

# ----
# Alturas!!!!
cluster_13 = Cluster_118(G_2=list_21, _1=c_o_suelo, G=[crv_4, crv_5, crv_6, crv_7])
num_33 = Number(list_20)
num_34 = Number(list_21)
linea_oficial_8 = Curve(linea_oficial_2)
num_35 = Number(panel_14)
num_36 = Number(panel_12)
num_37 = Number(panel_15)
num_38 = Number(panel_13)
num_39 = Number(panel_16)
clscrv = CloseCurve(Curve=crv_8, CloseType=3, Bulge=0.5, Tolerance=0)  # -> Closed, R
area_10 = Area(Geometry=clscrv.Closed)  # -> Area, Centroid
filter = StreamFilter(Gate=num_33, Stream1=list_12)
boundary_2 = BoundarySurfaces(Edges=join)
mcp = MCPServer(Port=3001, ServerName="Swiftlet")
wip = Panel("6000")
num_40 = Number(constructibilidad)
num_41 = Number(wip)
num_42 = Number(list_2)
num_43 = Number(150)
Y_4 = UnitY(Factor=num_43)
material = CreateMaterial(Diffuse=RGB(255, 162, 0), Specular=RGB(255, 217, 0), Emission=RGB(242, 178, 0), Transparency=0.7, Shine=1)
bool = Boolean(True)
equals = Equality(FirstNumber=proyectar_volumen_teórico, SecondNumber=bool)  # -> Equality, Inequality
terrazas = BooleanToggle(False)
num_44 = Number(0)
filter_2 = StreamFilter(Gate=terrazas, Stream0=num_44, Stream1=Slider(2, range=0..10))
num_45 = Number([810, 396])
estacionamientos_requeridos = Panel(num_45)
item_5 = ListItem(List=altura_estacionamiento, Index=3, Wrap=True)
bool_2 = Boolean(exportación_zonas_archicad_a_supabase)
panel_18 = Panel("""-2
-1""")
panel_19 = Panel("""1
2
3
4""")
panel_20 = Panel("""1
2
3
4""")
txt = Text("Proyectados")
num_46 = Number(item_5)
# Respaldos csv deberían guardarse
# en un servidor
panel_21 = Panel("C:\Users\puqui\Desktop\App Cabidas")
retail_7 = Colour(RGB(55, 55, 55))
retail_8 = Colour(retail_7)
material_2 = CreateMaterial(Diffuse=retail_7, Specular=retail_7, Emission=retail_7, Transparency=0.5, Shine=100)
material_3 = CreateMaterial(Diffuse=retail_8, Specular=retail_8, Emission=retail_8, Transparency=0.95, Shine=100)
panel_22 = Panel(version_id_2)
panel_23 = Panel(direccion_url_proyecto_supabase)
panel_24 = Panel(clave_secreta_2)
panel_25 = Panel("superficies")
txt_2 = Text("Estacionamientos")
python = GhPythonScript(TRIGGER=bool_2, BASE_URL=panel_23, ANON_KEY=panel_24, TABLE_NAME=panel_25, BACKUP_FOLDER=panel_21)  # -> out, RESULT, DEBUG_INFO, SUCCESS, BACKUP_FILE
# ---------- python: Python ----------
import json
import System
from System.Net import WebClient, WebException
from System.IO import Directory, Path, File
from System.Text import Encoding

RESULT = ""
DEBUG_INFO = ""
SUCCESS = False
BACKUP_FILE = ""

try:
    if not TRIGGER:
        RESULT = "Waiting for TRIGGER"
    else:
        # Use TABLE_NAME input if provided, otherwise default to 'superficies'
        # Handle various edge cases: undefined, None, empty string, whitespace
        try:
            DEBUG_INFO += "TABLE_NAME received: type=" + str(type(TABLE_NAME)) + ", value='" + str(TABLE_NAME) + "'. "
            if TABLE_NAME:
                table_name_raw = str(TABLE_NAME).strip()
                if table_name_raw and table_name_raw != "" and table_name_raw.lower() != "none":
                    table_name = table_name_raw
                    DEBUG_INFO += "Valid TABLE_NAME found: '" + table_name + "'. "
                else:
                    table_name = "superficies"
                    DEBUG_INFO += "TABLE_NAME provided but empty/None, using default 'superficies'. "
            else:
                table_name = "superficies"
                DEBUG_INFO += "TABLE_NAME not provided (None/empty), using default 'superficies'. "
        except NameError:
            # TABLE_NAME input parameter doesn't exist in Grasshopper
            table_name = "superficies"
            DEBUG_INFO += "TABLE_NAME input not defined in Grasshopper, using default 'superficies'. "
        
        # Validate and prepare backup folder
        try:
            DEBUG_INFO += "BACKUP_FOLDER received: type=" + str(type(BACKUP_FOLDER)) + ", value='" + str(BACKUP_FOLDER) + "'. "
            if BACKUP_FOLDER:
                backup_folder_raw = str(BACKUP_FOLDER).strip()
                if backup_folder_raw and backup_folder_raw != "" and backup_folder_raw.lower() != "none":
                    backup_folder = backup_folder_raw
                    DEBUG_INFO += "Valid BACKUP_FOLDER found: '" + backup_folder + "'. "
                else:
                    RESULT = "ERROR: BACKUP_FOLDER is empty"
                    SUCCESS = False
                    raise Exception("BACKUP_FOLDER cannot be empty")
            else:
                RESULT = "ERROR: BACKUP_FOLDER not provided"
                SUCCESS = False
                raise Exception("BACKUP_FOLDER is required")
        except NameError:
            RESULT = "ERROR: BACKUP_FOLDER input not defined in Grasshopper"
            SUCCESS = False
            raise Exception("BACKUP_FOLDER input parameter doesn't exist")
        
        # Create backup folder if it doesn't exist
        if not Directory.Exists(backup_folder):
            DEBUG_INFO += "Creating backup folder: '" + backup_folder + "'. "
            Directory.CreateDirectory(backup_folder)
            DEBUG_INFO += "Backup folder created. "
        else:
            DEBUG_INFO += "Backup folder exists. "
        
        # Generate timestamp filename
        import datetime
        timestamp = datetime.datetime.now().strftime("%Y%m%d_%H%M%S")
        filename = table_name + "_" + timestamp + ".csv"
        full_path = Path.Combine(backup_folder, filename)
        DEBUG_INFO += "Backup file path: '" + full_path + "'. "
        
        # Retry logic for fetching and writing data
        max_retries = 2
        backup_successful = False
        last_error = ""
        
        for attempt in range(max_retries):
            try:
                DEBUG_INFO += "Backup attempt " + str(attempt + 1) + " of " + str(max_retries) + ". "
                
                # Fetch all data from Supabase
                url = BASE_URL.rstrip("/") + "/" + table_name + "?select=*"
                DEBUG_INFO += "Fetching data from: " + url + ". "
                
                client = WebClient()
                client.Headers.Add("apikey", ANON_KEY)
                client.Headers.Add("Authorization", "Bearer " + ANON_KEY)
                
                response = client.DownloadString(url)
                data = json.loads(response)
                
                DEBUG_INFO += "Fetched " + str(len(data)) + " rows. "
                
                # Convert JSON to CSV
                if len(data) == 0:
                    # Empty table - create CSV with headers only
                    csv_content = "id,external_uuid,unidad_id,version_id,programa_id,area,volumen,nivel,archicad_guid,program_name,geom,updated_at\n"
                    DEBUG_INFO += "Table is empty, creating CSV with headers only. "
                else:
                    # Get headers from first row
                    headers = []
                    if len(data) > 0:
                        first_row = data[0]
                        for key in first_row.keys():
                            headers.append(key)
                    
                    DEBUG_INFO += "CSV columns: " + str(len(headers)) + ". "
                    
                    # Build CSV content
                    csv_lines = []
                    
                    # Add header row
                    header_line = ",".join(['"' + str(h) + '"' for h in headers])
                    csv_lines.append(header_line)
                    
                    # Add data rows
                    for row in data:
                        values = []
                        for header in headers:
                            value = row.get(header)
                            if value is None:
                                values.append('""')
                            elif isinstance(value, dict) or isinstance(value, list):
                                # Serialize nested JSON (like geom field)
                                json_str = json.dumps(value, ensure_ascii=False)
                                # Escape quotes and wrap in quotes
                                escaped = json_str.replace('"', '""')
                                values.append('"' + escaped + '"')
                            else:
                                # Convert to string and escape
                                str_value = str(value)
                                if ',' in str_value or '"' in str_value or '\n' in str_value:
                                    escaped = str_value.replace('"', '""')
                                    values.append('"' + escaped + '"')
                                else:
                                    values.append('"' + str_value + '"')
                        
                        csv_lines.append(",".join(values))
                    
                    csv_content = "\n".join(csv_lines) + "\n"
                
                DEBUG_INFO += "CSV content generated (" + str(len(csv_content)) + " chars). "
                
                # Write to file with UTF-8 encoding
                File.WriteAllText(full_path, csv_content, Encoding.UTF8)
                DEBUG_INFO += "CSV file written successfully. "
                
                # Success!
                backup_successful = True
                BACKUP_FILE = full_path
                SUCCESS = True
                RESULT = "Backup successful: " + str(len(data)) + " rows saved to " + filename
                break
                
            except WebException as e:
                last_error = "HTTP error: " + str(e.Response.StatusCode)
                try:
                    error_stream = e.Response.GetResponseStream()
                    reader = System.IO.StreamReader(error_stream)
                    error_body = reader.ReadToEnd()
                    last_error += " - " + error_body
                except:
                    pass
                DEBUG_INFO += "Attempt " + str(attempt + 1) + " failed: " + last_error + ". "
                
            except Exception as e:
                last_error = "Error: " + str(e)
                DEBUG_INFO += "Attempt " + str(attempt + 1) + " failed: " + last_error + ". "
        
        # If all retries failed
        if not backup_successful:
            SUCCESS = False
            RESULT = "Backup FAILED after " + str(max_retries) + " attempts: " + last_error
            DEBUG_INFO += "All backup attempts failed. "

except Exception as e:
    RESULT = "Script error: " + str(e)
    DEBUG_INFO += "Exception: " + str(e) + ". "
    SUCCESS = False
    BACKUP_FILE = ""
# ---------- end python ----------
python_2 = GhPythonScript(TRIGGER=python.SUCCESS, BASE_URL=panel_23, ANON_KEY=panel_24, VERSION_ID=panel_22, TABLE_NAME=panel_25)  # -> out, URL_BUILT, RESPONSE_RAW, DEBUG_INFO, RESULT, SUCCESS
# ---------- python_2: Python ----------
import json
import System
from System.Net import WebClient, WebException

RESULT = ""
DEBUG_INFO = ""
SUCCESS = False

try:
    if not TRIGGER:
        RESULT = "Waiting for TRIGGER"
    else:
        # Use TABLE_NAME input if provided, otherwise default to 'superficies'
        # Handle various edge cases: undefined, None, empty string, whitespace
        try:
            DEBUG_INFO += "TABLE_NAME received: type=" + str(type(TABLE_NAME)) + ", value='" + str(TABLE_NAME) + "'. "
            if TABLE_NAME:
                table_name_raw = str(TABLE_NAME).strip()
                if table_name_raw and table_name_raw != "" and table_name_raw.lower() != "none":
                    table_name = table_name_raw
                    DEBUG_INFO += "Valid TABLE_NAME found: '" + table_name + "'. "
                else:
                    table_name = "superficies"
                    DEBUG_INFO += "TABLE_NAME provided but empty/None, using default 'superficies'. "
            else:
                table_name = "superficies"
                DEBUG_INFO += "TABLE_NAME not provided (None/empty), using default 'superficies'. "
        except NameError:
            # TABLE_NAME input parameter doesn't exist in Grasshopper
            table_name = "superficies"
            DEBUG_INFO += "TABLE_NAME input not defined in Grasshopper, using default 'superficies'. "
        
        # Build Edge Function URL
        base = BASE_URL.rstrip("/")
        
        # Remove /rest/v1 if present
        rest_suffix = "/rest/v1"
        if len(base) >= len(rest_suffix):
            if base[-len(rest_suffix):] == rest_suffix:
                base = base[:-len(rest_suffix)]
        
        # Always use Edge Function with table name in body
        edge_function_url = base + "/functions/v1/clear-superficies"
        DEBUG_INFO += "Using table: '" + table_name + "' for Edge Function call. "
        
        client = WebClient()
        client.Headers.Add("apikey", ANON_KEY)
        client.Headers.Add("Authorization", "Bearer " + ANON_KEY)
        client.Headers.Add("Content-Type", "application/json")
        
        try:
            # Send table name in request body to Edge Function
            request_body = json.dumps({"table_name": table_name}, ensure_ascii=False)
            DEBUG_INFO += "Edge Function URL: " + edge_function_url + ". "
            DEBUG_INFO += "Request body: " + request_body + ". "
            DEBUG_INFO += "Calling Edge Function for table: '" + table_name + "'. "
            
            response = client.UploadString(edge_function_url, "POST", request_body)
            DEBUG_INFO += "Edge Function response received. "
            DEBUG_INFO += "Raw response: " + str(response) + ". "
            response_data = json.loads(response)
            DEBUG_INFO += "Parsed response: success=" + str(response_data.get("success")) + ", message=" + str(response_data.get("message", "")) + ". "
            
            if response_data.get("success"):
                DEBUG_INFO += "Edge Function successful: " + response_data.get("message", "") + ". "
                RESULT = "Delete successful for table: " + table_name
                SUCCESS = True
            else:
                error_msg = "Edge Function failed: " + response_data.get("error", "Unknown error")
                DEBUG_INFO += error_msg + ". "
                RESULT = error_msg
                SUCCESS = False
                
        except WebException as e:
            error_msg = "HTTP request failed: HTTP " + str(e.Response.StatusCode)
            try:
                error_stream = e.Response.GetResponseStream()
                reader = System.IO.StreamReader(error_stream)
                error_body = reader.ReadToEnd()
                error_msg += " - " + error_body
            except:
                pass
            DEBUG_INFO += error_msg + ". "
            RESULT = error_msg
            SUCCESS = False
            
        except Exception as e:
            error_msg = "Request error: " + str(e)
            DEBUG_INFO += error_msg + ". "
            RESULT = error_msg
            SUCCESS = False
        
except Exception as e:
    RESULT = "Script error: " + str(e)
    DEBUG_INFO += "Exception: " + str(e)
    SUCCESS = False
# ---------- end python_2 ----------
panel_26 = Panel("""-2
-1""")
panel_27 = Panel("""0
1
2
3
4""")
panel_28 = Panel("""-2
-1""")
panel_29 = Panel("""0
1
2
3
4""")
panel_30 = Panel("""-2
-1""")
panel_31 = Panel("""0
1
2
3
4""")
panel_32 = Panel("""-2
-1""")
panel_33 = Panel("""0
1
2
3
4""")
bool_3 = Boolean(beneficio_eliminacion_estacionamientos)
bool_4 = Boolean(True)
txt_3 = Text(["SUP. UTIL TOTAL", "CONST. PERMITIDA", "SUP. COEF. CONSTRUCTIBILIDAD", "PORCENTAJE CONSTR. UTILIZADO"])
txt_4 = Text(["SUP. UTIL RESIDENCIAL", "SUP. UTIL OFICINAS", "SUP. UTIL RETAIL", "SUP. UTIL ESTACIONAMIENTOS"])
concat = Concatenate(FragmentA="PROYECTO ", FragmentB=nombre_proyecto)
panel_34 = Panel("""0
-1""")
panel_35 = Panel("0.6")  # disabled
panel_36 = Panel("0.1")  # disabled
panel_37 = Panel("6")  # disabled
crv_10 = Curve([linea_oficial, linea_oficial_2])  # disabled
join_2 = JoinCurves(Curves=crv_10, Preserve=False)  # disabled
division = Division(A=panel_35, B=2)  # disabled
panel_38 = Panel("""0
0
-1""")
panel_39 = Panel("""Altura
Subtotal""")
txt_5 = Text(["   ", "Area Subterraneo Libre"])
txt_6 = Text(["  ", "Estacionamientos Requeridos"])
txt_7 = Text("Estacionamientos Proyectados")
txt_8 = Text(["   ", "Area según 10%"])
txt_9 = Text(["   ", "Area Est. según ratio."])
panel_40 = Panel("-1")  # disabled
panel_41 = Panel("""1
2
3
4""")  # disabled
panel_42 = Panel("-2")  # disabled
panel_43 = Panel("0")  # disabled
panel_44 = Panel("Superficie Construida(M2)")
number_slider_15 = Slider(0.3, range=0..1)  # disabled
division_2 = Division(A=number_slider_15, B=2)  # disabled
panel_45 = Panel("0.3")  # disabled
beamsetr = BeamSettingsRectangular(
    Height=0.8,
    Width=panel_45,
    Height_2=0.8,
    Width_2=panel_45,
    AC_ActiveState_Name="SC_Rectangular_TopVerticalCut_BottomVerticalCut")  # disabled
button = Button()  # disabled
toggle = BooleanToggle(True)  # disabled
columnsetr = ColumnSettingsRectangular(
    Depth=panel_35,
    Width=panel_35,
    Depth_2=panel_35,
    Width_2=panel_35,
    AC_ActiveState_Name="SC_Rectangular_TopHorizontalCut_BottomHorizontalCut")  # disabled
toggle_2 = BooleanToggle(False)  # disabled
columnsetr_2 = ColumnSettingsRectangular(
    Depth=panel_45,
    Width=panel_45,
    Depth_2=panel_45,
    Width_2=panel_45,
    AC_ActiveState_Name="SC_Rectangular_TopHorizontalCut_BottomHorizontalCut")  # disabled
panel_46 = Panel("0.15")  # disabled
# Estacionamientos requeridos vs proyectados....
beamsetr_2 = BeamSettingsRectangular(
    Height=panel_46,
    Width=panel_45,
    Height_2=panel_46,
    Width_2=panel_45,
    AC_ActiveState_Name="SC_Rectangular_TopVerticalCut_BottomVerticalCut")  # disabled

# ---- group: Circulaciones
# Circulaciones Verticales
# Volumenes
# Dimensiones para
# Superficie menor a 1000 m2
# Dimensiones para
# Superficie mayor a 1000 m2
# Adicionales
# Nivel Tope Circulacion
# Ubicacion
# Dimensiones para
# Ascensores Adicionales
A = Panel("11.5")
B = Panel("12")
A_2 = Panel("12")
B_2 = Panel("14")
pt_2 = Point(<point referenced from the Rhino model>)
A_3 = Panel("12")
B_3 = Panel("4")
list_23 = ValueList({"Podio": 0, "Nivel Calle": 1, "Subterraneo 1": 2}, selected="Podio")

# ----
# Dashboard
sup_subtotal = Panel("ASD")
sup_subtotal_2 = Panel("ASD")
beneficio_1_3 = Panel(replace)
coef_ocupacion_suelo = Panel(cluster_13)

# ----
# Terreno / Volumen Teorico/Sombras
boundary_3 = BoundarySurfaces(Edges=clscrv.Closed)
cluster_14 = Cluster_19(coef_ex=panel_17, curve=linea_oficial_5, x=num_38, crv=linea_oficial_7, x_2=num_39)  # -> s_out, crv_6
cluster_15 = Cluster_24(curve=linea_oficial_5, x=num_37, crv=linea_oficial_7, x_2=num_39)  # -> G, R, crv_6
crv_11 = Curve(cluster_14.s_out)
volumen_edificación_continua = VolumenEdificaciónContinua(B=cluster_15.crv_6, F=num_35)  # -> brep_2, C
volumen_edificación_continua_2 = VolumenEdificaciónContinua(A=cluster_15.G, B=cluster_14.crv_6, F=num_36)  # -> brep_2, C
area_11 = Area(Geometry=crv_11)  # -> Area, Centroid
cluster_16 = Cluster_14()  # -> M_2, M

crv_12 = Curve(cluster_14.crv_6)
join_3 = JoinCurves(Curves=crv_12, Preserve=False)  # -> flatten(Curves)
move_5 = Move(Geometry=join_3, Motion=Y_2)  # -> Geometry, Transform
boundary_4 = BoundarySurfaces(Edges=move_5.Geometry)  # -> reparameterize(Surfaces)
area_12 = Area(Geometry=boundary_4)  # -> Area, Centroid
contour = Contour(Shape=boundary_4, Point=area_12.Centroid, Direction=[Y, X], Distance=[number_slider, number_slider_2])  # -> flatten(Contours)
srfsplit = SurfaceSplit(Surface=boundary_4, Curves=contour)
# Generación de Plantas Manzana Completa
cluster_17 = Cluster_127(
    crv=move_5.Geometry,
    x_3=number_slider_3,
    x_4=number_slider_4,
    x=number_slider_5,
    x_2=number_slider_6,
    L=genes,
    d1=number_slider_8,
    d2=number_slider_9,
    B=list,
    d3=number_slider_10,
    d4=number_slider_11)  # -> L_2, i, A, num_3
splitatcorners = SplitAtCorners(Poly=boundary_4, Angle=1)  # -> flatten(Corners), Parts
srf = Surface(boundary_4)
item_6 = ListItem(List=splitatcorners.Corners, Index=0, Wrap=True)
crv_13 = Curve(boundary_4)
area_13 = Area(Geometry=srf)  # -> Area, Centroid
subsrf = Isotrim(Surface=srf, Domain=dom²)  # -> flatten(Surface)
pln = Plane(item_6)
divide_2 = DivideCurve(Curve=crv_13, Count=lng_2, Kinks=False)  # -> Points, Tangents, Parameters
vrot = Rotate(Vector=X_3, Axis=pln, Angle=degrees(Slider(108.002, range=0..180)))
trim = TrimWithRegion(Curve=subsrf, Region=srf)  # -> flatten(Inside), Outside
addition_2 = Addition(A=divide_2.Parameters, B=number_slider_13)
eval_2 = EvaluateCurve(Curve=crv_13, Parameter=addition_2)  # -> Point, Tangent, Angle
contour_2 = Contour(Shape=srf, Point=pln, Direction=vrot, Distance=number_slider_14)  # -> flatten(Contours)
srfsplit_2 = SurfaceSplit(Surface=srf, Curves=[trim.Inside, contour_2])
area_14 = Area(Geometry=srfsplit_2)  # -> Area, Centroid
cp = ClosestPoint(Point=divide_2.Points, Cloud=area_14.Centroid)  # -> ClosestPoint, CPIndex, Distance
item_7 = ListItem(List=srfsplit_2, Index=cp.CPIndex, Wrap=True)
explode_2 = Explode(Curve=item_7, Recursive=True)  # -> simplify(Segments), Vertices
area_15 = Area(Geometry=item_7)  # -> Area, Centroid
len = Length(Curve=explode_2.Segments)
sort = SortList(Keys=len, ValuesA=len)  # -> Keys, reverse(ValuesA)
panel_47 = Panel(area_15.Area)
cluster_18 = Cluster_125(A=area_15.Area, B=item)
item_8 = ListItem(List=sort.ValuesA, Index=-1, Wrap=True)
panel_48 = Panel(item_8)
ma = MassAddition(Input=cluster_18)  # -> Result, PartialResults
subtraction_2 = Subtraction(A=item_8, B=entwine)
division_3 = Division(A=subtraction_2, B=entwine)
# -Cual es la superficie mas cercana al punto borde de la figura.
# -i
# -Selecciona i
# -Galapagos entonces seleccionará I, y ajustará las lineas para que I sea de tal superficie.
addition_3 = Addition(A=ma.Result)
abs = Absolute(Value=division_3)
ma_2 = MassAddition(Input=flatten(abs))  # -> Result, PartialResults
filter_3 = StreamFilter(Gate=num, Stream0=cluster_17.A, Stream1=area_15.Area)
panel_49 = Panel(filter_3)
filter_4 = StreamFilter(Gate=num, Stream0=cluster_17.num_3, Stream1=addition_3)
round = Round(Number=panel_49)  # -> Nearest, Floor, Ceiling
num_47 = Number(filter_4)
panel_50 = Panel(round.Nearest)
cluster_19 = Cluster_124(_0=linea_oficial_4, _1=cluster_15.crv_6)
crv_14 = Curve(cluster_14.crv_6)
filter_5 = StreamFilter(Gate=list_20, Stream1=cluster_19)
crv_15 = Curve(filter_5)

# ----
# Podio
cluster_20 = Cluster_28(crv=crv_15, F=num_36)
area_16 = Area(Geometry=clscrv.Closed)  # -> Area, Centroid
cluster_21 = Cluster_27(B=crv_15, A=num_35, B_2=cluster_20, L=cluster_10, i=num_27)  # -> Z_2, R_2, S, R, L_2, D
subtraction_3 = Subtraction(A=num_40, B=cluster_21.R_2)
cluster_22 = Cluster_25(G=num_33, _0=num_36, A=num_36, L=cluster_21.Z_2)
filter_6 = StreamFilter(Gate=num_33, Stream0=num_40, Stream1=subtraction_3)
filter_7 = StreamFilter(Gate=num_34, Stream0=filter_6, Stream1=num_40)
altura_permitida = Panel(cluster_22)
cluster_23 = Cluster_51(crv=crv_15, num=num_27, A=cluster_21.Z_2, num_2=num_23, B=10)  # -> L, D, simplify(flatten(D_2)), D_3, Z_2, i

# ----
# Plantas
boundary_5 = BoundarySurfaces(Edges=crv_15)
cluster_24 = Cluster_30(G=num_33, num=cluster_23.Z_2)  # -> s_1, R
num_48 = Number(cluster_24.s_1)
cluster_25 = Cluster_29(crv=crv_6, F=num_48, C=boundary_5)  # -> C_2, G
cluster_26 = Cluster_29(crv=crv_7, F=num_48, C=boundary_5)  # -> C_2, G
cluster_27 = Cluster_29(crv=crv_4, F=num_48, C=boundary_5)  # -> C_2, G
cluster_28 = Cluster_29(crv=crv_5, F=num_48, C=boundary_5)  # -> C_2, G
merge_3 = Merge(Data1=cluster_27.G, Data2=cluster_28.G, Data3=cluster_25.G, Data4=cluster_26.G)  # -> simplify(Result)
cluster_29 = Cluster_31(crv=merge_3)  # -> flatten(R), flatten(T)
ma_3 = MassAddition(Input=cluster_29.T)  # -> Result, PartialResults
crv_16 = Curve(cluster_29.R)
c_o_s = Panel(ma_3.Result)
clean = CleanTree(RemoveNulls=True, RemoveInvalid=True, RemoveEmpty=False, Tree=crv_16)

cluster_30 = Cluster_45(crv=crv_16)
move_6 = Move(Geometry=area_11.Centroid, Motion=Y_4)  # -> Geometry, Transform
area_17 = Area(Geometry=clean)  # -> Area, Centroid
ln_2 = Line(StartPoint=move_6.Geometry, EndPoint=area_17.Centroid)
crv_17 = Curve(clean)
cluster_31 = Cluster_98(L=crv_17, C=ln_2)  # -> I_2, I
num_49 = Number(cluster_21.L_2)
crv_18 = Curve(crv_11)
num_50 = Number(cluster_23.i)
crv_19 = Curve(crv_11)  # disabled
bbox = BoundingBox(Content=crv_19, Plane=PlaneXY(0, 0, 0), UnionBox=True)  # -> simplify(Box), simplify(Box_2); disabled
debrep = DeconstructBrep(Brep=bbox.Box)  # -> Faces, Edges, Vertices; disabled
item_9 = ListItem(List=debrep.Vertices, Index=0, Wrap=True)  # disabled
dim = Dimensions(Surface=debrep.Faces)  # -> UDimension, VDimension; disabled
cluster_32 = Cluster_133(C=crv_19, pt=item_9)  # disabled
division_4 = Division(A=dim.UDimension, B=panel_37)  # disabled
division_5 = Division(A=dim.VDimension, B=panel_37)  # disabled
int = Integer(expr("x+1", simplify(division_4)))  # disabled
int_2 = Integer(expr("x+1", simplify(division_5)))  # disabled
sqgrid = Square(Plane=item_9, Size=panel_37, ExtentX=int, ExtentY=int_2)  # -> simplify(Cells), Points; disabled
crv_20 = Curve(cluster_15.crv_6)  # disabled
trim_2 = TrimWithRegion(Curve=sqgrid.Cells, Region=crv_19)  # -> simplify(Inside), Outside; disabled
trim_3 = TrimWithRegion(Curve=sqgrid.Cells, Region=crv_20)  # -> simplify(Inside), Outside; disabled
crv_21 = Curve(trim_2.Inside)  # disabled
path_mapper = PathMapper(crv_21, source="{A;B}(i)", target="{A}")  # disabled
crv_22 = Curve(trim_3.Inside)  # disabled
path_mapper_2 = PathMapper(sqgrid.Cells, source="{A;B} ", target="{A}")  # disabled
explode_3 = Explode(Curve=path_mapper, Recursive=True)  # -> Segments, Vertices; disabled

# ---- group: Circulaciones (continued)
cluster_33 = Cluster_100(P=pt_2, srf=boundary_5, num=A_3, num_2=B_3)  # -> P_2, srf_3, I, I_2

# ----
cluster_34 = Cluster_10(
    relay=volumen_edificación_continua_2.brep_2,
    C=linea_oficial_5,
    _0=linea_oficial_7,
    A=list_20,
    G=linea_oficial_6,
    h_podio=cluster_21.Z_2,
    num=num_36,
    x=list_22)  # -> s_0, R, rasante
filter_8 = StreamFilter(Gate=proyectar_volumen_teórico, Stream1=cluster_34.R)
brep_2 = Brep(cluster_34.R)
cluster_35 = Cluster_13(G=proyectar_sombras_teóricas, B=cluster_34.R, run=True, E=boundary_3)  # -> s_0, D, D_2, D_3, R, R_2, R_3, excel_vt
preview = CustomPreview(Geometry=filter_8, Material=cluster_16.M_2)

sombra_poniente = Panel(cluster_35.D_2)
sombra_sur = Panel(cluster_35.D_3)
sombra_oriente = Panel(cluster_35.D)

# ----
# PENDIENTES.
# 
# -NODO BREP PARA VT Y VP
# -SI ALCANZA, EXPORTACION COMPLETA A AC (PILARES, VIGAS)
# brep exportable sombras y volumenes (typ)
entwine_2 = Entwine(Branch00=crv_4, Branch01=crv_5, Branch02=crv_6, Branch03=crv_7, FlattenInputs=True)
clean_2 = CleanTree(RemoveNulls=True, RemoveInvalid=True, RemoveEmpty=True, Tree=entwine_2)
lng_3 = ListLength(List=clean_2)
cluster_36 = Cluster_67(M=list_16, L=clean)
txt_10 = Text("RESIDENCIAL")
txt_11 = Text("OFICINAS")
txt_12 = Text("RETAIL")
txt_13 = Text("ESTACIONAMIENTO")
merge_4 = Merge(Data1=txt_10, Data2=txt_11, Data3=txt_12)
panel_51 = Panel(cluster_36)
num_51 = Number(cluster_36)

# ----
# PARKING!!!!!
txt_14 = Text(txt_13)

entwine_3 = Entwine(Branch00=num_29, Branch01=num_31, Branch02=num_32, Branch03=num_30, FlattenInputs=True)  # -> simplify(Result)
entwine_4 = Entwine(Branch00=num_25, Branch01=num_26, Branch02=num_21, Branch03=num_22, FlattenInputs=True)  # -> simplify(Result)
entwine_5 = Entwine(Branch00=panel_4, Branch01=panel_5, Branch02=panel_6, Branch03=panel_10, FlattenInputs=True)  # -> simplify(Result)
cluster_37 = Cluster_67(M=list_3, L=clean)
cluster_38 = Cluster_60(num=num_24, R="-1")
cluster_39 = Cluster_68(T=crv_11, R="-1")
panel_52 = Panel(cluster_37)
merge_5 = Merge(Data1=cluster_38, Data2=cluster_10, Data3=cluster_11, Data4=cluster_7, Data5=cluster_8, Data6=cluster_9)
crv_23 = Curve(clean)
panel_53 = Panel(cluster_38)

cluster_40 = Cluster_96(num=cluster_11, A=altura_permitida, num_2=num_29)  # -> i, R_2, item_2_2, R
area_18 = Area(Geometry=crv_23)  # -> Area, Centroid
cluster_41 = Cluster_96(num=cluster_7, A=altura_permitida, num_2=num_31)  # -> i, R_2, item_2_2, R
cluster_42 = Cluster_96(num=cluster_8, A=altura_permitida, num_2=num_32)  # -> i, R_2, item_2_2, R
cluster_43 = Cluster_96(num=cluster_9, A=altura_permitida, num_2=num_30)  # -> i, R_2, item_2_2, R
cluster_44 = Cluster_97(num=cluster_40.i, num_2=cluster_40.R_2, int=panel_7, B=num_49, I=cluster_40.item_2_2, B_2=cluster_40.R)  # -> R_3, R, R_2
cluster_45 = Cluster_97(num=cluster_41.i, num_2=cluster_41.R_2, int=panel_11, B=num_49, I=cluster_41.item_2_2, B_2=cluster_41.R)  # -> R_3, R, R_2
cluster_46 = Cluster_97(num=cluster_42.i, num_2=cluster_42.R_2, int=panel_8, B=num_49, I=cluster_42.item_2_2, B_2=cluster_42.R)  # -> R_3, R, R_2
cluster_47 = Cluster_97(num=cluster_43.i, num_2=cluster_43.R_2, int=panel_9, B=num_49, I=cluster_43.item_2_2, B_2=cluster_43.R)  # -> R_3, R, R_2
cluster_48 = Cluster_45(crv=crv_16)
merge_6 = Merge(Data1=cluster_44.R_3, Data2=cluster_45.R_3, Data3=cluster_46.R_3, Data4=cluster_47.R_3)  # -> flatten(Result)
merge_7 = Merge(Data1=cluster_44.R, Data2=cluster_45.R, Data3=cluster_46.R, Data4=cluster_47.R)  # -> flatten(Result)
merge_8 = Merge(Data1=cluster_40.item_2_2, Data2=cluster_41.item_2_2, Data3=cluster_42.item_2_2, Data4=cluster_43.item_2_2)
ma_4 = MassAddition()  # -> Result, PartialResults
cull_i = CullIndex(List=merge_7, Indices=cluster_48, Wrap=True)
cull_i_2 = CullIndex(List=merge_6, Indices=cluster_48, Wrap=True)
multiplication = Multiplication(A=area_18.Area, B=cull_i_2)
sort_2 = SortList(Keys=cull_i, ValuesA=cull_i)  # -> Keys, ValuesA
subtraction_4 = Subtraction(A=filter_7, B=ma_4.Result)
ma_5 = MassAddition(Input=flatten(multiplication))  # -> Result, PartialResults
item_10 = ListItem(List=sort_2.ValuesA, Index=-1, Wrap=True)  # -> simplify(Item)
num_52 = Number(area_18.Area)
mindex = MemberIndex(Set=cull_i, Member=item_10)  # -> Index, Count
subtraction_5 = Subtraction(A=subtraction_4, B=ma_5.Result)
item_11 = ListItem(List=mindex.Index, Index=0, Wrap=True)
neg = Negative(Value=subtraction_5)
ma_6 = MassAddition(Input=flatten(num_52))  # -> Result, PartialResults
smaller = SmallerThan(FirstNumber=subtraction_5, SecondNumber=0)  # -> SmallerThan, OrEqualTo
division_6 = Division(A=neg, B=ma_6.Result)
round_2 = Round(Number=division_6)  # -> Nearest, Floor, Ceiling
subtraction_6 = Subtraction(A=cull_i_2, B=round_2.Ceiling)
filter_9 = StreamFilter(Gate=smaller.SmallerThan, Stream0=cull_i_2, Stream1=subtraction_6)  # -> simplify(Stream)
item_12 = ListItem(List=filter_9, Index=item_11, Wrap=True)  # -> flatten(Item)
cull_i_3 = CullIndex(List=filter_9, Indices=item_11, Wrap=True)  # -> flatten(List)

filter_10 = StreamFilter(Gate=num_42, Stream0=cluster_37, Stream1=cluster_31.I_2, Stream2=item_11)

num_53 = Number(filter_10)

cluster_49 = Cluster_32(i=num_53, T=entwine_3)
cluster_50 = Cluster_33(d1=num_53, d2=cluster_30, T=entwine_3)
cluster_51 = Cluster_32(i=num_53, T=entwine_4)
cluster_52 = Cluster_33(d1=num_53, d2=cluster_30, T=entwine_4)
cluster_53 = Cluster_95(G=num_42, relay=cluster_50, R=cluster_31.I)
cluster_54 = Cluster_95(G=list_2, relay=cluster_52, R=cluster_31.I)
cluster_55 = Cluster_44(I=num_53, crv=crv_23)  # -> B, L
cluster_56 = Cluster_43(i=num_53, crv=crv_23)

cluster_57 = Cluster_32(i=num_53, T=entwine_5)
cluster_58 = Cluster_33(d1=num_53, d2=cluster_30, T=entwine_5)
num_54 = Number(filter_10)

num_55 = Number(cluster_50)
cluster_59 = Cluster_48(crv=cluster_39, num=num_28, num_3=num_24, B=list_15)  # -> L, D, D_2, D_3, Z_2, R
num_56 = Number(num_40)
num_57 = Number(cluster_49)
num_58 = Number(flatten(altura_permitida))
num_59 = Number(cluster_52)
num_60 = Number(num_42)
num_61 = Number(cluster_51)
brep_3 = Brep(cluster_23.D_2)
brep_4 = Brep(brep)
cluster_60 = Cluster_3(num_3=cluster_23.L, crv=cluster_56, num=num_57, num_7=num_58, num_2=num_61, pisos_2=cluster_57)  # -> alturas_2, sup_total_2, volumen_2, surface_2, alt_max_2, G
subtraction_7 = Subtraction(A=filter_7, B=cluster_60.sup_total_2)
cluster_61 = Cluster_42(
    L=cluster_23.L,
    A=num_42,
    num_10=cull_i_3,
    crv=cluster_55.B,
    CC=subtraction_7,
    num=num_55,
    num_5=altura_permitida,
    num_3=num_59,
    pisos_2=cluster_58)  # -> alturas_2, sup_total_2, volumen_2, surface_2, alt_max_2
num_62 = Number([altura_permitida, cluster_60.alt_max_2, cluster_21.Z_2])
cluster_62 = Cluster_54(brep=brep_3, R="{0}", D=cluster_23.D_3)  # -> D_7, D_8, D_10, D_11, D_12, D_13, D_9
cluster_63 = Cluster_54(brep=cluster_59.D_2, R="{-1}")  # -> D_7, D_8, D_10, D_11, D_12, D_13, D_9
ma_7 = MassAddition(Input=flatten([cluster_61.sup_total_2, cluster_60.sup_total_2]))  # -> Result, PartialResults
ma_8 = MassAddition(Input=flatten(cluster_60.sup_total_2))  # -> Result, PartialResults
cluster_64 = Cluster_52(A=cluster_60.sup_total_2, B=cluster_60.sup_total_2, crv=crv_23, I=num_53)
filter_11 = StreamFilter(Gate=list_20, Stream1=cluster_62.D_7)
filter_12 = StreamFilter(Gate=list_20, Stream1=cluster_23.L)
panel_54 = Panel(ma_7.Result)
sort_3 = SortList(Keys=cluster_64, ValuesA=cluster_64)  # -> Keys, reverse(ValuesA)
cluster_65 = Cluster_46(num=num_62, A=sort_3.ValuesA, num_2=num_55, num_3=num_59)
area_19 = Area(Geometry=cluster_61.volumen_2)  # -> Area, Centroid
lng_4 = ListLength(List=brep_4)
null = NullItem(Item=lng_4)  # -> NullFlags, InvalidFlags, Description
ma_9 = MassAddition(Input=flatten(area_19.Area))  # -> Result, PartialResults
num_63 = Number(cluster_65)
brep_5 = Brep(cluster_23.D_2)
crv_24 = Curve(cluster_23.D_3)
num_64 = Number(num_63)

merge_9 = Merge(Data1=cluster_60.volumen_2, Data2=cluster_61.volumen_2)  # -> simplify(Result)
cluster_66 = Cluster_99(brep=merge_9)
merge_10 = Merge(Data1=cluster_60.surface_2, Data2=cluster_61.surface_2, Data3=cluster_66)

# ---- group: Circulaciones (continued)
cluster_67 = Cluster_59(G_2=join, G=merge_10, F=num_48, num_3=cluster_59.R, num_5=A, num_6=B, num_7=A_2, num_8=B_2)  # -> i, R_2, R, simplify(circulaciones_2), simplify(vacios_2), simplify(ascensores_2), simplify(shafts_int_2), simplify(escaleras_2)
# © 2025-2026, Pedro Quiroz, para TERRITORIA
cluster_68 = Cluster_70(
    C=cluster_33.srf_3,
    d1=cluster_23.D_3,
    d2=cluster_59.D_3,
    pt=cluster_33.P_2,
    X=cluster_33.I,
    G=list_23,
    Y=cluster_33.I_2,
    _0=cluster_21.Z_2,
    _2=cluster_59.R)  # -> B, crv_3
crv_25 = Curve(cluster_67.R)

# ----
ma_10 = MassAddition(Input=[cluster_67.ascensores_2, cluster_67.shafts_int_2, cluster_67.escaleras_2])  # -> Result, PartialResults
crv_26 = Curve(cluster_67.i)
panel_55 = Panel(cluster_67.vacios_2)

brep_6 = Brep([brep_4, cluster_67.R_2])
merge_11 = Merge(Data1=brep_6, Data2=cluster_68.B)  # -> flatten(Result)
brep_7 = Brep(merge_11)
trim_4 = TrimSolid(Shape=cluster_62.D_8, Cutters=[brep_7, brep_6])  # -> flatten(Result)
filter_13 = StreamFilter(Gate=list_20, Stream1=trim_4)
sdiff = SolidDifference(BrepsA=cluster_60.volumen_2, BrepsB=brep_7)
cluster_69 = Cluster_72(S=cluster_60.surface_2, T=[brep_7, brep_6])
sdiff_2 = SolidDifference(BrepsA=cluster_61.volumen_2, BrepsB=brep_7)
trim_5 = TrimSolid(Shape=cluster_61.surface_2, Cutters=[brep_7, brep_6])
cap = CapHoles(Brep=sdiff)
path_mapper_3 = PathMapper(cluster_69, source="{A;B}", target="{A}")
cluster_70 = Cluster_73(A=num_42, brep=sdiff_2)
path_mapper_4 = PathMapper(trim_5, source="{A;B}", target="{A}")
sdiff_3 = SolidDifference(BrepsA=brep_5, BrepsB=brep_7)
trim_6 = TrimSolid(Shape=crv_24, Cutters=brep_7)  # -> flatten(Result)
trim_7 = TrimSolid(Shape=cluster_59.D_3, Cutters=brep_7)  # -> flatten(Result)
area_20 = Area(Geometry=cluster_69)  # -> Area, Centroid
area_21 = Area(Geometry=path_mapper_4)  # -> Area, Centroid
area_22 = Area(Geometry=trim_6)  # -> Area, Centroid
cluster_71 = Cluster_117(D=trim_7, T_2=trim_7, T=cluster_59.D_3)
ma_11 = MassAddition(Input=flatten([area_21.Area, area_20.Area]))  # -> Result, PartialResults
area_23 = Area(Geometry=cluster_70)  # -> Area, Centroid
ma_12 = MassAddition(Input=flatten(area_22.Area))  # -> Result, PartialResults
subtraction_8 = Subtraction(A=num_56, B=ma_12.Result)
filter_14 = StreamFilter(Gate=num_33, Stream0=num_56, Stream1=subtraction_8)
filter_15 = StreamFilter(Gate=num_34, Stream0=filter_14, Stream1=num_56)
subtraction_9 = Subtraction(A=filter_15, B=ma_11.Result)
cluster_72 = Cluster_89(A=num_42, srf=cluster_70, num=subtraction_9, I=area_23.Area)

panel_56 = Panel(cluster_61.alturas_2)
Z_3 = UnitZ(Factor=cluster_59.R)
move_7 = Move(Geometry=crv_18, Motion=Z_3)  # -> Geometry, Transform
project = Project(Geometry=crv_26, Plane=move_7.Geometry)  # -> Geometry, Transform
boundary_6 = BoundarySurfaces(Edges=move_7.Geometry)  # -> flatten(Surfaces)
boundary_7 = BoundarySurfaces(Edges=project.Geometry)  # -> flatten(Surfaces)
rdiff = RegionDifference(CurvesA=boundary_6, CurvesB=boundary_7)
boundary_8 = BoundarySurfaces(Edges=rdiff)
# Zonas!
brep_8 = Brep(brep_4)  # disabled

cluster_73 = Cluster_78(A=panel_12, srf=cluster_70, num=num_55, num_5=num_64, x=cluster_72, num_2=num_59, B=cluster_67.i)  # -> L_2, simplify(s_0), simplify(D), simplify(D_2), simplify(Z), simplify(L)
merge_12 = Merge(Data1=cluster_60.volumen_2, Data2=cluster_61.volumen_2, Data3=cluster_73.D)
merge_13 = Merge(Data1=sdiff_2, Data2=cluster_73.D)
join_4 = BrepJoin(Breps=merge_12)  # -> Breps, Closed
join_5 = BrepJoin(Breps=merge_13)  # -> Breps, Closed
num_65 = Number(merge_12)
sunion = SolidUnion(Breps=join_4.Breps)
sunion_2 = SolidUnion(Breps=join_5.Breps)
sunion_3 = SolidUnion(Breps=cap)
sdiff_4 = SolidDifference(BrepsA=sunion, BrepsB=brep_4)
cset = CreateSet(List=null.NullFlags)  # -> Set, Map
merge_14 = Merge(Data1=sunion_3, Data2=sunion_2)  # -> simplify(flatten(Result))
filter_16 = StreamFilter(Gate=cset.Set, Stream0=sdiff_4, Stream1=merge_12)
sunion_4 = SolidUnion(Breps=filter_16)  # -> flatten(Result)
merge_15 = Merge(Data1=path_mapper_3, Data2=path_mapper_4, Data3=cluster_73.D_2)
correccion_volumenes_sobre_nivel = CorreccionVolumenesSobreNivel(_0=num_51, i=cluster_37, brep=sunion_4, G=dist_volúmenes_aislados, T=merge_15)  # -> simplify(graft(B)), i_2, s_0, M, M_2, R, R_2
listdexs = ListIndices(List=flatten(correccion_volumenes_sobre_nivel.B))  # -> expr("x+1", Indices)
sunion_5 = SolidUnion(Breps=correccion_volumenes_sobre_nivel.B)
brep_9 = Brep(correccion_volumenes_sobre_nivel.R_2)
lng_5 = ListLength(List=correccion_volumenes_sobre_nivel.R)
sdiff_5 = SolidDifference(BrepsA=correccion_volumenes_sobre_nivel.B, BrepsB=correccion_volumenes_sobre_nivel.R)
equals_2 = Equality(FirstNumber=lng_5, SecondNumber=0)  # -> Equality, Inequality
cluster_74 = Cluster_85(brep=correccion_volumenes_sobre_nivel.B, I=num_65, T_3=num_55, T_2=num_64, T=num_59)  # -> B, B_2, B_6, B_4, B_5, B_3
filter_17 = StreamFilter(Gate=equals_2.Equality, Stream0=sdiff_5, Stream1=correccion_volumenes_sobre_nivel.B)
listdexs_2 = ListIndices(List=flatten(sunion_5))
area_24 = Area(Geometry=brep_9)  # -> Area, Centroid
area_25 = Area(Geometry=cluster_74.B)  # -> Area, Centroid
cluster_75 = Cluster_114(G=piso_retirado, T=sunion_5, P=num_54, L=cluster_49, num=cluster_51)  # -> brep, superficie, altura
brep_10 = Brep(cluster_67.R_2)
ma_13 = MassAddition(Input=flatten(area_24.Area))  # -> Result, PartialResults
subtraction_10 = Subtraction(A=filter_15, B=ma_13.Result)
cull_i_4 = CullIndex(List=listdexs_2, Indices=num_54, Wrap=True)
num_66 = Number(cluster_60.alturas_2)
cluster_76 = Cluster_116(I=cluster_75.altura, L=num_66)
cluster_77 = Cluster_115(I=cluster_75.superficie, T=brep_9, P=num_54)
cluster_78 = Cluster_89(A=num_42, srf=cluster_74.B, num=subtraction_10, I=area_25.Area)
cluster_79 = Cluster_92(
    A=panel_12,
    srf=cluster_74.B,
    num=cluster_74.B_6,
    num_4=cluster_74.B_4,
    x=cluster_78,
    num_3=cluster_74.B_5,
    B=cluster_67.i)  # -> L, simplify(s_0), simplify(D), simplify(D_2), simplify(Z_3), simplify(G)
branch = TreeBranch(Tree=brep_9, Path=cull_i_4, MaintainPaths=True)
merge_16 = Merge(Data1=cluster_77, Data2=branch)
clean_3 = CleanTree(RemoveNulls=True, RemoveInvalid=True, RemoveEmpty=False, Tree=cluster_76)
brep_11 = Brep(sunion_5)
fmerge = MergeFaces(Brep=brep_11)  # -> Breps, Before, After
cluster_80 = Cluster_104(brep=brep_11)  # -> simplify(flatten(Z))

merge_17 = Merge(Data1=clean_3, Data2=cluster_61.alturas_2, Data3=cluster_73.L_2, Data4=cluster_79.L)
cluster_81 = Cluster_53(Panel_2=num_64)  # -> C, Z
merge_18 = Merge(Data1=merge_16, Data2=cluster_79.D_2)
cluster_82 = Cluster_54(
    brep=merge_18,
    R=listdexs,
    D=merge_17,
    D_3=cluster_67.circulaciones_2,
    D_4=cluster_67.vacios_2,
    D_5=cluster_67.ascensores_2,
    D_6=cluster_67.shafts_int_2,
    D_2=cluster_67.escaleras_2)  # -> D_7, D_8, D_10, D_11, D_12, D_13, D_9
tag = TextTag(Location=cluster_81.C, Text=cluster_81.Z, Colour=RGB(25, 70, 255))
panel_58 = Panel("""0
1
2
3
4""")
cset_2 = CreateSet(List=merge_17)  # -> Set, Map
merge_19 = Merge(Data1=cluster_59.L, Data2=filter_12, Data3=cluster_82.D_8)
merge_20 = Merge(Data1=cluster_71, Data2=filter_13, Data3=cluster_82.D_7)
panel_59 = Panel("""1
2
3
4""")
item_13 = ListItem(List=cset_2.Set, Index=-1, Wrap=True)
clean_4 = CleanTree(RemoveNulls=True, RemoveInvalid=True, RemoveEmpty=True, Tree=merge_19)
clean_5 = CleanTree(RemoveNulls=True, RemoveInvalid=True, RemoveEmpty=True, Tree=merge_20)
clean_6 = CleanTree(RemoveNulls=True, RemoveInvalid=True, RemoveEmpty=True, Tree=cluster_82.D_7)
filter_18 = StreamFilter(Gate=num_33, Stream0=panel_59, Stream1=panel_58)
area_26 = Area(Geometry=clean_5)  # -> Area, Centroid
tstat = TreeStatistics(Tree=clean_6)  # -> Paths, Length, Count
filter_19 = StreamFilter(Gate=num_34, Stream0=filter_18, Stream1=panel_59)
num_67 = Number(clean_4)
tstat_2 = TreeStatistics(Tree=clean_5)  # -> Paths, Length, Count
subtraction_11 = Subtraction(A=cluster_82.D_10, B=cluster_82.D_11)
panel_60 = Panel("""1
2
3
4""")
panel_61 = Panel("""-1
0""")
branch_2 = TreeBranch(Tree=area_26.Area, Path=filter_19, MaintainPaths=True)
ma_14 = MassAddition(Input=flatten(cluster_82.D_10))  # -> Result, PartialResults
ma_15 = MassAddition(Input=flatten(cluster_82.D_11))  # -> Result, PartialResults
branch_3 = TreeBranch(Tree=area_26.Area, Path=panel_60, MaintainPaths=True)
branch_4 = TreeBranch(Tree=area_26.Area, Path=panel_61, MaintainPaths=True)
branch_5 = TreeBranch(Tree=merge_5, Path=tstat_2.Paths, MaintainPaths=True)
ma_16 = MassAddition(Input=flatten(branch_2))  # -> Result, PartialResults
clean_7 = CleanTree(RemoveNulls=True, RemoveInvalid=True, RemoveEmpty=True, Tree=branch_3)
clean_8 = CleanTree(RemoveNulls=True, RemoveInvalid=True, RemoveEmpty=True, Tree=branch_4)
subtraction_12 = Subtraction(A=ma_14.Result, B=ma_15.Result)
num_68 = Number(branch_5)
txt_15 = Text(merge_4)
subtraction_13 = Subtraction(A=clean_7, B=subtraction_11)
subtraction_14 = Subtraction(A=clean_8, B=subtraction_12)
replace_2 = ReplaceMembers(Set=num_67, Find=num_68, Replace=txt_15)  # -> simplify(Result)
merge_21 = Merge(Data1=subtraction_13, Data2=subtraction_14)
cluster_83 = Cluster_103(txt=replace_2, num=area_26.Area)  # -> L, L_2, L_3, L_4

# ----
# IF PARA FILTRAR
cluster_84 = Cluster_131(brep=cluster_82.D_7, num=num_54)
path_mapper_5 = PathMapper(cluster_84, source="{A;B;C;D}(i)", target="{A}")
boundary_9 = BoundarySurfaces(Edges=cluster_84)
crv_27 = Curve(path_mapper_5)
len_2 = Length(Curve=crv_27)
offset_3 = OffsetCurve(Curve=crv_27, Distance=filter_2, Corners=1)
rdiff_2 = RegionDifference(CurvesA=offset_3, CurvesB=boundary_9)
area_27 = Area(Geometry=boundary_9)  # -> Area, Centroid
boundary_10 = BoundarySurfaces(Edges=offset_3)
area_28 = Area(Geometry=boundary_10)  # -> Area, Centroid
boundary_11 = BoundarySurfaces(Edges=rdiff_2)
subtraction_15 = Subtraction(A=area_28.Area, B=area_27.Area)
area_29 = Area(Geometry=boundary_11)  # -> Area, Centroid
path_mapper_6 = PathMapper(boundary_10, source="{A;B}(i)", target="{A}")
path_mapper_7 = PathMapper(boundary_11, source="{A;B;C;D;E}(i)", target="{A}")
panel_62 = Panel(subtraction_15)
boundary_12 = BoundarySurfaces(Edges=path_mapper_6)
area_30 = Area(Geometry=path_mapper_7)  # -> Area, Centroid
num_69 = Number(area_30.Area)
merge_22 = Merge(Data1=cluster_71, Data2=filter_13, Data3=boundary_12)
ma_17 = MassAddition(Input=num_69)  # -> Result, PartialResults
ma_18 = MassAddition(Input=flatten(num_69))  # -> Result, PartialResults
panel_63 = Panel(num_67)
clean_9 = CleanTree(RemoveNulls=True, RemoveInvalid=True, RemoveEmpty=True, Tree=merge_22)
merge_23 = Merge(Data1=ma_17.Result)
terrazas_2 = Terrazas(
    circulaciones_vanos=cluster_67.circulaciones_2,
    brep=clean_9,
    srf=path_mapper_7,
    num_2=merge_21,
    num=num_67,
    num_3=branch_5)  # -> su_residencial_2, su_oficinas_2, su_retail_2, E, E_4, E_3, E_2, i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
ins = InsertItems(List=num_69, Item=merge_23, Indices=-1, Wrap=True)  # -> simplify(List)
brep_12 = Brep(terrazas_2.E)
brep_13 = Brep(terrazas_2.E_4)
brep_14 = Brep(terrazas_2.E_3)
brep_15 = Brep(terrazas_2.i)
brep_16 = Brep(terrazas_2.i_2)
brep_17 = Brep(terrazas_2.i_3)
brep_18 = Brep([brep_12, brep_15])
brep_19 = Brep([brep_13, brep_16])
brep_20 = Brep([brep_14, brep_17])
# Lista espejo de lista proyecto
# Lista Proyecto
# Lista actualizada
subtraction_16 = Subtraction(A=terrazas_2.su_residencial_2)
subtraction_17 = Subtraction(A=terrazas_2.su_oficinas_2)
subtraction_18 = Subtraction(A=terrazas_2.su_retail_2)
# Guardado xls en alguna parte
# de algun server o plataforma cloud
# con nombres consecutivos (v1 v2 v3)
ma_19 = MassAddition(Input=flatten(subtraction_16))  # -> Result, PartialResults
ma_20 = MassAddition(Input=flatten(subtraction_17))  # -> Result, PartialResults
ma_21 = MassAddition(Input=flatten(subtraction_18))  # -> Result, PartialResults
division_7 = Division(A=ma_19.Result, B=residencial_m2_unidad)
division_8 = Division(A=ma_20.Result, B=oficinas_m2_unidad)
division_9 = Division(A=ma_21.Result, B=retail_m2_unidad)
round_3 = Round(Number=division_9)  # -> Nearest, Floor, Ceiling
round_4 = Round(Number=division_7)  # -> Nearest, Floor, Ceiling
round_5 = Round(Number=division_8)  # -> Nearest, Floor, Ceiling
num_70 = Number(round_4.Nearest)
num_71 = Number(round_5.Nearest)
num_72 = Number(round_3.Nearest)
estacionamientos_requeridos_2 = Panel([num_70, num_71, num_72])
clean_10 = CleanTree(RemoveNulls=True, RemoveInvalid=True, RemoveEmpty=False, Tree=estacionamientos_requeridos_2)
ma_22 = MassAddition(Input=flatten(clean_10))  # -> Result, PartialResults
estacionamientos_requeridos_3 = Panel(ma_22.Result)
division_10 = Division(A=ma_22.Result, B=3)
round_6 = Round(Number=division_10)  # -> Nearest, Floor, Ceiling
subtraction_19 = Subtraction(A=ma_22.Result, B=round_6.Nearest)
filter_20 = StreamFilter(Gate=reducción_estacionamientos_1_3, Stream0=ma_22.Result, Stream1=subtraction_19)
cluster_85 = Cluster_64(srf=boundary_8, A=filter_20, B=superficie_estacionamiento_ratio, B_2=item_5)  # -> R, L, B_3, path_mapper_3, num_2, path_mapper_6, L_2, D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

Z_4 = UnitZ(Factor=expr("-x", cluster_85.L_2))
Z_5 = UnitZ(Factor=expr("-x", cluster_85.L_2))
extr = Extrude(Base=crv_25, Direction=Z_4)
extr_2 = Extrude(Base=cluster_68.crv_3, Direction=Z_5)
cap_2 = CapHoles(Brep=extr)
cap_3 = CapHoles(Brep=extr_2)
brep_21 = Brep(cap_3)
brep_22 = Brep(cap_2)
brep_23 = Brep([brep_21, brep_22])
merge_24 = Merge(Data2=brep_23)

estacionamientos_requeridos_4 = Panel(filter_20)
filter_21 = StreamFilter(Gate=beneficio_eliminacion_estacionamientos, Stream0=cluster_85.path_mapper_6)
item_14 = ListItem(List=cluster_85.path_mapper_6, Index=0, Wrap=True)
num_73 = Number(cluster_82.D_10)
num_74 = Number(cluster_82.D_13)
num_75 = Number(cluster_82.D_11)
num_76 = Number(cluster_82.D_9)
num_77 = Number(cluster_82.D_11)
num_78 = Number(cluster_82.D_12)
replace_3 = ReplaceMembers(Set=cluster_85.path_mapper_6, Find=num_46, Replace=txt_14)  # -> simplify(Result)
trim_8 = TrimSolid(Shape=cluster_85.path_mapper_4, Cutters=flatten(merge_24))
ins_2 = InsertItems(List=cluster_85.int_2, Item=txt, Indices=0, Wrap=True)
ma_23 = MassAddition(Input=flatten(num_73))  # -> Result, PartialResults
ma_24 = MassAddition(Input=flatten(num_77))  # -> Result, PartialResults
ma_25 = MassAddition(Input=flatten(num_78))  # -> Result, PartialResults
ma_26 = MassAddition(Input=flatten(num_74))  # -> Result, PartialResults
ma_27 = MassAddition(Input=flatten(num_75))  # -> Result, PartialResults
ma_28 = MassAddition(Input=flatten(num_76))  # -> Result, PartialResults
filter_22 = StreamFilter(Gate=beneficio_eliminacion_estacionamientos, Stream0=replace_3)
cluster_86 = Cluster_71(brep=trim_8, T=cluster_85.D)
cluster_87 = Cluster_66(T=clean_5)
cluster_88 = Cluster_65(d1=cluster_60.surface_2, d3=cluster_73.D_2, d4=cluster_79.D_2)
ma_29 = MassAddition(Input=cluster_85.int_2)  # -> Result, PartialResults
area_31 = Area(Geometry=cluster_86)  # -> Area, Centroid
filter_23 = StreamFilter(Gate=beneficio_eliminacion_estacionamientos, Stream0=area_31.Area)
merge_25 = Merge(Data2=area_26.Area, Data3=filter_23)
cluster_89 = Cluster_135(G=beneficio_eliminacion_estacionamientos, num=num_50, L=merge_25, P=tstat.Paths)  # -> niv_gen_pisos, num_8, R
num_79 = Number(merge_25)
num_80 = Number(num_79)
branch_6 = TreeBranch(Tree=num_80, Path=panel_19, MaintainPaths=True)
branch_7 = TreeBranch(Tree=num_80, Path="0", MaintainPaths=True)
listdexs_3 = ListIndices(List=branch_6)
branch_8 = TreeBranch(Tree=num_79, Path=panel_18, MaintainPaths=True)
branch_9 = TreeBranch(Tree=num_80, Path="0", MaintainPaths=True)
listdexs_4 = ListIndices(List=branch_9)
listdexs_5 = ListIndices(List=branch_6)
listdexs_6 = ListIndices(List=branch_8)
num_81 = Number(branch_9)
listdexs_7 = ListIndices(List=num_81)
num_82 = Number(branch_8)
listdexs_8 = ListIndices(List=branch_8)
replace_4 = ReplaceItems(List=branch_9, Item=ma_23.Result, Indices=listdexs_4, Wrap=False)  # -> simplify(flatten(List))
replace_5 = ReplaceItems(List=branch_6, Item=num_73, Indices=listdexs_5, Wrap=False)  # -> simplify(List)
replace_6 = ReplaceItems(List=num_82, Item=ma_24.Result, Indices=listdexs_6, Wrap=False)  # -> simplify(List)
replace_7 = ReplaceItems(List=num_81, Item=ma_24.Result, Indices=listdexs_7, Wrap=False)  # -> simplify(flatten(List))
replace_8 = ReplaceItems(List=branch_6, VaciosTotales=num_77, Indices=listdexs_3, Wrap=False)  # -> simplify(List)
replace_9 = ReplaceItems(List=branch_6, Ascensores=num_78, Indices=listdexs_3, Wrap=False)  # -> simplify(List)
replace_10 = ReplaceItems(List=branch_6, ShaftsInt=num_74, Indices=listdexs_3, Wrap=False)  # -> simplify(List)
replace_11 = ReplaceItems(List=branch_6, ShaftsInt=num_75, Indices=listdexs_3, Wrap=False)  # -> simplify(List)
replace_12 = ReplaceItems(List=branch_6, Escaleras=num_76, Indices=listdexs_3, Wrap=False)  # -> simplify(List)
clean_11 = CleanTree(RemoveNulls=True, RemoveInvalid=True, RemoveEmpty=True, Tree=cluster_89.R)
replace_13 = ReplaceItems(List=branch_8, Item=ma_23.Result, Indices=listdexs_8, Wrap=False)  # -> simplify(List)
num_83 = Number(branch_8)
ins_3 = InsertItems(List=ins_2, Item=txt_2, Indices=0, Wrap=True)
subtraction_20 = Subtraction(A=replace_4, B=replace_7)
subtraction_21 = Subtraction(A=replace_5, B=replace_8)
ma_30 = MassAddition(Input=flatten(replace_6))  # -> Result, PartialResults
ma_31 = MassAddition(Input=replace_6)  # -> Result, PartialResults
merge_26 = Merge(Data1=replace_7, Data2=replace_8)
replace_14 = ReplaceItems(List=num_81, Item=ma_25.Result, Indices=listdexs_7, Wrap=False)  # -> simplify(flatten(List))
replace_15 = ReplaceItems(List=num_81, Item=ma_26.Result, Indices=listdexs_7, Wrap=False)  # -> simplify(flatten(List))
replace_16 = ReplaceItems(List=num_81, Item=ma_27.Result, Indices=listdexs_7, Wrap=False)  # -> simplify(flatten(List))
replace_17 = ReplaceItems(List=num_81, Item=ma_28.Result, Indices=listdexs_7, Wrap=False)  # -> simplify(flatten(List))
merge_27 = Merge(Data1=cluster_87, Data2=cluster_88)
num_84 = Number(num_67)
merge_28 = Merge(Data1=filter_21, Data2=num_84)

propset = PropertySettings(PropertySettingsVersion=(1, 0, 0))  # -> PropertySettings, ElementClassification; disabled
cluster_90 = Cluster_121(num_3=branch_5, num=item_14, A=clean_11)  # -> R, txt_2
cluster_91 = Cluster_120(d1=clean_5, d2=cluster_86)  # -> R, A, D
num_85 = Number(merge_28)
cluster_92 = Cluster_119(I=cluster_91.D, brep=cluster_91.R, num_2=cluster_91.A, num=num_85, num_3=cluster_90.R, T=cluster_90.txt_2)  # -> planta_res_2, planta_ofi_2, planta_ret_2, planta_est_2, E, E_4, E_3, E_2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
area_32 = Area(Geometry=cluster_92.planta_est_2)  # -> Area, Centroid
pdecon = Deconstruct(Point=area_32.Centroid)  # -> XComponent, YComponent, ZComponent
path_mapper_8 = PathMapper(source="{A;B}(i)", target="{A}")
pt_3 = ConstructPoint(XCoordinate=pdecon.XComponent, YCoordinate=pdecon.YComponent, ZCoordinate=0)
zoneset = ZoneSettings(
    Category=zonecat,
    Name="RESIDENCIAL",
    Number=cluster_92.v_residencial_2,
    Height=cluster_92.h_residencial_3,
    Layer=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,
    PropertySettings=propset.PropertySettings)  # disabled
zoneset_2 = ZoneSettings(
    Category=zonecat_2,
    Name="OFICINAS",
    Number=cluster_92.v_oficinas_2,
    Height=cluster_92.h_oficinas_3,
    Layer=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,
    PropertySettings=propset.PropertySettings)  # disabled
zoneset_3 = ZoneSettings(
    Category=zonecat_3,
    Name="OFICINAS",
    Number=cluster_92.v_retail_2,
    Height=cluster_92.h_retail_3,
    Layer=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,
    PropertySettings=propset.PropertySettings)  # disabled
zoneset_4 = ZoneSettings(
    Category=zonecat_4,
    Name="OFICINAS",
    Number=cluster_92.v_estacionamientos_2,
    Height=cluster_92.h_estacionamientos_2,
    Layer=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,
    PropertySettings=propset.PropertySettings)  # disabled
zone = Zone(
    Synchronize=exportacion_zonas_a_archicad,
    Polygon=cluster_92.planta_ofi_2,
    StampPosition=<geometry referenced from the Rhino model>,
    ZoneSettings=zoneset_2)  # disabled
zone_2 = Zone(
    Synchronize=exportacion_zonas_a_archicad,
    Polygon=cluster_92.planta_res_2,
    StampPosition=<geometry referenced from the Rhino model>,
    ZoneSettings=zoneset)  # disabled
zone_3 = Zone(
    Synchronize=exportacion_zonas_a_archicad,
    Polygon=cluster_92.planta_ret_2,
    StampPosition=<geometry referenced from the Rhino model>,
    ZoneSettings=zoneset_3)  # disabled
zone_4 = Zone(
    Synchronize=exportacion_zonas_a_archicad,
    Polygon=cluster_92.planta_est_2,
    StampPosition=area_32.Centroid,
    ZoneSettings=zoneset_4)  # disabled
clean_12 = CleanTree(RemoveNulls=True, RemoveInvalid=True, RemoveEmpty=True, Tree=zone_2)  # -> simplify(Tree); disabled
clean_13 = CleanTree(RemoveNulls=True, RemoveInvalid=True, RemoveEmpty=True, Tree=zone)  # -> simplify(Tree); disabled
clean_14 = CleanTree(RemoveNulls=True, RemoveInvalid=True, RemoveEmpty=True, Tree=zone_3)  # -> simplify(Tree); disabled
clean_15 = CleanTree(RemoveNulls=True, RemoveInvalid=True, RemoveEmpty=True, Tree=zone_4)  # -> simplify(Tree); disabled
de_zone = DeconstructZone(
    Zone=clean_12,
    SurfaceType0_SurfaceType=(1, 0, 0),
    SurfaceType1_SurfaceType=(1, 0, 0),
    SurfaceType2_SurfaceType=(1, 0, 0),
    SurfaceType3_SurfaceType=(1, 0, 0),
    SurfaceType4_SurfaceType=(1, 0, 0),
    SurfaceType5_SurfaceType=(1, 0, 0),
    SurfaceType6_SurfaceType=(1, 0, 0),
    SurfaceType7_SurfaceType=(1, 0, 0),
    SurfaceType8_SurfaceType=(1, 0, 0),
    SurfaceType9_SurfaceType=(1, 0, 0),
    SurfaceType10_SurfaceType=(1, 0, 0),
    SurfaceType11_SurfaceType=(1, 0, 0),
    SurfaceType12_SurfaceType=(1, 0, 0),
    SurfaceType13_SurfaceType=(1, 0, 0),
    SurfaceType14_SurfaceType=(1, 0, 0),
    SurfaceType15_SurfaceType=(1, 0, 0),
    SurfaceType16_SurfaceType=(1, 0, 0),
    SurfaceType17_SurfaceType=(1, 0, 0),
    SurfaceType18_SurfaceType=(1, 0, 0),
    SurfaceType19_SurfaceType=(1, 0, 0))  # -> Polygon, StampPosition, Brep, ZoneSettings; disabled
de_zone_2 = DeconstructZone(
    Zone=clean_13,
    SurfaceType0_SurfaceType=(1, 0, 0),
    SurfaceType1_SurfaceType=(1, 0, 0),
    SurfaceType2_SurfaceType=(1, 0, 0),
    SurfaceType3_SurfaceType=(1, 0, 0),
    SurfaceType4_SurfaceType=(1, 0, 0),
    SurfaceType5_SurfaceType=(1, 0, 0),
    SurfaceType6_SurfaceType=(1, 0, 0),
    SurfaceType7_SurfaceType=(1, 0, 0),
    SurfaceType8_SurfaceType=(1, 0, 0),
    SurfaceType9_SurfaceType=(1, 0, 0),
    SurfaceType10_SurfaceType=(1, 0, 0),
    SurfaceType11_SurfaceType=(1, 0, 0),
    SurfaceType12_SurfaceType=(1, 0, 0),
    SurfaceType13_SurfaceType=(1, 0, 0),
    SurfaceType14_SurfaceType=(1, 0, 0),
    SurfaceType15_SurfaceType=(1, 0, 0),
    SurfaceType16_SurfaceType=(1, 0, 0),
    SurfaceType17_SurfaceType=(1, 0, 0),
    SurfaceType18_SurfaceType=(1, 0, 0),
    SurfaceType19_SurfaceType=(1, 0, 0))  # -> Polygon, StampPosition, Brep, ZoneSettings; disabled
de_zone_3 = DeconstructZone(
    Zone=clean_14,
    SurfaceType0_SurfaceType=(1, 0, 0),
    SurfaceType1_SurfaceType=(1, 0, 0),
    SurfaceType2_SurfaceType=(1, 0, 0),
    SurfaceType3_SurfaceType=(1, 0, 0),
    SurfaceType4_SurfaceType=(1, 0, 0),
    SurfaceType5_SurfaceType=(1, 0, 0),
    SurfaceType6_SurfaceType=(1, 0, 0),
    SurfaceType7_SurfaceType=(1, 0, 0),
    SurfaceType8_SurfaceType=(1, 0, 0),
    SurfaceType9_SurfaceType=(1, 0, 0),
    SurfaceType10_SurfaceType=(1, 0, 0),
    SurfaceType11_SurfaceType=(1, 0, 0),
    SurfaceType12_SurfaceType=(1, 0, 0),
    SurfaceType13_SurfaceType=(1, 0, 0),
    SurfaceType14_SurfaceType=(1, 0, 0),
    SurfaceType15_SurfaceType=(1, 0, 0),
    SurfaceType16_SurfaceType=(1, 0, 0),
    SurfaceType17_SurfaceType=(1, 0, 0),
    SurfaceType18_SurfaceType=(1, 0, 0),
    SurfaceType19_SurfaceType=(1, 0, 0))  # -> Polygon, StampPosition, Brep, ZoneSettings; disabled
de_zone_4 = DeconstructZone(
    Zone=clean_15,
    SurfaceType0_SurfaceType=(1, 0, 0),
    SurfaceType1_SurfaceType=(1, 0, 0),
    SurfaceType2_SurfaceType=(1, 0, 0),
    SurfaceType3_SurfaceType=(1, 0, 0),
    SurfaceType4_SurfaceType=(1, 0, 0),
    SurfaceType5_SurfaceType=(1, 0, 0),
    SurfaceType6_SurfaceType=(1, 0, 0),
    SurfaceType7_SurfaceType=(1, 0, 0),
    SurfaceType8_SurfaceType=(1, 0, 0),
    SurfaceType9_SurfaceType=(1, 0, 0),
    SurfaceType10_SurfaceType=(1, 0, 0),
    SurfaceType11_SurfaceType=(1, 0, 0),
    SurfaceType12_SurfaceType=(1, 0, 0),
    SurfaceType13_SurfaceType=(1, 0, 0),
    SurfaceType14_SurfaceType=(1, 0, 0),
    SurfaceType15_SurfaceType=(1, 0, 0),
    SurfaceType16_SurfaceType=(1, 0, 0),
    SurfaceType17_SurfaceType=(1, 0, 0),
    SurfaceType18_SurfaceType=(1, 0, 0),
    SurfaceType19_SurfaceType=(1, 0, 0))  # -> Polygon, StampPosition, Brep, ZoneSettings; disabled
extzoneset = ExtractZoneSettings(ZoneSettings=de_zone.ZoneSettings)  # -> Category, Name, Number, Height, SubfloorThickness, Layer, HomeStory, ID, RenovationStatus; disabled
extzoneset_2 = ExtractZoneSettings(ZoneSettings=de_zone_2.ZoneSettings)  # -> Category, Name, Number, Height, SubfloorThickness, Layer, HomeStory, ID, RenovationStatus; disabled
extzoneset_3 = ExtractZoneSettings(ZoneSettings=de_zone_3.ZoneSettings)  # -> Category, Name, Number, Height, SubfloorThickness, Layer, HomeStory, ID, RenovationStatus; disabled
extzoneset_4 = ExtractZoneSettings(ZoneSettings=de_zone_4.ZoneSettings)  # -> Category, Name, Number, Height, SubfloorThickness, Layer, HomeStory, ID, RenovationStatus; disabled
merge_29 = Merge(Data1=extzoneset.Number, Data2=extzoneset_2.Number, Data3=extzoneset_3.Number, Data4=extzoneset_4.Number)  # disabled
merge_30 = Merge(Data1=extzoneset.HomeStory, Data2=extzoneset_2.HomeStory, Data3=extzoneset_3.HomeStory, Data4=extzoneset_4.HomeStory)  # disabled
merge_31 = Merge(Data1=extzoneset.Category, Data2=extzoneset_2.Category, Data3=extzoneset_3.Category, Data4=extzoneset_4.Category)  # disabled
merge_32 = Merge(Data1=extzoneset.ID, Data2=extzoneset_2.ID, Data3=extzoneset_3.ID, Data4=extzoneset_4.ID)  # disabled
merge_33 = Merge(Data1=extzoneset.Height, Data2=extzoneset_2.Height, Data3=extzoneset_3.Height, Data4=extzoneset_4.Height)  # disabled
panel_64 = Panel(merge_32)  # disabled

merge_34 = Merge(Data1=cluster_92.T_3, Data2=cluster_92.T_5, Data3=cluster_92.T_4, Data4=cluster_92.T_2)  # disabled
merge_35 = Merge(
    Data1=cluster_92.planta_res_2,
    Data2=cluster_92.planta_ofi_2,
    Data3=cluster_92.planta_ret_2,
    Data4=cluster_92.planta_est_2)  # disabled
clean_16 = CleanTree(RemoveNulls=True, RemoveInvalid=True, RemoveEmpty=True, Tree=merge_35)  # disabled
area_33 = Area(Geometry=clean_16)  # -> Area, Centroid; disabled
gguid = GenerateGUID(Generate=area_33.Area, Format="D")
panel_65 = Panel(merge_28)
python_3 = GhPythonScript(
    AREAS=area_33.Area,
    NIVELES=merge_34,
    VOLUMEN=merge_29,
    PROGRAMA_IDS=merge_31,
    VERSION_ID=panel_22,
    ARCHICAD_GUIDS=merge_32,
    EXTERNAL_UUIDS=gguid,
    ALTURAS=merge_33,
    BASE_URL=panel_23,
    ANON_KEY=panel_24,
    TABLE_NAME=panel_25,
    TRIGGER=python_2.SUCCESS)  # -> out, a, RESULT, DEBUG_INFO, SENT_ROWS, SKIPPED; inputs AREAS: list, NIVELES: list, PROGRAMA_IDS: list, ARCHICAD_GUIDS: list, EXTERNAL_UUIDS: list, ALTURAS: list
# ---------- python_3: Python ----------
import json
import System
from System.Net import WebClient, WebException

RESULT = "Ready"
SENT_ROWS = 0
SKIPPED = 0
DEBUG_INFO = ""

def get_program_name(program_string):
    if program_string and program_string != "null":
        return str(program_string).strip()
    else:
        return "UNKNOWN"

def flatten_list(data):
    """Flatten nested lists/trees from Grasshopper into a single flat list"""
    result = []
    if data is None:
        return result
    try:
        if hasattr(data, '__iter__') and not isinstance(data, str):
            for item in data:
                if hasattr(item, '__iter__') and not isinstance(item, str):
                    # Recursively flatten nested lists
                    result.extend(flatten_list(item))
                else:
                    result.append(item)
        else:
            result.append(data)
    except:
        # If iteration fails, treat as single value
        result.append(data)
    return result

try:
    if not TRIGGER:
        RESULT = "Waiting for TRIGGER"
    else:
        areas = []
        niveles = []
        programa_ids = []
        archicad_guids = []
        external_uuids = []
        
        if hasattr(AREAS, '__iter__'):
            areas = list(AREAS)
        else:
            areas = [AREAS]
        
        if hasattr(NIVELES, '__iter__'):
            niveles = list(NIVELES)
        else:
            niveles = [NIVELES]
        
        if hasattr(PROGRAMA_IDS, '__iter__'):
            programa_ids = list(PROGRAMA_IDS)
        else:
            programa_ids = [PROGRAMA_IDS]
        
        if hasattr(ARCHICAD_GUIDS, '__iter__'):
            archicad_guids = list(ARCHICAD_GUIDS)
        else:
            archicad_guids = [ARCHICAD_GUIDS]
        
        if hasattr(EXTERNAL_UUIDS, '__iter__'):
            external_uuids = list(EXTERNAL_UUIDS)
        else:
            external_uuids = [EXTERNAL_UUIDS]
        
        while len(external_uuids) < len(areas):
            external_uuids.append(None)
        
        volumenes = []
        if hasattr(VOLUMEN, '__iter__'):
            volumenes = list(VOLUMEN)
        else:
            volumenes = [VOLUMEN]
        
        while len(volumenes) < len(areas):
            volumenes.append(None)
        
        alturas = []
        try:
            alturas = flatten_list(ALTURAS)
            DEBUG_INFO += "ALTURAS flattened: length=" + str(len(alturas)) + ". "
            if len(alturas) > 0 and len(alturas) <= 5:
                DEBUG_INFO += "ALTURAS values: " + str(alturas) + ". "
            elif len(alturas) > 5:
                first_five = []
                for j in range(5):
                    first_five.append(alturas[j])
                DEBUG_INFO += "ALTURAS first 5 values: " + str(first_five) + "... "
        except NameError:
            alturas = []
            DEBUG_INFO += "ALTURAS input not provided. "
        
        while len(alturas) < len(areas):
            alturas.append(None)
        
        DEBUG_INFO += "VOLUMEN input type: " + str(type(VOLUMEN)) + ", raw value: " + str(VOLUMEN) + ", converted list: " + str(volumenes) + ", length: " + str(len(volumenes)) + ". "
        
        lengths = {
            'AREAS': len(areas),
            'NIVELES': len(niveles),
            'PROGRAMA_IDS': len(programa_ids),
            'ARCHICAD_GUIDS': len(archicad_guids),
            'EXTERNAL_UUIDS': len(external_uuids),
            'VOLUMEN': len(volumenes),
            'ALTURAS': len(alturas)
        }
        
        DEBUG_INFO += "Lengths: " + str(lengths) + ". "
        
        required_lengths = {
            'AREAS': len(areas),
            'NIVELES': len(niveles),
            'PROGRAMA_IDS': len(programa_ids),
            'ARCHICAD_GUIDS': len(archicad_guids),
            'EXTERNAL_UUIDS': len(external_uuids)
        }
        
        required_unique_lengths = set(required_lengths.values())
        if len(required_unique_lengths) > 1:
            RESULT = "Validation error: List lengths don't match: " + str(required_lengths)
        else:
            rows = []
            for i in range(len(areas)):
                if i < len(external_uuids):
                    ext_uuid = external_uuids[i]
                else:
                    ext_uuid = None
                
                if i < len(areas):
                    area = areas[i]
                else:
                    area = None
                
                if i < len(programa_ids):
                    prog_id = programa_ids[i]
                else:
                    prog_id = None
                
                volumen = None
                if i < len(volumenes):
                    volumen = volumenes[i]
                    if volumen is None and len(volumenes) > 0 and volumenes[0] is not None:
                        volumen = volumenes[0]
                        DEBUG_INFO += " Row " + str(i) + ": Using first volume value (" + str(volumenes[0]) + ") because index " + str(i) + " is None. "
                    else:
                        DEBUG_INFO += " Row " + str(i) + ": Got volume from index " + str(i) + " = " + str(volumen) + ". "
                elif len(volumenes) > 0:
                    volumen = volumenes[0]
                    DEBUG_INFO += " Row " + str(i) + ": Using first volume value = " + str(volumen) + ". "
                
                if prog_id:
                    prog_name = get_program_name(prog_id)
                else:
                    prog_name = "UNKNOWN"
                DEBUG_INFO += " Program string received: '" + str(prog_id) + "', result: '" + str(prog_name) + "'. "
                
                if not ext_uuid or ext_uuid == "null":
                    ext_uuid = "test-uuid-" + str(i)
                
                try:
                    if area is not None:
                        area = float(area)
                except (ValueError, TypeError):
                    if isinstance(area, str) and len(area) > 0:
                        area = float(len(area))
                    else:
                        area = 1.0
                
                if area is None:
                    DEBUG_INFO += " Row " + str(i) + ": Missing area, using default 1.0. "
                    area = 1.0
                
                # Set altura value (numeric)
                altura_value = None
                if i < len(alturas):
                    altura = alturas[i]
                    if altura is not None and altura != "null":
                        try:
                            altura_value = float(altura)
                        except (ValueError, TypeError):
                            altura_value = None
                            DEBUG_INFO += " Row " + str(i) + ": Invalid altura value (" + str(altura) + "), setting to None. "
                elif len(alturas) > 0 and alturas[0] is not None:
                    try:
                        altura_value = float(alturas[0])
                        DEBUG_INFO += " Row " + str(i) + ": Using first altura value (" + str(alturas[0]) + ") because index " + str(i) + " is out of range. "
                    except (ValueError, TypeError):
                        altura_value = None
                
                # Set volumen value
                if volumen is not None and volumen != "null":
                    volumen_value = str(volumen)
                else:
                    volumen_value = None
                
                # Set nivel value
                if i < len(niveles) and niveles[i] is not None and niveles[i] != "null":
                    nivel_value = str(niveles[i])
                else:
                    nivel_value = None
                
                # Set archicad_guid value
                if i < len(archicad_guids) and archicad_guids[i] and archicad_guids[i] != "null":
                    archicad_guid_value = str(archicad_guids[i])
                else:
                    archicad_guid_value = None
                
                row = {
                    "external_uuid": str(ext_uuid),
                    "area": float(area),
                    "volumen": volumen_value,
                    "nivel": nivel_value,
                    "programa_id": prog_name,
                    "program_name": prog_name,
                    "version_id": VERSION_ID,
                    "archicad_guid": archicad_guid_value,
                    "altura": altura_value
                }
                
                if i < len(niveles):
                    nivel_debug = str(niveles[i])
                else:
                    nivel_debug = "N/A"
                if altura_value is not None:
                    altura_debug = str(altura_value)
                else:
                    altura_debug = "None"
                DEBUG_INFO += " Row " + str(i) + ": area=" + str(area) + ", volumen=" + str(volumen) + ", nivel=" + nivel_debug + ", altura=" + altura_debug + ". "
                rows.append(row)
            
            SKIPPED = len(areas) - len(rows)
            DEBUG_INFO += "Total areas: " + str(len(areas)) + ", Valid rows: " + str(len(rows)) + ", Skipped: " + str(SKIPPED) + ". "
            
            if not rows:
                RESULT = "No valid rows to send (all filtered out)"
            else:
                # Use TABLE_NAME input if provided, otherwise default to 'superficies'
                # Handle various edge cases: undefined, None, empty string, whitespace
                try:
                    DEBUG_INFO += "TABLE_NAME received: type=" + str(type(TABLE_NAME)) + ", value='" + str(TABLE_NAME) + "'. "
                    if TABLE_NAME:
                        table_name_raw = str(TABLE_NAME).strip()
                        if table_name_raw and table_name_raw != "" and table_name_raw.lower() != "none":
                            table_name = table_name_raw
                            DEBUG_INFO += "Valid TABLE_NAME found: '" + table_name + "'. "
                        else:
                            table_name = "superficies"
                            DEBUG_INFO += "TABLE_NAME provided but empty/None, using default 'superficies'. "
                    else:
                        table_name = "superficies"
                        DEBUG_INFO += "TABLE_NAME not provided (None/empty), using default 'superficies'. "
                except NameError:
                    # TABLE_NAME input parameter doesn't exist in Grasshopper
                    table_name = "superficies"
                    DEBUG_INFO += "TABLE_NAME input not defined in Grasshopper, using default 'superficies'. "
                
                DEBUG_INFO += "Using table: '" + table_name + "'. "
                # Use on_conflict for upsert behavior (requires unique constraint on external_uuid)
                url = BASE_URL.rstrip("/") + "/" + table_name + "?on_conflict=external_uuid"
                DEBUG_INFO += "FINAL URL: " + url + ". "
                DEBUG_INFO += "Note: If you get 'no unique constraint' error, add UNIQUE index on external_uuid column. "
                
                client = WebClient()
                client.Headers.Add("apikey", ANON_KEY)
                client.Headers.Add("Authorization", "Bearer " + ANON_KEY)
                client.Headers.Add("Content-Type", "application/json")
                client.Headers.Add("Prefer", "resolution=merge-duplicates,return=representation")
                
                body = json.dumps(rows, ensure_ascii=False)
                
                try:
                    DEBUG_INFO += "About to POST to: " + url + ". "
                    DEBUG_INFO += "Request body size: " + str(len(body)) + " bytes. "
                    DEBUG_INFO += "Number of rows: " + str(len(rows)) + ". "
                    body_bytes = System.Text.Encoding.UTF8.GetBytes(body)
                    response = client.UploadData(url, "POST", body_bytes)
                    response_text = System.Text.Encoding.UTF8.GetString(response)
                    DEBUG_INFO += "Response received: " + response_text[:200] + ". "
                    RESULT = "SUCCESS: " + str(len(rows)) + " rows sent (upserted), " + str(SKIPPED) + " skipped"
                    SENT_ROWS = len(rows)
                except WebException as e:
                    error_details = "HTTP " + str(e.Response.StatusCode) + " - "
                    try:
                        error_stream = e.Response.GetResponseStream()
                        reader = System.IO.StreamReader(error_stream)
                        error_body = reader.ReadToEnd()
                        error_details += error_body
                        DEBUG_INFO += "HTTP Error Response: " + error_body + ". "
                        # Check for the specific "no unique constraint" error
                        if "42P10" in error_body or "no unique or exclusion constraint" in error_body.lower():
                            DEBUG_INFO += "ERROR: Table '" + table_name + "' is missing UNIQUE constraint on 'external_uuid' column. "
                            DEBUG_INFO += "Run SQL: CREATE UNIQUE INDEX " + table_name + "_external_uuid_idx ON " + table_name + "(external_uuid); "
                            error_details += " [FIX: Add UNIQUE constraint on external_uuid column]"
                    except:
                        error_details += str(e)
                        DEBUG_INFO += "HTTP Error (no body): " + str(e) + ". "
                    RESULT = "FAILED: " + error_details
                    DEBUG_INFO += "Full error: " + str(e) + ". "
                except Exception as e:
                    error_msg = "Error: " + str(e)
                    RESULT = "FAILED: " + error_msg
                    DEBUG_INFO += "Exception details: " + error_msg + ". "
                    DEBUG_INFO += "Exception type: " + str(type(e)) + ". "

except Exception as e:
    RESULT = "Script error: " + str(e)
    SENT_ROWS = 0
    SKIPPED = 0
    DEBUG_INFO = "Exception: " + str(e)
# ---------- end python_3 ----------
txt_16 = Text(replace_2)
merge_36 = Merge(Data1=filter_22, Data2=txt_16)
concat_2 = Concatenate(FragmentA="PISO ", FragmentB=clean_11)
subtraction_22 = Subtraction(A=replace_13, B=replace_6)
panel_66 = Panel(ins_3)
replace_18 = ReplaceItems(List=num_82, Item=ma_25.Result, Indices=listdexs_6, Wrap=False)  # -> simplify(List)
replace_19 = ReplaceItems(List=num_82, Item=ma_26.Result, Indices=listdexs_6, Wrap=False)  # -> simplify(List)
replace_20 = ReplaceItems(List=num_82, Item=ma_28.Result, Indices=listdexs_6, Wrap=False)  # -> simplify(List)
brep_24 = Brep(cluster_85.B_3)
srf_2 = Surface(cluster_86)
merge_37 = Merge(Data2=replace_16, Data3=replace_11)
subtraction_23 = Subtraction(A=num_83, B=subtraction_22)
ma_32 = MassAddition(Input=flatten(subtraction_22))  # -> Result, PartialResults
ma_33 = MassAddition(Input=subtraction_22)  # -> Result, PartialResults
merge_38 = Merge(Data1=replace_4, Data2=subtraction_21)
ma_34 = MassAddition(Input=flatten(ma_30.Result))  # -> Result, PartialResults
addition_4 = Addition(A=branch_9, B=replace_7)
ma_35 = MassAddition(Input=merge_26)  # -> Result, PartialResults
ma_36 = MassAddition(Input=flatten(merge_26))  # -> Result, PartialResults
addition_5 = Addition(A=branch_6, B=replace_8)
merge_39 = Merge(Data1=replace_18, Data2=replace_14, Data3=replace_9)
merge_40 = Merge(Data1=replace_19, Data2=replace_15, Data3=replace_10)
merge_41 = Merge(Data1=replace_20, Data2=replace_17, Data3=replace_12)
# para dashboards
# ID Único deberia ser estatico
# no cambiar con cada push
# ¿concatenacion?
branch_10 = TreeBranch(Tree=concat_2, Path=panel_26, MaintainPaths=True)
branch_11 = TreeBranch(Tree=concat_2, Path=panel_27, MaintainPaths=True)
branch_12 = TreeBranch(Tree=merge_36, Path=panel_31, MaintainPaths=True)
branch_13 = TreeBranch(Tree=merge_28, Path=panel_30, MaintainPaths=True)
branch_14 = TreeBranch(Tree=merge_28, Path=panel_31, MaintainPaths=True)
branch_15 = TreeBranch(Tree=num_79, Path=panel_32, MaintainPaths=True)
branch_16 = TreeBranch(Tree=num_79, Path=panel_33, MaintainPaths=True)
branch_17 = TreeBranch(Tree=merge_36, Path=panel_28, MaintainPaths=True)
# Subterraneo 1
panel_67 = Panel(python_3.RESULT)
filter_24 = StreamFilter(Gate=bool_3, Stream0=brep_24)
filter_25 = StreamFilter(Gate=bool_3, Stream0=srf_2)
ma_37 = MassAddition(Input=flatten(ma_32.Result))  # -> Result, PartialResults
clean_17 = CleanTree(RemoveNulls=True, RemoveInvalid=True, RemoveEmpty=True, Tree=merge_38)
branch_18 = TreeBranch(Tree=merge_38, Path="0", MaintainPaths=True)
tstat_3 = TreeStatistics(Tree=merge_38)  # -> Paths, Length, Count
merge_42 = Merge(Data1=addition_4, Data2=addition_5)
num_86 = Number(branch_6)
merge_43 = Merge(Data1=branch_12, Data2=branch_17)
ma_38 = MassAddition(Input=branch_15)  # -> Result, PartialResults
ma_39 = MassAddition(Input=branch_16)  # -> Result, PartialResults
listdexs_9 = ListIndices(List=num_86)
cset_3 = CreateSet(List=flatten(merge_43))  # -> simplify(graft(Set)), Map
clean_18 = CleanTree(RemoveNulls=True, RemoveInvalid=True, RemoveEmpty=True, Tree=subtraction_23)
branch_19 = TreeBranch(Tree=merge_38, Path=panel_20, MaintainPaths=True)
lng_6 = ListLength(List=flatten(cset_3.Set))
preview_2 = CustomPreview(Geometry=filter_25, Material=material_2)
preview_3 = CustomPreview(Geometry=filter_24, Material=material_3)
ma_40 = MassAddition(Input=flatten(ma_38.Result))  # -> Result, PartialResults
ma_41 = MassAddition(Input=flatten(ma_39.Result))  # -> Result, PartialResults
ma_42 = MassAddition(Input=flatten(merge_42))  # -> Result, PartialResults
ma_43 = MassAddition(Input=merge_42)  # -> Result, PartialResults
ma_44 = MassAddition(Input=merge_42)  # -> Result, PartialResults
branch_20 = TreeBranch(Tree=clean_18, Path="-1", MaintainPaths=True)
tstat_4 = TreeStatistics(Tree=cset_3.Set)  # -> Paths, Length, Count
# EDGE BACKUP: import { serve } from "https://deno.land/std@0.168.0/http/server.ts";
# const corsHeaders = {
#   'Access-Control-Allow-Origin': '*',
#   'Access-Control-Allow-Headers': 'authorization, x-client-info, apikey, content-type'
# };
# serve(async (req)=>{
#   if (req.method === 'OPTIONS') {
#     return new Response('ok', {
#       headers: corsHeaders
#     });
#   }
#   try {
#     const supabaseUrl = Deno.env.get('SUPABASE_URL') ?? '';
#     const supabaseKey = Deno.env.get('SUPABASE_SERVICE_ROLE_KEY') ?? '';
#     // DELETE with WHERE clause - delete where id is not null (all rows)
#     const response = await fetch(`${supabaseUrl}/rest/v1/superficies?id=not.is.null`, {
#       method: 'DELETE',
#       headers: {
#         'apikey': supabaseKey,
#         'Authorization': `Bearer ${supabaseKey}`,
#         'Content-Type': 'application/json',
#         'Prefer': 'return=minimal'
#       }
#     });
#     if (!response.ok) {
#       const errorText = await response.text();
#       throw new Error(`Delete failed: ${response.status} - ${errorText}`);
#     }
#     return new Response(JSON.stringify({
#       success: true,
#       message: 'All superficies data cleared successfully'
#     }), {
#       headers: {
#         ...corsHeaders,
#         'Content-Type': 'application/json'
#       },
#       status: 200
#     });
#   } catch (error) {
#     return new Response(JSON.stringify({
#       success: false,
#       error: error.message
#     }), {
#       headers: {
#         ...corsHeaders,
#         'Content-Type': 'application/json'
#       },
#       status: 500
#     });
#   }
# });
panel_68 = Panel(python_3.RESULT)
replace_21 = ReplaceItems(List=num_86, Item=0, Indices=listdexs_9, Wrap=False)  # -> simplify(List)
tstat_5 = TreeStatistics(Tree=tstat_4.Paths)  # -> Paths, Length, Count
merge_44 = Merge(Data1=branch_15, Data2=branch_16)
# Incorporar
num_87 = Number(branch_9)
num_88 = Number(cluster_89.niv_gen_pisos)
num_89 = Number(flatten(num_88))
listdexs_10 = ListIndices(List=num_89)
formato_e_p_i = FormatoEPI_3(relay=merge_43, pisos=num_88)  # -> simplify(L), i
replace_22 = ReplaceItems(List=num_89, Indices=listdexs_10, Wrap=False)
listdexs_11 = ListIndices(List=formato_e_p_i.L)  # -> flatten(Indices)
addition_6 = Addition(A=branch_8, B=replace_6)
ma_45 = MassAddition(Input=addition_6)  # -> Result, PartialResults
panel_69 = Panel(num_88)
merge_45 = Merge(Data1=addition_6, Data2=merge_42)
cluster_93 = Cluster_163(num=merge_45)
cluster_94 = Cluster_142(num=merge_45)
merge_46 = Merge(Data1=cluster_94, Data2=num_69)
merge_47 = Merge(Data1=cluster_93, Data2=merge_37)
ma_46 = MassAddition(Input=flatten(addition_6))  # -> Result, PartialResults
ma_47 = MassAddition(Input=addition_6)  # -> Result, PartialResults
formato_e_p_i_2 = FormatoEPI_2(relay=merge_45, pisos=num_88)  # -> D, i
formato_e_p_i_3 = FormatoEPI(relay=merge_45, pisos=num_88)  # -> R, i
formato_e_p_i_4 = FormatoEPI(relay=merge_45, pisos=num_88)  # -> R, i
formato_e_p_i_5 = FormatoEPI(relay=merge_39, pisos=num_88)  # -> R, i
formato_e_p_i_6 = FormatoEPI(relay=merge_40, pisos=num_88)  # -> R, i
formato_e_p_i_7 = FormatoEPI(relay=merge_47, pisos=num_88)  # -> R, i
formato_e_p_i_8 = FormatoEPI(relay=merge_41, pisos=num_88)  # -> R, i
formato_e_p_i_9 = FormatoEPI(relay=merge_46, pisos=num_88)  # -> R, i
addition_7 = Addition(A=num_87, B=replace_7, C=subtraction_20)
subtraction_24 = Subtraction(A=num_87, B=subtraction_20)
est_com = EstCom(L=formato_e_p_i_3.R, index_est=formato_e_p_i_3.i)  # -> R, R_2
num_90 = Number(num_88)
est_com_2 = EstCom(L=formato_e_p_i_4.R, index_est=formato_e_p_i_4.i)  # -> R, R_2
est_com_3 = EstCom(L=formato_e_p_i_5.R, index_est=formato_e_p_i_5.i)  # -> R, R_2
est_com_4 = EstCom(L=formato_e_p_i_6.R, index_est=formato_e_p_i_6.i)  # -> R, R_2
est_com_5 = EstCom(L=formato_e_p_i_7.R, index_est=formato_e_p_i_7.i)  # -> R, R_2
est_com_6 = EstCom(L=formato_e_p_i_8.R, index_est=formato_e_p_i_8.i)  # -> R, R_2
terraza = Terraza(L=formato_e_p_i_9.R, index_est=formato_e_p_i_9.i)  # -> R, area_comercial
num_91 = Number(est_com.R)
num_92 = Number(est_com.R_2)
num_93 = Number(est_com_4.R_2)
num_94 = Number(terraza.R)
gba_t = Number(num_94)
num_95 = Number(terraza.area_comercial)
num_96 = Number(est_com_2.R)
num_97 = Number(est_com_2.R_2)
num_98 = Number(est_com_3.R)
num_99 = Number(est_com_3.R_2)
num_100 = Number(est_com_4.R)
num_101 = Number(est_com_5.R)
num_102 = Number(est_com_5.R_2)
num_103 = Number(est_com_6.R)
num_104 = Number(est_com_6.R_2)
cluster_95 = Cluster_148(pisos=num_90, num=num_97)
cluster_96 = Cluster_150(pisos=num_90, num=num_99)
cluster_97 = Cluster_151(pisos=num_90, num=num_93)
cluster_98 = Cluster_164(pisos=num_90, num=num_102)
cluster_99 = Cluster_153(pisos=num_90, num=num_104)
cluster_100 = Cluster_147(pisos=num_90, num=num_96)
cluster_101 = Cluster_149(pisos=num_90, num=num_98)
cluster_102 = Cluster_152(pisos=num_90, num=num_100)
cluster_103 = Cluster_154(pisos=num_90, num=num_103)
addition_8 = Addition(A=num_96, B=num_97)
addition_9 = Addition(A=num_98, B=num_99)
addition_10 = Addition(SComE=num_100, SComT=num_93, SInt=num_102)
num_105 = Number(num_90)
addition_11 = Addition(A=num_103, B=num_104)
panel_70 = Panel(num_91)
cluster_104 = Cluster_159(pisos=num_90, num=addition_8)
cluster_105 = Cluster_160(pisos=num_90, num=addition_9)
cluster_106 = Cluster_161(pisos=num_90, num=addition_10)
addition_12 = Addition(A=addition_9, B=addition_10, C=addition_11)
cluster_107 = Cluster_162(pisos=num_105, num=addition_11)
cluster_108 = Cluster_158(pisos=num_90, num=num_94)
cluster_109 = Cluster_157(pisos=num_90, num=num_95)
subtraction_25 = Subtraction(A=addition_8, B=addition_12, C=num_95)
cluster_110 = Cluster_169(pisos=num_90, num=formato_e_p_i_2.D)
cluster_111 = Cluster_165(pisos=num_105, num=subtraction_25)
division_11 = Division(A=num_94, B=2)
cluster_112 = Cluster_179(pisos=num_90, num=division_11)
gla_t = Number(cluster_112)
subtraction_26 = Subtraction(A=addition_8, B=addition_10, C=addition_9)
gba = Number(subtraction_26)
cluster_113 = Cluster_170(pisos=num_105, num=subtraction_26)
addition_13 = Addition(A=subtraction_26, B=num_94)
cluster_114 = Cluster_171(pisos=num_105, num=num_94)
cluster_115 = Cluster_172(pisos=num_105, num=addition_13)
cluster_116 = Cluster_175(pisos=num_105, num=division_11)
merge_48 = Merge(Data1=branch_13, Data2=branch_14)
clean_19 = CleanTree(RemoveNulls=True, RemoveInvalid=True, RemoveEmpty=True, Tree=merge_48)
ins_4 = InsertItems(List=branch_10, Item="Nivel", Indices=panel_34, Wrap=True)  # -> simplify(List)
ins_5 = InsertItems(List=branch_11, Item="Nivel", Indices=panel_34, Wrap=True)  # -> simplify(List)
num_106 = Number(subtraction_23)
cluster_117 = Cluster_122(brep=sunion_5)  # -> i_2, i, R, i_3, srf_2; disabled
clean_20 = CleanTree(RemoveNulls=True, RemoveInvalid=True, RemoveEmpty=True, Tree=ins_5)
branch_21 = TreeBranch(Tree=num_106, Path="-2", MaintainPaths=True)
clean_21 = CleanTree(RemoveNulls=True, RemoveInvalid=True, RemoveEmpty=True, Tree=ins_4)
multiplication_2 = Multiplication(A=branch_21, B=0.9)
cluster_118 = Cluster_138(T=clean_20)  # -> D_2, D, R
cluster_119 = Cluster_136(T=clean_21)  # -> D_2, D, R
item_15 = ListItem(List=cluster_117.i_2, Index=0, Wrap=True)  # disabled
offset_4 = OffsetCurve(Curve=cluster_117.i_2, Distance=expr("-x", division), Corners=1)  # disabled
merge_49 = Merge(Data1=merge_20, Data2=cluster_86)  # -> simplify(Result); disabled
ma_48 = MassAddition(Input=flatten(num_106))  # -> Result, PartialResults
merge_50 = Merge(Data1=cluster_119.D, Data2=cluster_119.D_2, Data3=clean_21)
merge_51 = Merge(Data1=cluster_118.D, Data2=cluster_118.D_2, Data3=clean_20)
brep_25 = Brep(sunion_5)  # disabled
listdexs_12 = ListIndices(List=multiplication_2)
crv_28 = Curve(offset_4)  # disabled
branch_22 = TreeBranch(Tree=num_106, Path="-1", MaintainPaths=True)
crv_29 = Curve(item_15)  # disabled
replace_23 = ReplaceItems(List=branch_21, Item=multiplication_2, Indices=listdexs_12, Wrap=False)  # -> simplify(List)
ins_6 = InsertItems(List=branch_17, Item="Programa", Indices=panel_38, Wrap=True)  # -> simplify(List)
cluster_120 = Cluster_137(T=merge_50)
ins_7 = InsertItems(List=estacionamientos_requeridos_4, Item=txt_6, Indices=0, Wrap=True)
ins_8 = InsertItems(List=ma_29.Result, Item=txt_7, Indices=0, Wrap=True)
ins_9 = InsertItems(List=ins_3, Item=ma_29.Result, Indices=-1, Wrap=True)
ins_10 = InsertItems(List=cluster_85.L, Item=txt_9, Indices=0, Wrap=True)
ins_11 = InsertItems(List=cluster_85.R, Item=txt_5, Indices=0, Wrap=True)
crv_30 = Curve(cluster_117.i_2)  # disabled
crv_31 = Curve(crv_29)  # disabled
merge_52 = Merge(Data1=replace_23, Data2=branch_22)  # -> simplify(Result)
ma_49 = MassAddition(Input=flatten(replace_23))  # -> Result, PartialResults
ins_12 = InsertItems(List=branch_13, Item=panel_39, Indices=panel_38, Wrap=True)  # -> simplify(List)
ins_13 = InsertItems(List=branch_14, Item=panel_39, Indices=[0, 0, -1], Wrap=True)  # -> simplify(List)
ins_14 = InsertItems(List=branch_12, Item="Programa", Indices=panel_38, Wrap=True)  # -> simplify(List)
ins_15 = InsertItems(List=ins_7, Item=ins_8, Indices=-1, Wrap=True)
branch_23 = TreeBranch(Tree=merge_49, Path=panel_40, MaintainPaths=True)  # disabled
branch_24 = TreeBranch(Tree=merge_49, Path=panel_41, MaintainPaths=True)  # disabled
branch_25 = TreeBranch(Tree=merge_49, Path=panel_43, MaintainPaths=True)  # disabled
branch_26 = TreeBranch(Tree=merge_49, Path=panel_42, MaintainPaths=True)  # disabled
crv_32 = Curve(cluster_117.i)  # disabled
ins_16 = InsertItems(List=replace_23, Item=ma_49.Result, Indices=-1, Wrap=True)
ins_17 = InsertItems(List=ins_16, Item=txt_8, Indices=0, Wrap=True)
panel_71 = Panel(ins_17)
cluster_121 = Cluster_137(T=ins_12, I="TOTAL")
cluster_122 = Cluster_137(T=ins_6)
cluster_123 = Cluster_137(T=ins_14)
cluster_124 = Cluster_137(T=ins_13, I="TOTAL")
panel_72 = Panel(cluster_124)
cluster_125 = Cluster_137(T=merge_51)
txt_17 = Text([cluster_120, cluster_125])
listdexs_13 = ListIndices(List=txt_17)
replace_24 = ReplaceItems(List=txt_17, Indices=listdexs_13, Wrap=False)  # -> simplify(List)
ma_50 = MassAddition(Input=merge_52)  # -> Result, PartialResults
area_34 = Area(Geometry=crv_30)  # -> Area, Centroid; disabled
clean_22 = CleanTree(RemoveNulls=True, RemoveInvalid=True, RemoveEmpty=True, Tree=branch_24)  # -> flatten(Tree); disabled
area_35 = Area(Geometry=crv_32)  # -> Area, Centroid; disabled
clean_23 = CleanTree(RemoveNulls=True, RemoveInvalid=True, RemoveEmpty=True, Tree=merge_49)  # -> flatten(Tree); disabled
pdecon_2 = Deconstruct(Point=area_34.Centroid)  # -> XComponent, YComponent, ZComponent; disabled
pdecon_3 = Deconstruct(Point=area_35.Centroid)  # -> XComponent, YComponent, ZComponent; disabled
ins_18 = InsertItems(List=addition_6, Item=ma_47.Result, Indices="-1", Wrap=True)  # -> simplify(List)
ins_19 = InsertItems(List=merge_42, Item=ma_43.Result, Indices="-1", Wrap=True)  # -> simplify(List)
ins_20 = InsertItems(List=branch_15, Item=ma_38.Result, Indices="-1", Wrap=True)  # -> simplify(List)
ins_21 = InsertItems(List=branch_16, Item=ma_39.Result, Indices="-1", Wrap=True)  # -> simplify(List)
ins_22 = InsertItems(List=subtraction_22, Item=ma_33.Result, Indices="-1", Wrap=True)  # -> simplify(List)
ins_23 = InsertItems(List=replace_6, Item=ma_31.Result, Indices="-1", Wrap=True)  # -> simplify(List)
ins_24 = InsertItems(List=merge_26, Item=ma_35.Result, Indices="-1", Wrap=True)  # -> simplify(List)
ins_25 = InsertItems(List=merge_52, Item=ma_50.Result, Indices="-1", Wrap=True)  # -> simplify(List)
subtraction_27 = Subtraction(A=pdecon_3.ZComponent, B=pdecon_2.ZComponent)  # disabled
crv_33 = Curve(crv_30)  # disabled
debrep_2 = DeconstructBrep(Brep=clean_23)  # -> Faces, Edges, Vertices; disabled
trim_9 = TrimWithRegion(Curve=flatten(sqgrid.Cells), Region=crv_33)  # -> Inside, Outside; disabled
srf_3 = Surface([cluster_117.i_3, merge_18])  # disabled
join_6 = JoinCurves(Curves=debrep_2.Edges, Preserve=False)  # disabled
debrep_3 = DeconstructBrep(Brep=srf_3)  # -> Faces, Edges, Vertices; disabled
ins_26 = InsertItems(List=ins_18, Item="Superficie Bruta(M2)", Indices=[0, 0], Wrap=True)  # -> simplify(List)
ins_27 = InsertItems(List=ins_19, Item="Superficie Bruta(M2)", Indices=[0, 0], Wrap=True)  # -> simplify(List)
ins_28 = InsertItems(List=ins_20, Item=panel_44, Indices=[0, 0], Wrap=True)  # -> simplify(List)
ins_29 = InsertItems(List=ins_21, Item=panel_44, Indices=[0, 0], Wrap=True)  # -> simplify(List)
ins_30 = InsertItems(List=ins_22, Item="Superficie Común (M2)", Indices=[0, 0], Wrap=True)  # -> simplify(List)
ins_31 = InsertItems(List=ins_23, Item="Superficie Vacios (M2)", Indices=[0, 0], Wrap=True)  # -> simplify(List)
ins_32 = InsertItems(List=ins_24, Item="Superficie Vacios (M2)", Indices=[0, 0], Wrap=True)  # -> simplify(List)
ins_33 = InsertItems(List=ins_25, Item="Superficie Util(M2)", Indices=0, Wrap=True)  # -> simplify(List)
ins_34 = InsertItems(List=ins, Item="Superficie Terraza(M2)", Indices=[0, 0], Wrap=True)  # -> simplify(List)
cluster_126 = Cluster_137(T=ins_34, I=ma_18.Result)
debrep_4 = DeconstructBrep(Brep=srf_3)  # -> Faces, Edges, Vertices; disabled
crv_34 = Curve(trim_9.Inside)  # disabled
join_7 = JoinCurves(Curves=debrep_3.Edges, Preserve=False)  # disabled
cluster_127 = Cluster_137(T=ins_26, I=ma_46.Result)
cluster_128 = Cluster_137(T=ins_27, I=ma_42.Result)
cluster_129 = Cluster_137(T=ins_28, I=ma_40.Result)
cluster_130 = Cluster_139(relay=cluster_129, T=ins_29)  # -> simplify(R)
cluster_131 = Cluster_137(T=ins_29, I=ma_41.Result)
cluster_132 = Cluster_137(T=ins_30, I=ma_37.Result)
cluster_133 = Cluster_137(T=ins_31, I=ma_34.Result)
cluster_134 = Cluster_137(T=ins_32, I=ma_36.Result)
cluster_135 = Cluster_137(T=ins_33, I=ma_48.Result)
Z_6 = UnitZ(Factor=subtraction_27)  # disabled
project_2 = Project(Curve=crv_21, Brep=flatten(branch_26), Direction=Vector(0, 0, 1))  # -> simplify(Curve); disabled
project_3 = Project(Curve=graft(sqgrid.Cells), Brep=branch_23, Direction=Vector(0, 0, 1))  # disabled
project_4 = Project(Curve=crv_22, Brep=branch_25, Direction=Vector(0, 0, 1))  # disabled
project_5 = Project(Curve=crv_34, Brep=clean_22, Direction=Vector(0, 0, 1))  # disabled
move_8 = Move(Geometry=path_mapper, Motion=Z_6)  # -> Geometry, Transform; disabled
slab = Slab(Synchronize=True, Polygon=srf_3)  # disabled
explode_4 = Explode(Curve=move_8.Geometry, Recursive=True)  # -> Segments, Vertices; disabled
divlength = DivideLength(Curve=crv_31, Length=3)  # -> Points, Tangents, Parameters; disabled
merge_53 = Merge(Data1=project_2, Data2=project_4, Data3=project_5)  # disabled
ln_3 = Line(StartPoint=explode_3.Vertices, EndPoint=explode_4.Vertices)  # disabled
trim_10 = TrimWithBreps(Curve=ln_3, Brep=brep_8)  # -> Inside, Outside; disabled
merge_54 = Merge(Data1=merge_53, Data2=join_6, Data3=project_3)  # disabled
cluster_136 = Cluster_134(crv=merge_53)  # -> L, L_2; disabled
offset_5 = OffsetCurve(Curve=join_7, Distance=division_2, Corners=1)  # -> simplify(Curve); disabled
offset_6 = OffsetCurve(Curve=crv_31, Distance=division_2, Corners=1)  # disabled
crv_35 = Curve(trim_10.Outside)  # disabled
# Pisos
crv_cp = CurveClosestPoint(Point=divlength.Points, Curve=offset_6)  # -> Point, Parameter, Distance; disabled
crv_cp_2 = CurveClosestPoint(Point=divlength.Points, Curve=crv_31)  # -> Point, Parameter, Distance; disabled
boundary_13 = BoundarySurfaces(Edges=offset_5)  # -> simplify(Surfaces); disabled
ln_4 = Line(StartPoint=cluster_136.L, EndPoint=cluster_136.L_2)  # disabled
pframe = PerpFrame(Curve=offset_6, Parameter=crv_cp.Parameter)  # disabled
path_mapper_9 = PathMapper(boundary_13, source="{A;B;C}(i)", target="{A;B}")  # disabled
end = EndPoints(Curve=ln_4)  # -> Start, End; disabled
beam = Beam(Synchronize=toggle, Curve=flatten(merge_54), BeamSettings=beamsetr)  # disabled
column = Column(Synchronize=toggle, AnchorPoint=end.Start, EndPoint=end.End, ColumnSettings=columnsetr)  # disabled
# Estacionamientos requeridos vs proyectados....
path_mapper_10 = PathMapper(boundary_13, source="{A;B;C}(i)", target="{A}")  # disabled

alturas = Panel(cluster_80)
const_municipal = Panel(ma_16.Result)
sup_subtotal_3 = Panel(cluster_83.L_3)
sup_subtotal_4 = Panel(cluster_83.L_2)
sup_subtotal_5 = Panel(cluster_83.L_4)
sup_subtotal_6 = Panel(cluster_83.L)
niveles = Panel(cluster_85.num_2)
est_requeridos = Panel(filter_20)
est_proyectados = Panel(cluster_85.R_2)
cluster_137 = Cluster_123(A=const_municipal, B=constructibilidad)

subtraction_28 = Subtraction(A=constructibilidad, B=const_municipal)
addition_14 = Addition(A=list_15, B=niveles)
niveles_subterraneo = Panel(addition_14)
uso_cc = Panel(cluster_137)

const_holgura = Panel(subtraction_28)

cluster_138 = Cluster_94(brep=brep_10, I=num_65, crv=crv_25, F=item_13)  # -> i_2, Z_3, G, C, i

merge_55 = Merge(Data3=fmerge.Breps, Data4=cluster_79.D)
sunion_6 = SolidUnion(Breps=flatten(merge_55))
fmerge_2 = MergeFaces(Brep=sunion_6)  # -> Breps, Before, After
brep_26 = Brep(sdiff_3)
filter_26 = StreamFilter(Gate=list_20, Stream1=brep_26)
merge_56 = Merge(Data1=filter_26, Data3=fmerge.Breps, Data4=cluster_79.D, Data6=filter_26)
brep_27 = Brep(merge_56)
sunion_7 = SolidUnion(Breps=flatten(brep_27))
join_8 = BrepJoin(Breps=flatten(sunion_7))  # -> Breps, Closed
fmerge_3 = MergeFaces(Brep=join_8.Breps)  # -> Breps, Before, After
# V1
# Correccion Distanciamiento
# V2 - Sup. Bruta
# Correccion Sacados(Terrazas, Vanos, Shafts)
# V3 - Volumenes Totales
# Estacionamientos Calculo
# Superficies.
# Logica Supabase
# 
# 1. Backup
# 2. Limpieza de Listado
# 3. Push de data nueva
cluster_139 = Cluster_112(G=0, B=brep_2, run=tabla_superficie_sombras, G_2=proyectar_sombras_teóricas, B_2=fmerge_3.Breps, E=boundary_3)  # -> s_0, R_4, R_5, R_6, excel_vt, s_0_2, D, D_2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

sombra_poniente_2 = Panel(cluster_139.D_2)
sombra_oriente_2 = Panel(cluster_139.D)
sombra_sur_2 = Panel(cluster_139.D_3)

filter_27 = StreamFilter(Gate=equals.Equality, Stream0=cluster_139.s_0_2, Stream1=cluster_35.s_0)

preview_4 = CustomPreview(Geometry=filter_27, Material=cluster_16.M)

cluster_140 = Cluster_94(brep=fmerge_2.Breps, I=num_65, crv=cluster_138.i_2, F=item_13)  # -> i_2, Z_3, G, C, i
ln_5 = Line(StartPoint=cluster_138.C, EndPoint=cluster_140.G)
extr_3 = Extrude(Base=cluster_138.i, Direction=ln_5)

cluster_141 = Cluster_63(brep=clean_5, num_2=merge_21, num=num_67, num_3=branch_5)  # -> planta_res_2, planta_ofi_2, planta_ret_2, D, E, E_4, E_3, E_2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
number_slider_16 = Slider(100, range=0..100)
retail_9 = Colour(RGBA(0, 0, 231, 152))
retail_10 = Colour(RGB(0, 0, 128))
brep_28 = Brep(brep_18)
brep_29 = Brep(brep_19)
brep_30 = Brep(brep_20)
retail_11 = Colour(RGB(255, 162, 0))
retail_12 = Colour(RGB(70, 124, 255))
retail_13 = Colour(RGB(230, 113, 0))
material_4 = CreateMaterial(Diffuse=retail_11, Specular=retail_11, Emission=retail_11, Transparency=0.7, Shine=number_slider_16)
material_5 = CreateMaterial(Diffuse=retail_12, Specular=retail_12, Emission=retail_12, Transparency=0.7, Shine=number_slider_16)
material_6 = CreateMaterial(Diffuse=retail_9, Specular=retail_10, Emission=retail_10, Transparency=Slider(0.97, range=0..1), Shine=100)
material_7 = CreateMaterial(Diffuse=retail_13, Specular=retail_13, Emission=retail_13, Transparency=0.7, Shine=number_slider_16)
preview_5 = CustomPreview(Geometry=[extr_3, brep_23], Material=material_6)
preview_6 = CustomPreview(Geometry=brep_28, Material=material_4)
preview_7 = CustomPreview(Geometry=brep_29, Material=material_5)
preview_8 = CustomPreview(Geometry=brep_30, Material=material_7)

brep_31 = Brep([brep_27, extr_3])

num_107 = Number(simplify(cluster_141.I))
branch_27 = TreeBranch(Tree=num_107, Path=panel_20, MaintainPaths=True)
num_108 = Number(simplify(cluster_141.I))
branch_28 = TreeBranch(Tree=simplify(num_108), Path=panel_19, MaintainPaths=True)
item_16 = ListItem(List=num_86, Index=simplify(branch_27), Wrap=True)
multiplication_3 = Multiplication(A=item_16, B=Slider(0.3, range=0..1))
replace_25 = ReplaceItems(List=replace_21, Item=multiplication_3, Indices=branch_28, Wrap=False)  # -> simplify(List)
addition_15 = Addition(A=branch_19, B=replace_25)
merge_57 = Merge(Data2=branch_18, Data3=addition_15)
merge_58 = Merge(Data1=merge_57, Data2=subtraction_22)
ma_51 = MassAddition(Input=flatten(merge_57))  # -> Result, PartialResults
subtraction_29 = Subtraction(A=num_86, B=subtraction_21, C=replace_25)
formato_e_p_i_10 = FormatoEPI(relay=merge_58, pisos=num_88)  # -> R, i
clean_24 = CleanTree(RemoveNulls=True, RemoveInvalid=True, RemoveEmpty=True, Tree=subtraction_29)
nb_uyg = NBUyG(L=formato_e_p_i_10.R, index_est=formato_e_p_i_10.i)  # -> R, area_comercial
addition_16 = Addition(A=clean_24, B=num_69)
merge_59 = Merge(Data1=subtraction_24, Data2=addition_16)
num_109 = Number(nb_uyg.area_comercial)
num_110 = Number(nb_uyg.R)
ma_52 = MassAddition(Input=flatten(merge_59))  # -> Result, PartialResults
ma_53 = MassAddition(Input=merge_59)  # -> Result, PartialResults
cluster_142 = Cluster_155(pisos=num_90, num=num_109)
cluster_143 = Cluster_156(pisos=num_90, num=num_110)
addition_17 = Addition(A=num_110, B=num_109)
subtraction_30 = Subtraction(A=subtraction_25, B=addition_17)
cluster_144 = Cluster_166(pisos=num_105, num=addition_17)
cluster_145 = Cluster_167(pisos=num_105, num=subtraction_30)
addition_18 = Addition(A=addition_9, B=addition_10, C=addition_11, D=num_110, E=num_109)
subtraction_31 = Subtraction(A=addition_8, B=addition_18)
cluster_146 = Cluster_179(pisos=num_90, num=subtraction_31)
gla = Number(cluster_146)
addition_19 = Addition(A=subtraction_31, B=division_11)
cluster_147 = Cluster_173(pisos=num_105, num=subtraction_31)
cluster_148 = Cluster_172(pisos=num_105, num=addition_19)
entwine_6 = Entwine(
    Branch01=cluster_110,
    Branch02=cluster_100,
    Branch03=cluster_95,
    Branch04=cluster_104,
    Branch05=cluster_101,
    Branch06=cluster_96,
    Branch07=cluster_105,
    Branch08=cluster_102,
    Branch09=cluster_97,
    Branch010=cluster_98,
    Branch011=cluster_106,
    Branch012=cluster_103,
    Branch013=cluster_99,
    Branch014=cluster_107,
    Branch015=cluster_143,
    Branch016=cluster_142,
    Branch017=cluster_108,
    Branch018=cluster_109,
    Branch020=cluster_111,
    Branch021=cluster_144,
    Branch022=cluster_145,
    Branch024=cluster_113,
    Branch025=cluster_114,
    Branch026=cluster_115,
    Branch028=cluster_147,
    Branch029=cluster_116,
    Branch030=cluster_148,
    FlattenInputs=True)  # -> simplify(Result)
merge_60 = Merge(Data1=multiplication_2, Data2=branch_20, Data3=subtraction_24, Data4=addition_16)
tstat_6 = TreeStatistics(Tree=entwine_6)  # -> Paths, Length, Count
listdexs_14 = ListIndices(List=simplify(tstat_6.Paths))
item_17 = ListItem(List=listdexs_14, Index=0, Wrap=True)  # -> Item1, Item
series_2 = Series(Start=item_17.Item1, Step=1, Count=lng_6)
item_18 = ListItem(List=series_2, Index=0, Wrap=True)  # -> Item1, Item
addition_20 = Addition(A=item_18.Item1, B=1)
replace_26 = ReplacePaths(Data=cset_3.Set, Search=tstat_4.Paths, Replace=series_2)
replace_27 = ReplaceItems(List=replace_26, Item=replace_22, Indices=0, Wrap=False)  # -> simplify(List)
branch_29 = TreeBranch(Tree=replace_27, Path=tstat_5.Paths, MaintainPaths=True)
gba_2 = GBA(pisos=num_90, format=branch_29, prog_total=formato_e_p_i.L, programas=replace_26, gross_area=gba)  # -> D_2, D_3, D_4, D_5, D
gba_3 = GBA_2(pisos=num_90, format=branch_29, prog_total=formato_e_p_i.L, programas=gba_2.D, gross_area=gba_t)  # -> D_2, D_3, D_4, D_5, D
cluster_149 = Cluster_182(d1=replace_26, d2=gba_2.D, total=cluster_115)  # -> D, num_3, D_2
series_3 = Series(Start=cluster_149.num_3, Step=1, Count=lng_6)
replace_28 = ReplacePaths(Data=cset_3.Set, Search=tstat_4.Paths, Replace=series_3)
gla_2 = GBA(pisos=num_90, format=branch_29, prog_total=formato_e_p_i.L, programas=replace_28, gross_area=gla)  # -> D_2, D_3, D_4, D_5, D
gla_3 = GBA_2(pisos=num_90, format=branch_29, prog_total=formato_e_p_i.L, programas=gla_2.D, gross_area=gla_t)  # -> D_2, D_3, D_4, D_5, D
cluster_150 = Cluster_182(d1=replace_28, d2=gla_2.D, total=cluster_148)  # -> D, num_3, D_2
merge_61 = Merge(
    Data1=gba_2.D_2,
    Data2=gba_2.D_3,
    Data3=gba_2.D_4,
    Data4=gba_2.D_5,
    Data6=gba_3.D_2,
    Data7=gba_3.D_3,
    Data8=gba_3.D_4,
    Data9=gba_3.D_5,
    Data10=cluster_149.D,
    Data11=cluster_149.D_2,
    Data15=gla_2.D_2,
    Data16=gla_2.D_3,
    Data17=gla_2.D_4,
    Data18=gla_2.D_5,
    Data21=gla_3.D_2,
    Data22=gla_3.D_3,
    Data23=gla_3.D_4,
    Data24=gla_3.D_5,
    Data25=cluster_150.D)
panel_73 = Panel(gla_3.D_2)
merge_62 = Merge(Data1=entwine_6, Data2=merge_61)
writexl = WriteToExcel(Run=Button(), ExcelWorksheet="1", WriteOptions="None", ColumnnsOrRows=False, DataToWriteIntoColumns=merge_62)
cluster_151 = Cluster_174(num_2=merge_60, num=clean_19, num_3=cluster_90.R)  # -> I, num_16, I_2, num_17, I_3, num_18, I_4, num_19
clean_25 = CleanTree(RemoveNulls=True, RemoveInvalid=True, RemoveEmpty=True, Tree=cluster_151.num_19)
merge_63 = Merge(Data1=cluster_151.num_16, Data2=cluster_151.num_17, Data3=cluster_151.num_18, Data4=clean_25)
null_2 = NullItem(Item=merge_63)  # -> NullFlags, InvalidFlags, Description
mindex_2 = MemberIndex(Set=null_2.NullFlags, Member=bool_4)  # -> Index, Count
replace_29 = ReplaceItems(List=merge_63, Item=0, Indices=mindex_2.Index, Wrap=False)
ins_35 = InsertItems(List=replace_29, Item=txt_4, Indices=[0, 1, 2, 3], Wrap=True)
merge_64 = Merge(Data1=cluster_151.num_16, Data2=cluster_151.num_17, Data3=cluster_151.num_18, Data4=ma_49.Result)
clean_26 = CleanTree(RemoveNulls=True, RemoveInvalid=True, RemoveEmpty=False, Tree=merge_64)
ma_54 = MassAddition(Input=flatten(clean_26))  # -> Result, PartialResults
merge_65 = Merge(Data1=ma_54.Result, Data2=constructibilidad, Data3=ma_16.Result, Data4=cluster_137)
ins_36 = InsertItems(List=merge_65, Item=txt_3, Indices=[0, 1, 2, 3], Wrap=True)
ins_37 = InsertItems(List=ins_36, Item=ins_35, Indices=-1, Wrap=True)
superficies_generales_m2 = Panel(ins_37)
ins_38 = InsertItems(List=ins_37, Item=concat, Indices=0, Wrap=True)
ma_55 = MassAddition(Input=merge_57)  # -> Result, PartialResults
ins_39 = InsertItems(List=merge_57, Item=ma_55.Result, Indices="-1", Wrap=True)  # -> simplify(List)
ins_40 = InsertItems(List=merge_59, Item=ma_53.Result, Indices="-1", Wrap=True)  # -> simplify(List)
ins_41 = InsertItems(List=ins_39, Item="Superficie Común (M2)", Indices=[0, 0], Wrap=True)  # -> simplify(List)
ins_42 = InsertItems(List=ins_40, Item="Superficie Util(M2)", Indices=[0, 0], Wrap=True)  # -> simplify(List)
cluster_152 = Cluster_137(T=ins_41, I=ma_51.Result)
cluster_153 = Cluster_137(T=ins_42, I=ma_52.Result)

tstat_7 = TreeStatistics(Tree=clean_5)  # -> flatten(Paths), Length, Count
txt_18 = Text(tstat_7.Paths)
txt_19 = Text(flatten(["{-2}", "{-1}", "{0}", "{1}", "{2}", "{3}", "{4}"]))
txt_20 = Text(["Estacionamientos", "Subterraneo", "Podio", "Torre 1", "Torre 2 ", "Torre 3", "Torre 4"])
mindex_3 = MemberIndex(Set=txt_19, Member=txt_18)  # -> Index, Count
item_19 = ListItem(List=txt_19, Index=mindex_3.Index, Wrap=True)
item_20 = ListItem(List=txt_20, Index=mindex_3.Index, Wrap=True)
item_21 = ListItem(List=txt_20, Index=0, Wrap=True)
item_22 = ListItem(List=txt_19, Index=0, Wrap=True)
tstat_8 = TreeStatistics(Tree=item_19)  # -> Paths, Length, Count
tstat_9 = TreeStatistics(Tree=item_21)  # -> Paths, Length, Count
replace_30 = ReplacePaths(Data=item_21, Search=tstat_9.Paths, Replace=item_22)
replace_31 = ReplacePaths(Data=item_20, Search=tstat_8.Paths, Replace=tstat_7.Paths)

filter_28 = StreamFilter(Gate=beneficio_eliminacion_estacionamientos, Stream0=replace_30)

merge_66 = Merge(Data1=replace_31, Data2=filter_28)
panel_74 = Panel(merge_66)

txt_21 = Text(panel_74)
replace_32 = ReplaceItems(List=replace_24, Item=txt_21, Indices=1, Wrap=False)
entwine_7 = Entwine(
    Branch00=ins_38,
    Branch03=replace_32,
    Branch04=[cluster_120, cluster_125],
    Branch05=[cluster_122, cluster_123],
    Branch06=[cluster_121, cluster_124],
    Branch07=[cluster_127, cluster_128],
    Branch08=[cluster_132, cluster_152],
    Branch09=[cluster_129, cluster_131],
    Branch010=[cluster_133, cluster_134],
    Branch011=[cluster_135, cluster_153],
    Branch012=[cluster_126, cluster_130],
    Branch014=ins_9,
    Branch015=ins_17,
    Branch016=ins_15,
    Branch017=ins_10,
    Branch018=ins_11,
    FlattenInputs=True)
writexl_2 = WriteToExcel(
    Run=tabla_general_superficies,
    ExcelWorksheet="1",
    WriteOptions="None",
    ColumnnsOrRows=False,
    DataToWriteIntoColumns=entwine_7)

# ==== cluster Cluster
G = ClusterInput()
E = ClusterInput()
boundary = BoundarySurfaces(Edges=E)
B = ClusterInput()
_0 = ClusterInput()
area = Area(Geometry=boundary)  # -> Area, Centroid
area_2 = Area(Geometry=boundary)  # -> Area, Centroid
filter = StreamFilter(Gate=G, Stream0=_0, Stream1=1)
multiplication = Multiplication(A=area_2.Area, B=B)
multiplication_2 = Multiplication(A=area.Area, B=filter)
R = ClusterOutput(multiplication)
R_2 = ClusterOutput(multiplication_2)
panel = Panel(multiplication)
panel_2 = Panel(multiplication_2)

# ==== cluster Cluster_3
crv = ClusterInput()
num = ClusterInput()
num_2 = ClusterInput()
num_3 = ClusterInput()
num_4 = Number(num)
crv_2 = Curve(crv)
num_5 = Number(num_3)
num_6 = Number(num_2)
item = ListItem(List=num_4, Index=0, Wrap=True)
item_2 = ListItem(List=num_4, Index=1, Wrap=True)
item_3 = ListItem(List=num_4, Index=2, Wrap=True)
num_7 = ClusterInput()
lng = ListLength(List=num_5)
crv_3 = Curve(crv_2)
item_4 = ListItem(List=num_6, Index=item, Wrap=True)
item_5 = ListItem(List=num_6, Index=item_2, Wrap=True)
num_8 = Number(num_7)
pisos_2 = ClusterInput()
num_9 = Number(item_3)
division = Division(A=num_8, AlturaPrograma1=item_4)
tstat = TreeStatistics(Tree=num_9)  # -> Paths, Length, Count
pisos_2_2 = Text(pisos_2)
clean = CleanTree(RemoveNulls=True, RemoveInvalid=True, RemoveEmpty=True, Tree="21")
pisos_max = Round(Number=division)  # -> Nearest, Floor, Ceiling
lng_2 = ListLength(List=pisos_2_2)
num_10 = Number(pisos_max.Nearest)
tmatch = MatchText(Text=pisos_2_2, Pattern="*-*", Case=True)
tmatch_2 = MatchText(Text=pisos_2_2, Pattern="*,*", Case=True)
equals = Equality(FirstNumber=pisos_2_2, SecondNumber=0)  # -> Equality, Inequality
equals_2 = Equality(FirstNumber=lng_2, SecondNumber=1)  # -> Equality, Inequality
or = GateOr(A=tmatch, B=tmatch_2)
bool = Boolean(True)
bool_2 = Boolean(True)
cset = CreateSet(List=equals.Equality)  # -> Set, Map
mindex = MemberIndex(Set=tmatch, Member=bool_2)  # -> Index, Count
mindex_2 = MemberIndex(Set=tmatch_2, Member=bool)  # -> Index, Count
not = GateNot(A=or)
and = GateAnd(A=cset.Set, B=equals_2.Equality)
filter = StreamFilter(Gate=and, Stream0=not)
pisos_2_3 = Text(pisos_2_2)
bool_3 = Boolean(True)
addition = Addition(A=num_10, B=lng)
mindex_3 = MemberIndex(Set=filter, Member=bool_3)  # -> Index, Count
item_6 = ListItem(List=pisos_2_3, Index=mindex.Index, Wrap=True)
item_7 = ListItem(List=pisos_2_3, Index=mindex_2.Index, Wrap=True)
rep = ReplaceText(Text=item_6, Find="-", Replace=" to ", RecursiveReplace=False)
split = TextSplit(Text=item_7, Separators=",")
item_8 = ListItem(List=pisos_2_3, Index=mindex_3.Index, Wrap=True)
dedomain = DeconstructDomain(Domain=rep)  # -> Start, End
rep_2 = ReplaceText(Text=split, Find=" ", RecursiveReplace=False)  # -> flatten(Result)
smaller = SmallerThan(FirstNumber=addition, SecondNumber=item_8)  # -> SmallerThan, OrEqualTo
subtraction = Subtraction(A=dedomain.End, B=dedomain.Start)
smaller_2 = SmallerThan(FirstNumber=rep_2, SecondNumber=addition)  # -> SmallerThan, OrEqualTo
filter_2 = StreamFilter(Gate=smaller.OrEqualTo, Stream0=item_8, Stream1=addition)
series = Series(Start=dedomain.Start, Step=1, Count=expr("x+1", subtraction))  # -> flatten(Series)
cull = CullPattern(List=rep_2, CullPattern=smaller_2.OrEqualTo)
smaller_3 = SmallerThan(FirstNumber=series, SecondNumber=num_10)  # -> SmallerThan, OrEqualTo
cull_2 = CullPattern(List=series, CullPattern=smaller_3.OrEqualTo)
merge = Merge(Data1=cull_2, Data2=cull, Data3=filter_2)  # -> flatten(Result)
subtraction_2 = Subtraction(A=merge, B=lng)
sort = SortList(Keys=subtraction_2, ValuesA=subtraction_2)  # -> Keys, ValuesA
series_2 = Series(Start=1, Step=1, Count=num_10)  # -> simplify(Series)
dcon = DeleteConsecutive(Set=sort.ValuesA, Wrap=False)  # -> Set, Count
listdexs = ListIndices(List=series_2)
num_11 = Number(expr("x-1", dcon.Set))
replace = ReplaceItems(List=series_2, Item=item_4, Indices=listdexs, Wrap=False)  # -> simplify(List)
negative_0 = Negative0(_0=num_11, A=num_11)  # -> flatten(L)
filter_3 = StreamFilter(Gate=and, Stream0=negative_0)
replace_2 = ReplaceItems(List=replace, Item=item_5, Indices=filter_3, Wrap=False)  # -> simplify(List)
Z = UnitZ(Factor=replace_2)
ma = MassAddition(Input=replace_2)  # -> Result, PartialResults
larger = LargerThan(FirstNumber=num_8, SecondNumber=ma.Result)  # -> LargerThan, OrEqualTo
subtraction_3 = Subtraction(A=ma.Result, B=num_8)
division_2 = Division(A=subtraction_3, B=item_4)
round = Round(Number=division_2)  # -> Nearest, Floor, Ceiling
multiplication = Multiplication(A=round.Ceiling, B=item_4)
subtraction_4 = Subtraction(A=ma.Result, B=multiplication)
series_3 = Series(Start=1, Step=1, Count=round.Ceiling)  # -> expr("x*-1", Series)
ins = InsertItems(List=ma.PartialResults, Item=0, Indices=0, Wrap=True)
cull_i = CullIndex(List=ins, Indices=-1, Wrap=True)
cull_i_2 = CullIndex(List=cull_i, Indices=series_3, Wrap=True)
cull_i_3 = CullIndex(List=replace_2, Indices=series_3, Wrap=True)
filter_4 = StreamFilter(Gate=larger.LargerThan, Stream0=cull_i_2, Stream1=cull_i)
filter_5 = StreamFilter(Gate=larger.LargerThan, Stream0=cull_i_3, Stream1=replace_2)
simplify = SimplifyTree(Tree=crv_3, Front=False)
ma_2 = MassAddition(Input=filter_5)  # -> Result, PartialResults
Z_2 = UnitZ(Factor=filter_5)
area = Area(Geometry=simplify)  # -> Area, Centroid
filter_6 = StreamFilter(Gate=larger.LargerThan, Stream0=ma_2.Result, Stream1=ma.Result)
line = LineSDL(Start=area.Centroid, Direction=Vector(0, 0, 1), Length=filter_6)
division_3 = Division(A=filter_4, B=filter_6)
eval = EvaluateCurve(Curve=line, Parameter=division_3)  # -> Point, Tangent, Angle
orient = Orient(Geometry=simplify, Source=area.Centroid, Target=eval.Point)  # -> Geometry, Transform
extr = Extrude(Base=orient.Geometry, Direction=Z_2)
item_9 = ListItem(List=orient.Geometry, Index=0, Wrap=True)
item_10 = ListItem(List=extr, Index=0, Wrap=True)
extr_2 = Extrude(Base=item_9, Direction=line)
cap = CapHoles(Brep=extr_2)
cap_2 = CapHoles(Brep=extr)
item_11 = ListItem(List=cap_2, Index=-1, Wrap=True)
boundary = BoundarySurfaces(Edges=orient.Geometry)
debrep = DeconstructBrep(Brep=item_11)  # -> Faces, Edges, Vertices
re_map = REMAP(R=tstat.Paths, D=cap)
re_map_2 = REMAP(R=tstat.Paths, D=cap_2)
re_map_3 = REMAP(R=tstat.Paths, D=boundary)
cluster = Cluster_2(B=re_map)  # -> simplify(Z)
area_2 = Area(Geometry=debrep.Faces)  # -> Area, Centroid
Z_3 = UnitZ(Factor=1)
area_3 = Area(Geometry=re_map_3)  # -> Area, Centroid
pdecon = Deconstruct(Point=area_2.Centroid)  # -> XComponent, YComponent, ZComponent
line_2 = LineSDL(Start=area_3.Centroid, Direction=Z_3, Length=filter_5)
ma_3 = MassAddition(Input=area_3.Area)  # -> Result, PartialResults
sort_2 = SortList(Keys=area_2.Centroid, ValuesA=pdecon.ZComponent)  # -> Keys, ValuesA
len = Length(Curve=line_2)
tstat_2 = TreeStatistics(Tree=len)  # -> Paths, Length, Count
tstat_3 = TreeStatistics(Tree=area_3.Centroid)  # -> Paths, Length, Count
sup_total = Number(ma_3.Result)
sup_piso = Number(ma_3.Result)
volumen = Brep(re_map)
alt_max = Number(cluster)
surface = Surface(re_map_3)
replace_3 = ReplacePaths(Data=len, Search=tstat_2.Paths, Replace=tstat_3.Paths)
alturas = Number(replace_3)
panel = Panel(alt_max)
G = ClusterOutput(orient.Geometry)
alt_max_2 = ClusterOutput(alt_max)
surface_2 = ClusterOutput(surface)
volumen_2 = ClusterOutput(volumen)
sup_total_2 = ClusterOutput(sup_total)
alturas_2 = ClusterOutput(alturas)

# ==== cluster Cluster_10
h_podio = ClusterInput()
Z = UnitZ(HPodio=h_podio)
C = ClusterInput()
_0 = ClusterInput()
A = ClusterInput()
G = ClusterInput()
move = Move(Geometry=_0, Motion=Z)  # -> Geometry, Transform
equals = Equality(FirstNumber=A, SecondNumber=1)  # -> Equality, Inequality
relay = ClusterInput()
move_2 = Move(Geometry=G, Motion=Z)  # -> Geometry, Transform
filter = StreamFilter(Gate=equals.Equality, Stream0=_0, Stream1=move.Geometry)
filter_2 = StreamFilter(Gate=equals.Equality, Stream0=G, Stream1=move_2.Geometry)
join = JoinCurves(Curves=[C, _0], Preserve=False)
x = ClusterInput()
explode = Explode(Curve=filter, Recursive=True)  # -> Segments, Vertices
num = ClusterInput()
crv = Curve(join)
sin = Sine(Value=degrees(x))
tan = Tangent(Value=degrees(x))
pline = PolyLine(Vertices=explode.Vertices, Closed=False)
num_2 = Number(num)
crv_2 = Curve(filter_2)
division = Division(A=num_2, B=tan)
crv_3 = Curve(pline)
lng = ListLength(List=flatten(crv_3))
cluster = Cluster_4(crv=crv_3)
join_2 = JoinCurves(Curves=crv_3, Preserve=False)
neg = Negative(Value=division)
Z_2 = UnitZ(Factor=num_2)
null = NullItem(Item=lng)  # -> NullFlags, InvalidFlags, Description
neg_2 = Negative(Value=division)
cluster_2 = Cluster_6(relay=graft(join_2), A=x, T=Z_2, E=join, A_2=Z_2)  # -> B, B_2, rasante
cluster_3 = Cluster_9(crv=graft(crv_2), D=neg_2, T=Z_2, T_2=Z_2)  # -> R, R_2
join_3 = BrepJoin(Breps=flatten(cluster_3.R_2))  # -> Breps, Closed
join_4 = BrepJoin(Breps=flatten(cluster_3.R))  # -> Breps, Closed
brep = Brep(cluster_2.rasante)
brep_2 = Brep(flatten(cluster_2.B))
cap = CapHoles(Brep=join_4.Breps)  # -> flatten(Brep)
cap_2 = CapHoles(Brep=join_3.Breps)  # -> flatten(Brep)
rasante = ClusterOutput(cluster_2.rasante)
join_5 = BrepJoin(Breps=[cap, cap_2])  # -> Breps, Closed
join_6 = BrepJoin()  # -> Breps, Closed
merge = Merge(Data1=brep_2, Data2=join_5.Breps)
cap_3 = CapHoles(Brep=join_5.Breps)
srf = Surface()
sdiff = SolidDifference(BrepsA=relay, BrepsB=merge)
filter_3 = StreamFilter(Gate=null.NullFlags, Stream1=sdiff)
brep_3 = Brep(sdiff)
s_0 = ClusterOutput(filter_3)
R = ClusterOutput(sdiff)

# ==== cluster Cluster_13
B = ClusterInput()
E = ClusterInput()
debrep = DeconstructBrep(Brep=B)  # -> Faces, Edges, Vertices
boundary = BoundarySurfaces(Edges=E)
num = Number("0.49")
num_2 = Number("1.54")
pdecon = Deconstruct(Point=debrep.Vertices)  # -> XComponent, YComponent, ZComponent
pt = Point(debrep.Vertices)
sort = SortList(Keys=pdecon.ZComponent, ValuesA=pdecon.ZComponent)  # -> Keys, ValuesA
item = ListItem(List=sort.ValuesA, Index=-1, Wrap=True)
sort_2 = SortList(Keys=pdecon.ZComponent, ValuesA=debrep.Vertices)  # -> Keys, ValuesA
sort_3 = SortList(Keys=sort.ValuesA, ValuesA=pt)  # -> Keys, ValuesA
item_2 = ListItem(List=sort_3.ValuesA, Index=-1, Wrap=True)
pdecon_2 = Deconstruct(Point=item_2)  # -> XComponent, YComponent, ZComponent
altura_maxima_volumen = Panel(pdecon_2.ZComponent)
neg = Negative(Value=num)
division = Division(A=pdecon.ZComponent, B=neg)
division_2 = Division(A=pdecon.ZComponent, B=num_2)
division_3 = Division(A=pdecon.ZComponent, B=num)
neg_2 = Negative(Value=division_2)
X = UnitX(Factor=division_3)
X_2 = UnitX(Factor=division)
Y = UnitY(Factor=neg_2)
move = Move(Geometry=debrep.Vertices, Motion=X)  # -> Geometry, Transform
move_2 = Move(Geometry=debrep.Vertices, Motion=X_2)  # -> Geometry, Transform
move_3 = Move(Geometry=debrep.Vertices, Motion=Y)  # -> Geometry, Transform
project = Project(Geometry=move.Geometry, Plane=PlaneXY(0, 0, 0))  # -> Geometry, Transform
project_2 = Project(Geometry=move_2.Geometry, Plane=PlaneXY(0, 0, 0))  # -> Geometry, Transform
project_3 = Project(Geometry=move_3.Geometry, Plane=PlaneXY(0, 0, 0))  # -> Geometry, Transform
del = DelaunayMesh(Points=project.Geometry, Plane=PlaneXY(0, 0, 0))
del_2 = DelaunayMesh(Points=project_2.Geometry, Plane=PlaneXY(0, 0, 0))
del_3 = DelaunayMesh(Points=project_3.Geometry, Plane=PlaneXY(0, 0, 0))
medges = MeshEdges(Mesh=del)  # -> NakedEdges, InteriorEdges, NonManifoldEdges
medges_2 = MeshEdges(Mesh=del_2)  # -> NakedEdges, InteriorEdges, NonManifoldEdges
medges_3 = MeshEdges(Mesh=del_3)  # -> NakedEdges, InteriorEdges, NonManifoldEdges
boundary_2 = BoundarySurfaces(Edges=medges.NakedEdges)
boundary_3 = BoundarySurfaces(Edges=medges_2.NakedEdges)
boundary_4 = BoundarySurfaces(Edges=medges_3.NakedEdges)
explode = Explode(Curve=boundary_2, Recursive=True)  # -> Segments, Vertices
explode_2 = Explode(Curve=boundary_3, Recursive=True)  # -> Segments, Vertices
explode_3 = Explode(Curve=boundary_4, Recursive=True)  # -> Segments, Vertices
button = Button()
rdiff = RegionDifference(CurvesA=boundary_2, CurvesB=boundary)
rdiff_2 = RegionDifference(CurvesA=boundary_3, CurvesB=boundary)
rdiff_3 = RegionDifference(CurvesA=boundary_4, CurvesB=boundary)
G = ClusterInput()
boundary_5 = BoundarySurfaces(Edges=rdiff)
boundary_6 = BoundarySurfaces(Edges=rdiff_2)
boundary_7 = BoundarySurfaces(Edges=rdiff_3)
run = ClusterInput()
filter = StreamFilter(Gate=G, Stream1=[boundary_5, boundary_6, boundary_7, explode.Segments, explode_2.Segments, explode_3.Segments])
area = Area(Geometry=boundary_6)  # -> Area, Centroid
area_2 = Area(Geometry=boundary_5)  # -> Area, Centroid
area_3 = Area(Geometry=boundary_7)  # -> Area, Centroid
s_0 = ClusterOutput(filter)
ma = MassAddition(Input=flatten(area_2.Area))  # -> Result, PartialResults
ma_2 = MassAddition(Input=flatten(area.Area))  # -> Result, PartialResults
ma_3 = MassAddition(Input=flatten(area_3.Area))  # -> Result, PartialResults

# ----
# Superficies Sombra Teorica (m2)
# 
# 
# 
# Sombra Poniente
# 
# 
# 
# Sombra Sur
# 
# 
# 
# Sombra Oriente
cset = CreateSet(List=sort.ValuesA)  # -> Set, Map
cull_i = CullIndex(List=cset.Set, Indices=0, Wrap=True)
roundd = RoundToDecimalPlace(NumberX=cull_i, DecimalPlace="2", RoundType=0)  # -> flatten(Rounded), Difference
dcon = DeleteConsecutive(Set=roundd.Rounded, Wrap=False)  # -> Set, Count
lng = ListLength(List=dcon.Set)
panel = Panel(lng)
division_4 = Division(A=dcon.Set, B=0.49)
division_5 = Division(A=dcon.Set, B=1.54)
division_6 = Division(A=dcon.Set, B=0.49)
roundd_2 = RoundToDecimalPlace(NumberX=division_4, DecimalPlace="2", RoundType=0)  # -> flatten(Rounded), Difference
roundd_3 = RoundToDecimalPlace(NumberX=division_5, DecimalPlace="2", RoundType=0)  # -> flatten(Rounded), Difference
roundd_4 = RoundToDecimalPlace(NumberX=division_6, DecimalPlace="2", RoundType=0)  # -> flatten(Rounded), Difference
cluster = Cluster_12(L=ma_2.Result, L_2=ma_3.Result, L_3=ma.Result)  # -> L_4, L_5, L_6
cluster_2 = Cluster_11(L=dcon.Set, L_2=num, L_3=roundd_2.Rounded)  # -> L_4, L_5, L_6
cluster_3 = Cluster_11(L=dcon.Set, L_2=num_2, L_3=roundd_3.Rounded)  # -> L_4, L_5, L_6
cluster_4 = Cluster_11(L=dcon.Set, L_2=num, L_3=roundd_4.Rounded)  # -> L_4, L_5, L_6
entwine = Entwine(
    Branch00=cluster.L_4,
    Branch01=cluster.L_5,
    Branch02=cluster.L_6,
    Branch04=cluster_2.L_4,
    Branch05=cluster_2.L_5,
    Branch06=cluster_2.L_6,
    Branch08=cluster_3.L_4,
    Branch09=cluster_3.L_5,
    Branch010=cluster_3.L_6,
    Branch012=cluster_4.L_4,
    Branch013=cluster_4.L_5,
    Branch014=cluster_4.L_6,
    FlattenInputs=True)
panel_2 = Panel(entwine)

R = ClusterOutput(roundd_2.Rounded)
R_2 = ClusterOutput(roundd_3.Rounded)
R_3 = ClusterOutput(roundd_4.Rounded)
excel_vt = ClusterOutput(entwine)
D = ClusterOutput(ma.Result)
D_2 = ClusterOutput(ma_2.Result)
D_3 = ClusterOutput(ma_3.Result)

# ==== cluster Cluster_14
retail = Colour(RGB(28, 31, 241))
retail_2 = Colour(RGB(206, 48, 0))
material = CreateMaterial(Diffuse=retail_2, Specular=retail_2, Emission=retail_2, Transparency=0.7, Shine=1)
material_2 = CreateMaterial(Diffuse=retail, Specular=retail, Emission=retail, Transparency=0.7, Shine=1)
M = ClusterOutput(material_2)
M_2 = ClusterOutput(material)

# ==== cluster VolumenEdificaciónContinua
B = ClusterInput()
F = ClusterInput()
C = ClusterOutput(B)
Z = UnitZ(Factor=expr("x*3", F))
boundary = BoundarySurfaces(Edges=B)
A = ClusterInput()
extr = Extrude(Base=B, Direction=Z)
Z_2 = UnitZ(Factor=F)
debrep = DeconstructBrep(Brep=extr)  # -> Faces, Edges, Vertices
move = Move(Geometry=boundary, Motion=Z)  # -> Geometry, Transform
merge = Merge(Data1=move.Geometry, Data2=boundary, Data3=debrep.Faces)  # -> flatten(Result)
join = BrepJoin(Breps=merge)  # -> Breps, Closed
brep = Brep(join.Breps)
brep_2 = ClusterOutput(brep)

# ==== cluster Cluster_19
coef_ex = ClusterInput()
curve = ClusterInput()
x = ClusterInput()
crv = ClusterInput()
x_2 = ClusterInput()
neg = Negative(Value="2")
neg_2 = Negative(Value=x)
crv_2 = Curve()
neg_3 = Negative(Value=x_2)
crv_3 = Curve(crv)
merge = Merge(Data1=curve, Data2=crv_3)
join = JoinCurves(Curves=merge, Preserve=False)
boundary = BoundarySurfaces(Edges=join)
cluster = Cluster_17(crv=boundary, relay=curve, relay_2=neg_2, relay_3=crv_3, relay_4=neg_3)  # -> i, _1, N
cluster_2 = Cluster_17(crv=boundary, relay=curve, relay_2=neg, relay_3=crv_3, relay_4=neg)  # -> i, _1, N
filter = StreamFilter(Gate=cluster_2.N, Stream0=cluster_2.i, Stream1=cluster_2._1)
filter_2 = StreamFilter(Gate=cluster.N, Stream0=cluster.i, Stream1=cluster._1)
crv_4 = Curve(filter)
area = Area(Geometry=boundary)  # -> Area, Centroid
crv_5 = Curve(filter_2)
boundary_2 = BoundarySurfaces(Edges=crv_4)
multiplication = Multiplication(A=area.Area, CoefEx=coef_ex)
crv_6 = ClusterOutput(crv_5)
area_2 = Area(Geometry=boundary_2)  # -> Area, Centroid
area_terreno_oguc_reducida_70 = Panel(multiplication)
area_terreno_reducido_por_excavacion_2cm = Panel(area_2.Area)
len = Length(Curve=boundary_2)
multiplication_2 = Multiplication(A=len, B=0.7)
_10 = Number(10)
cluster_3 = Cluster_18(relay_3=boundary_2, relay_2=boundary_2, relay=multiplication_2)
division = Division(A=area_terreno_oguc_reducida_70, B=area_terreno_reducido_por_excavacion_2cm)
multiplication_3 = Multiplication()
python = GhPythonScript(C=crv_4, ratio=division, maxD=_10)  # -> d, S_out; inputs C: Curve
# ---------- python: Python ----------
import Rhino
import Rhino.Geometry as rg

tol = Rhino.RhinoDoc.ActiveDoc.ModelAbsoluteTolerance

def area_from_offset(crv, plane, dist):
    # inward offset => negative distance
    offs = crv.Offset(plane, -dist, tol, rg.CurveOffsetCornerStyle.Sharp)
    if not offs or len(offs) == 0: 
        return 0.0, None
    # take the first resulting curve
    offs_crv = offs[0]
    breps = rg.Brep.CreatePlanarBreps(offs_crv, tol)
    if not breps or len(breps) == 0:
        return 0.0, None
    b = breps[0]
    return rg.AreaMassProperties.Compute(b).Area, b

if C is None:
    d = None
    S_out = None
else:
    # original area
    breps0 = rg.Brep.CreatePlanarBreps(C, tol)
    A0 = rg.AreaMassProperties.Compute(breps0[0]).Area
    target = ratio * A0

    # plane of the curve
    ok, pl = C.TryGetPlane()
    if not ok:
        raise Exception("Curve is not planar.")

    # binary search for d in [0, maxD]
    low = 0.0
    high = maxD
    d = 0.0
    S_out = None

    for i in range(40):  # ~2^-40 of the interval, plenty precise
        mid = 0.5 * (low + high)
        A_mid, brep_mid = area_from_offset(C, pl, mid)

        if brep_mid is None:
            # offset failed => too large, move high down
            high = mid
            continue

        # store best candidate so far
        d = mid
        S_out = brep_mid

        if A_mid > target:
            # still too big, need to offset more
            low = mid
        else:
            # too small, offset too much
            high = mid

        # optional: stop early by area tolerance
        if abs(A_mid - target) < 1e-4:
            break
# ---------- end python ----------
sqrt = SquareRoot(Value=division)
scale = Scale(Geometry=boundary_2, Center=area.Centroid, Factor=sqrt)  # -> Geometry, Transform
area_3 = Area(Geometry=python.S_out)  # -> Area, Centroid
s_out = ClusterOutput(python.S_out)
area_4 = Area(Geometry=scale.Geometry)  # -> Area, Centroid
offset = OffsetCurve(Curve=boundary_2, Distance=1, Corners=1)
area_5 = Area(Geometry=offset)  # -> Area, Centroid

# ==== cluster Cluster_24
curve = ClusterInput()
x = ClusterInput()
crv = ClusterInput()
x_2 = ClusterInput()
neg = Negative(Value="2")
neg_2 = Negative(Value=x)
crv_2 = Curve()
neg_3 = Negative(Value=x_2)
crv_3 = Curve(crv)
merge = Merge(Data1=curve, Data2=crv_3)
join = JoinCurves(Curves=merge, Preserve=False)
boundary = BoundarySurfaces(Edges=join)
cluster = Cluster_23(crv=boundary, relay=curve, relay_2=neg, relay_3=crv_3, relay_4=neg)  # -> stream, _1, N
cluster_2 = Cluster_23(crv=boundary, relay=curve, relay_2=neg_2, relay_3=crv_3, relay_4=neg_3)  # -> stream, _1, N
filter = StreamFilter(Gate=cluster.N, Stream1=cluster._1)
crv_4 = Curve(cluster_2.stream)
crv_5 = Curve(filter)
area = Area(Geometry=boundary)  # -> Area, Centroid
boundary_2 = BoundarySurfaces(Edges=crv_5)
rdiff = RegionDifference(CurvesA=boundary, CurvesB=crv_4)
area_2 = Area(Geometry=boundary_2)  # -> Area, Centroid
multiplication = Multiplication(A=area.Area, B=0.7)
area_terreno_oguc_reducida_70 = Panel(multiplication)
area_terreno_reducido_por_excavacion_2cm = Panel(area_2.Area)
crv_6 = ClusterOutput(crv_4)
R = ClusterOutput(rdiff)
division = Division(A=area_terreno_oguc_reducida_70, B=area_terreno_reducido_por_excavacion_2cm)
multiplication_2 = Multiplication()
sqrt = SquareRoot(Value=division)
scale = Scale(Geometry=boundary_2, Center=area_2.Centroid, Factor=sqrt)  # -> Geometry, Transform
G = ClusterOutput(scale.Geometry)
area_3 = Area(Geometry=scale.Geometry)  # -> Area, Centroid

# ==== cluster Cluster_25
L = ClusterInput()
item = ListItem(List=flatten(L), Index=0, Wrap=True)
A = ClusterInput()
_0 = ClusterInput()
subtraction = Subtraction(A=A, B=item)
G = ClusterInput()
filter = StreamFilter(Gate=G, Stream0=_0, Stream1=subtraction)
s_1 = ClusterOutput(filter)

# ==== cluster Cluster_27
L = ClusterInput()
i = ClusterInput()
A = ClusterInput()
item = ListItem(List=L, Index=i, Wrap=True)
division = Division(A=A, B=item)
round = Round(Number=division)  # -> Nearest, Floor, Ceiling
multiplication = Multiplication(A=round.Floor, B=item)
B = ClusterInput()
addition = Addition(A=round.Floor, B=1)
Z = UnitZ(Factor=multiplication)
extr = Extrude(Base=B, Direction=Z)
B_2 = ClusterInput()
cap = CapHoles(Brep=extr)
sdiff = SolidDifference(BrepsA=cap, BrepsB=B_2)
crv = Curve(B)
R = ClusterOutput(sdiff)
tstat = TreeStatistics(Tree=crv)  # -> Paths, Length, Count
cluster = Cluster_26(B=sdiff)
replace = ReplacePaths(Data=crv, Search=tstat.Paths, Replace="{-1}")
item_2 = ListItem(List=cluster, Index=0, Wrap=True)
item_3 = ListItem(List=cluster, Index=-1, Wrap=True)
D = ClusterOutput(replace)
area = Area(Geometry=item_2)  # -> Area, Centroid
area_2 = Area(Geometry=item_3)  # -> Area, Centroid
ln = Line(StartPoint=area.Centroid, EndPoint=area_2.Centroid)
pdecon = Deconstruct(Point=area_2.Centroid)  # -> XComponent, YComponent, ZComponent
arrcurve = CurveArray(Geometry=item_2, Curve=ln, Count=graft(addition))  # -> Geometry, Transform
Z_2 = ClusterOutput(pdecon.ZComponent)
cull_i = CullIndex(List=arrcurve.Geometry, Indices=-1, Wrap=True)
area_3 = Area(Geometry=arrcurve.Geometry)  # -> Area, Centroid
tstat_2 = TreeStatistics(Tree=cull_i)  # -> Paths, Length, Count
item_4 = ListItem(List=tstat_2.Paths, Index=0, Wrap=True)
replace_2 = ReplacePaths(Data=cull_i, Search=item_4, Replace="{0}")
area_4 = Area(Geometry=replace_2)  # -> Area, Centroid
line = LineSDL(Start=area_3.Centroid, Direction=Vector(0, 0, 1), Length=item)
boundary = BoundarySurfaces(Edges=replace_2)
ma = MassAddition(Input=flatten(area_4.Area))  # -> Result, PartialResults
cull_i_2 = CullIndex(List=line, Indices=-1, Wrap=True)
S = ClusterOutput(boundary)
lng = ListLength(List=boundary)
R_2 = ClusterOutput(ma.Result)
L_2 = ClusterOutput(lng)

# ==== cluster Cluster_28
crv = ClusterInput()
F = ClusterInput()
crv_2 = Curve(crv)
Z = UnitZ(Factor=F)
boundary = BoundarySurfaces(Edges=crv_2)
move = Move(Geometry=boundary, Motion=Z)  # -> Geometry, Transform
extr = Extrude(Base=crv_2, Direction=Z)
join = BrepJoin(Breps=[extr, move.Geometry, boundary])  # -> Breps, Closed
cap = CapHoles(Brep=join.Breps)

# ---- group: Cluster Output
B = ClusterOutput(cap)

# ==== cluster Cluster_29
crv = ClusterInput()
F = ClusterInput()
C = ClusterInput()
crv_2 = Curve(crv)
crv_3 = Curve(crv_2)
Z = UnitZ(Factor=F)
area = Area(Geometry=crv_3)  # -> Area, Centroid
area_2 = Area(Geometry=crv_2)  # -> Area, Centroid
crv_4 = Curve(C)
incurve = PointInCurve(Point=area.Centroid, Curve=C)  # -> Relationship, Point
move = Move(Geometry=crv_2, Motion=Z)  # -> Geometry, Transform
equals = Equality(FirstNumber=incurve.Relationship, SecondNumber=0)  # -> Equality, Inequality
filter = StreamFilter(Gate=equals.Equality, Stream0=move.Geometry, Stream1=crv_2)  # -> flatten(Stream)
panel = Panel(filter)
C_2 = ClusterOutput(area_2.Centroid)
G = ClusterOutput(move.Geometry)

# ==== cluster Cluster_30
num = ClusterInput()
num_2 = Number(num)
cset = CreateSet(List=flatten(num_2))  # -> Set, Map
num_3 = Number(0)
Z = UnitZ(Factor=cset.Set)
G = ClusterInput()
filter = StreamFilter(Gate=G, Stream0=num_3, Stream1=cset.Set)
filter_2 = StreamFilter(Gate=G, Stream0=num_3, Stream1=Z)
entwine = Entwine(Branch00=filter, Branch01=filter, Branch02=filter, Branch03=filter, FlattenInputs=True)
s_1 = ClusterOutput(filter_2)
R = ClusterOutput(entwine)

# ==== cluster Cluster_31
crv = ClusterInput()
crv_2 = Curve(crv)
listdexs = ListIndices(List=crv_2)
runion = RegionUnion(Curves=crv_2)
listdexs_2 = ListIndices(List=runion)
equals = Equality(FirstNumber=listdexs, SecondNumber=listdexs_2)  # -> Equality, Inequality
mindex = MemberIndex(Set=equals.Equality, Member=False)  # -> Index, Count
mindex_2 = MemberIndex(Set=equals.Equality, Member=True)  # -> Index, Count
replace = ReplaceItems(List=equals.Equality, Indices=mindex.Index, Wrap=False)
replace_2 = ReplaceItems(List=replace, Item=runion, Indices=mindex_2.Index, Wrap=False)
area = Area(Geometry=replace_2)  # -> Area, Centroid
bang = ExplodeTree(Data=graft(replace_2))  # -> _0000000, _0000001, _0000002, _0000003
clean = CleanTree(RemoveNulls=True, RemoveInvalid=True, RemoveEmpty=False, Tree=area.Area)
merge = Merge(Data1=bang._0000000, Data2=bang._0000001, Data3=bang._0000002, Data4=bang._0000003)
R = ClusterOutput(merge)
T = ClusterOutput(clean)

# ==== cluster Cluster_32
i = ClusterInput()
T = ClusterInput()
tstat = TreeStatistics(Tree=T)  # -> Paths, Length, Count
item = ListItem(List=tstat.Paths, Index=i, Wrap=True)
branch = TreeBranch(Tree=T, Path=item, MaintainPaths=True)
B = ClusterOutput(branch)

# ==== cluster Cluster_33
T = ClusterInput()
d1 = ClusterInput()
d2 = ClusterInput()
merge = Merge(Data1=d1, Data2=d2)  # -> flatten(Result)
tstat = TreeStatistics(Tree=T)  # -> Paths, Length, Count
cull_i = CullIndex(List=tstat.Paths, Indices=merge, Wrap=True)
branch = TreeBranch(Tree=T, Path=cull_i, MaintainPaths=True)
B = ClusterOutput(branch)

# ==== cluster Cluster_42
pisos_2 = ClusterInput()
panel = Panel("""3-8
12,15""")
panel_2 = Panel("""3-5
7,10""")
pisos_2_2 = Text(pisos_2)
clean = CleanTree(RemoveNulls=True, RemoveInvalid=True, RemoveEmpty=True, Tree=pisos_2_2)
replace = ReplacePaths(Data=panel, Search="{0}", Replace="{1}")
len = TextLength(Text=clean)
relay = Relay([panel_2, replace])
nullrep = ReplaceNulls(Items=clean, Replacements=0)  # -> Items, Count
equals = Equality(FirstNumber=len, SecondNumber=0)  # -> Equality, Inequality
cull = CullPattern(List=clean, CullPattern=invert(equals.Equality))
L = ClusterInput()
num = ClusterInput()
lng = ListLength(List=L)
pisos_2_3 = Text(cull)
num_2 = Number(num)
item = ListItem(List=num_2, Index=0, Wrap=True)
item_2 = ListItem(List=num_2, Index=1, Wrap=True)
item_3 = ListItem(List=num_2, Index=2, Wrap=True)
crv = ClusterInput()
num_3 = ClusterInput()
equals_2 = Equality(FirstNumber=pisos_2_3, SecondNumber=0)  # -> Equality, Inequality
crv_2 = Curve(crv)
num_4 = Number(num_3)
num_5 = ClusterInput()
num_6 = Number(num_5)
num_7 = Number(item_3)
lng_2 = ListLength(List=pisos_2_3)
area = Area(Geometry=crv_2)  # -> Area, Centroid
clean_2 = CleanTree(RemoveNulls=True, RemoveInvalid=True, RemoveEmpty=True, Tree=equals_2.Equality)
tmatch = MatchText(Text=pisos_2_3, Pattern="*-*", Case=True)
tmatch_2 = MatchText(Text=pisos_2_3, Pattern="*,*", Case=True)
num_8 = Number(flatten(num_5))
equals_3 = Equality(FirstNumber=lng_2, SecondNumber=1)  # -> Equality, Inequality
item_4 = ListItem(List=num_4, Index=item, Wrap=True)
division = Division(A=num_6, AlturaPrograma1=item_4)
pisos_max = Round(Number=division)  # -> Nearest, Floor, Ceiling
num_9 = Number(pisos_max.Nearest)
num_10 = ClusterInput()
item_5 = ListItem(List=num_4, Index=item_2, Wrap=True)
bool = Boolean(True)
panel_3 = Panel(ClusterInput())
or = GateOr(A=tmatch, B=tmatch_2)
bool_2 = Boolean(True)
cset = CreateSet(List=clean_2)  # -> Set, Map
multiplication = Multiplication(A=area.Area, B=num_7)
mindex = MemberIndex(Set=tmatch, Member=bool_2)  # -> Index, Count
mindex_2 = MemberIndex(Set=tmatch_2, Member=bool)  # -> Index, Count
cluster = Cluster_39(T=crv_2, num=area.Area)  # -> i_2, s_0, i
not = GateNot(A=or)
A = ClusterInput()
multiplication_2 = Multiplication(A=item_5, B=num_7)
and = GateAnd(A=cset.Set, B=equals_3.Equality)
ma = MassAddition(Input=flatten(area.Area))  # -> Result, PartialResults
filter = StreamFilter(Gate=and, Stream0=not)
num_11 = Number(flatten(panel_3))
equals_4 = Equality(FirstNumber=A, SecondNumber=2)  # -> Equality, Inequality
pisos_2_4 = Text(pisos_2_3)
num_12 = Number(simplify(graft(num_10)))
ma_2 = MassAddition(Input=flatten(multiplication))  # -> Result, PartialResults
bool_3 = Boolean(True)
division_2 = Division(A=num_8, B=item_4)
mindex_3 = MemberIndex(Set=filter, Member=bool_3)  # -> Index, Count
item_6 = ListItem(List=pisos_2_4, Index=mindex.Index, Wrap=True)
item_7 = ListItem(List=pisos_2_4, Index=mindex_2.Index, Wrap=True)
subtraction = Subtraction(A=flatten(panel_3), B=ma_2.Result)
round = Round(Number=division_2)  # -> Nearest, Floor, Ceiling
item_8 = ListItem(List=pisos_2_4, Index=mindex_3.Index, Wrap=True)  # -> simplify(Item)
rep = ReplaceText(Text=item_6, Find="-", Replace=" to ", RecursiveReplace=False)  # -> simplify(Result)
split = TextSplit(Text=item_7, Separators=",")  # -> simplify(Result)
lng_3 = ListLength(List=flatten(crv_2))
panel_4 = Panel(round.Nearest)
dedomain = DeconstructDomain(Domain=rep)  # -> Start, End
rep_2 = ReplaceText(Text=split, Find=" ", RecursiveReplace=False)
num_13 = Number(item_8)
multiplication_3 = Multiplication(A=panel_4, B=area.Area)
panel_5 = Panel(subtraction)
tstat = TreeStatistics(Tree=rep)  # -> Paths, Length, Count
clean_3 = CleanTree(RemoveNulls=True, RemoveInvalid=True, RemoveEmpty=True, Tree=num_13)
subtraction_2 = Subtraction(A=dedomain.End, B=dedomain.Start)
ma_3 = MassAddition(Input=flatten(multiplication_3))  # -> Result, PartialResults
equals_5 = Equality(FirstNumber=lng_3, SecondNumber=1)  # -> Equality, Inequality
series = Series(Start=dedomain.Start, Step=1, Count=expr("x+1", subtraction_2))
path_mapper = PathMapper(series, source="{A;B}(i)", target="{A}")
addition = Addition(A=num_7, B=1)
subtraction_3 = Subtraction(A=ma_3.Result, B=num_11)
smaller = SmallerThan(FirstNumber=ma_3.Result, SecondNumber=num_11)  # -> SmallerThan, OrEqualTo
division_3 = Division(A=subtraction_3, B=ma.Result)
filter_2 = StreamFilter(Gate=equals_5.Equality, Stream0=path_mapper, Stream1=series)
int = Integer(division_3)
lng_4 = ListLength(List=cluster.s_0)
subtraction_4 = Subtraction(A=panel_4, B=int)
panel_6 = Panel(filter_2)
multiplication_4 = Multiplication(PISOS=subtraction_4, AREA=area.Area)
cluster_2 = Cluster_40(I=multiplication_4, cc=num_11, B=cluster.i, R=cluster.i_2)
branch = TreeBranch(Tree=subtraction_4, Path=cluster.s_0, MaintainPaths=True)
branch_2 = TreeBranch(Tree=subtraction_4, Path=cluster.i_2, MaintainPaths=True)
equals_6 = Equality(FirstNumber=lng_4, SecondNumber=1)  # -> Equality, Inequality
addition_2 = Addition(A=branch_2, B=cluster_2)
merge = Merge(Data1=branch, Data2=addition_2)
filter_3 = StreamFilter(Gate=equals_6.Equality, Stream0=merge, Stream1=branch)
filter_4 = StreamFilter(Gate=smaller.OrEqualTo, Stream0=filter_3, Stream1=panel_4)
Z = UnitZ(Factor=multiplication_2)
filter_5 = StreamFilter(Gate=equals_4.Equality, Stream0=filter_4, Stream1=num_12)
num_14 = Number(filter_5)
addition_3 = Addition(A=num_14, B=lng)
num_15 = Number(addition_3)
expression = Expression(x=num_15, y=clean_3, Expression="if(x≥y,y,x)")
smaller_2 = SmallerThan(FirstNumber=rep_2, SecondNumber=addition_3)  # -> SmallerThan, OrEqualTo
cull_2 = CullPattern(List=rep_2, CullPattern=smaller_2.OrEqualTo)  # -> simplify(List)
cluster_3 = Cluster_41(D=expression, T_2=expression, T=clean_3)  # -> D_2, P
addition_4 = Addition(A=num_14, B=lng)
branch_3 = TreeBranch(Tree=cluster_3.D_2, Path=cluster_3.P, MaintainPaths=True)
smaller_3 = SmallerThan(FirstNumber=filter_2, SecondNumber=addition_4)  # -> SmallerThan, OrEqualTo
series_2 = Series(Start=1, Step=1, Count=num_14)
cull_3 = CullPattern(List=filter_2, CullPattern=smaller_3.OrEqualTo)  # -> simplify(List)
merge_2 = Merge(Data1=cull_3, Data2=cull_2, Data3=branch_3)  # -> simplify(Result)
null = NullItem(Item=merge_2)  # -> NullFlags, InvalidFlags, Description
subtraction_5 = Subtraction(A=merge_2, B=lng)
cull_4 = CullPattern(List=subtraction_5, CullPattern=invert(null.NullFlags))
sort = SortList(Keys=cull_4, ValuesA=cull_4)  # -> Keys, ValuesA
dcon = DeleteConsecutive(Set=sort.ValuesA, Wrap=False)  # -> Set, Count
listdexs = ListIndices(List=series_2)
num_16 = Number(expr("x-1", dcon.Set))
replace_2 = ReplaceItems(List=series_2, Item=item_4, Indices=listdexs, Wrap=False)  # -> simplify(List)
negative_0 = Negative0_2(_0=num_16, A=num_16)  # -> simplify(L)
filter_6 = StreamFilter(Gate=and, Stream0=negative_0)
replace_3 = ReplaceItems(List=replace_2, Item=item_5, Indices=filter_6, Wrap=False)
move = Move(Geometry=crv_2, Motion=Z)  # -> Geometry, Transform
crv_3 = Curve(crv_2)
Z_2 = UnitZ(Factor=replace_3)
panel_7 = Panel(negative_0)
addition_5 = Addition(A=filter_5, B=1)
ma_4 = MassAddition(Input=replace_3)  # -> Result, PartialResults
area_2 = Area(Geometry=crv_3)  # -> Area, Centroid
area_3 = Area(Geometry=move.Geometry)  # -> Area, Centroid
multiplication_5 = Multiplication(A=item_4, B=filter_5)
larger = LargerThan(FirstNumber=num_6, SecondNumber=ma_4.Result)  # -> LargerThan, OrEqualTo
subtraction_6 = Subtraction(A=ma_4.Result, B=num_6)
ln = Line(StartPoint=area_2.Centroid, EndPoint=area_3.Centroid)  # -> simplify(Line)
line = LineSDL(Start=area_3.Centroid, Direction=Vector(0, 0, 1), Length=multiplication_5)  # -> simplify(Line)
arrcurve = CurveArray(Geometry=move.Geometry, Curve=line, Count=addition_5)  # -> Geometry, Transform
tstat_2 = TreeStatistics(Tree=crv_2)  # -> Paths, Length, Count
division_4 = Division(A=subtraction_6, B=item_4)
item_9 = ListItem(Index=0, Wrap=True)
arrcurve_2 = CurveArray(Geometry=crv_3, Curve=ln, Count=addition)  # -> Geometry, Transform
round_2 = Round(Number=division_4)  # -> Nearest, Floor, Ceiling
cluster_4 = Cluster_35(R=tstat_2.Paths, E=arrcurve.Geometry, D=line)  # -> D_4, D_2, A, C, D_3
cluster_5 = Cluster_35(R=tstat_2.Paths, E=arrcurve_2.Geometry, D=ln)  # -> D_4, D_2, A, C, D_3
multiplication_6 = Multiplication(A=round_2.Ceiling, B=item_4)
panel_8 = Panel(tstat_2.Paths)
subtraction_7 = Subtraction(A=ma_4.Result, B=multiplication_6)
series_3 = Series(Start=1, Step=1, Count=round_2.Ceiling)  # -> expr("x*-1", Series)
ins = InsertItems(List=ma_4.PartialResults, Item=0, Indices=0, Wrap=True)
sunion = SolidUnion(Breps=flatten([cluster_5.D_2, cluster_4.D_2]))  # -> graft(Result)
num_17 = Number([cluster_4.A, cluster_5.A])
cluster_6 = Cluster_38(B=sunion)
merge_3 = Merge(Data1=cluster_5.D_3, Data2=cluster_4.D_3)
cull_i = CullIndex(List=ins, Indices=-1, Wrap=True)
cull_i_2 = CullIndex(List=cull_i, Indices=series_3, Wrap=True)
cull_i_3 = CullIndex(List=replace_3, Indices=series_3, Wrap=True)
line_2 = LineSDL(Start=cluster_4.C, Direction=Vector(0, 0, 1), Length=item_4)
cluster_7 = Cluster_37(crv=arrcurve_2.Geometry)
line_3 = LineSDL(Start=cluster_5.C, Direction=Vector(0, 0, 1), Length=item_5)
cluster_8 = Cluster_36(R=panel_8, I=num_17)
cluster_9 = REMAP(R=panel_8, D=sunion)
cluster_10 = REMAP(R=panel_8, D=merge_3)
cluster_11 = Cluster_2(B=sunion)
cluster_12 = Cluster_37(crv=arrcurve.Geometry)
filter_7 = StreamFilter(Gate=larger.LargerThan, Stream0=cull_i_2, Stream1=cull_i)
filter_8 = StreamFilter(Gate=larger.LargerThan, Stream0=cull_i_3, Stream1=replace_3)  # -> simplify(Stream)
merge_4 = Merge(Data1=line_3, Data2=line_2)
panel_9 = Panel(cluster_12)
panel_10 = Panel(cluster_7)
panel_11 = Panel(sunion)
simplify = SimplifyTree(Tree=crv_3, Front=False)
Z_3 = UnitZ(Factor=filter_8)
ma_5 = MassAddition(Input=filter_8)  # -> Result, PartialResults
cluster_13 = REMAP(R=panel_8, D=merge_4)
area_4 = Area(Geometry=cluster_10)  # -> Area, Centroid
len_2 = Length(Curve=cluster_13)
area_5 = Area(Geometry=simplify)  # -> Area, Centroid
filter_9 = StreamFilter(Gate=larger.LargerThan, Stream0=ma_5.Result, Stream1=ma_4.Result)
ma_6 = MassAddition(Input=flatten(area_4.Area))  # -> Result, PartialResults
line_4 = LineSDL(Start=area_5.Centroid, Direction=Vector(0, 0, 1), Length=filter_9)
division_5 = Division(A=filter_7, B=filter_9)
panel_12 = Panel(ma_6.Result)
panel_13 = Panel(filter_8)
eval = EvaluateCurve(Curve=line_4, Parameter=division_5)  # -> Point, Tangent, Angle
orient = Orient(Geometry=simplify, Source=area_5.Centroid, Target=eval.Point)  # -> Geometry, Transform
tstat_3 = TreeStatistics(Tree=crv_2)  # -> Paths, Length, Count
extr = Extrude(Base=orient.Geometry, Direction=Z_3)
item_10 = ListItem(List=extr, Index=0, Wrap=True)
item_11 = ListItem(List=orient.Geometry, Index=0, Wrap=True)
extr_2 = Extrude(Base=item_11, Direction=line_4)
cap = CapHoles(Brep=extr_2)
cap_2 = CapHoles(Brep=extr)
item_12 = ListItem(List=cap_2, Index=-1, Wrap=True)
boundary = BoundarySurfaces(Edges=orient.Geometry)
debrep = DeconstructBrep(Brep=item_12)  # -> Faces, Edges, Vertices
re_map = REMAP(R=tstat_3.Paths, D=cap)
re_map_2 = REMAP(R=tstat_3.Paths, D=cap_2)
re_map_3 = REMAP(R=tstat_3.Paths, D=boundary)
cluster_14 = Cluster_2(B=re_map)
area_6 = Area(Geometry=debrep.Faces)  # -> Area, Centroid
area_7 = Area(Geometry=re_map_3)  # -> Area, Centroid
Z_4 = UnitZ(Factor=1)
pdecon = Deconstruct(Point=area_6.Centroid)  # -> XComponent, YComponent, ZComponent
line_5 = LineSDL(Start=area_7.Centroid, Direction=Z_4, Length=filter_8)
ma_7 = MassAddition(Input=area_7.Area)  # -> Result, PartialResults
sort_2 = SortList(Keys=area_6.Centroid, ValuesA=pdecon.ZComponent)  # -> Keys, ValuesA
len_3 = Length(Curve=line_5)
alt_max = Number(cluster_14)
alt_max_2 = ClusterOutput(alt_max)
alturas = Number(len_3)
alturas_2 = ClusterOutput(alturas)
sup_total = Number(ma_7.Result)
sup_total_2 = ClusterOutput(sup_total)
sup_piso = Number(ma_7.Result)
volumen = Brep(re_map)
volumen_2 = ClusterOutput(volumen)
surface = Surface(re_map_3)
surface_2 = ClusterOutput(surface)

# ==== cluster Cluster_43
i = ClusterInput()
crv = ClusterInput()
crv_2 = Curve(simplify(graft(crv)))
tstat = TreeStatistics(Tree=crv_2)  # -> Paths, Length, Count
panel = Panel(crv_2)
item = ListItem(List=tstat.Paths, Index=i, Wrap=True)
branch = TreeBranch(Tree=crv_2, Path=item, MaintainPaths=True)  # -> simplify(Branch)
tstat_2 = TreeStatistics(Tree=branch)  # -> Paths, Length, Count
replace = ReplacePaths(Data=branch, Search=tstat_2.Paths, Replace=i)
panel_2 = Panel(replace)
D = ClusterOutput(replace)

# ==== cluster Cluster_44
I = ClusterInput()
crv = ClusterInput()
crv_2 = Curve(simplify(graft(crv)))
panel = Panel(crv_2)
tstat = TreeStatistics(Tree=crv_2)  # -> Paths, Length, Count
cull_i = CullIndex(List=tstat.Paths, Indices=I, Wrap=True)
branch = TreeBranch(Tree=crv_2, Path=cull_i, MaintainPaths=True)  # -> simplify(Branch)
B = ClusterOutput(branch)
L = ClusterOutput(cull_i)

# ==== cluster Cluster_45
crv = ClusterInput()
crv_2 = Curve(crv)
null = NullItem(Item=crv_2)  # -> simplify(NullFlags), InvalidFlags, Description
bool = Boolean(True)
crv_3 = Curve(simplify(graft(crv_2)))
mindex = MemberIndex(Set=null.NullFlags, Member=bool)  # -> Index, Count
tstat = TreeStatistics(Tree=crv_3)  # -> Paths, Length, Count
I = ClusterOutput(mindex.Index)
item = ListItem(List=tstat.Paths, Index=mindex.Index, Wrap=True)

# ==== cluster Cluster_46
num = ClusterInput()
num_2 = ClusterInput()
num_3 = ClusterInput()
num_4 = Number(num)
A = ClusterInput()
num_5 = Number(num_2)
num_6 = Number(num_3)
item = ListItem(List=flatten(num_4), Index=0, Wrap=True)  # -> Item, Item1, Item2
item_2 = ListItem(List=num_5, Index=0, Wrap=True)
item_3 = ListItem(List=num_5, Index=1, Wrap=True)
item_4 = ListItem(List=num_5, Index=2, Wrap=True)
tstat = TreeStatistics(Tree=num_5)  # -> Paths, Length, Count
item_5 = ListItem(List=num_6, Index=item_3, Wrap=True)
subtraction = Subtraction(A=graft(A), B=item_4)  # -> simplify(Result)
item_6 = ListItem(List=num_6, Index=item_2, Wrap=True)
multiplication = Multiplication(A=item_4, B=item_5)
subtraction_2 = Subtraction(A=item.Item1, B=multiplication)
division = Division(A=subtraction_2, B=item_6)
round = Round(Number=division)  # -> Nearest, Floor, Ceiling
expression = Expression(N1=round.Floor, A=subtraction, Expression="if(A<N1, A, N1)")  # -> simplify(R)
multiplication_2 = Multiplication(A=expression, B=item_6)
addition = Addition(A=item.Item2, B=multiplication_2, C=multiplication)
addition_2 = Addition(A=multiplication_2, B=multiplication)
expression_2 = Expression(N1=item.Item, A=addition, H1=addition_2, H2=item.Item1, H=item_6, Expression="if(A<N1, H1, H2-H)")  # -> simplify(R)
tstat_2 = TreeStatistics(Tree=expression_2)  # -> Paths, Length, Count
replace = ReplacePaths(Data=expression_2, Search=tstat_2.Paths, Replace=tstat.Paths)
D = ClusterOutput(replace)
panel = Panel(replace)

# ==== cluster Cluster_48
num = ClusterInput()
num_2 = Number(num)
item = ListItem(List=num_2, Index=0, Wrap=True)
item_2 = ListItem(List=num_2, Index=1, Wrap=True)
item_3 = ListItem(List=num_2, Index=2, Wrap=True)
crv = ClusterInput()
num_3 = ClusterInput()
crv_2 = Curve(crv)
num_4 = Number(item_3)
num_5 = Number(num_3)
panel = Panel(crv_2)
item_4 = ListItem(List=num_5, Index=item, Wrap=True)
item_5 = ListItem(List=num_5, Index=item_2, Wrap=True)
multiplication = Multiplication(A=item_5, B=num_4)
B = ClusterInput()
Z = UnitZ(Factor=multiplication)
addition = Addition(A=B, B=1)
crv_3 = Curve(crv_2)
neg = Negative(Value=item_4)
area = Area(Geometry=crv_3)  # -> Area, Centroid
multiplication_2 = Multiplication(A=neg, B=B)
line = LineSDL(Start=area.Centroid, Direction=Vector(0, 0, 1), Length=multiplication_2)  # -> simplify(Line)
arrcurve = CurveArray(Geometry=crv_3, Curve=line, Count=addition)  # -> simplify(Geometry), Transform
R = ClusterOutput(multiplication_2)
cluster = Cluster_47(E=arrcurve.Geometry, D=line)  # -> Z, B, A, L
tstat = TreeStatistics(Tree=crv_2)  # -> Paths, Length, Count
crv_4 = Curve(cluster.L)
merge = Merge(Data2=cluster.L)  # -> flatten(Result)
sunion = SolidUnion(Breps=flatten(cluster.B))  # -> graft(Result)
area_2 = Area(Geometry=merge)  # -> Area, Centroid
num_6 = Number(cluster.A)
cluster_2 = Cluster_37()
cluster_3 = Cluster_37(crv=arrcurve.Geometry)
line_2 = LineSDL(Start=area_2.Centroid, Direction=Vector(0, 0, 1), Length=item_4)
cluster_4 = Cluster_36(R=tstat.Paths, I=num_6)
cluster_5 = REMAP(R=tstat.Paths, D=sunion)
cluster_6 = Cluster_2(B=sunion)
cluster_7 = REMAP(R=tstat.Paths, D=merge)
cluster_8 = Cluster_38(B=sunion)
panel_2 = Panel(cluster_2)
panel_3 = Panel(cluster_3)
D = ClusterOutput(cluster_4)
D_2 = ClusterOutput(cluster_5)
D_3 = ClusterOutput(cluster_7)
Z_2 = ClusterOutput(cluster_6)
cluster_9 = REMAP(R=tstat.Paths, D=line_2)
len = Length(Curve=cluster_9)
L = ClusterOutput(len)

# ==== cluster Cluster_51
num = ClusterInput()
num_2 = ClusterInput()
num_3 = Number(num)
item = ListItem(List=num_3, Index=0, Wrap=True)
item_2 = ListItem(List=num_3, Index=1, Wrap=True)
item_3 = ListItem(List=num_3, Index=2, Wrap=True)
crv = ClusterInput()
num_4 = Number(num_2)
crv_2 = Curve(flatten(crv))
num_5 = Number(item_3)
item_4 = ListItem(List=num_4, Index=item, Wrap=True)
item_5 = ListItem(List=num_4, Index=item_2, Wrap=True)
A = ClusterInput()
multiplication = Multiplication(A=item_5, B=num_5)
B = ClusterInput()
division = Division(A=A, B=item_4)
Z = UnitZ(Factor=multiplication)
round = Round(Number=division)  # -> Nearest, Floor, Ceiling
crv_3 = Curve(crv_2)
area = Area(Geometry=crv_3)  # -> Area, Centroid
multiplication_2 = Multiplication(A=round.Nearest, B=item_4)  # -> flatten(Result)
addition = Addition(A=round.Nearest, B=1)  # -> flatten(Result)
line = LineSDL(Start=area.Centroid, Direction=Vector(0, 0, 1), Length=multiplication_2)  # -> simplify(Line)
arrcurve = CurveArray(Geometry=crv_3, Curve=line, Count=addition)  # -> Geometry, Transform
cluster = Cluster_49(E=arrcurve.Geometry, D=line)  # -> Z, B, A, L
tstat = TreeStatistics(Tree=crv_2)  # -> Paths, Length, Count
merge = Merge(Data2=cluster.L)
area_2 = Area(Geometry=flatten(merge))  # -> Area, Centroid
sunion = SolidUnion(Breps=flatten(cluster.B))  # -> graft(Result)
num_6 = Number(cluster.A)
cluster_2 = Cluster_37()
cluster_3 = Cluster_37(crv=arrcurve.Geometry)
line_2 = LineSDL(Start=area_2.Centroid, Direction=Vector(0, 0, 1), Length=item_4)
cluster_4 = Cluster_50(R=tstat.Paths, D=flatten(merge))
cluster_5 = Cluster_36(R=tstat.Paths, I=num_6)
cluster_6 = Cluster_50(R=tstat.Paths, D=sunion)
cluster_7 = Cluster_2(B=sunion)
cluster_8 = Cluster_38(B=sunion)
area_3 = Area(Geometry=merge)  # -> Area, Centroid
D = ClusterOutput(cluster_5)
D_2 = ClusterOutput(cluster_6)
D_3 = ClusterOutput(cluster_4)
Z_2 = ClusterOutput(cluster_7)
cluster_9 = REMAP(R=tstat.Paths, D=line_2)
pdecon = Deconstruct(Point=area_3.Centroid)  # -> XComponent, YComponent, ZComponent
len = Length(Curve=cluster_9)
sort = SortList(Keys=pdecon.ZComponent, ValuesA=pdecon.ZComponent)  # -> Keys, ValuesA
L = ClusterOutput(len)
panel = Panel(len)
cset = CreateSet(List=sort.ValuesA)  # -> Set, Map
listdexs = ListIndices(List=cset.Set)  # -> flatten(Indices)
addition_2 = Addition(A=listdexs, B=1)  # -> flatten(Result)
i = ClusterOutput(listdexs)
sort_2 = SortList(Keys=addition_2, ValuesA=addition_2)  # -> Keys, ValuesA
panel_2 = Panel(sort_2.ValuesA)

# ==== cluster Cluster_52
crv = ClusterInput()
crv_2 = Curve(crv)
I = ClusterInput()
listdexs = ListIndices(List=flatten(crv_2))
cull_i = CullIndex(List=listdexs, Indices=I, Wrap=True)  # -> simplify(List)
A = ClusterInput()
B = ClusterInput()
item = ListItem(List=flatten(crv_2), Index=cull_i, Wrap=True)
lng = ListLength(List=cull_i)  # -> flatten(Length)
subtraction = Subtraction(A=A, B=B)
area = Area(Geometry=item)  # -> Area, Centroid
division = Division(A=subtraction, B=lng)
division_2 = Division(A=division, B=area.Area)
round = Round(Number=division_2)  # -> Nearest, Floor, Ceiling
N = ClusterOutput(round.Nearest)

# ==== cluster Cluster_53
B = ClusterInput()
debrep = DeconstructBrep(Brep=B)  # -> Faces, Edges, Vertices
area = Area(Geometry=debrep.Faces)  # -> Area, Centroid
pdecon = Deconstruct(Point=area.Centroid)  # -> XComponent, YComponent, ZComponent
sort = SortList(Keys=pdecon.ZComponent, ValuesA=debrep.Faces)  # -> Keys, ValuesA
item = ListItem(List=sort.ValuesA, Index=-1, Wrap=True)
panel = Panel(ClusterInput())
panel_2 = Panel(ClusterInput())
B_2 = ClusterInput()
area_2 = Area(Geometry=item)  # -> Area, Centroid
pdecon_2 = Deconstruct(Point=area_2.Centroid)  # -> XComponent, YComponent, ZComponent
C = ClusterOutput(area_2.Centroid)
addition = Addition(A=panel, B=flatten(B_2))
Z = ClusterOutput(pdecon_2.ZComponent)
panel_3 = Panel(addition)

# ==== cluster Cluster_54
D = ClusterInput()
D_2 = ClusterInput()
R = ClusterInput()
D_3 = ClusterInput()
D_4 = ClusterInput()
D_5 = ClusterInput()
brep = ClusterInput()
D_6 = ClusterInput()
brep_2 = Brep(brep)
tstat = TreeStatistics(Tree=D)  # -> Paths, Length, Count
tstat_2 = TreeStatistics(Tree=D_2)  # -> Paths, Length, Count
tstat_3 = TreeStatistics(Tree=D_3)  # -> Paths, Length, Count
tstat_4 = TreeStatistics(Tree=D_4)  # -> Paths, Length, Count
tstat_5 = TreeStatistics(Tree=D_5)  # -> Paths, Length, Count
tstat_6 = TreeStatistics(Tree=D_6)  # -> Paths, Length, Count
tstat_7 = TreeStatistics(Tree=brep_2)  # -> Paths, Length, Count
replace = ReplacePaths(Data=brep_2, Search=tstat_7.Paths, Replace=R)
replace_2 = ReplacePaths(Data=D, Search=tstat.Paths, Replace=R)
replace_3 = ReplacePaths(Data=D_2, Search=tstat_2.Paths, Replace=R)
replace_4 = ReplacePaths(Data=D_3, Search=tstat_3.Paths, Replace=R)
replace_5 = ReplacePaths(Data=D_4, Search=tstat_4.Paths, Replace=R)
replace_6 = ReplacePaths(Data=D_5, Search=tstat_5.Paths, Replace=R)
replace_7 = ReplacePaths(Data=D_6, Search=tstat_6.Paths, Replace=R)
D_7 = ClusterOutput(replace)
D_8 = ClusterOutput(replace_2)
D_9 = ClusterOutput(replace_3)
D_10 = ClusterOutput(replace_4)
D_11 = ClusterOutput(replace_5)
D_12 = ClusterOutput(replace_6)
D_13 = ClusterOutput(replace_7)

# ==== cluster Cluster_59
num = ClusterInput()
num_2 = Number(0)
num_3 = ClusterInput()
F = ClusterInput()
panel = Panel(num_2)
num_4 = Number(num_3)
Z = UnitZ(Factor=expr("-x", F))
Z_2 = UnitZ(Factor=num_4)
num_5 = ClusterInput()
num_6 = ClusterInput()
num_7 = ClusterInput()
num_8 = ClusterInput()
G = ClusterInput()
cluster = Cluster_55(G=G)  # -> simplify(i)
num_9 = Number(num_5)
num_10 = Number(num_6)
num_11 = Number(num_7)
num_12 = Number(num_8)
addition = Addition(A=Z, B=Z_2)
Z_3 = UnitZ(Factor=0)
cluster_2 = Cluster_56(G=G)  # -> simplify(i)
G_2 = ClusterInput()
caja_foso_ascensor = Panel("0.25")
caja_shafts = Panel("0.03")
caja_escaleras = Panel("0.13")
pln = Plane(cluster)
filter = StreamFilter(Gate=panel, Stream0=addition, Stream1=Z, Stream2=Z_3)
project = Project(Geometry=cluster, Plane=pln)  # -> Geometry, Transform
area = Area(Geometry=G_2)  # -> Area, Centroid
crv = Curve(G_2)
pdecon = Deconstruct(Point=area.Centroid)  # -> XComponent, YComponent, ZComponent
move = Move(Geometry=project.Geometry, Motion=filter)  # -> Geometry, Transform
dom = ConstructDomain(DomainStart=expr("x/2", num_9), DomainEnd=expr("-x/2", num_9))
dom_2 = ConstructDomain(DomainStart=expr("x/2", num_10), DomainEnd=expr("-x/2", num_10))
dom_3 = ConstructDomain(DomainStart=expr("x/2", num_11), DomainEnd=expr("-x/2", num_11))
dom_4 = ConstructDomain(DomainStart=expr("x/2", num_12), DomainEnd=expr("-x/2", num_12))
multiplication = Multiplication(A=num_9, B=num_10)
multiplication_2 = Multiplication(A=num_11, B=num_12)
area_2 = Area(Geometry=move.Geometry)  # -> Area, Centroid
area_3 = Area(Geometry=cluster_2)  # -> Area, Centroid
wip_1000m2 = Panel(multiplication)
rango_sup_planta_m2 = Panel("1000")
wip_1000m2_2 = Panel(multiplication_2)
larger = LargerThan(FirstNumber=area_2.Area, SecondNumber=rango_sup_planta_m2)  # -> LargerThan, OrEqualTo
clean = CleanTree(RemoveNulls=True, RemoveInvalid=True, RemoveEmpty=False, Tree=area_2.Area)
subtraction = Subtraction(A=addition, B=filter)
multiplication_3 = Multiplication(A=wip_1000m2, B=caja_foso_ascensor)
multiplication_4 = Multiplication(A=wip_1000m2, B=caja_shafts)
multiplication_5 = Multiplication(A=wip_1000m2, B=caja_escaleras)
multiplication_6 = Multiplication(A=wip_1000m2_2, B=caja_foso_ascensor)
multiplication_7 = Multiplication(A=wip_1000m2_2, B=caja_shafts)
multiplication_8 = Multiplication(A=wip_1000m2_2, B=caja_escaleras)
dispatch = Dispatch(List=area_2.Centroid, DispatchPattern=larger.LargerThan)  # -> ListA, ListB
merge = Merge(Data1=dispatch.ListB, Data2=dispatch.ListA)  # -> flatten(Result)
ma = MassAddition(Input=[caja_foso_ascensor, caja_shafts, caja_escaleras])  # -> Result, PartialResults
dispatch_2 = Dispatch(List=area_3.Centroid, DispatchPattern=larger.LargerThan)  # -> ListA, ListB
larger_2 = LargerThan(FirstNumber=clean, SecondNumber=rango_sup_planta_m2)  # -> LargerThan, OrEqualTo
devec = DeconstructVector(Vector=merge)  # -> XComponent, YComponent, ZComponent
ma_2 = MassAddition(Input=[multiplication_3, multiplication_4, multiplication_5])  # -> Result, PartialResults
multiplication_9 = Multiplication(A=wip_1000m2_2, B=ma.Result)
ma_3 = MassAddition(Input=[multiplication_6, multiplication_7, multiplication_8])  # -> Result, PartialResults
pdecon_2 = Deconstruct(Point=dispatch.ListA)  # -> XComponent, YComponent, ZComponent
pdecon_3 = Deconstruct(Point=dispatch.ListB)  # -> XComponent, YComponent, ZComponent
cset = CreateSet(List=devec.ZComponent)  # -> Set, Map
subtraction_2 = Subtraction(A=wip_1000m2, B=ma_2.Result)
subtraction_3 = Subtraction(A=wip_1000m2_2, B=ma_3.Result)
ma_4 = MassAddition(Input=[caja_foso_ascensor, caja_shafts, caja_escaleras])  # -> Result, PartialResults
ma_5 = MassAddition(Input=[caja_foso_ascensor, caja_shafts, caja_escaleras])  # -> Result, PartialResults
circulacion_neta = Panel(subtraction_2)
rectangle = Rectangle(Plane=dispatch.ListB, XSize=dom, YSize=dom_2, Radius=0)  # -> Rectangle, Length
rectangle_2 = Rectangle(Plane=dispatch.ListA, XSize=dom_3, YSize=dom_4, Radius=0)  # -> Rectangle, Length
pdecon_4 = Deconstruct(Point=dispatch_2.ListB)  # -> XComponent, YComponent, ZComponent
pdecon_5 = Deconstruct(Point=dispatch_2.ListA)  # -> XComponent, YComponent, ZComponent
addition_2 = Addition(A=pdecon.ZComponent, B=flatten(pdecon_2.ZComponent))
addition_3 = Addition(A=pdecon.ZComponent, B=flatten(pdecon_3.ZComponent))
circulacion_neta_2 = Panel(subtraction_3)
Z_4 = UnitZ(Factor=cset.Set)
Z_5 = UnitZ(Factor=addition_3)
Z_6 = UnitZ(Factor=addition_2)
move_2 = Move(Geometry=G_2, Motion=Z_4)  # -> Geometry, Transform
expression = Expression(x=larger_2.LargerThan, y=multiplication_3, z=multiplication_6, Expression="if(x=true, z, y)")  # -> graft(R)
expression_2 = Expression(x=larger_2.LargerThan, y=multiplication_4, z=multiplication_7, Expression="if(x=true, z, y)")  # -> graft(R)
expression_3 = Expression(x=larger_2.LargerThan, y=multiplication_5, z=multiplication_8, Expression="if(x=true, z, y)")  # -> graft(R)
expression_4 = Expression(x=larger_2.LargerThan, y=ma_2.Result, z=ma_3.Result, Expression="if(x=true, z, y)")  # -> graft(R)
expression_5 = Expression(x=larger_2.LargerThan, y=subtraction_2, z=subtraction_3, Expression="if(x=true, z, y)")  # -> graft(R)
neg = Negative(Value=pdecon_2.ZComponent)
neg_2 = Negative(Value=pdecon_3.ZComponent)
move_3 = Move(Geometry=G_2, Motion=Z_4)  # -> Geometry, Transform
sqrt = SquareRoot(Value=ma_4.Result)
sqrt_2 = SquareRoot(Value=ma_5.Result)
addition_4 = Addition(A=pdecon_4.ZComponent, B=neg_2)
pt = Point(dispatch.ListB)
pt_2 = Point(dispatch.ListA)
addition_5 = Addition(A=pdecon_5.ZComponent, B=neg)
cluster_3 = Cluster_58(C=move_2.Geometry, G=rectangle.Rectangle, pt=dispatch.ListB)  # -> simplify(G_2)
cluster_4 = Cluster_58(C=move_3.Geometry, G=rectangle_2.Rectangle, pt=dispatch.ListA)
number_slider = Slider(0.549, range=0..1)
circulaciones = Number(expression_5)
vacios = Number(expression_4)
shafts_int = Number(expression_2)
ascensores = Number(expression)
escaleras = Number(expression_3)
line = LineSDL(Start=pt_2, Direction=Vector(0, 0, 1), Length=addition_5)
line_2 = LineSDL(Start=pt, Direction=Vector(0, 0, 1), Length=addition_4)
circulaciones_2 = ClusterOutput(circulaciones)
vacios_2 = ClusterOutput(vacios)
ascensores_2 = ClusterOutput(ascensores)
shafts_int_2 = ClusterOutput(shafts_int)
escaleras_2 = ClusterOutput(escaleras)
scale = Scale(Geometry=cluster_3, Center=dispatch.ListB, Factor=sqrt_2)  # -> Geometry, Transform
scale_2 = Scale(Geometry=cluster_4, Center=dispatch.ListA, Factor=sqrt)  # -> Geometry, Transform
area_4 = Area(Geometry=scale.Geometry)  # -> flatten(Area), Centroid
panel_2 = Panel(circulaciones)
panel_3 = Panel(escaleras)
merge_2 = Merge(Data1=scale.Geometry, Data2=scale_2.Geometry)
panel_4 = Panel(cluster_3)
subtraction_4 = Subtraction(A=Z_2, B=subtraction)
sobrerecorrido = Panel("2.5")
R = ClusterOutput(merge_2)
Z_7 = UnitZ(Factor=subtraction_4)
Z_8 = UnitZ(Factor=pdecon_4.ZComponent)
Z_9 = UnitZ(Factor=pdecon_5.ZComponent)
Z_10 = UnitZ(Factor=sobrerecorrido)
addition_6 = Addition(A=Z_8, B=Z_10)
addition_7 = Addition(A=Z_9, B=Z_10)
extr = Extrude(Base=scale.Geometry, Direction=line_2)
extr_2 = Extrude(Base=scale_2.Geometry, Direction=line)
cap = CapHoles(Brep=extr)  # -> simplify(Brep)
cap_2 = CapHoles(Brep=extr_2)  # -> simplify(Brep)
panel_5 = Panel(cap_2)
merge_3 = Merge(Data1=cap, Data2=cap_2)  # -> flatten(Result)
cluster_5 = Cluster_57(B=merge_3)  # -> simplify(i)
i = ClusterOutput(cluster_5)
R_2 = ClusterOutput(merge_3)

# ==== cluster Cluster_60
num = ClusterInput()
R = ClusterInput()
num_2 = Number(num)
tstat = TreeStatistics(Tree=num_2)  # -> Paths, Length, Count
replace = ReplacePaths(Data=num_2, Search=tstat.Paths, Replace=R)
D = ClusterOutput(replace)

# ==== cluster Cluster_63
circulaciones_vanos = ClusterInput()
brep = ClusterInput()
num = ClusterInput()
num_2 = ClusterInput()
num_3 = ClusterInput()
brep_2 = Brep(brep)
num_4 = Number(num_2)
num_5 = Number(num)
num_6 = Number(num_3)
panel = Panel(num_5)
panel_2 = Panel("""-1
0""")
panel_3 = Panel("""1
2
3
4""")
circulaciones_vanos_2 = Number(circulaciones_vanos)
branch = TreeBranch(Tree=brep_2, Path=panel_2, MaintainPaths=True)
branch_2 = TreeBranch(Tree=brep_2, Path=panel_3, MaintainPaths=True)
ma = MassAddition(Input=flatten(circulaciones_vanos_2))  # -> Result, PartialResults
clean = CleanTree(RemoveNulls=True, RemoveInvalid=True, RemoveEmpty=True, Tree=branch)
clean_2 = CleanTree(RemoveNulls=True, RemoveInvalid=True, RemoveEmpty=True, Tree=branch_2)
num_7 = Number(panel)
item = ListItem(List=num_6, Index=0, Wrap=True)  # -> Item, Item1, Item2, Item3
lng = ListLength(List=clean_2)
lng_2 = ListLength(List=clean)
num_8 = Number(num_7)
branch_3 = TreeBranch(Tree=item.Item3, Path="{-2}", MaintainPaths=True)
series = Series(Start=ma.Result, Step=0, Count=lng_2)  # -> simplify(Series)
series_2 = Series(Start=circulaciones_vanos_2, Step=0, Count=lng)  # -> simplify(Series)
tstat = TreeStatistics(Tree=brep_2)  # -> Paths, Length, Count
cset = CreateSet(List=item.Item)  # -> Set, Map
cset_2 = CreateSet(List=item.Item1)  # -> Set, Map
cset_3 = CreateSet(List=item.Item2)  # -> Set, Map
cset_4 = CreateSet(List=branch_3)  # -> Set, Map
cluster = Cluster_62(T=clean, relay=series)
cluster_2 = Cluster_62(T=lng, relay=series_2)
merge = Merge(Data1=cluster, Data2=cluster_2)
num_9 = Number(num_2)
mindex = MemberIndex(Set=cset_4.Set, Member=num_8)  # -> Index, Count
mindex_2 = MemberIndex(Set=cset.Set, Member=num_8)  # -> Index, Count
mindex_3 = MemberIndex(Set=cset_2.Set, Member=num_8)  # -> Index, Count
mindex_4 = MemberIndex(Set=cset_3.Set, Member=num_8)  # -> Index, Count
mindex_5 = MemberIndex(Set=mindex_2.Count, Member=1)  # -> Index, Count
mindex_6 = MemberIndex(Set=mindex_3.Count, Member=1)  # -> Index, Count
mindex_7 = MemberIndex(Set=mindex_4.Count, Member=1)  # -> Index, Count
mindex_8 = MemberIndex(Set=mindex.Count, Member=1)  # -> Index, Count
panel_4 = Panel(merge)
item_2 = ListItem(List=num_9, Index=mindex_5.Index, Wrap=True)  # -> simplify(Item)
item_3 = ListItem(List=num_9, Index=mindex_6.Index, Wrap=True)  # -> simplify(Item)
item_4 = ListItem(List=num_9, Index=mindex_7.Index, Wrap=True)  # -> simplify(Item)
item_5 = ListItem(List=num_9, Index=mindex_8.Index, Wrap=True)  # -> simplify(Item)
panel_5 = Panel(tstat.Paths)
brep_3 = Brep(brep_2)
clean_3 = CleanTree(RemoveNulls=True, RemoveInvalid=True, RemoveEmpty=True, Tree=item_5)
panel_6 = Panel(mindex_7.Index)
item_6 = ListItem(List=num_8, Index=mindex_5.Index, Wrap=True)  # -> simplify(Item)
item_7 = ListItem(List=num_8, Index=mindex_6.Index, Wrap=True)  # -> simplify(Item)
item_8 = ListItem(List=num_8, Index=mindex_7.Index, Wrap=True)  # -> simplify(Item)
item_9 = ListItem(List=num_8, Index=mindex_8.Index, Wrap=True)  # -> simplify(Item)
item_10 = TreeItem(Tree=brep_3, Path=graft(panel_5), Index=mindex_8.Index, Wrap=True)  # -> simplify(BrepRet)
item_11 = TreeItem(Tree=brep_3, Path=graft(panel_5), Index=mindex_5.Index, Wrap=True)  # -> simplify(BrepRes)
item_12 = TreeItem(Tree=brep_3, Path=graft(panel_5), Index=mindex_7.Index, Wrap=True)  # -> simplify(BrepRet)
item_13 = TreeItem(Tree=brep_3, Path=graft(panel_5), Index=mindex_6.Index, Wrap=True)  # -> simplify(BrepOfi)
clean_4 = CleanTree(RemoveNulls=True, RemoveInvalid=True, RemoveEmpty=True, Tree=item_9)
Z = UnitZ(Factor=item_6)
Z_2 = UnitZ(Factor=item_7)
Z_3 = UnitZ(Factor=item_8)
Z_4 = UnitZ(Factor=clean_4)
clean_5 = CleanTree(RemoveNulls=True, RemoveInvalid=True, RemoveEmpty=True, Tree=item_10)
clean_6 = CleanTree(RemoveNulls=True, RemoveInvalid=True, RemoveEmpty=True, Tree=clean_5)
num_10 = Number(item_2)
num_11 = Number(item_3)
num_12 = Number(item_4)
num_13 = Number(clean_3)
extr = Extrude(Base=item_11, Direction=Z)
extr_2 = Extrude(Base=item_13, Direction=Z_2)
extr_3 = Extrude(Base=item_12, Direction=Z_3)
extr_4 = Extrude(Base=clean_5, Direction=Z_4)
planta_res = Brep(item_11)
planta_ret = Brep(item_12)
planta_ofi = Brep(item_13)
planta_est = Brep(clean_6)
I = ClusterOutput(mindex_5.Index)
num_14 = ClusterOutput(num_10)
I_2 = ClusterOutput(mindex_6.Index)
num_15 = ClusterOutput(num_11)
I_3 = ClusterOutput(mindex_7.Index)
num_16 = ClusterOutput(num_12)
I_4 = ClusterOutput(mindex_8.Index)
num_17 = ClusterOutput(num_13)
cluster_3 = Cluster_61(relay=planta_est, T=extr_4)
panel_7 = Panel(item_13)
E = ClusterOutput(extr)
E_2 = ClusterOutput(extr_4)
planta_ret_2 = ClusterOutput(planta_ret)
planta_res_2 = ClusterOutput(planta_res)
D = ClusterOutput(cluster_3)
E_3 = ClusterOutput(extr_3)
planta_ofi_2 = ClusterOutput(planta_ofi)
E_4 = ClusterOutput(extr_2)
area = Area(Geometry=item_3)  # -> Area, Centroid

# ==== cluster Cluster_64
srf = ClusterInput()
A = ClusterInput()
B = ClusterInput()
srf_2 = Surface(srf)
multiplication = Multiplication(A=A, B=B)
area = Area(Geometry=srf_2)  # -> Area, Centroid
area_2 = Area(Geometry=srf_2)  # -> Area, Centroid
division = Division(A=area.Area, B=B)
B_2 = ClusterInput()
round = Round(Number=division)  # -> Nearest, Floor, Ceiling
division_2 = Division(A=A, B=round.Floor)
multiplication_2 = Multiplication(A=round.Floor, B=division_2)
round_2 = Round(Number=division_2)  # -> Nearest, Floor, Ceiling
series = Series(Start=round.Floor, Step=0, Count=round_2.Floor)
series_2 = Series(Start=area.Area, Step=0, Count=round_2.Floor)
subtraction = Subtraction(A=division_2, B=round_2.Floor)
multiplication_3 = Multiplication(A=area.Area, B=subtraction)
addition = Addition(A=round_2.Floor, B=1)
equals = Equality(FirstNumber=round_2.Floor, SecondNumber=0)  # -> Equality, Inequality
multiplication_4 = Multiplication(A=subtraction, B=round.Floor)
ins = InsertItems(List=series, Item=multiplication_4, Indices=-1, Wrap=True)
ins_2 = InsertItems(List=series_2, Item=multiplication_3, Indices=-1, Wrap=True)
ins_3 = InsertItems(List=series_2, Item=multiplication_3, Indices=-1, Wrap=True)
filter = StreamFilter(Gate=equals.Equality, Stream0=ins, Stream1=round.Floor)
num = Number(addition)
lng = ListLength(List=ins_3)
niveles_subterraneos = Panel(addition)
series_3 = Series(Start=area.Area, Step=0, Count=lng)
addition_2 = Addition(A=num, B=1)
subtraction_2 = Subtraction(A=series_3, B=ins_2)
multiplication_5 = Multiplication(A=num, B=B_2)
L = ClusterOutput(ins_2)
neg = Negative(Value=multiplication_5)
R = ClusterOutput(subtraction_2)
Z = UnitZ(Factor=neg)
num_2 = ClusterOutput(num)
move = Move(Geometry=srf_2, Motion=Z)  # -> Geometry, Transform
area_3 = Area(Geometry=move.Geometry)  # -> Area, Centroid
ln = Line(StartPoint=area_2.Centroid, EndPoint=area_3.Centroid)
len = Length(Curve=ln)
L_2 = ClusterOutput(len)
arrcurve = CurveArray(Geometry=srf_2, Curve=ln, Count=graft(addition_2))  # -> Geometry, Transform
tstat = TreeStatistics(Tree=arrcurve.Geometry)  # -> Paths, Length, Count
area_4 = Area(Geometry=arrcurve.Geometry)  # -> Area, Centroid
replace = ReplacePaths(Data=arrcurve.Geometry, Search=tstat.Paths, Replace="{-2}")
cull_i = CullIndex(List=replace, Indices=0, Wrap=True)
division_3 = Division(A=area_4.Area, B=B)
area_5 = Area(Geometry=cull_i)  # -> Area, Centroid
round_3 = Round(Number=division_3)  # -> Nearest, Floor, Ceiling
item = ListItem(List=replace, Index=1, Wrap=True)
Z_2 = UnitZ(Factor=ln)
area_6 = Area(Geometry=replace)  # -> Area, Centroid
item_2 = ListItem(List=replace, Index=0, Wrap=True)
division_4 = Division(A=area_5.Area, B=B)
int = Integer(division_4)
cull_i_2 = CullIndex(List=replace, Indices=0, Wrap=True)
ma = MassAddition(Input=round_3.Nearest)  # -> Result, PartialResults
cull_i_3 = CullIndex(List=area_6.Area, Indices=-1, Wrap=True)  # -> simplify(List)
neg_2 = Negative(Value=Z_2)
area_7 = Area(Geometry=item_2)  # -> Area, Centroid
area_8 = Area(Geometry=item)  # -> Area, Centroid
extr = Extrude(Base=item_2, Direction=neg_2)
ma_2 = MassAddition(Input=filter)  # -> Result, PartialResults
path_mapper = PathMapper(cull_i_3, source="{A;B}", target="{A}")
ln_2 = Line(StartPoint=graft(area_7.Centroid), EndPoint=graft(area_8.Centroid))  # -> simplify(Line)
path_mapper_2 = PathMapper(cull_i_2, source="{A;B}(i)", target="{A}")
area_9 = Area(Geometry=cull_i_2)  # -> Area, Centroid
path_mapper_3 = ClusterOutput(path_mapper)
cap = CapHoles(Brep=extr)
int_2 = ClusterOutput(filter)
R_2 = ClusterOutput(ma_2.Result)
len_2 = Length(Curve=ln_2)  # -> flatten(Length)
line = LineSDL(Start=area_9.Centroid, Direction=Vector(0, 0, 1), Length=len_2)
area_10 = Area(Geometry=cull_i_2)  # -> Area, Centroid
path_mapper_4 = ClusterOutput(path_mapper_2)
cull_i_4 = CullIndex(List=line, Indices=-1, Wrap=True)
B_3 = ClusterOutput(cap)
item_3 = ListItem(List=cull_i_4, Index=-1, Wrap=True)
D = ClusterOutput(replace)
len_3 = Length(Curve=line)
path_mapper_5 = PathMapper(len_3, source="{A;B}", target="{A}")
path_mapper_6 = ClusterOutput(path_mapper_5)

# ==== cluster Cluster_65
d1 = ClusterInput()
d2 = ClusterInput()
d3 = ClusterInput()
d4 = ClusterInput()
merge = Merge(Data1=d1, Data2=d2, Data3=d3, Data4=d4)
tstat = TreeStatistics(Tree=merge)  # -> Paths, Length, Count
listdexs = ListIndices(List=tstat.Paths)
num = Number(expr("x+1", listdexs))
concat = Concatenate(FragmentA="Torre ", FragmentB=num)  # -> simplify(graft(Result))
tstat_2 = TreeStatistics(Tree=concat)  # -> Paths, Length, Count
replace = ReplacePaths(Data=concat, Search=tstat_2.Paths, Replace=tstat.Paths)
D = ClusterOutput(replace)

# ==== cluster Cluster_66
T = ClusterInput()
panel = Panel("""{-1}
{0}""")
branch = TreeBranch(Tree=T, Path=panel, MaintainPaths=True)
clean = CleanTree(RemoveNulls=True, RemoveInvalid=True, RemoveEmpty=True, Tree=branch)
tstat = TreeStatistics(Tree=clean)  # -> Paths, Length, Count
panel_2 = Panel("""SUBTERRANEO
PODIO""")
txt = Text(flatten(tstat.Paths))
txt_2 = Text(panel)
dpath = DeconstructPath(Branch=tstat.Paths)  # -> flatten(Indices)
replace = ReplaceMembers(Set=txt, Find=txt_2, Replace=panel_2)  # -> simplify(graft(Result))
tstat_2 = TreeStatistics(Tree=replace)  # -> Paths, Length, Count
replace_2 = ReplacePaths(Data=replace, Search=tstat_2.Paths, Replace=dpath)
D = ClusterOutput(replace_2)

# ==== cluster Cluster_67
L = ClusterInput()
M = ClusterInput()
listdexs = ListIndices(List=L)
mindex = MemberIndex(Set=listdexs, Member=M)  # -> Index, Count
item = ListItem(List=listdexs, Index=-1, Wrap=True)
null = NullItem(Item=mindex.Index)  # -> NullFlags, InvalidFlags, Description
filter = StreamFilter(Gate=null.NullFlags, Stream0=mindex.Index, Stream1=item)
tstat = TreeStatistics(Tree=filter)  # -> Paths, Length, Count
replace = ReplacePaths(Data=filter, Search=tstat.Paths, Replace=M)
panel = Panel(replace)
s_0 = ClusterOutput(filter)

# ==== cluster Cluster_68
T = ClusterInput()
R = ClusterInput()
tstat = TreeStatistics(Tree=T)  # -> Paths, Length, Count
replace = ReplacePaths(Data=T, Search=tstat.Paths, Replace=R)
D = ClusterOutput(replace)

# ==== cluster Cluster_70
pt = ClusterInput()
C = ClusterInput()
pt_2 = Point(pt)
G = ClusterInput()
_0 = ClusterInput()
_2 = ClusterInput()
d1 = ClusterInput()
d2 = ClusterInput()
X = ClusterInput()
Y = ClusterInput()
merge = Merge(Data1=d1, Data2=d2)  # -> flatten(Result)
filter = StreamFilter(Gate=G, Stream0=_0, Stream1=0, Stream2=_2)
area = Area(Geometry=merge)  # -> Area, Centroid
pdecon = Deconstruct(Point=area.Centroid)  # -> XComponent, YComponent, ZComponent
sort = SortList(Keys=pdecon.ZComponent, ValuesA=pdecon.ZComponent)  # -> Keys, ValuesA
item = ListItem(List=sort.ValuesA, Index=0, Wrap=True)
Z = UnitZ(Factor=item)
Z_2 = UnitZ(Factor=filter)
move = Move(Geometry=pt_2, Motion=Z_2)  # -> Geometry, Transform
move_2 = Move(Geometry=pt_2, Motion=Z)  # -> Geometry, Transform
rectangle = Rectangle(Plane=move_2.Geometry, XSize=X, YSize=Y, Radius=0)  # -> Rectangle, Length
crv = Curve(rectangle.Rectangle)
cluster = Cluster_69(G=crv, C=C, pt=pt_2)
crv_2 = Curve(cluster)
crv_3 = ClusterOutput(crv_2)
ln = Line(StartPoint=move_2.Geometry, EndPoint=move.Geometry)
devec = DeconstructVector(Vector=ln)  # -> XComponent, YComponent, ZComponent
extr = Extrude(Base=crv_2, Direction=ln)
panel = Panel(devec.ZComponent)
cap = CapHoles(Brep=extr)
B = ClusterOutput(cap)

# ==== cluster Cluster_71
brep = ClusterInput()
T = ClusterInput()
brep_2 = Brep(flatten(brep))
tstat = TreeStatistics(Tree=brep_2)  # -> Paths, Length, Count
replace = ReplacePaths(Data=brep_2, Search=tstat.Paths, Replace="-2")
D = ClusterOutput(replace)

# ==== cluster Cluster_72
S = ClusterInput()
T = ClusterInput()
trim = TrimSolid(Shape=S, Cutters=T)
R = ClusterOutput(trim)

# ==== cluster Cluster_73
brep = ClusterInput()
input = ClusterInput()
brep_2 = Brep(simplify(brep))
debrep = DeconstructBrep(Brep=brep_2)  # -> Faces, Edges, Vertices
tstat = TreeStatistics(Tree=brep_2)  # -> Paths, Length, Count
area = Area(Geometry=debrep.Faces)  # -> Area, Centroid
pdecon = Deconstruct(Point=area.Centroid)  # -> XComponent, YComponent, ZComponent
sort = SortList(Keys=pdecon.ZComponent, ValuesA=debrep.Faces)  # -> Keys, ValuesA
item = ListItem(List=sort.ValuesA, Index=-1, Wrap=True)  # -> simplify(Item)
A = ClusterInput()
area_2 = Area(Geometry=item)  # -> Area, Centroid
equals = Equality(FirstNumber=A, SecondNumber=2)  # -> Equality, Inequality
pdecon_2 = Deconstruct(Point=area_2.Centroid)  # -> XComponent, YComponent, ZComponent
num = Number(flatten(pdecon_2.ZComponent))
tstat_2 = TreeStatistics(Tree=pdecon_2.ZComponent)  # -> Paths, Length, Count
sort_2 = SortList(Keys=num, ValuesA=num)  # -> Keys, ValuesA
filter = StreamFilter(Gate=equals.Equality, Stream0=item)
item_2 = ListItem(List=sort_2.ValuesA, Index=0, Wrap=True)
tstat_3 = TreeStatistics(Tree=filter)  # -> Paths, Length, Count
mindex = MemberIndex(Set=num, Member=item_2)  # -> Index, Count
cull_i = CullIndex(List=tstat_2.Paths, Indices=mindex.Index, Wrap=True)
replace = ReplacePaths(Data=filter, Search=tstat_3.Paths, Replace=tstat.Paths)
branch = TreeBranch(Tree=item, Path=cull_i, MaintainPaths=True)
D = ClusterOutput(replace)

# ==== cluster Cluster_78
num = ClusterInput()
srf = ClusterInput()
tstat = TreeStatistics(Tree=srf)  # -> Paths, Length, Count
num_2 = ClusterInput()
num_3 = Number(num)
A = ClusterInput()
num_4 = Number(num_2)
num_5 = ClusterInput()
srf_2 = Surface(simplify(srf))
item = ListItem(List=num_3, Index=0, Wrap=True)
item_2 = ListItem(List=num_3, Index=1, Wrap=True)
item_3 = ListItem(List=num_3, Index=2, Wrap=True)
num_6 = Number(item_3)
num_7 = Number(num_5)
item_4 = ListItem(List=num_4, Index=item_2, Wrap=True)
item_5 = ListItem(List=num_4, Index=item, Wrap=True)
area = Area(Geometry=srf_2)  # -> Area, Centroid
x = ClusterInput()
pdecon = Deconstruct(Point=area.Centroid)  # -> XComponent, YComponent, ZComponent
B = ClusterInput()
subtraction = Subtraction(A=A, B=pdecon.ZComponent)
integer_division = IntegerDivision(A=subtraction, B=item_5)
expression = Expression(x=reverse(x), y=integer_division, Expression="if (x≤y, x, y)")
panel = Panel(srf_2)
srf_3 = Surface(srf_2)
area_2 = Area(Geometry=srf_3)  # -> Area, Centroid
multiplication = Multiplication(A=item_5, B=expression)
addition = Addition(A=expression, B=1)
line = LineSDL(Start=area_2.Centroid, Direction=Vector(0, 0, 1), Length=multiplication)  # -> simplify(Line)
panel_2 = Panel(line)
arrcurve = CurveArray(Geometry=srf_3, Curve=line, Count=addition)  # -> simplify(Geometry), Transform
cluster = Cluster_77(T=line, D=arrcurve.Geometry)
cluster_2 = Cluster_37(crv=arrcurve.Geometry)
cluster_3 = Cluster_76(relay=cluster)
tstat_2 = TreeStatistics(Tree=srf_2)  # -> Paths, Length, Count
cluster_4 = Cluster_74(relay=srf_2, srf=cluster_3, D=line)  # -> Z, B, A, D_2
tstat_3 = TreeStatistics(Tree=cluster_3)  # -> Paths, Length, Count
branch = TreeBranch(Tree=item_5, Path=tstat_3.Paths, MaintainPaths=True)
panel_4 = Panel(cluster_2)
num_8 = Number(cluster_4.A)
sunion = SolidUnion(Breps=cluster_4.B)  # -> simplify(Result)
cluster_5 = Cluster_37()
L = ClusterOutput(cluster_3)
cluster_6 = Cluster_36(R=tstat_2.Paths, I=num_8)
merge = Merge(Data2=cluster_4.D_2)
area_3 = Area(Geometry=merge)  # -> Area, Centroid
path_mapper = PathMapper(source="{A;B}", target="{A}")
line_2 = LineSDL(Start=area_3.Centroid, Direction=Vector(0, 0, 1), Length=branch)
cap = CapHoles(Brep=sunion)
panel_5 = Panel(cluster_5)
cluster_7 = Cluster_75(R=tstat_3.Paths, D=cap)
cluster_8 = REMAP(R=tstat_2.Paths, D=line_2)
cluster_9 = Cluster_2(B=cap)
panel_6 = Panel(merge)
panel_7 = Panel(cluster_7)
cluster_10 = Cluster_75(R=tstat_2.Paths, D=merge)
Z = ClusterOutput(cluster_9)
D = ClusterOutput(cluster_7)
len = Length(Curve=cluster_8)  # -> simplify(Length)
area_4 = Area(Geometry=cluster_10)  # -> Area, Centroid
D_2 = ClusterOutput(cluster_10)
ma = MassAddition(Input=flatten(num_4))  # -> Result, PartialResults
panel_8 = Panel(len)
L_2 = ClusterOutput(len)
ma_2 = MassAddition(Input=flatten(area_4.Area))  # -> Result, PartialResults
equals = Equality(FirstNumber=ma.Result, SecondNumber=0)  # -> Equality, Inequality
filter = StreamFilter(Gate=equals.Equality, Stream0=0, Stream1=ma_2.Result)
panel_9 = Panel(filter)
s_0 = ClusterOutput(filter)

# ==== cluster CorreccionVolumenesSobreNivel
i = ClusterInput()
brep = ClusterInput()
brep_2 = Brep(brep)
cluster = Cluster_79(i=i, B=brep_2)  # -> i_2, flatten(Z)
listdexs = ListIndices(List=brep_2)
lng = ListLength(List=brep_2)
_0 = ClusterInput()
equals = Equality(FirstNumber=lng, SecondNumber=1)  # -> Equality, Inequality
filter = StreamFilter(Gate=equals.Equality, Stream0=_0, Stream1=0)
clean = CleanTree(RemoveNulls=True, RemoveInvalid=True, RemoveEmpty=False, Tree=cluster.Z)
clean_2 = CleanTree(RemoveNulls=True, RemoveInvalid=True, RemoveEmpty=False, Tree=brep_2)
listdexs_2 = ListIndices(List=clean)
item = ListItem(List=brep_2, Index=Slider(3, range=0..4), Wrap=True)
sort = SortList(Keys=clean, ValuesA=flatten(clean_2))  # -> Keys, ValuesA
sort_2 = SortList(Keys=clean, ValuesA=clean)  # -> Keys, ValuesA
item_2 = ListItem(List=sort_2.Keys, Index=0, Wrap=True)
item_3 = ListItem(List=brep_2, Index=filter, Wrap=True)
cull_i = CullIndex(List=listdexs, Indices=filter, Wrap=True)
cull_i_2 = CullIndex(List=listdexs_2, Indices=filter, Wrap=True)
item_4 = ListItem(List=brep_2, Index=cull_i_2, Wrap=True)  # -> simplify(graft(Item))
fmerge = MergeFaces(Brep=item_4)  # -> Breps, Before, After
bang = ExplodeTree(Data=fmerge.Breps)  # -> Branch0, Branch1, Branch2, Branch3
brep_3 = Brep(bang.Branch2)
brep_4 = Brep(bang.Branch1)
brep_5 = Brep(bang.Branch0)
cluster_2 = Cluster_80(B=brep_4)  # -> S, Z
cluster_3 = Cluster_80(B=item_3)  # -> S, Z
cluster_4 = Cluster_80(B=brep_5)  # -> S, Z
cluster_5 = Cluster_80(B=brep_3)  # -> S, Z
listdexs_3 = ListIndices(List=brep_2)
cluster_6 = Cluster_84(L=item_2, B=item_3)  # -> B_2, S, Z
cluster_7 = Cluster_83(crv=cluster_2.S, E=cluster_2.S, A=item_2)
cluster_8 = Cluster_83(crv=cluster_5.S, E=cluster_5.S, A=item_2)
cluster_9 = Cluster_83(crv=cluster_4.S, E=cluster_4.S, A=item_2)
item_5 = ListItem(List=sort.Keys, Index=-1, Wrap=True)
cluster_10 = Cluster_83(crv=cluster_3.S, E=cluster_3.S, A=item_2)
T = ClusterInput()
replace = ReplaceItems(List=listdexs_3, Indices=listdexs_3, Wrap=False)
Z = UnitZ(Factor=item_5)
extr = Extrude(Base=cluster_10, Direction=Z)  # -> flatten(Extrusion)
extr_2 = Extrude(Base=cluster_9, Direction=Z)  # -> flatten(Extrusion)
extr_3 = Extrude(Base=cluster_8, Direction=Z)  # -> flatten(Extrusion)
extr_4 = Extrude(Base=cluster_7, Direction=Z)  # -> flatten(Extrusion)
brep_6 = Brep()
item_6 = ListItem(List=sort.Keys, Index=0, Wrap=True)
branch = TreeBranch(Tree=T, Path=filter, MaintainPaths=True)
branch_2 = TreeBranch(Tree=T, Path=cull_i, MaintainPaths=True)
merge = Merge(Data1=extr_2, Data2=extr_4, Data3=extr_3)
sdiff = SolidDifference(BrepsA=brep_5, BrepsB=extr)
sdiff_2 = SolidDifference(BrepsA=brep_4, BrepsB=extr)
sdiff_3 = SolidDifference(BrepsA=brep_3, BrepsB=extr)
merge_2 = Merge(Data1=merge, Data2=extr)  # -> flatten(Result)
division = Division(A=item_6, B=2)
trim = TrimSolid(Shape=branch_2, Cutters=merge_2)
merge_3 = Merge(Data1=sdiff, Data2=sdiff_2, Data3=sdiff_3)
panel = Panel(sdiff_3)
join = BrepJoin(Breps=flatten(merge))  # -> Breps, Closed
merge_4 = Merge(Data1=cluster_10)
Z_2 = UnitZ(Factor=division)
path_mapper = PathMapper(trim, source="{A;B}(i)", target="{A}")
sdiff_4 = SolidDifference(BrepsA=[brep_5, brep_4, brep_3], BrepsB=merge)
sdiff_5 = SolidDifference(BrepsA=merge_3, BrepsB=merge)  # -> flatten(Result)
replace_2 = ReplaceItems(List=replace, Item=item_3, Indices=filter, Wrap=False)
move = Move(Geometry=merge_4, Motion=Z_2)  # -> Geometry, Transform
clean_3 = CleanTree(RemoveNulls=True, RemoveInvalid=True, RemoveEmpty=False, Tree=sdiff_4)
merge_5 = Merge(Data1=branch, Data2=path_mapper)
R = ClusterOutput(merge)
sdiff_6 = SolidDifference(BrepsA=clean_3, BrepsB=extr_2)  # -> flatten(Result)
G = ClusterInput()
R_2 = ClusterOutput(merge_5)
replace_3 = ReplaceItems(List=replace_2, Item=sdiff_5, Indices=cull_i_2, Wrap=False)
filter_2 = StreamFilter(Gate=G, Stream1=move.Geometry)
material = CreateMaterial(Diffuse=RGB(255, 0, 0), Specular=RGB(255, 255, 255), Emission=RGB(0, 0, 0), Transparency=0, Shine=0)
material_2 = CreateMaterial(Diffuse=RGB(219, 241, 255), Specular=RGB(187, 237, 229), Emission=RGB(0, 0, 0), Transparency=1, Shine=0)
cap = CapHoles(Brep=replace_3)
M = ClusterOutput(material)
M_2 = ClusterOutput(material_2)
s_0 = ClusterOutput(filter_2)
cluster_11 = Cluster_57(B=cap)
B = ClusterOutput(cap)
i_2 = ClusterOutput(cluster_11)
panel_2 = Panel(cluster_11)
panel_3 = Panel(replace_3)

# ==== cluster Cluster_85
brep = ClusterInput()
I = ClusterInput()
brep_2 = Brep(simplify(flatten(brep)))
cull_i = CullIndex(List=brep_2, Indices=I, Wrap=True)  # -> simplify(graft(List))
tstat = TreeStatistics(Tree=brep)  # -> Paths, Length, Count
tstat_2 = TreeStatistics(Tree=cull_i)  # -> Paths, Length, Count
cull_i_2 = CullIndex(List=tstat.Paths, Indices=I, Wrap=True)
replace = ReplacePaths(Data=cull_i, Search=tstat_2.Paths, Replace=cull_i_2)
debrep = DeconstructBrep(Brep=replace)  # -> Faces, Edges, Vertices
area = Area(Geometry=debrep.Faces)  # -> Area, Centroid
pdecon = Deconstruct(Point=area.Centroid)  # -> XComponent, YComponent, ZComponent
sort = SortList(Keys=pdecon.ZComponent, ValuesA=debrep.Faces)  # -> Keys, ValuesA
item = ListItem(List=sort.ValuesA, Index=-1, Wrap=True)  # -> simplify(Item)
area_2 = Area(Geometry=item)  # -> Area, Centroid
pdecon_2 = Deconstruct(Point=area_2.Centroid)  # -> XComponent, YComponent, ZComponent
num = Number(flatten(pdecon_2.ZComponent))
tstat_3 = TreeStatistics(Tree=pdecon_2.ZComponent)  # -> Paths, Length, Count
sort_2 = SortList(Keys=num, ValuesA=num)  # -> Keys, ValuesA
item_2 = ListItem(List=sort_2.ValuesA, Index=0, Wrap=True)
T = ClusterInput()
T_2 = ClusterInput()
T_3 = ClusterInput()
T_4 = ClusterInput()
mindex = MemberIndex(Set=num, Member=item_2)  # -> Index, Count
cull_i_3 = CullIndex(List=tstat_3.Paths, Indices=mindex.Index, Wrap=True)
branch = TreeBranch(Tree=item, Path=cull_i_3, MaintainPaths=True)
branch_2 = TreeBranch(Tree=T_4, Path=cull_i_3, MaintainPaths=True)
branch_3 = TreeBranch(Tree=T_2, Path=cull_i_3, MaintainPaths=True)
branch_4 = TreeBranch(Tree=T, Path=cull_i_3, MaintainPaths=True)
branch_5 = TreeBranch(Tree=T_3, Path=cull_i_3, MaintainPaths=True)
B = ClusterOutput(branch)
B_2 = ClusterOutput(branch)
B_3 = ClusterOutput(branch_2)
B_4 = ClusterOutput(branch_3)
B_5 = ClusterOutput(branch_4)
B_6 = ClusterOutput(branch_5)

# ==== cluster Cluster_89
I = ClusterInput()
num = ClusterInput()
ma = MassAddition(Input=flatten(I))  # -> Result, PartialResults
num_2 = Number(num)
division = Division(A=num_2, B=ma.Result)
srf = ClusterInput()
int = Integer(division)
cluster = Cluster_87(srf=srf, pisos=int, cc=num_2)
A = ClusterInput()
equals = Equality(FirstNumber=A, SecondNumber=2)  # -> Equality, Inequality
cluster_2 = Cluster_88(T=cluster)
filter = StreamFilter(Gate=equals.Equality, Stream0=cluster, Stream1=cluster_2)
s_0 = ClusterOutput(filter)

# ==== cluster Cluster_92
num = ClusterInput()
num_2 = Number(num)
item = ListItem(List=num_2, Index=0, Wrap=True)
item_2 = ListItem(List=num_2, Index=1, Wrap=True)
item_3 = ListItem(List=num_2, Index=2, Wrap=True)
A = ClusterInput()
srf = ClusterInput()
num_3 = ClusterInput()
srf_2 = Surface(srf)
num_4 = ClusterInput()
num_5 = Number(item_3)
B = ClusterInput()
num_6 = Number(num_3)
area = Area(Geometry=srf_2)  # -> Area, Centroid
num_7 = Number(num_4)
item_4 = ListItem(List=num_6, Index=item, Wrap=True)
item_5 = ListItem(List=num_6, Index=item_2, Wrap=True)
tstat = TreeStatistics(Tree=srf_2)  # -> Paths, Length, Count
pdecon = Deconstruct(Point=area.Centroid)  # -> XComponent, YComponent, ZComponent
multiplication = Multiplication(A=item_5, B=num_5)
subtraction = Subtraction(A=A, B=pdecon.ZComponent)
x = ClusterInput()
integer_division = IntegerDivision(A=subtraction, B=item_4)
subtraction_2 = Subtraction(A=num_7, B=multiplication)
Z = UnitZ(Factor=multiplication)
expression = Expression(x=x, y=integer_division, Expression="if (x≤y, x, y)")
srf_3 = Surface(srf_2)
multiplication_2 = Multiplication(A=item_4, B=expression)
area_2 = Area(Geometry=srf_3)  # -> Area, Centroid
Z_2 = UnitZ(Factor=multiplication_2)
area_3 = Area(Geometry=srf_3)  # -> Area, Centroid
line = LineSDL(Start=area_3.Centroid, Direction=Vector(0, 0, 1), Length=multiplication_2)  # -> simplify(Line)
addition = Addition(A=expression, B=1)
extr = Extrude(Base=B, Direction=Z_2)
arrcurve = CurveArray(Geometry=srf_3, Curve=line, Count=addition)  # -> simplify(Geometry), Transform
cap = CapHoles(Brep=extr)
cluster = Cluster_37()
cluster_2 = Cluster_77(T=line, D=arrcurve.Geometry)
null = NullItem(Item=cap)  # -> NullFlags, InvalidFlags, Description
tstat_2 = TreeStatistics(Tree=srf_2)  # -> Paths, Length, Count
cluster_3 = Cluster_91(relay=cluster_2)  # -> simplify(T)
cluster_4 = Cluster_37(crv=cluster_3)
bool = Boolean(True)
tstat_3 = TreeStatistics(Tree=cluster_3)  # -> Paths, Length, Count
cluster_5 = Cluster_90(T=srf_2, srf=cluster_3, D=line)  # -> Z, B, A, D_2
mindex = MemberIndex(Set=null.NullFlags, Member=bool)  # -> Index, Count
panel = Panel(line)
panel_2 = Panel(cluster_4)
branch = TreeBranch(Tree=item_4, Path=tstat_3.Paths, MaintainPaths=True)
cull_i = CullIndex(List=cap, Indices=mindex.Index, Wrap=True)
sunion = SolidUnion(Breps=flatten(cluster_5.B))  # -> simplify(graft(Result))
num_8 = Number(cluster_5.A)
merge = Merge(Data2=cluster_5.D_2)  # -> simplify(Result)
area_4 = Area(Geometry=merge)  # -> Area, Centroid
cap_2 = CapHoles(Brep=cull_i)  # -> flatten(Brep)
line_2 = LineSDL(Start=area_4.Centroid, Direction=Vector(0, 0, 1), Length=branch)
cluster_6 = Cluster_38(B=sunion)
G = ClusterOutput(cluster_3)
cluster_7 = Cluster_36(R=tstat_2.Paths, I=num_8)
cap_3 = CapHoles(Brep=sunion)
cluster_8 = Cluster_2(B=cap_3)
panel_3 = Panel(cap_2)
cluster_9 = Cluster_75(R=tstat_2.Paths, D=cap_3)
cluster_10 = REMAP(R=tstat_3.Paths, D=line_2)
Z_3 = ClusterOutput(cluster_8)
cluster_11 = Cluster_75(R=tstat_3.Paths, D=merge)
D = ClusterOutput(cluster_9)
len = Length(Curve=cluster_10)  # -> simplify(Length)
area_5 = Area(Geometry=cluster_11)  # -> Area, Centroid
D_2 = ClusterOutput(cluster_11)
ma = MassAddition(Input=flatten(num_6))  # -> Result, PartialResults
L = ClusterOutput(len)
panel_4 = Panel(len)
equals = Equality(FirstNumber=ma.Result, SecondNumber=0)  # -> Equality, Inequality
ma_2 = MassAddition(Input=flatten(area_5.Area))  # -> Result, PartialResults
filter = StreamFilter(Gate=equals.Equality, Stream0=0, Stream1=ma_2.Result)
s_0 = ClusterOutput(filter)

# ==== cluster Cluster_94
crv = ClusterInput()
brep = ClusterInput()
I = ClusterInput()
F = ClusterInput()
brep_2 = Brep(simplify(brep))
crv_2 = Curve(crv)
cull_i = CullIndex(List=brep_2, Indices=I, Wrap=True)
area = Area(Geometry=crv_2)  # -> Area, Centroid
cluster = Cluster_93(B=brep_2)  # -> i, A
pdecon = Deconstruct(Point=area.Centroid)  # -> XComponent, YComponent, ZComponent
area_2 = Area(Geometry=cluster.i)  # -> Area, Centroid
area_3 = Area(Geometry=cluster.i)  # -> Area, Centroid
pdecon_2 = Deconstruct(Point=area_2.Centroid)  # -> XComponent, YComponent, ZComponent
subtraction = Subtraction(A=pdecon_2.ZComponent, B=pdecon.ZComponent)
item = ListItem(List=cluster.A, Index=0, Wrap=True)  # -> simplify(Item)
Z = UnitZ(Factor=subtraction)
panel = Panel("2.5")
move = Move(Geometry=area.Centroid, Motion=Z)  # -> Geometry, Transform
area_4 = Area(Geometry=item)  # -> Area, Centroid
Z_2 = UnitZ(Factor=F)
panel_2 = Panel(pdecon_2.ZComponent)
i = ClusterOutput(item)
C = ClusterOutput(area_4.Centroid)
i_2 = ClusterOutput(cluster.i)
move_2 = Move(Geometry=move.Geometry, Motion=Z_2)  # -> Geometry, Transform
Z_3 = ClusterOutput(pdecon_2.ZComponent)
Z_4 = UnitZ(Factor=pdecon_2.ZComponent)
G = ClusterOutput(move_2.Geometry)

# ==== cluster Cluster_95
relay = ClusterInput()
R = ClusterInput()
tstat = TreeStatistics(Tree=relay)  # -> Paths, Length, Count
G = ClusterInput()
replace = ReplacePaths(Data=relay, Search=tstat.Paths, Replace=R)
panel = Panel(relay)
filter = StreamFilter(Gate=G, Stream0=relay, Stream1=replace)
s_0 = ClusterOutput(filter)

# ==== cluster Cluster_96
num = ClusterInput()
num_2 = ClusterInput()
num_3 = Number(num)
num_4 = Number(num_2)
item = ListItem(List=num_4, Index=0, Wrap=True)  # -> Item, Item1, Item2
item_2 = ListItem(List=num_3, Index=item.Item1, Wrap=True)
item_3 = ListItem(List=num_3, Index=item.Item, Wrap=True)
A = ClusterInput()
multiplication = Multiplication(A=item_2, B=item.Item2)
R = ClusterOutput(multiplication)
item_2_2 = ClusterOutput(item.Item2)
i = ClusterOutput(item_3)
subtraction = Subtraction(A=A, B=multiplication)
R_2 = ClusterOutput(subtraction)

# ==== cluster Cluster_97
num = ClusterInput()
num_2 = ClusterInput()
int = ClusterInput()
B = ClusterInput()
I = ClusterInput()
B_2 = ClusterInput()
int_2 = Integer(int)
num_3 = Number(num)
num_4 = Number(num_2)
subtraction = Subtraction(A=int_2, B=B)
expression = Expression(b=subtraction, Expression="if (0<b, b, 0)")
num_5 = Number(num_4)
multiplication = Multiplication(A=num_3, B=expression)
division = Division(A=num_4, B=num_3)
round = Round(Number=division)  # -> Nearest, Floor, Ceiling
expression_2 = Expression(x=multiplication, y=num_5, a=round.Floor, b=expression, Expression="if(x≤y, b, a)")
multiplication_2 = Multiplication(A=expression_2, B=num_3)
ma = MassAddition(Input=flatten([expression_2, B, I]))  # -> Result, PartialResults
addition = Addition(A=expression_2)
addition_2 = Addition(A=multiplication_2, B=B_2)
R = ClusterOutput(addition_2)
R_2 = ClusterOutput(ma.Result)
R_3 = ClusterOutput(addition)

# ==== cluster Cluster_98
C = ClusterInput()
len = Length(Curve=C)
crv = Curve(C)
sort = SortList(Keys=len, ValuesA=len)  # -> Keys, reverse(ValuesA)
item = ListItem(List=sort.ValuesA, Index="0", Wrap=True)
cull_i = CullIndex(List=sort.ValuesA, Indices="0", Wrap=True)
mindex = MemberIndex(Set=len, Member=item)  # -> flatten(Index), Count
mindex_2 = MemberIndex(Set=len, Member=cull_i)  # -> flatten(Index), Count
L = ClusterInput()
I = ClusterOutput(mindex_2.Index)
item_2 = ListItem(List=L, Index=mindex.Index, Wrap=True)
rev = ReverseList(List=mindex_2.Index)
I_2 = ClusterOutput(mindex.Index)

# ==== cluster Cluster_99
brep = ClusterInput()
brep_2 = Brep(simplify(brep))
tstat = TreeStatistics(Tree=brep_2)  # -> Paths, Length, Count
debrep = DeconstructBrep(Brep=brep_2)  # -> Faces, Edges, Vertices
area = Area(Geometry=debrep.Faces)  # -> Area, Centroid
pdecon = Deconstruct(Point=area.Centroid)  # -> XComponent, YComponent, ZComponent
sort = SortList(Keys=pdecon.ZComponent, ValuesA=debrep.Faces)  # -> Keys, ValuesA
item = ListItem(List=sort.ValuesA, Index=-1, Wrap=True)  # -> simplify(Item)
tstat_2 = TreeStatistics(Tree=item)  # -> Paths, Length, Count
replace = ReplacePaths(Data=item, Search=tstat_2.Paths, Replace=tstat.Paths)
area_2 = Area(Geometry=item)  # -> Area, Centroid
D = ClusterOutput(replace)
pdecon_2 = Deconstruct(Point=area_2.Centroid)  # -> XComponent, YComponent, ZComponent
tstat_3 = TreeStatistics(Tree=pdecon_2.ZComponent)  # -> Paths, Length, Count
num = Number(flatten(pdecon_2.ZComponent))
sort_2 = SortList(Keys=num, ValuesA=num)  # -> Keys, ValuesA
item_2 = ListItem(List=sort_2.ValuesA, Index=0, Wrap=True)
mindex = MemberIndex(Set=num, Member=item_2)  # -> Index, Count
cull_i = CullIndex(List=tstat_3.Paths, Indices=mindex.Index, Wrap=True)
branch = TreeBranch(Tree=item, Path=cull_i, MaintainPaths=True)

# ==== cluster Cluster_100
num = ClusterInput()
num_2 = ClusterInput()
srf = ClusterInput()
P = ClusterInput()
num_3 = Number(num)
num_4 = Number(num_2)
srf_2 = Surface(srf)
dom = ConstructDomain(DomainStart=expr("x/2", num_3), DomainEnd=expr("-x/2", num_3))
dom_2 = ConstructDomain(DomainStart=expr("x/2", num_4), DomainEnd=expr("-x/2", num_4))
pull = PullPoint(Point=P, Geometry=srf_2, ClosestOnly=False)  # -> ClosestPoint, Distance
P_2 = ClusterOutput(pull.ClosestPoint)
srf_3 = ClusterOutput(srf_2)
I = ClusterOutput(dom)
I_2 = ClusterOutput(dom_2)

# ==== cluster Cluster_103
num = ClusterInput()
txt = ClusterInput()
cluster = Cluster_102(num=num)
cluster_2 = Cluster_101(txt=txt)  # -> subtotales, N
partition = PartitionList(List=num, Size=cluster_2.N)
panel = Panel(txt)
num_2 = Number(partition)
panel_2 = Panel("""{1;0}
{1;1}""")
panel_3 = Panel("""{2;0}
{2;1}""")
panel_4 = Panel("""{3;0}
{3;1}""")
panel_5 = Panel("""{4;0}
{4;1}""")
panel_6 = Panel("""{1;0}
{1;1}""")
panel_7 = Panel("""{2;0}
{2;1}""")
panel_8 = Panel("""{3;0}
{3;1}""")
panel_9 = Panel("""{4;0}
{4;1}""")
split = SplitTree(Data=num_2, Masks=flatten(panel_2))  # -> Positive, Negative
split_2 = SplitTree(Data=num_2, Masks=flatten(panel_3))  # -> Positive, Negative
split_3 = SplitTree(Data=num_2, Masks=flatten(panel_4))  # -> Positive, Negative
split_4 = SplitTree(Data=num_2, Masks=flatten(panel_5))  # -> Positive, Negative
panel_10 = Panel(num_2)
split_5 = SplitTree(Data=cluster_2.subtotales, Masks=flatten(panel_6))  # -> Positive, Negative
split_6 = SplitTree(Data=cluster_2.subtotales, Masks=flatten(panel_7))  # -> Positive, Negative
split_7 = SplitTree(Data=cluster_2.subtotales, Masks=flatten(panel_8))  # -> Positive, Negative
split_8 = SplitTree(Data=cluster_2.subtotales, Masks=flatten(panel_9))  # -> Positive, Negative
panel_11 = Panel(split.Positive)
panel_12 = Panel(split_2.Positive)
panel_13 = Panel(split_3.Positive)
panel_14 = Panel(split_4.Positive)
panel_15 = Panel(split_5.Positive)
panel_16 = Panel(split_6.Positive)
panel_17 = Panel(split_7.Positive)
panel_18 = Panel(split_8.Positive)
ma = MassAddition(Input=panel_11)  # -> V1Subtotales, PartialResults
ma_2 = MassAddition(Input=panel_12)  # -> V2Subtotales, PartialResults
ma_3 = MassAddition(Input=panel_13)  # -> V3Subtotales, PartialResults
ma_4 = MassAddition(Input=panel_14)  # -> V4Subtotales, PartialResults
txt_2 = Text(graft(["Programa Adicional", "Programa Principal"]))
cset = CreateSet(List=split_5.Positive)  # -> Set, Map
cset_2 = CreateSet(List=split_6.Positive)  # -> Set, Map
cset_3 = CreateSet(List=split_7.Positive)  # -> Set, Map
cset_4 = CreateSet(List=split_8.Positive)  # -> Set, Map
null = NullItem(Item=ma_3.V3Subtotales)  # -> NullFlags, InvalidFlags, Description
ins = InsertItems(List=ma.V1Subtotales, Item=cset.Set, Indices=0, Wrap=True)
ins_2 = InsertItems(List=ma_2.V2Subtotales, Item=cset_2.Set, Indices=0, Wrap=True)
ins_3 = InsertItems(List=ma_3.V3Subtotales, Item=cset_3.Set, Indices=0, Wrap=True)
ins_4 = InsertItems(List=ma_4.V4Subtotales, Item=cset_4.Set, Indices=0, Wrap=True)
panel_19 = Panel(ins)
panel_20 = Panel(ins_2)
panel_21 = Panel(ins_3)
panel_22 = Panel(ins_4)
L = ClusterOutput(ins)
L_2 = ClusterOutput(ins_2)
L_3 = ClusterOutput(ins_3)
L_4 = ClusterOutput(ins_4)

# ==== cluster Cluster_104
brep = ClusterInput()
brep_2 = Brep(simplify(brep))
debrep = DeconstructBrep(Brep=simplify(brep_2))  # -> Faces, Edges, Vertices
area = Area(Geometry=debrep.Faces)  # -> Area, Centroid
pdecon = Deconstruct(Point=area.Centroid)  # -> XComponent, YComponent, ZComponent
sort = SortList(Keys=pdecon.ZComponent, ValuesA=debrep.Faces)  # -> Keys, ValuesA
item = ListItem(List=sort.ValuesA, Index=-1, Wrap=True)
area_2 = Area(Geometry=item)  # -> Area, Centroid
pdecon_2 = Deconstruct(Point=area_2.Centroid)  # -> XComponent, YComponent, ZComponent
Z = ClusterOutput(pdecon_2.ZComponent)

# ==== cluster Cluster_112
B = ClusterInput()
B_2 = ClusterInput()
E = ClusterInput()
boundary = BoundarySurfaces(Edges=E)
debrep = DeconstructBrep(Brep=B)  # -> Faces, Edges, Vertices
debrep_2 = DeconstructBrep(Brep=B_2)  # -> Faces, Edges, Vertices
num = Number("0.49")
num_2 = Number("1.54")
pdecon = Deconstruct(Point=debrep_2.Vertices)  # -> XComponent, YComponent, ZComponent
pt = Point(debrep_2.Vertices)
pdecon_2 = Deconstruct(Point=debrep.Vertices)  # -> XComponent, YComponent, ZComponent
pt_2 = Point(debrep.Vertices)
sort = SortList(Keys=pdecon.ZComponent, ValuesA=pdecon.ZComponent)  # -> Keys, ValuesA
sort_2 = SortList(Keys=pdecon_2.ZComponent, ValuesA=pdecon_2.ZComponent)  # -> Keys, ValuesA
item = ListItem(List=sort.ValuesA, Index=-1, Wrap=True)
item_2 = ListItem(List=sort_2.ValuesA, Index=-1, Wrap=True)
sort_3 = SortList(Keys=pdecon.ZComponent, ValuesA=debrep_2.Vertices)  # -> Keys, ValuesA
sort_4 = SortList(Keys=sort.ValuesA, ValuesA=pt)  # -> Keys, ValuesA
sort_5 = SortList(Keys=pdecon_2.ZComponent, ValuesA=debrep.Vertices)  # -> Keys, ValuesA
sort_6 = SortList(Keys=sort_2.ValuesA, ValuesA=pt_2)  # -> Keys, ValuesA
item_3 = ListItem(List=sort_4.ValuesA, Index=-1, Wrap=True)
item_4 = ListItem(List=sort_6.ValuesA, Index=-1, Wrap=True)
pdecon_3 = Deconstruct(Point=item_3)  # -> XComponent, YComponent, ZComponent
pdecon_4 = Deconstruct(Point=item_4)  # -> XComponent, YComponent, ZComponent
altura_maxima_volumen = Panel(pdecon_3.ZComponent)
altura_maxima_volumen_2 = Panel(pdecon_4.ZComponent)
neg = Negative(Value=num)
division = Division(A=pdecon_2.ZComponent, B=neg)
division_2 = Division(A=pdecon_2.ZComponent, B=num_2)
division_3 = Division(A=pdecon_2.ZComponent, B=num)
atan = ArcTangent(Value="1.54")
atan_2 = ArcTangent(Value="0.49")
atan_3 = ArcTangent(Value="-0.49")
neg_2 = Negative(Value=division_2)
X = UnitX(Factor=division_3)
X_2 = UnitX(Factor=division)
Y = UnitY(Factor=neg_2)
X_3 = UnitX(Factor=1)
Y_2 = UnitY(Factor=1)
deg = Degrees(Radians=atan)
X_4 = UnitX(Factor=1)
Y_3 = UnitY(Factor=1)
deg_2 = Degrees(Radians=atan_2)
X_5 = UnitX(Factor=1)
Y_4 = UnitY(Factor=1)
deg_3 = Degrees(Radians=atan_3)
move = Move(Geometry=debrep.Vertices, Motion=X)  # -> Geometry, Transform
move_2 = Move(Geometry=debrep.Vertices, Motion=X_2)  # -> Geometry, Transform
move_3 = Move(Geometry=debrep.Vertices, Motion=Y)  # -> Geometry, Transform
txt = Text("SOMBRA VOLUMEN TEORICO")
txt_2 = Text("Sombra Poniente")
txt_3 = Text("Sombra Sur")
txt_4 = Text("Sombra Oriente")
vrot = Rotate(Vector=Y_2, Axis=X_3, Angle=degrees(deg))
vrot_2 = Rotate(Vector=X_4, Axis=Y_3, Angle=degrees(deg_2))
vrot_3 = Rotate(Vector=X_5, Axis=Y_4, Angle=degrees(deg_3))
project = Project(Geometry=move.Geometry, Plane=PlaneXY(0, 0, 0))  # -> Geometry, Transform
project_2 = Project(Geometry=move_2.Geometry, Plane=PlaneXY(0, 0, 0))  # -> Geometry, Transform
project_3 = Project(Geometry=move_3.Geometry, Plane=PlaneXY(0, 0, 0))  # -> Geometry, Transform
projecta = ProjectAlong(Geometry=B_2, Plane=PlaneXY(0, 0, 0), Direction=vrot)  # -> Geometry, Transform
projecta_2 = ProjectAlong(Geometry=B_2, Plane=PlaneXY(0, 0, 0), Direction=vrot_2)  # -> Geometry, Transform
projecta_3 = ProjectAlong(Geometry=B_2, Plane=PlaneXY(0, 0, 0), Direction=vrot_3)  # -> Geometry, Transform
del = DelaunayMesh(Points=project.Geometry, Plane=PlaneXY(0, 0, 0))
del_2 = DelaunayMesh(Points=project_2.Geometry, Plane=PlaneXY(0, 0, 0))
del_3 = DelaunayMesh(Points=project_3.Geometry, Plane=PlaneXY(0, 0, 0))
txt_5 = Text("SOMBRA VOLUMEN PROYECTADO")
mjoin = MeshJoin(Meshes=projecta.Geometry)
mjoin_2 = MeshJoin(Meshes=projecta_2.Geometry)
mjoin_3 = MeshJoin(Meshes=projecta_3.Geometry)
mshadow = MeshShadow(Mesh=mjoin, Light=Vector(0, 0, -1), Plane=PlaneXY(0, 0, 0))
mshadow_2 = MeshShadow(Mesh=mjoin_2, Light=Vector(0, 0, -1), Plane=PlaneXY(0, 0, 0))
mshadow_3 = MeshShadow(Mesh=mjoin_3, Light=Vector(0, 0, -1), Plane=PlaneXY(0, 0, 0))
medges = MeshEdges(Mesh=del)  # -> NakedEdges, InteriorEdges, NonManifoldEdges
medges_2 = MeshEdges(Mesh=del_2)  # -> NakedEdges, InteriorEdges, NonManifoldEdges
medges_3 = MeshEdges(Mesh=del_3)  # -> NakedEdges, InteriorEdges, NonManifoldEdges
splitatcorners = SplitAtCorners(Poly=mshadow, Angle=1)  # -> Corners, Parts
splitatcorners_2 = SplitAtCorners(Poly=mshadow_2, Angle=1)  # -> Corners, Parts
splitatcorners_3 = SplitAtCorners(Poly=mshadow_3, Angle=1)  # -> Corners, Parts
boundary_2 = BoundarySurfaces(Edges=medges.NakedEdges)
boundary_3 = BoundarySurfaces(Edges=medges_2.NakedEdges)
boundary_4 = BoundarySurfaces(Edges=medges_3.NakedEdges)
explode = Explode(Curve=boundary_2, Recursive=True)  # -> Segments, Vertices
explode_2 = Explode(Curve=boundary_3, Recursive=True)  # -> Segments, Vertices
explode_3 = Explode(Curve=boundary_4, Recursive=True)  # -> Segments, Vertices
rdiff = RegionDifference(CurvesA=boundary_2, CurvesB=boundary)
rdiff_2 = RegionDifference(CurvesA=boundary_3, CurvesB=boundary)
rdiff_3 = RegionDifference(CurvesA=boundary_4, CurvesB=boundary)
crv = Curve(boundary)
G = ClusterInput()
boundary_5 = BoundarySurfaces(Edges=splitatcorners_2.Parts)
boundary_6 = BoundarySurfaces(Edges=splitatcorners_3.Parts)
boundary_7 = BoundarySurfaces(Edges=splitatcorners.Parts)
boundary_8 = BoundarySurfaces(Edges=rdiff)
boundary_9 = BoundarySurfaces(Edges=rdiff_2)
boundary_10 = BoundarySurfaces(Edges=rdiff_3)
explode_4 = Explode(Curve=boundary_5, Recursive=True)  # -> Segments, Vertices
explode_5 = Explode(Curve=boundary_6, Recursive=True)  # -> Segments, Vertices
explode_6 = Explode(Curve=boundary_7, Recursive=True)  # -> Segments, Vertices
filter = StreamFilter(Gate=G, Stream1=[boundary_8, boundary_9, boundary_10, explode.Segments, explode_2.Segments, explode_3.Segments])
rdiff_4 = RegionDifference(CurvesA=boundary_5, CurvesB=crv)
rdiff_5 = RegionDifference(CurvesA=boundary_6, CurvesB=crv)
rdiff_6 = RegionDifference(CurvesA=boundary_7, CurvesB=crv)
area = Area(Geometry=boundary_9)  # -> Area, Centroid
area_2 = Area(Geometry=boundary_8)  # -> Area, Centroid
G_2 = ClusterInput()
area_3 = Area(Geometry=boundary_10)  # -> Area, Centroid
boundary_11 = BoundarySurfaces(Edges=rdiff_4)
boundary_12 = BoundarySurfaces(Edges=rdiff_5)
boundary_13 = BoundarySurfaces(Edges=rdiff_6)
ma = MassAddition(Input=flatten(area_2.Area))  # -> Result, PartialResults
ma_2 = MassAddition(Input=flatten(area.Area))  # -> Result, PartialResults
ma_3 = MassAddition(Input=flatten(area_3.Area))  # -> Result, PartialResults
cluster = Cluster_107(txt_2=txt, L=ma_2.Result, L_2=ma_3.Result, L_3=ma.Result)  # -> L_4, L_5, L_6
s_0 = ClusterOutput(filter)
filter_2 = StreamFilter(Gate=G_2, Stream1=[boundary_11, boundary_12, boundary_13, explode_4.Segments, explode_5.Segments, explode_6.Segments])
area_4 = Area(Geometry=boundary_11)  # -> Area, Centroid
area_5 = Area(Geometry=boundary_12)  # -> Area, Centroid
area_6 = Area(Geometry=boundary_13)  # -> Area, Centroid
s_0_2 = ClusterOutput(filter_2)
button = Button()
ma_4 = MassAddition(Input=flatten(area_4.Area))  # -> Result, PartialResults
ma_5 = MassAddition(Input=flatten(area_5.Area))  # -> Result, PartialResults
ma_6 = MassAddition(Input=flatten(area_6.Area))  # -> Result, PartialResults

# ----
# C:\Users\puqui\Documents\TP-Excel Sombras Template.xlsx
cset = CreateSet(List=sort.ValuesA)  # -> Set, Map
cull_i = CullIndex(List=cset.Set, Indices=0, Wrap=True)
roundd = RoundToDecimalPlace(NumberX=cull_i, DecimalPlace="2", RoundType=0)  # -> flatten(Rounded), Difference
dcon = DeleteConsecutive(Set=roundd.Rounded, Wrap=False)  # -> Set, Count
lng = ListLength(List=dcon.Set)
panel = Panel(lng)
division_4 = Division(A=dcon.Set, B=0.49)
division_5 = Division(A=dcon.Set, B=1.54)
division_6 = Division(A=dcon.Set, B=0.49)
roundd_2 = RoundToDecimalPlace(NumberX=division_4, DecimalPlace="2", RoundType=0)  # -> flatten(Rounded), Difference
roundd_3 = RoundToDecimalPlace(NumberX=division_5, DecimalPlace="2", RoundType=0)  # -> flatten(Rounded), Difference
roundd_4 = RoundToDecimalPlace(NumberX=division_6, DecimalPlace="2", RoundType=0)  # -> flatten(Rounded), Difference
cluster_2 = Cluster_105(L=dcon.Set, d1=txt_3, L_2=num_2, L_3=roundd_3.Rounded)  # -> L_4, L_5, L_6
cluster_3 = Cluster_105(L=dcon.Set, d1=txt_4, L_2=num, L_3=roundd_4.Rounded)  # -> L_4, L_5, L_6
cluster_4 = Cluster_105(L=dcon.Set, d1=txt_2, L_2=num, L_3=roundd_2.Rounded)  # -> L_4, L_5, L_6
cluster_5 = Cluster_106(txt=txt_5, L=ma_5.Result, L_2=ma_6.Result, L_3=ma_4.Result)  # -> L_4, L_5, L_6
panel_2 = Panel("""Superficies Totales (m2)



Sombra Poniente



Sombra Sur 



Sombra Oriente""")

R = ClusterOutput(roundd_2.Rounded)
R_2 = ClusterOutput(roundd_3.Rounded)
R_3 = ClusterOutput(roundd_4.Rounded)
panel_3 = Panel(dcon.Set)
D = ClusterOutput(ma_4.Result)
D_2 = ClusterOutput(ma_5.Result)
D_3 = ClusterOutput(ma_6.Result)
subtraction = Subtraction(A=ma.Result, B=ma_4.Result)
subtraction_2 = Subtraction(A=ma_2.Result, B=ma_5.Result)
subtraction_3 = Subtraction(A=ma_3.Result, B=ma_6.Result)
txt_6 = Text("Diferencia")
ins = InsertItems(List=subtraction, Item=txt_6, Indices=0, Wrap=True)
ins_2 = InsertItems(List=subtraction_3, Item=txt_6, Indices=0, Wrap=True)
ins_3 = InsertItems(List=subtraction_2, Item=txt_6, Indices=0, Wrap=True)
relay = Relay()
# Sombra Poniente
# 
# 
# 
# Sombra Sur
# 
# 
# 
# Sombra Oriente
button_2 = Button()
run = ClusterInput()
wo = WriteOptions(ClearDataOverwrite=True, SaveAfterWrite=False, CloseAfterWrite=False, ColumnStartPosition=1, RowStartPosition=1)  # -> UserMessages, WriteOptions

# ----
# Superficies Sombra Teorica (m2)
# 
# 
# 
# Sombra Poniente
# 
# 
# 
# Sombra Sur
# 
# 
# 
# Sombra Oriente
cset_2 = CreateSet(List=sort_2.ValuesA)  # -> Set, Map
cull_i_2 = CullIndex(List=cset_2.Set, Indices=0, Wrap=True)
roundd_5 = RoundToDecimalPlace(NumberX=cull_i_2, DecimalPlace="2", RoundType=0)  # -> flatten(Rounded), Difference
dcon_2 = DeleteConsecutive(Set=roundd_5.Rounded, Wrap=False)  # -> Set, Count
lng_2 = ListLength(List=dcon_2.Set)
panel_4 = Panel(lng_2)
division_7 = Division(A=dcon_2.Set, B=0.49)
division_8 = Division(A=dcon_2.Set, B=1.54)
division_9 = Division(A=dcon_2.Set, B=0.49)
roundd_6 = RoundToDecimalPlace(NumberX=division_7, DecimalPlace="2", RoundType=0)  # -> flatten(Rounded), Difference
roundd_7 = RoundToDecimalPlace(NumberX=division_8, DecimalPlace="2", RoundType=0)  # -> flatten(Rounded), Difference
roundd_8 = RoundToDecimalPlace(NumberX=division_9, DecimalPlace="2", RoundType=0)  # -> flatten(Rounded), Difference

R_4 = ClusterOutput(roundd_6.Rounded)
R_5 = ClusterOutput(roundd_7.Rounded)
R_6 = ClusterOutput(roundd_8.Rounded)
listdexs = ListIndices(List=dcon_2.Set)  # -> flatten(Indices)
ins_4 = InsertItems(List=listdexs, Indices=0, Wrap=True)
listdexs_2 = ListIndices(List=ins_4)  # -> flatten(Indices)
cluster_6 = Cluster_108(L=dcon_2.Set, d2=txt_2, L_2=num, L_3=roundd_6.Rounded)  # -> L_4, L_5, L_6
cluster_7 = Cluster_108(L=dcon_2.Set, d2=txt_3, L_2=num_2, L_3=roundd_7.Rounded)  # -> L_4, L_5, L_6
cluster_8 = Cluster_108(L=dcon_2.Set, d2=txt_4, L_2=num, L_3=roundd_8.Rounded)  # -> L_4, L_5, L_6
num_3 = Number(listdexs_2)
cluster_9 = Cluster_109(L=cluster.L_4, I=cluster_5.L_4, num=num_3)
cluster_10 = Cluster_109(L=cluster.L_5, I=cluster_5.L_5, num=num_3)
cluster_11 = Cluster_109(L=cluster.L_6, I=cluster_5.L_6, num=num_3)
ins_5 = InsertItems(List=cluster_9, Item=ins_3, Indices=-1, Wrap=True)
ins_6 = InsertItems(List=cluster_10, Item=ins_2, Indices=-1, Wrap=True)
ins_7 = InsertItems(List=cluster_11, Item=ins, Indices=-1, Wrap=True)
cluster_12 = Cluster_111(L_2=cluster_6.L_4, d2_3=cluster_4.L_4, I=cluster_6.L_5, d2_2=cluster_4.L_5, L=cluster_6.L_6, d2=cluster_4.L_6)  # -> L_5, L_4, L_3
cluster_13 = Cluster_111(L_2=cluster_7.L_4, d2_3=cluster_2.L_4, I=cluster_7.L_5, d2_2=cluster_2.L_5, L=cluster_7.L_6, d2=cluster_2.L_6)  # -> L_5, L_4, L_3
cluster_14 = Cluster_111(L_2=cluster_8.L_4, d2_3=cluster_3.L_4, I=cluster_8.L_5, d2_2=cluster_3.L_5, L=cluster_8.L_6, d2=cluster_3.L_6)  # -> L_5, L_4, L_3

entwine = Entwine(
    Branch00=ins_5,
    Branch01=ins_6,
    Branch02=ins_7,
    Branch04=cluster_12.L_5,
    Branch05=cluster_12.L_4,
    Branch06=cluster_12.L_3,
    Branch08=cluster_13.L_5,
    Branch09=cluster_13.L_4,
    Branch010=cluster_13.L_3,
    Branch012=cluster_14.L_5,
    Branch013=cluster_14.L_4,
    Branch014=cluster_14.L_3,
    FlattenInputs=True)
panel_5 = Panel(entwine)

excel_vt = ClusterOutput(entwine)
writexl = WriteToExcel(
    Run=run,
    ExcelWorksheet="1",
    ColumnNames=panel_2,
    WriteOptions=wo.WriteOptions,
    ColumnnsOrRows=False,
    DataToWriteIntoColumns=entwine)

# ==== cluster Cluster_114
P = ClusterInput()
T = ClusterInput()
tstat = TreeStatistics(Tree=T)  # -> Paths, Length, Count
num = ClusterInput()
lng = ListLength(List=tstat.Paths)
equals = Equality(FirstNumber=lng, SecondNumber=1)  # -> Equality, Inequality
branch = TreeBranch(Tree=T, Path=P, MaintainPaths=True)
L = ClusterInput()
G = ClusterInput()
filter = StreamFilter(Gate=equals.Equality, Stream0=branch, Stream1=T)
item = ListItem(List=L, Index=0, Wrap=True)
num_2 = Number(num)
filter_2 = StreamFilter(Gate=G, Stream1=filter)
item_2 = ListItem(List=num_2, Index=item, Wrap=True)
debrep = DeconstructBrep(Brep=filter_2)  # -> Faces, Edges, Vertices
area = Area(Geometry=debrep.Faces)  # -> Area, Centroid
pdecon = Deconstruct(Point=area.Centroid)  # -> XComponent, YComponent, ZComponent
sort = SortList(Keys=pdecon.ZComponent, ValuesA=debrep.Faces)  # -> Keys, ValuesA
item_3 = ListItem(List=sort.ValuesA, Index=-1, Wrap=True)
area_2 = Area(Geometry=item_3)  # -> Area, Centroid
scale = Scale(Geometry=item_3, Center=area_2.Centroid, Factor=0.5)  # -> Geometry, Transform
Z = UnitZ(Factor=item_2)
area_3 = Area(Geometry=scale.Geometry)  # -> Area, Centroid
extr = Extrude(Base=scale.Geometry, Direction=Z)
move = Move(Geometry=scale.Geometry, Motion=Z)  # -> Geometry, Transform
line = LineSDL(Start=area_3.Centroid, Direction=Z, Length=item_2)
cap = CapHoles(Brep=extr)
len = Length(Curve=line)
cluster = Cluster_113(T_2=scale.Geometry, T=branch)
cluster_2 = Cluster_113(T_2=len, T=branch)
cluster_3 = Cluster_113(T_2=cap, T=branch)
superficie = ClusterOutput(cluster)
altura = ClusterOutput(cluster_2)
brep = ClusterOutput(cluster_3)

# ==== cluster Cluster_115
T = ClusterInput()
P = ClusterInput()
I = ClusterInput()
branch = TreeBranch(Tree=T, Path=P, MaintainPaths=True)
tstat = TreeStatistics(Tree=branch)  # -> Paths, Length, Count
ins = InsertItems(List=branch, Item=I, Indices=-1, Wrap=True)  # -> simplify(List)
tstat_2 = TreeStatistics(Tree=ins)  # -> Paths, Length, Count
replace = ReplacePaths(Data=ins, Search=tstat_2.Paths, Replace=tstat.Paths)
D = ClusterOutput(replace)

# ==== cluster Cluster_116
L = ClusterInput()
I = ClusterInput()
tstat = TreeStatistics(Tree=L)  # -> Paths, Length, Count
ins = InsertItems(List=L, Item=I, Indices=-1, Wrap=True)  # -> simplify(List)
tstat_2 = TreeStatistics(Tree=ins)  # -> Paths, Length, Count
replace = ReplacePaths(Data=ins, Search=tstat_2.Paths, Replace=tstat.Paths)
D = ClusterOutput(replace)

# ==== cluster Cluster_117
T = ClusterInput()
T_2 = ClusterInput()
tstat = TreeStatistics(Tree=T)  # -> Paths, Length, Count
tstat_2 = TreeStatistics(Tree=T_2)  # -> Paths, Length, Count
D = ClusterInput()
replace = ReplacePaths(Data=D, Search=tstat_2.Paths, Replace=tstat.Paths)
D_2 = ClusterOutput(replace)

# ==== cluster Cluster_118
G = ClusterInput()
G_2 = ClusterInput()
_1 = ClusterInput()
area = Area(Geometry=G)  # -> Area, Centroid
ma = MassAddition(Input=area.Area)  # -> Result, PartialResults
filter = StreamFilter(Gate=G_2, Stream0=ma.Result, Stream1=_1)
s_1 = ClusterOutput(filter)

# ==== cluster Cluster_119
I = ClusterInput()
brep = ClusterInput()
num = ClusterInput()
num_2 = ClusterInput()
num_3 = ClusterInput()
T = ClusterInput()
num_4 = Number(num_2)
num_5 = Number(num)
num_6 = Number(num_3)
tstat = TreeStatistics(Tree=num_6)  # -> Paths, Length, Count
cull_i = CullIndex(List=tstat.Paths, Indices=0, Wrap=True)
item = ListItem(List=tstat.Paths, Index=0, Wrap=True)
brep_2 = Brep(brep)
branch = TreeBranch(Tree=num_6, Path=cull_i, MaintainPaths=True)
branch_2 = TreeBranch(Tree=num_6, Path=item, MaintainPaths=True)
branch_3 = TreeBranch(Tree=T, Path=item, MaintainPaths=True)
branch_4 = TreeBranch(Tree=T, Path=cull_i, MaintainPaths=True)
branch_5 = TreeBranch(Tree=num_5, Path=cull_i, MaintainPaths=True)
branch_6 = TreeBranch(Tree=num_5, Path=item, MaintainPaths=True)
listdexs = ListIndices(List=brep_2)
item_2 = ListItem(List=branch, Index=0, Wrap=True)  # -> Item, Item1, Item2, Item3
num_7 = Number(branch_5)
cset = CreateSet(List=num_7)  # -> Set, Map
replace = ReplaceItems(List=brep_2, Item=I, Indices=listdexs, Wrap=False)  # -> simplify(List)
niveles = Text(branch_4)
panel = Panel(niveles)
panel_2 = Panel(num_6)
num_8 = Number(num_7)
mindex = MemberIndex(Set=num_7, Member=cset.Set)  # -> Index, Count
cset_2 = CreateSet(List=item_2.Item)  # -> Set, Map
cset_3 = CreateSet(List=item_2.Item1)  # -> Set, Map
cset_4 = CreateSet(List=item_2.Item2)  # -> Set, Map
cset_5 = CreateSet(List=branch_2)  # -> Set, Map
branch_7 = TreeBranch(Tree=replace, Path=item, MaintainPaths=True)
branch_8 = TreeBranch(Tree=replace, Path=cull_i, MaintainPaths=True)
partition = PartitionList(List=num_4, Size=mindex.Count)
tstat_2 = TreeStatistics(Tree=brep_2)  # -> Paths, Length, Count
num_9 = Number(num_2)
mindex_2 = MemberIndex(Set=cset_5.Set, Member=branch_6)  # -> Index, Count
mindex_3 = MemberIndex(Set=cset_2.Set, Member=num_8)  # -> Index, Count
mindex_4 = MemberIndex(Set=cset_3.Set, Member=num_8)  # -> Index, Count
mindex_5 = MemberIndex(Set=cset_4.Set, Member=num_8)  # -> Index, Count
subtotales = ClusterOutput(partition)
partition_2 = PartitionList(List=num_7, Size=mindex.Count)
mindex_6 = MemberIndex(Set=mindex_3.Count, Member=1)  # -> Index, Count
mindex_7 = MemberIndex(Set=mindex_4.Count, Member=1)  # -> Index, Count
mindex_8 = MemberIndex(Set=mindex_5.Count, Member=1)  # -> Index, Count
mindex_9 = MemberIndex(Set=mindex_2.Count, Member=1)  # -> Index, Count
alturas = ClusterOutput(partition_2)
panel_3 = Panel(tstat_2.Paths)
item_3 = ListItem(List=num_9, Index=mindex_6.Index, Wrap=True)  # -> simplify(Item)
item_4 = ListItem(List=num_9, Index=mindex_7.Index, Wrap=True)  # -> simplify(Item)
item_5 = ListItem(List=num_9, Index=mindex_8.Index, Wrap=True)  # -> simplify(Item)
item_6 = ListItem(List=num_9, Index=mindex_9.Index, Wrap=True)  # -> simplify(Item)
item_7 = ListItem(List=num_7, Index=mindex_6.Index, Wrap=True)  # -> simplify(Item)
item_8 = ListItem(List=num_7, Index=mindex_7.Index, Wrap=True)  # -> simplify(Item)
item_9 = ListItem(List=num_7, Index=mindex_8.Index, Wrap=True)  # -> simplify(Item)
item_10 = ListItem(List=branch_6, Index=mindex_9.Index, Wrap=True)  # -> simplify(Item)
item_11 = ListItem(List=branch_8, Index=mindex_6.Index, Wrap=True)  # -> simplify(Item)
item_12 = ListItem(List=branch_8, Index=mindex_7.Index, Wrap=True)  # -> simplify(Item)
item_13 = ListItem(List=branch_8, Index=mindex_8.Index, Wrap=True)  # -> simplify(Item)
item_14 = ListItem(List=branch_7, Index=mindex_9.Index, Wrap=True)  # -> simplify(Item)
item_15 = ListItem(List=niveles, Index=mindex_6.Index, Wrap=True)  # -> simplify(Item)
item_16 = ListItem(List=niveles, Index=mindex_7.Index, Wrap=True)  # -> simplify(Item)
item_17 = ListItem(List=niveles, Index=mindex_8.Index, Wrap=True)  # -> simplify(Item)
item_18 = ListItem(List=branch_3, Index=mindex_9.Index, Wrap=True)  # -> simplify(Item)
brep_3 = Brep(brep_2)
clean = CleanTree(RemoveNulls=True, RemoveInvalid=True, RemoveEmpty=True, Tree=item_18)
panel_4 = Panel(item_12)
h_oficinas = Text(item_16)
h_retail = Text(item_17)
h_estacionamiento = Text(clean)
h_residencial = Text(item_15)
item_19 = ListItem(List=num_8, Index=mindex_6.Index, Wrap=True)  # -> simplify(Item)
item_20 = ListItem(List=num_8, Index=mindex_7.Index, Wrap=True)  # -> simplify(Item)
item_21 = ListItem(List=num_8, Index=mindex_8.Index, Wrap=True)  # -> simplify(Item)
item_22 = ListItem(List=branch_6, Index=mindex_9.Index, Wrap=True)  # -> simplify(Item)
num_10 = Number(item_4)
num_11 = Number(item_5)
num_12 = Number(item_6)
h_residencial_2 = Number(item_7)
h_oficinas_2 = Number(item_8)
h_retail_2 = Number(item_9)
h_estacionamientos = Number(item_10)
v_residencial = Text(item_11)
v_oficinas = Text(item_12)
v_retail = Text(item_13)
v_estacionamientos = Text(item_14)
num_13 = Number(item_3)
item_23 = TreeItem(Tree=brep_3, Path=graft(item), Index=mindex_9.Index, Wrap=True)  # -> simplify(BrepRet)
item_24 = TreeItem(Tree=brep_3, Path=graft(cull_i), Index=mindex_6.Index, Wrap=True)  # -> simplify(BrepRes)
item_25 = TreeItem(Tree=brep_3, Path=graft(cull_i), Index=mindex_7.Index, Wrap=True)  # -> simplify(BrepOfi)
item_26 = TreeItem(Tree=brep_3, Path=graft(cull_i), Index=mindex_8.Index, Wrap=True)  # -> simplify(BrepRet)
clean_2 = CleanTree(RemoveNulls=True, RemoveInvalid=True, RemoveEmpty=True, Tree=h_residencial)
clean_3 = CleanTree(RemoveNulls=True, RemoveInvalid=True, RemoveEmpty=True, Tree=h_oficinas)
clean_4 = CleanTree(RemoveNulls=True, RemoveInvalid=True, RemoveEmpty=True, Tree=h_retail)
clean_5 = CleanTree(RemoveNulls=True, RemoveInvalid=True, RemoveEmpty=True, Tree=h_estacionamiento)
Z = UnitZ(Factor=item_19)
Z_2 = UnitZ(Factor=item_20)
Z_3 = UnitZ(Factor=item_21)
Z_4 = UnitZ(Factor=item_22)
num_14 = ClusterOutput(num_10)
num_15 = ClusterOutput(num_11)
num_16 = ClusterOutput(num_12)
h_residencial_3 = ClusterOutput(h_residencial_2)
h_oficinas_3 = ClusterOutput(h_oficinas_2)
h_retail_3 = ClusterOutput(h_retail_2)
h_estacionamientos_2 = ClusterOutput(h_estacionamientos)
v_residencial_2 = ClusterOutput(v_residencial)
v_oficinas_2 = ClusterOutput(v_oficinas)
v_retail_2 = ClusterOutput(v_retail)
v_estacionamientos_2 = ClusterOutput(v_estacionamientos)
num_17 = ClusterOutput(num_13)
T_2 = ClusterOutput(clean_5)
T_3 = ClusterOutput(clean_2)
T_4 = ClusterOutput(clean_4)
T_5 = ClusterOutput(clean_3)
extr = Extrude(Base=item_24, Direction=Z)
extr_2 = Extrude(Base=item_25, Direction=Z_2)
extr_3 = Extrude(Base=item_26, Direction=Z_3)
extr_4 = Extrude(Base=item_23, Direction=Z_4)
planta_est = Brep(item_23)
planta_res = Brep(item_24)
planta_ret = Brep(item_26)
planta_ofi = Brep(item_25)
ma = MassAddition(Input=flatten(item_4))  # -> Result, PartialResults
cluster = Cluster_61(relay=planta_est, T=extr_4)
E = ClusterOutput(extr)
E_2 = ClusterOutput(extr_4)
planta_ret_2 = ClusterOutput(planta_ret)
planta_res_2 = ClusterOutput(planta_res)
E_3 = ClusterOutput(extr_3)
planta_ofi_2 = ClusterOutput(planta_ofi)
E_4 = ClusterOutput(extr_2)
planta_est_2 = ClusterOutput(planta_est)

# ==== cluster Cluster_120
d1 = ClusterInput()
d2 = ClusterInput()
merge = Merge(Data1=d1, Data2=d2)
tstat = TreeStatistics(Tree=merge)  # -> flatten(Paths), Length, Count
R = ClusterOutput(merge)
area = Area(Geometry=merge)  # -> Area, Centroid
txt = Text(flatten(["{-2}", "{-1}", "{0}", "{1}", "{2}", "{3}", "{4}"]))
txt_2 = Text(tstat.Paths)
txt_3 = Text(["Estacionamientos", "Subterraneo", "Podio", "Torre 1", "Torre 2 ", "Torre 3", "Torre 4"])
mindex = MemberIndex(Set=txt, Member=txt_2)  # -> Index, Count
A = ClusterOutput(area.Area)
item = ListItem(List=txt, Index=mindex.Index, Wrap=True)
item_2 = ListItem(List=txt_3, Index=mindex.Index, Wrap=True)
item_3 = ListItem(List=txt_3, Index=0, Wrap=True)
item_4 = ListItem(List=txt, Index=0, Wrap=True)
tstat_2 = TreeStatistics(Tree=item)  # -> Paths, Length, Count
tstat_3 = TreeStatistics(Tree=item_3)  # -> Paths, Length, Count
replace = ReplacePaths(Data=item_2, Search=tstat_2.Paths, Replace=tstat.Paths)
replace_2 = ReplacePaths(Data=item_3, Search=tstat_3.Paths, Replace=item_4)
D = ClusterOutput(replace)

# ==== cluster Cluster_121
num = ClusterInput()
series = Series(Start=0, Step=1, Count=3)
num_2 = Number(num)
item = ListItem(List=num_2, Index=series, Wrap=True)  # -> flatten(Item)
num_3 = ClusterInput()
tstat = TreeStatistics(Tree=item)  # -> Paths, Length, Count
tstat_2 = TreeStatistics(Tree=num_2)  # -> Paths, Length, Count
A = ClusterInput()
replace = ReplacePaths(Data=item, Search=tstat.Paths, Replace=tstat_2.Paths)
num_4 = Number(num_3)
merge = Merge(Data1=replace, Data2=num_4)
concat = Concatenate(FragmentA=A, FragmentB=". Piso")
txt = Text(concat)
R = ClusterOutput(merge)
txt_2 = ClusterOutput(txt)

# ==== cluster Cluster_122
brep = ClusterInput()
brep_2 = Brep(simplify(brep))
debrep = DeconstructBrep(Brep=simplify(brep_2))  # -> Faces, Edges, Vertices
area = Area(Geometry=debrep.Faces)  # -> Area, Centroid
pdecon = Deconstruct(Point=area.Centroid)  # -> XComponent, YComponent, ZComponent
vec = Vector("{0,0,1}")
sort = SortList(Keys=pdecon.ZComponent, ValuesA=debrep.Faces)  # -> Keys, ValuesA
evalsrf = EvaluateSurface(Surface=debrep.Faces, Point=vec)  # -> Point, Normal, UDirection, VDirection, Frame
item = ListItem(List=sort.ValuesA, Index=-1, Wrap=True)  # -> simplify(Item)
item_2 = ListItem(List=sort.ValuesA, Index=0, Wrap=True)  # -> simplify(Item)
vec2pt = Vector2Pt(PointA=evalsrf.Normal, PointB=vec, Unitize=False)  # -> Vector, Length
i = ClusterOutput(item)
area_2 = Area(Geometry=item)  # -> Area, Centroid
cull = CullPattern(List=debrep.Faces, CullPattern=vec2pt.Vector)
sunion = SolidUnion(Breps=cull)
i_2 = ClusterOutput(item_2)
fmerge = MergeFaces(Brep=sunion)  # -> Breps, Before, After
area_3 = Area(Geometry=item_2)  # -> Area, Centroid
devec = DeconstructVector(Vector=area_2.Centroid)  # -> XComponent, YComponent, ZComponent
debrep_2 = DeconstructBrep(Brep=simplify(fmerge.Breps))  # -> Faces, Edges, Vertices
devec_2 = DeconstructVector(Vector=area_3.Centroid)  # -> XComponent, YComponent, ZComponent
subtraction = Subtraction(A=devec.ZComponent, B=devec_2.ZComponent)
area_4 = Area(Geometry=debrep_2.Faces)  # -> Area, Centroid
pdecon_2 = Deconstruct(Point=area_4.Centroid)  # -> XComponent, YComponent, ZComponent
sort_2 = SortList(Keys=pdecon_2.ZComponent, ValuesA=pdecon_2.ZComponent)  # -> Keys, ValuesA
i_3 = ClusterOutput(item)
R = ClusterOutput(subtraction)
panel = Panel(subtraction)
item_3 = ListItem(List=sort_2.ValuesA, Index=0, Wrap=True)
equals = Equality(FirstNumber=pdecon_2.ZComponent, SecondNumber=item_3)  # -> Equality, Inequality
panel_2 = Panel(item_3)
dispatch = Dispatch(List=debrep_2.Faces, DispatchPattern=equals.Equality)  # -> ListA, ListB
srf = Surface(dispatch.ListB)
srf_2 = ClusterOutput(srf)

# ==== cluster Cluster_123
A = ClusterInput()
B = ClusterInput()
division = Division(A=A, B=B)
num = Number(expr("x*100", division))
concat = Concatenate(FragmentA=num, FragmentB="%")
R = ClusterOutput(concat)

# ==== cluster Cluster_124
_0 = ClusterInput()
null = NullItem(Item=_0)  # -> NullFlags, InvalidFlags, Description
_1 = ClusterInput()
filter = StreamFilter(Gate=null.NullFlags, Stream0=_0, Stream1=_1)
crv = Curve(filter)
crv_2 = ClusterOutput(crv)

# ==== cluster Cluster_127
number_slider = Slider(8, range=5..20)
crv = ClusterInput()
x = ClusterInput()
x_2 = ClusterInput()
x_3 = ClusterInput()
x_4 = ClusterInput()
neg = Negative(Value=x_3)
neg_2 = Negative(Value=x)
neg_3 = Negative(Value=x_2)
neg_4 = Negative(Value=x_4)
crv_2 = Curve(crv)
crv_3 = Curve(crv)
crv_4 = Curve(crv)
crv_5 = Curve(crv)
d1 = ClusterInput()
d2 = ClusterInput()
d3 = ClusterInput()
d4 = ClusterInput()
merge = Merge(Data1=d1, Data2=d2, Data3=d3, Data4=d4)
merge_2 = Merge()
L = ClusterInput()
B = ClusterInput()
lng = ListLength(List=merge)
subtraction = Subtraction(A=lng, B=B)
multiplication = Multiplication(A=subtraction, B=2)
series = Series(Start=0, Step=1, Count=subtraction)
series_2 = Series(Start=0, Step=1, Count=multiplication)
item = ListItem(List=L, Index=series_2, Wrap=True)
item_2 = ListItem(List=merge, Index=series, Wrap=True)
sort = SortList(Keys=item, ValuesA=item)  # -> Keys, ValuesA
ins = InsertItems(List=sort.ValuesA, Item=[0, 1], Indices=[0, -1], Wrap=True)
cluster = Cluster_126(relay=crv_3, C=crv_3, relay_2=neg_4, t=ins)  # -> F, C_2
cluster_2 = Cluster_126(relay=crv_4, C=crv_4, relay_2=neg_2, t=ins)  # -> F, C_2
cluster_3 = Cluster_126(relay=crv_5, C=crv_5, relay_2=neg_3, t=ins)  # -> F, C_2
item_3 = ListItem(List=cluster.F, Index=3, Wrap=True)
item_4 = ListItem(List=cluster_2.F, Index=5, Wrap=True)
cluster_4 = Cluster_126(relay=crv_2, C=crv_2, relay_2=neg, t=ins)  # -> F, C_2
item_5 = ListItem(List=cluster_3.F, Index=7, Wrap=True)
item_6 = ListItem(List=cluster_4.F, Index=1, Wrap=True)
merge_3 = Merge(Data1=item_6, Data2=item_3, Data3=item_4, Data4=item_5)
item_7 = ListItem(List=cluster_4.F, Index=1, Wrap=True)
listdexs = ListIndices(List=cluster_4.F)
item_8 = ListItem(List=merge_3, Index=series, Wrap=True)
cull = CullPattern(List=listdexs, CullPattern=[True, False])
cull_2 = CullPattern(List=listdexs, CullPattern=[False, True])
item_9 = ListItem(List=cluster_4.F, Index=cull_2, Wrap=True)
item_10 = ListItem(List=cluster_4.F, Index=cull, Wrap=True)
area = Area(Geometry=item_8)  # -> Area, Centroid
i = ClusterOutput(item_9)
crv_cp = CurveClosestPoint(Point=area.Centroid, Curve=cluster_4.C_2)  # -> Point, Parameter, Distance
len = Length(Curve=cluster_4.C_2)
lng_2 = ListLength(List=item_10)
A = ClusterOutput(area.Area)
L_2 = ClusterOutput(len)
num = Number(expr("x+1", lng_2))
pline = PolyLine(Vertices=crv_cp.Point, Closed=True)
division = Division(A=len, B=num)
equals = Equality(FirstNumber=subtraction, SecondNumber=1)  # -> Equality, Inequality
cluster_5 = Cluster_125(A=area.Area, B=item_2)
explode = Explode(Curve=pline, Recursive=True)  # -> Segments, Vertices
len_2 = Length(Curve=explode.Segments)
x_plus_one = XPlusOne(NumberX=cull)
subtraction_2 = Subtraction(A=division, B=len_2)
ins_2 = InsertItems(List=cluster_5, Item=0, Indices=x_plus_one, Wrap=True)
max = Maximum(A=subtraction_2, B=0)
ma = MassAddition(Input=ins_2)  # -> Result, PartialResults
ma_2 = MassAddition(Input=max)  # -> Result, PartialResults
filter = StreamFilter(Gate=equals.Equality, Stream0=ma_2.Result, Stream1=0)
addition = Addition(A=filter, B=ma.Result)
num_2 = Number(addition)
num_3 = ClusterOutput(num_2)

# ==== cluster Cluster_128
num = ClusterInput()
num_2 = ClusterInput()
num_3 = ClusterInput()
num_4 = ClusterInput()
num_5 = Number(num)
num_6 = Number(num_2)
num_7 = Number(num_3)
num_8 = Number(num_4)
num_9 = ClusterOutput(num_5)
A = ClusterInput()
A_2 = ClusterInput()
A_3 = ClusterInput()
A_4 = ClusterInput()
dom = ConstructDomain(DomainStart=expr("x/2", num_5), DomainEnd=expr("-x/2", num_5))
dom_2 = ConstructDomain(DomainStart=expr("x/2", num_6), DomainEnd=expr("-x/2", num_6))
dom_3 = ConstructDomain(DomainStart=expr("x/2", num_7), DomainEnd=expr("-x/2", num_7))
dom_4 = ConstructDomain(DomainStart=expr("x/2", num_8), DomainEnd=expr("-x/2", num_8))
num_10 = ClusterOutput(num_6)
num_11 = ClusterOutput(num_7)
division = Division(A=A_2, B=num_6)
dom_5 = ConstructDomain(DomainStart=expr("x/2", division), DomainEnd=expr("-x/2", division))  # -> reverse(Domain)
I = ClusterOutput(division)
division_2 = Division(A=A_3, B=num_7)
dom_6 = ConstructDomain(DomainStart=expr("x/2", division_2), DomainEnd=expr("-x/2", division_2))  # -> reverse(Domain)
I_2 = ClusterOutput(division_2)
division_3 = Division(A=A_4, B=num_8)
dom_7 = ConstructDomain(DomainStart=expr("x/2", division_3), DomainEnd=expr("-x/2", division_3))  # -> reverse(Domain)
I_3 = ClusterOutput(division_3)
division_4 = Division(A=A, B=num_5)
dom_8 = ConstructDomain(DomainStart=expr("x/2", division_4), DomainEnd=expr("-x/2", division_4))  # -> reverse(Domain)
I_4 = ClusterOutput(division_4)
I_5 = ClusterOutput(dom_4)
R = ClusterOutput(division_4)
R_2 = ClusterOutput(division)
R_3 = ClusterOutput(division_2)
R_4 = ClusterOutput(division_3)

# ==== cluster Cluster_129
K = ClusterInput()
sort = SortList(Keys=K, ValuesA=K)  # -> Keys, ValuesA
entwine = Entwine(Branch00=0, Branch01=sort.ValuesA, Branch02=1, FlattenInputs=True)  # -> flatten(Result)
shift = ShiftList(List=entwine, Shift=1, Wrap=False)
dom = ConstructDomain(DomainStart=entwine, DomainEnd=shift)  # -> flatten(Domain)
cull_i = CullIndex(List=dom, Indices=-1, Wrap=True)
L = ClusterOutput(cull_i)

# ==== cluster Cluster_130
K = ClusterInput()
sort = SortList(Keys=K, ValuesA=K)  # -> Keys, ValuesA
dom = ConstructDomain(DomainStart=0, DomainEnd=1)  # -> flatten(Domain)
cull_i = CullIndex(List=dom, Indices=-1, Wrap=True)
I = ClusterOutput(dom)

# ==== cluster Cluster_131
brep = ClusterInput()
num = ClusterInput()
brep_2 = Brep(brep)
num_2 = Number()
debrep = DeconstructBrep(Brep=brep_2)  # -> Faces, Edges, Vertices
num_3 = Number(expr("x+1", num))
clean = CleanTree(RemoveNulls=True, RemoveInvalid=True, RemoveEmpty=True, Tree=debrep.Edges)
branch = TreeBranch(Tree=brep_2, Path=num_3, MaintainPaths=True)
join = JoinCurves(Curves=clean, Preserve=False)
item = ListItem(List=branch, Index="-1", Wrap=True)
area = Area(Geometry=join)  # -> Area, Centroid
lng = ListLength(List=join)
sort = SortList(Keys=area.Area, ValuesA=join)  # -> Keys, ValuesA
equals = Equality(FirstNumber=lng, SecondNumber=1)  # -> Equality, Inequality
bool = Boolean(True)
mindex = MemberIndex(Set=equals.Equality, Member=bool)  # -> Index, Count
panel = Panel(join)
item_2 = ListItem(List=sort.ValuesA, Index=mindex.Index, Wrap=True)
cull_i = CullIndex(List=sort.ValuesA, Indices=0, Wrap=True)
merge = Merge(Data1=cull_i, Data2=item_2)
R = ClusterOutput(merge)

# ==== cluster Terrazas
panel = Panel("""1
2
3
4""")
brep = ClusterInput()
srf = ClusterInput()
num = ClusterInput()
num_2 = ClusterInput()
num_3 = ClusterInput()
circulaciones_vanos = ClusterInput()
brep_2 = Brep(brep)
srf_2 = Surface(srf)
num_4 = Number(num_2)
num_5 = Number(num)
num_6 = Number(num_3)
branch = TreeBranch(Tree=num_6, Path=panel, MaintainPaths=True)
panel_2 = Panel("""-1
0""")
branch_2 = TreeBranch(Tree=num_5, Path=panel, MaintainPaths=True)
area = Area(Geometry=srf_2)  # -> Area, Centroid
panel_3 = Panel("""1
2
3
4""")
panel_4 = Panel(num_4)
circulaciones_vanos_2 = Number(circulaciones_vanos)
tstat = TreeStatistics(Tree=brep_2)  # -> Paths, Length, Count
branch_3 = TreeBranch(Tree=brep_2, Path=panel_2, MaintainPaths=True)
branch_4 = TreeBranch(Tree=brep_2, Path=panel_3, MaintainPaths=True)
num_7 = Number(branch_2)
num_8 = Number(num_5)
item = ListItem(List=num_6, Index=0, Wrap=True)  # -> Item, Item1, Item2, Item3
item_2 = ListItem(List=branch, Index=0, Wrap=True)  # -> Item, Item1, Item2, Item3
ma = MassAddition(Input=flatten(circulaciones_vanos_2))  # -> Result, PartialResults
clean = CleanTree(RemoveNulls=True, RemoveInvalid=True, RemoveEmpty=True, Tree=branch_4)
clean_2 = CleanTree(RemoveNulls=True, RemoveInvalid=True, RemoveEmpty=True, Tree=branch_3)
brep_3 = Brep()
lng = ListLength(List=clean)
lng_2 = ListLength(List=clean_2)
area_2 = Area(Geometry=clean)  # -> Area, Centroid
area_3 = Area(Geometry=clean_2)  # -> Area, Centroid
cluster = Cluster_132(L=item.Item, L_2=item.Item1, L_3=item.Item2, T=item.Item3, num=num_8)  # -> I, I_2, I_3, I_4, num_3
tstat_2 = TreeStatistics(Tree=brep_2)  # -> Paths, Length, Count
cluster_2 = Cluster_132(L=item_2.Item, L_2=item_2.Item1, L_3=item_2.Item2, T=item_2.Item3, num=num_7)  # -> I, I_2, I_3, I_4, num_3
series = Series(Start=ma.Result, Step=0, Count=lng_2)  # -> simplify(Series)
series_2 = Series(Start=circulaciones_vanos_2, Step=0, Count=lng)  # -> simplify(Series)
cluster_3 = Cluster_62(T=clean_2, relay=series)
cluster_4 = Cluster_62(T=lng, relay=series_2)
num_9 = Number(num_2)
panel_5 = Panel(num_6)
subtraction = Subtraction(A=area_3.Area, B=cluster_3)
subtraction_2 = Subtraction(A=area_2.Area, B=cluster_4)
merge = Merge(Data1=subtraction, Data2=subtraction_2)
item_3 = ListItem(List=merge, Index=cluster.I, Wrap=True)  # -> simplify(Item)
item_4 = ListItem(List=merge, Index=cluster.I_2, Wrap=True)  # -> simplify(Item)
item_5 = ListItem(List=merge, Index=cluster.I_3, Wrap=True)  # -> simplify(Item)
panel_6 = Panel(tstat.Paths)
su_residencial = Number(item_3)
su_oficinas = Number(item_4)
su_retail = Number(item_5)
item_6 = ListItem(List=srf_2, Index=cluster_2.I, Wrap=True)  # -> simplify(Item)
item_7 = ListItem(List=srf_2, Index=cluster_2.I_2, Wrap=True)  # -> simplify(Item)
item_8 = ListItem(List=srf_2, Index=cluster_2.I_3, Wrap=True)  # -> simplify(Item)
item_9 = ListItem(List=srf_2, Index=cluster_2.I_4, Wrap=True)  # -> simplify(Item)
brep_4 = Brep(brep_2)
su_residencial_2 = ClusterOutput(su_residencial)
su_oficinas_2 = ClusterOutput(su_oficinas)
su_retail_2 = ClusterOutput(su_retail)
item_10 = ListItem(List=cluster.num_3, Index=cluster.I_2, Wrap=True)  # -> simplify(Item)
item_11 = ListItem(List=cluster.num_3, Index=cluster.I, Wrap=True)  # -> simplify(Item)
item_12 = ListItem(List=cluster.num_3, Index=cluster.I_3, Wrap=True)  # -> simplify(Item)
item_13 = ListItem(List=cluster.num_3, Index=cluster.I_4, Wrap=True)  # -> simplify(Item)
i = ClusterOutput(item_6)
i_2 = ClusterOutput(item_7)
i_3 = ClusterOutput(item_8)
i_4 = ClusterOutput(item_9)
item_14 = TreeItem(Tree=brep_4, Path=graft(panel_6), Index=cluster.I_4, Wrap=True)  # -> simplify(BrepRet)
item_15 = TreeItem(Tree=brep_4, Path=graft(panel_6), Index=cluster.I, Wrap=True)  # -> simplify(BrepRes)
item_16 = TreeItem(Tree=brep_4, Path=graft(panel_6), Index=cluster.I_2, Wrap=True)  # -> simplify(BrepOfi)
item_17 = TreeItem(Tree=brep_4, Path=graft(panel_6), Index=cluster.I_3, Wrap=True)  # -> simplify(BrepRet)
clean_3 = CleanTree(RemoveNulls=True, RemoveInvalid=True, RemoveEmpty=True, Tree=item_13)
Z = UnitZ(Factor=item_11)
Z_2 = UnitZ(Factor=item_10)
Z_3 = UnitZ(Factor=item_12)
Z_4 = UnitZ(Factor=clean_3)
clean_4 = CleanTree(RemoveNulls=True, RemoveInvalid=True, RemoveEmpty=True, Tree=item_14)
extr = Extrude(Base=item_15, Direction=Z)
extr_2 = Extrude(Base=item_16, Direction=Z_2)
extr_3 = Extrude(Base=item_17, Direction=Z_3)
extr_4 = Extrude(Base=clean_4, Direction=Z_4)
E = ClusterOutput(extr)
E_2 = ClusterOutput(extr_4)
E_3 = ClusterOutput(extr_3)
E_4 = ClusterOutput(extr_2)

# ==== cluster Cluster_133
pt = ClusterInput()
C = ClusterInput()
pt_2 = Point(pt)
crv_cp = CurveClosestPoint(Point=pt_2, Curve=reparameterize(C))  # -> Point, Parameter, Distance
ln = Line(StartPoint=pt_2, EndPoint=crv_cp.Point)
pln = Plane(pt_2)
pln_2 = Plane(ln)
deplane = DeconstructPlane(Plane=pln_2)  # -> Origin, XAxis, YAxis, ZAxis
pl = ConstructPlane(Origin=deplane.Origin, XAxis=deplane.XAxis, YAxis=Vector(0, 1, 0))
pl_2 = ClusterOutput(pl)

# ==== cluster Cluster_134
crv = ClusterInput()
crv_2 = Curve(crv)
clean = CleanTree(RemoveNulls=True, RemoveInvalid=True, RemoveEmpty=True, Tree=crv_2)
explode = Explode(Curve=clean, Recursive=True)  # -> Segments, flatten(Vertices)
cullpt = CullDuplicates(Points=explode.Vertices, Tolerance=0.1, CullMode=1)  # -> Points, Indices, Valence
sort_pt = SortPoints(Points=cullpt.Points)  # -> Points, Indices
pdecon = Deconstruct(Point=sort_pt.Points)  # -> XComponent, YComponent, ZComponent
pt = ConstructPoint(XCoordinate=pdecon.XComponent, YCoordinate=pdecon.YComponent, ZCoordinate=0)
pgroups = PointGroups(Points=pt, Distance=0.01)  # -> Groups, Indices
item = ListItem(List=sort_pt.Points, Index=pgroups.Indices, Wrap=True)
pdecon_2 = Deconstruct(Point=item)  # -> XComponent, YComponent, ZComponent
sort = SortList(Keys=pdecon_2.ZComponent, ValuesA=item)  # -> Keys, ValuesA
lng = ListLength(List=sort.ValuesA)
equals = Equality(FirstNumber=lng, SecondNumber=1)  # -> Equality, Inequality
cull = CullPattern(List=sort.ValuesA, CullPattern=equals.Inequality)
shift = ShiftList(List=cull, Shift=1, Wrap=True)
L = ClusterOutput(cull)
ln = Line(StartPoint=cull, EndPoint=shift)
L_2 = ClusterOutput(shift)
item_2 = ListItem(List=ln, Index=0, Wrap=True)
panel = Panel(cull)

# ==== cluster Cluster_135
num = ClusterInput()
L = ClusterInput()
P = ClusterInput()
num_2 = Number(num)
panel = Panel(num_2)
cset = CreateSet(List=num_2)  # -> Set, Map
listdexs = ListIndices(List=L)
panel_2 = Panel("{0}")
num_3 = Number(expr("x+1", listdexs))
lng = ListLength(List=cset.Set)  # -> flatten(Length)
num_4 = Number(expr("x+1", num_2))
branch = TreeBranch(Tree=num_3, Path="{-1}", MaintainPaths=True)
branch_2 = TreeBranch(Tree=num_3, Path="{-2}", MaintainPaths=True)
branch_3 = TreeBranch(Tree=num_3, Path=P, MaintainPaths=True)
G = ClusterInput()
lng_2 = ListLength(List=branch_3)
lng_3 = ListLength(List=branch)
sort = SortList(Keys=num_4, ValuesA=num_4)  # -> Keys, ValuesA
addition = Addition(A=branch_2, B=lng_3)
sort_2 = SortList(Keys=flatten(lng_2), ValuesA=flatten(lng_2))  # -> Keys, ValuesA
addition_2 = Addition(A=lng, B=branch_3)
num_5 = Number(expr("x*-1", branch))
num_6 = Number(expr("x*-1", addition))
item = ListItem(List=sort_2.ValuesA, Index=0, Wrap=True)  # -> Item1, Item
filter = StreamFilter(Gate=G, Stream0=num_6)
merge = Merge(Data1=filter, Data2=num_5, Data3=sort.ValuesA, Data4=addition_2)
equals = Equality(FirstNumber=lng_2, SecondNumber=item.Item1)  # -> Equality, Inequality
num_7 = Number(expr("x-1", merge))
cull = CullPattern(List=branch_3, CullPattern=equals.Equality)
num_8 = ClusterOutput(num_7)
clean = CleanTree(RemoveNulls=True, RemoveInvalid=True, RemoveEmpty=True, Tree=cull)
tstat = TreeStatistics(Tree=clean)  # -> Paths, Length, Count
R = ClusterOutput(merge)
item_2 = ListItem(List=tstat.Paths, Index=0, Wrap=True)
branch_4 = TreeBranch(Tree=clean, Path=item_2, MaintainPaths=True)
addition_3 = Addition(A=lng, B=branch_4)
merge_2 = Merge(Data1=reverse(filter), Data2=reverse(num_5), Data3=sort.ValuesA, Data4=addition_3)
niv_gen_pisos = ClusterOutput(merge_2)
panel_3 = Panel(merge_2)

# ==== cluster Cluster_136
T = ClusterInput()
tstat = TreeStatistics(Tree=T)  # -> Paths, Length, Count
item = ListItem(List=tstat.Paths, Index=-1, Wrap=True)
branch = TreeBranch(Tree=T, Path=item, MaintainPaths=True)
cull_i = CullIndex(List=tstat.Paths, Indices=-1, Wrap=True)
listdexs = ListIndices(List=branch)
ins = InsertItems(List=branch, Item="TOTAL", Indices=-1, Wrap=True)  # -> flatten(List)
cull_i_2 = CullIndex(List=tstat.Paths, Indices=0, Wrap=True)
item_2 = ListItem(List=tstat.Paths, Index=0, Wrap=True)
tstat_2 = TreeStatistics(Tree=ins)  # -> Paths, Length, Count
branch_2 = TreeBranch(Tree=T, Path=cull_i, MaintainPaths=True)
replace = ReplacePaths(Data=ins, Search=tstat_2.Paths, Replace=cull_i_2)
replace_2 = ReplacePaths(Data="Superficie Edificada Subterraneo", Search="{0}", Replace=item_2)
replace_3 = ReplacePaths(Search="{0}", Replace=cull_i_2)
merge = Merge(Data1=branch_2, Data2=replace)
D = ClusterOutput(replace_3)
D_2 = ClusterOutput(replace_2)
R = ClusterOutput(merge)

# ==== cluster Cluster_137
T = ClusterInput()
clean = CleanTree(RemoveNulls=True, RemoveInvalid=True, RemoveEmpty=True, Tree=T)
I = ClusterInput()
tstat = TreeStatistics(Tree=clean)  # -> Paths, Length, Count
item = ListItem(List=tstat.Paths, Index=-1, Wrap=True)
branch = TreeBranch(Tree=clean, Path=item, MaintainPaths=True)
listdexs = ListIndices(List=branch)
cull_i = CullIndex(List=tstat.Paths, Indices=-1, Wrap=True)
ins = InsertItems(List=branch, Item=I, Indices=-1, Wrap=True)  # -> flatten(List)
tstat_2 = TreeStatistics(Tree=ins)  # -> Paths, Length, Count
branch_2 = TreeBranch(Tree=clean, Path=cull_i, MaintainPaths=True)
replace = ReplacePaths(Data=ins, Search=tstat_2.Paths, Replace=item)
merge = Merge(Data1=branch_2, Data2=replace)
R = ClusterOutput(merge)
panel = Panel(T)

# ==== cluster Cluster_138
T = ClusterInput()
tstat = TreeStatistics(Tree=T)  # -> Paths, Length, Count
item = ListItem(List=tstat.Paths, Index=-1, Wrap=True)
branch = TreeBranch(Tree=T, Path=item, MaintainPaths=True)
cull_i = CullIndex(List=tstat.Paths, Indices=-1, Wrap=True)
listdexs = ListIndices(List=branch)
ins = InsertItems(List=branch, Item="TOTAL", Indices=-1, Wrap=True)  # -> flatten(List)
cull_i_2 = CullIndex(List=tstat.Paths, Indices=0, Wrap=True)
listdexs_2 = ListIndices(List=cull_i_2)
panel = Panel(T)
item_2 = ListItem(List=tstat.Paths, Index=0, Wrap=True)
replace = ReplaceItems(List=listdexs_2, Indices=listdexs_2, Wrap=False)  # -> graft(List)
tstat_2 = TreeStatistics(Tree=ins)  # -> Paths, Length, Count
branch_2 = TreeBranch(Tree=T, Path=cull_i, MaintainPaths=True)
tstat_3 = TreeStatistics(Tree=replace)  # -> Paths, Length, Count
replace_2 = ReplacePaths(Data=ins, Search=tstat_2.Paths, Replace=cull_i_2)
replace_3 = ReplacePaths(Data="Superficie Edificada Sobre Terreno", Search="{0}", Replace=item_2)
merge = Merge(Data1=branch_2, Data2=replace_2)
replace_4 = ReplacePaths(Data=replace, Search=tstat_3.Paths, Replace=cull_i_2)
D = ClusterOutput(replace_4)
D_2 = ClusterOutput(replace_3)
R = ClusterOutput(merge)
panel_2 = Panel(replace_3)

# ==== cluster Cluster_139
T = ClusterInput()
relay = ClusterInput()
branch = TreeBranch(Tree=T, Path="{0}", MaintainPaths=True)
listdexs = ListIndices(List=branch)
listdexs_2 = ListIndices(List=relay)
replace = ReplaceItems(List=branch, Indices=listdexs, Wrap=False)  # -> simplify(List)
replace_2 = ReplaceItems(List=relay, Indices=listdexs_2, Wrap=False)  # -> simplify(List)
merge = Merge(Data1=replace, Data2=replace_2)
R = ClusterOutput(merge)
panel = Panel(merge)

# ==== cluster FormatoEPI
relay = ClusterInput()
panel = Panel("""1
2
3
4""")
panel_2 = Panel("""-2
-1
0""")
branch = TreeBranch(Superficie=relay, Torres=panel, MaintainPaths=True)
branch_2 = TreeBranch(Superficie=relay, Torres=panel_2, MaintainPaths=True)
panel_3 = Panel("""-2
-1""")
branch_3 = TreeBranch(Superficie=relay, Podio="{0}", MaintainPaths=True)
clean = CleanTree(RemoveNulls=False, RemoveInvalid=True, RemoveEmpty=True, Superficie=branch_2)
branch_4 = TreeBranch(Superficie=relay, Subtes=panel_3, MaintainPaths=True)
clean_2 = CleanTree(RemoveNulls=True, RemoveInvalid=True, RemoveEmpty=True, Superficie=branch)
pisos = ClusterInput()
lng = ListLength(List=branch_3)
listdexs = ListIndices(List=branch_3)
branch_5 = TreeBranch(Superficie=pisos, Path="{-2}", MaintainPaths=True)
num = Number(clean_2)
lng_2 = ListLength(BackcountSub=flatten(clean))
clean_3 = CleanTree(RemoveNulls=False, RemoveInvalid=True, RemoveEmpty=True, Superficie=branch_4)  # -> flatten(Tree)
pisos_2 = Number(flatten(pisos))
equals = Equality(FirstNumber=lng, SecondNumber=0)  # -> Equality, Inequality
listdexs_2 = ListIndices(List=pisos_2)
listdexs_3 = ListIndices(List=num)
num_2 = Number(num)
listdexs_4 = ListIndices(List=branch_5)
listdexs_5 = ListIndices(List=clean_3)
replace = ReplaceItems(List=pisos_2, Indices=listdexs_2, Wrap=False)  # -> simplify(List)
addition = Addition(BackcountPodio=lng_2, B=listdexs_3)
lng_3 = ListLength(List=listdexs_5)
i = ClusterOutput(listdexs_4)
replace_2 = ReplaceItems(List=replace, Item=num, Indices=addition, Wrap=False)  # -> simplify(List)
addition_2 = Addition(A=lng_3, B=listdexs)
filter = StreamFilter(Gate=equals.Equality, Stream0=addition_2)
cluster = Cluster_140(relay=replace_2, T=num)
merge = Merge(Data1=clean_3, Data2=branch_3)
cluster_2 = Cluster_140(relay=filter, T=num_2)
replace_3 = ReplaceItems(List=replace, Item=clean_3, Indices=listdexs_5, Wrap=False)  # -> simplify(List)
cluster_3 = Cluster_140(relay=branch_3, T=num)
cluster_4 = Cluster_140(relay=listdexs_5, T=num_2)
cluster_5 = Cluster_141(relay=cluster)
clean_4 = CleanTree(RemoveNulls=True, RemoveInvalid=True, RemoveEmpty=True, Tree=cluster)  # -> simplify(Tree)
clean_5 = CleanTree(RemoveNulls=True, RemoveInvalid=True, RemoveEmpty=True, Tree=replace_3)  # -> simplify(Tree)
cluster_6 = Cluster_140(relay=clean_3, T=num_2)
merge_2 = Merge(Data1=cluster_4, Data2=cluster_2, Data3=cluster_5)
merge_3 = Merge(Data1=cluster_6, Data2=cluster_5)
ma = MassAddition(Input=merge_3)  # -> Superficie000, PartialResults
ma_2 = MassAddition(Input=[clean_4, cluster_3])  # -> Superficie000, PartialResults
replace_4 = ReplaceItems(List=cluster, Item=merge, Indices=merge_2, Wrap=False)  # -> simplify(AreasFormatoNaked)
panel_4 = Panel(merge_2)
clean_6 = CleanTree(RemoveNulls=True, RemoveInvalid=True, RemoveEmpty=True, Tree=ma.Superficie000)  # -> simplify(Tree)
ma_3 = MassAddition(Input=[clean_6, ma_2.Superficie000])  # -> Result, PartialResults
null = NullItem(Item=replace_4)  # -> NullFlags, InvalidFlags, Description
merge_4 = Merge(Data1=ma.Superficie000, Data2=ma_2.Superficie000, Data3=ma_3.Result)
listdexs_6 = ListIndices(List=merge_4)
expression = Expression(x=null.NullFlags, y=replace_4, Expression="if(x=True, 0,y)")
ins = InsertItems(List=replace_4, Item=merge_4, Indices=-1, Wrap=True)
replace_5 = ReplaceItems(List=merge_4, Indices=listdexs_6, Wrap=False)
replace_6 = ReplaceItems(List=replace_2, Item=pisos_2, Indices=listdexs_2, Wrap=False)  # -> simplify(List)
ins_2 = InsertItems(List=replace_6, Item=replace_5, Indices=-1, Wrap=True)  # -> simplify(PisosFormato)
R = ClusterOutput(expression)

# ==== cluster Cluster_142
num = ClusterInput()
num_2 = Number(num)
listdexs = ListIndices(List=num_2)
replace = ReplaceItems(List=num_2, Indices=listdexs, Wrap=False)  # -> simplify(List)
panel = Panel("""-2
-1
0""")
branch = TreeBranch(Tree=replace, Path=panel, MaintainPaths=True)
B = ClusterOutput(branch)

# ==== cluster EstCom
L = ClusterInput()
index_est = ClusterInput()
index_est_2 = Number(index_est)
L_2 = Number(L)
listdexs = ListIndices(List=L_2)
cull_i = CullIndex(List=listdexs, Indices=index_est_2, Wrap=True)  # -> simplify(List)
replace = ReplaceItems(List=L_2, Indices=cull_i, Wrap=False)
replace_2 = ReplaceItems(List=L_2, Indices=index_est_2, Wrap=False)
cluster = Cluster_143(relay=replace_2)
cluster_2 = Cluster_143(relay=replace)
R = ClusterOutput(cluster_2)
R_2 = ClusterOutput(cluster)

# ==== cluster Cluster_147
num = ClusterInput()
pisos = ClusterInput()
cluster = Cluster_144(num=num)
panel = Panel("""Area
Estac.""")
panel_2 = Panel("""Area Total
A'""")
d1 = ClusterInput()
txt = Text("Construibles")
ins = InsertItems(List=cluster, Item=panel, Indices=0, Wrap=True)
merge = Merge(Data1=d1, Data2=panel_2)
cluster_2 = Totales(pisos=pisos, areas=num)
ins_2 = InsertItems(List=ins, Item=merge, Indices=0, Wrap=True)
num_2 = Number(cluster_2)
ins_3 = InsertItems(List=ins_2, Item=cluster_2, Indices=-1, Wrap=True)
cluster_3 = Cluster_145(d1=d1, L=num_2)
cluster_4 = Cluster_146(I=cluster_3, T=ins_3)
R = ClusterOutput(cluster_4)

# ==== cluster Cluster_148
num = ClusterInput()
pisos = ClusterInput()
d1 = ClusterInput()
cluster = Totales(pisos=pisos, areas=num)
panel = Panel("""Area 
Comercial""")
cluster_2 = Cluster_144(num=num)
ins = InsertItems(List=cluster_2, Item=panel, Indices=0, Wrap=True)
merge = Merge(Data1=d1, Data3="A''")
ins_2 = InsertItems(List=ins, Item=merge, Indices=0, Wrap=True)
num_2 = Number(cluster)
ins_3 = InsertItems(List=ins_2, Item=cluster, Indices=-1, Wrap=True)
cluster_3 = Cluster_145(d1=d1, L=num_2)
cluster_4 = Cluster_146(I=cluster_3, T=ins_3)
R = ClusterOutput(cluster_4)

# ==== cluster Cluster_149
num = ClusterInput()
pisos = ClusterInput()
cluster = Cluster_144(num=num)
panel = Panel("""Ascensor
Estac.""")
panel_2 = Panel("""Vacios
B'""")
d1 = ClusterInput()
txt = Text("Construibles")
ins = InsertItems(List=cluster, Item=panel, Indices=0, Wrap=True)
merge = Merge(Data1=d1, Data2=panel_2)
cluster_2 = Totales(pisos=pisos, areas=num)
ins_2 = InsertItems(List=ins, Item=merge, Indices=0, Wrap=True)
ins_3 = InsertItems(List=ins_2, Item=cluster_2, Indices=-1, Wrap=True)
num_2 = Number(cluster_2)
cluster_3 = Cluster_145(d1=d1, L=num_2)
cluster_4 = Cluster_146(I=cluster_3, T=ins_3)
R = ClusterOutput(cluster_4)

# ==== cluster Cluster_150
num = ClusterInput()
cluster = Cluster_144(num=num)
pisos = ClusterInput()
panel = Panel("""Ascensor
Comercial""")
d1 = ClusterInput()
ins = InsertItems(List=cluster, Item=panel, Indices=0, Wrap=True)
merge = Merge(Data1=d1, Data2="B''")
cluster_2 = Totales(pisos=pisos, areas=num)
ins_2 = InsertItems(List=ins, Item=merge, Indices=0, Wrap=True)
ins_3 = InsertItems(List=ins_2, Item=cluster_2, Indices=-1, Wrap=True)
num_2 = Number(cluster_2)
cluster_3 = Cluster_145(d1=d1, L=num_2)
cluster_4 = Cluster_146(I=cluster_3, T=ins_3)
R = ClusterOutput(cluster_4)

# ==== cluster Cluster_151
num = ClusterInput()
pisos = ClusterInput()
cluster = Cluster_144(num=num)
panel = Panel("""Shafts
Comercial""")
d1 = ClusterInput()
ins = InsertItems(List=cluster, Item=panel, Indices=0, Wrap=True)
merge = Merge(Data1=d1, Data2="C''")
ins_2 = InsertItems(List=ins, Item=merge, Indices=0, Wrap=True)
cluster_2 = Totales(pisos=pisos, areas=num)
ins_3 = InsertItems(List=ins_2, Item=cluster_2, Indices=-1, Wrap=True)
num_2 = Number(cluster_2)
cluster_3 = Cluster_145(d1=d1, L=num_2)
cluster_4 = Cluster_146(I=cluster_3, T=ins_3)
R = ClusterOutput(cluster_4)

# ==== cluster Cluster_152
num = ClusterInput()
pisos = ClusterInput()
cluster = Cluster_144(num=num)
panel = Panel("""Shafts
Estac.""")
d1 = ClusterInput()
txt = Text("Construibles")
ins = InsertItems(List=cluster, Item=panel, Indices=0, Wrap=True)
merge = Merge(Data1=d1, Data2="C'")
cluster_2 = Totales(pisos=pisos, areas=num)
ins_2 = InsertItems(List=ins, Item=merge, Indices=0, Wrap=True)
num_2 = Number(cluster_2)
ins_3 = InsertItems(List=ins_2, Item=cluster_2, Indices=-1, Wrap=True)
cluster_3 = Cluster_145(d1=d1, L=num_2)
cluster_4 = Cluster_146(I=cluster_3, T=ins_3)
R = ClusterOutput(cluster_4)

# ==== cluster Cluster_153
num = ClusterInput()
pisos = ClusterInput()
cluster = Cluster_144(num=num)
panel = Panel("""Area 
Comercial""")
d1 = ClusterInput()
ins = InsertItems(List=cluster, Item=panel, Indices=0, Wrap=True)
merge = Merge(Data1=d1, Data2="D''")
cluster_2 = Totales(pisos=pisos, areas=num)
ins_2 = InsertItems(List=ins, Item=merge, Indices=0, Wrap=True)
ins_3 = InsertItems(List=ins_2, Item=cluster_2, Indices=-1, Wrap=True)
num_2 = Number(cluster_2)
cluster_3 = Cluster_145(d1=d1, L=num_2)
cluster_4 = Cluster_146(I=cluster_3, T=ins_3)
R = ClusterOutput(cluster_4)

# ==== cluster NBUyG
L = ClusterInput()
index_est = ClusterInput()
L_2 = Number(L)
index_est_2 = Number(index_est)
listdexs = ListIndices(List=L_2)
cull_i = CullIndex(List=listdexs, Indices=index_est_2, Wrap=True)  # -> simplify(List)
listdexs_2 = ListIndices(List=L_2)
replace = ReplaceItems(List=L_2, Indices=cull_i, Wrap=False)
replace_2 = ReplaceItems(List=L_2, Indices=listdexs_2, Wrap=False)
cluster = Cluster_143(relay=L_2)
area_comercial = ClusterOutput(replace_2)
R = ClusterOutput(cluster)
panel = Panel(cluster)

# ==== cluster Cluster_154
num = ClusterInput()
pisos = ClusterInput()
cluster = Cluster_144(num=num)
panel = Panel("""Area
Estac.""")
panel_2 = Panel("""Escaleras
D'""")
d1 = ClusterInput()
txt = Text("Construibles")
ins = InsertItems(List=cluster, Item=panel, Indices=0, Wrap=True)
merge = Merge(Data1=d1, Data2=panel_2)
ins_2 = InsertItems(List=ins, Item=merge, Indices=0, Wrap=True)
cluster_2 = Totales(pisos=pisos, areas=num)
ins_3 = InsertItems(List=ins_2, Item=cluster_2, Indices=-1, Wrap=True)
num_2 = Number(cluster_2)
cluster_3 = Cluster_145(d1=d1, L=num_2)
cluster_4 = Cluster_146(I=cluster_3, T=ins_3)
R = ClusterOutput(cluster_4)

# ==== cluster Cluster_155
num = ClusterInput()
pisos = ClusterInput()
cluster = Cluster_144(num=num)
panel = Panel("""Area 
Comercial""")
d1 = ClusterInput()
ins = InsertItems(List=cluster, Item=panel, Indices=0, Wrap=True)
merge = Merge(Data1=d1, Data2="E''")
cluster_2 = Totales(pisos=pisos, areas=num)
ins_2 = InsertItems(List=ins, Item=merge, Indices=0, Wrap=True)
num_2 = Number(cluster_2)
ins_3 = InsertItems(List=ins_2, Item=cluster_2, Indices=-1, Wrap=True)
cluster_3 = Cluster_145(d1=d1, L=num_2)
cluster_4 = Cluster_146(I=cluster_3, T=ins_3)
R = ClusterOutput(cluster_4)

# ==== cluster Cluster_156
num = ClusterInput()
cluster = Cluster_144(num=num)
pisos = ClusterInput()
panel = Panel("""A'
Estacionamiento""")
d1 = ClusterInput()
txt = Text("No Vendibles")
panel_2 = Panel("""Halls/Lobbies
E'""")
ins = InsertItems(List=cluster, Item=txt, Indices=0, Wrap=True)
merge = Merge(Data1=d1, Data2=panel_2)
cluster_2 = Totales(pisos=pisos, areas=num)
ins_2 = InsertItems(List=ins, Item=merge, Indices=0, Wrap=True)
num_2 = Number(cluster_2)
ins_3 = InsertItems(List=ins_2, Item=cluster_2, Indices=-1, Wrap=True)
cluster_3 = Cluster_145(d1=d1, L=num_2)
cluster_4 = Cluster_146(I=cluster_3, T=ins_3)
R = ClusterOutput(cluster_4)

# ==== cluster Terraza
L = ClusterInput()
index_est = ClusterInput()
L_2 = Number(L)
index_est_2 = Number(index_est)
listdexs = ListIndices(List=L_2)
cull_i = CullIndex(List=listdexs, Indices=index_est_2, Wrap=True)  # -> simplify(List)
listdexs_2 = ListIndices(List=L_2)
replace = ReplaceItems(List=L_2, Indices=cull_i, Wrap=False)
replace_2 = ReplaceItems(List=L_2, Indices=listdexs_2, Wrap=False)
cluster = Cluster_143(relay=L_2)
panel = Panel(index_est)
area_comercial = ClusterOutput(replace_2)
R = ClusterOutput(cluster)

# ==== cluster Cluster_157
num = ClusterInput()
cluster = Cluster_144(num=num)
pisos = ClusterInput()
d1 = ClusterInput()
ins = InsertItems(List=cluster, Item="Municipal", Indices=0, Wrap=True)
merge = Merge(Data1=d1, Data2="F''")
cluster_2 = Totales(pisos=pisos, areas=num)
ins_2 = InsertItems(List=ins, Item=merge, Indices=0, Wrap=True)
ins_3 = InsertItems(List=ins_2, Item=cluster_2, Indices=-1, Wrap=True)
num_2 = Number(cluster_2)
cluster_3 = Cluster_145(d1=d1, L=num_2)
cluster_4 = Cluster_146(I=cluster_3, T=ins_3)
R = ClusterOutput(cluster_4)

# ==== cluster Cluster_158
num = ClusterInput()
cluster = Cluster_144(num=num)
pisos = ClusterInput()
d1 = ClusterInput()
txt = Text("Construibles")
panel = Panel("""Terrazas
F'""")
ins = InsertItems(List=cluster, Item=txt, Indices=0, Wrap=True)
merge = Merge(Data1=d1, Data2=panel)
cluster_2 = Totales(pisos=pisos, areas=num)
ins_2 = InsertItems(List=ins, Item=merge, Indices=0, Wrap=True)
ins_3 = InsertItems(List=ins_2, Item=cluster_2, Indices=-1, Wrap=True)
num_2 = Number(cluster_2)
cluster_3 = Cluster_145(d1=d1, L=num_2)
cluster_4 = Cluster_146(I=cluster_3, T=ins_3)
R = ClusterOutput(cluster_4)

# ==== cluster Cluster_159
num = ClusterInput()
pisos = ClusterInput()
d1 = ClusterInput()
cluster = Cluster_144(num=num)
ins = InsertItems(List=cluster, Item="Area Total", Indices=0, Wrap=True)
merge = Merge(Data1=d1, Data2="A")
cluster_2 = Totales(pisos=pisos, areas=num)
ins_2 = InsertItems(List=ins, Item=merge, Indices=0, Wrap=True)
num_2 = Number(cluster_2)
ins_3 = InsertItems(List=ins_2, Item=cluster_2, Indices=-1, Wrap=True)
cluster_3 = Cluster_145(d1=d1, L=num_2)
cluster_4 = Cluster_146(I=cluster_3, T=ins_3)
R = ClusterOutput(cluster_4)

# ==== cluster Cluster_160
num = ClusterInput()
pisos = ClusterInput()
cluster = Cluster_144(num=num)
d1 = ClusterInput()
ins = InsertItems(List=cluster, Item="Total Ascensor", Indices=0, Wrap=True)
merge = Merge(Data1=d1, Data2="B")
cluster_2 = Totales(pisos=pisos, areas=num)
ins_2 = InsertItems(List=ins, Item=merge, Indices=0, Wrap=True)
ins_3 = InsertItems(List=ins_2, Item=cluster_2, Indices=-1, Wrap=True)
num_2 = Number(cluster_2)
cluster_3 = Cluster_145(d1=d1, L=num_2)
cluster_4 = Cluster_146(I=cluster_3, T=ins_3)
R = ClusterOutput(cluster_4)

# ==== cluster Cluster_161
d1 = ClusterInput()
pisos = ClusterInput()
num = ClusterInput()
cluster = Cluster_144(num=num)
ins = InsertItems(List=cluster, Item="Total Shafts", Indices=0, Wrap=True)
cluster_2 = Totales(pisos=pisos, areas=num)
merge = Merge(Data1=d1, Data2="C")
ins_2 = InsertItems(List=ins, Item=merge, Indices=0, Wrap=True)
ins_3 = InsertItems(List=ins_2, Item=cluster_2, Indices=-1, Wrap=True)
num_2 = Number(cluster_2)
cluster_3 = Cluster_145(d1=d1, L=num_2)
cluster_4 = Cluster_146(I=cluster_3, T=ins_3)
R = ClusterOutput(cluster_4)

# ==== cluster Cluster_162
num = ClusterInput()
pisos = ClusterInput()
panel = Panel("""Total 
Escaleras""")
cluster = Cluster_144(num=num)
d1 = ClusterInput()
ins = InsertItems(List=cluster, Item=panel, Indices=0, Wrap=True)
merge = Merge(Data1=d1, Data2="D")
cluster_2 = Totales(pisos=pisos, areas=num)
ins_2 = InsertItems(List=ins, Item=merge, Indices=0, Wrap=True)
num_2 = Number(cluster_2)
ins_3 = InsertItems(List=ins_2, Item=cluster_2, Indices=-1, Wrap=True)
cluster_3 = Cluster_145(d1=d1, L=num_2)
cluster_4 = Cluster_146(I=cluster_3, T=ins_3)
R = ClusterOutput(cluster_4)

# ==== cluster Cluster_163
num = ClusterInput()
num_2 = Number(num)
listdexs = ListIndices(List=num_2)
replace = ReplaceItems(List=num_2, Indices=listdexs, Wrap=False)  # -> simplify(List)
panel = Panel("""-2
-1""")
branch = TreeBranch(Tree=replace, Path=panel, MaintainPaths=True)
B = ClusterOutput(branch)

# ==== cluster Cluster_164
num = ClusterInput()
cluster = Cluster_144(num=num)
pisos = ClusterInput()
panel = Panel("""Shafts
Interior""")
d1 = ClusterInput()
ins = InsertItems(List=cluster, Item=panel, Indices=0, Wrap=True)
merge = Merge(Data1=d1, Data2="C'''")
ins_2 = InsertItems(List=ins, Item=merge, Indices=0, Wrap=True)
cluster_2 = Totales(pisos=pisos, areas=num)
ins_3 = InsertItems(List=ins_2, Item=cluster_2, Indices=-1, Wrap=True)
num_2 = Number(cluster_2)
cluster_3 = Cluster_145(d1=d1, L=num_2)
cluster_4 = Cluster_146(I=cluster_3, T=ins_3)
R = ClusterOutput(cluster_4)

# ==== cluster Cluster_165
num = ClusterInput()
cluster = Cluster_144(num=num)
pisos = ClusterInput()
d1 = ClusterInput()
ins = InsertItems(List=cluster, Item="Sup. Bruta", Indices=0, Wrap=True)
panel = Panel("""Superficie Municipal
H=A-B-C-D+F"
""")
cluster_2 = Totales(pisos=pisos, areas=num)
merge = Merge(Data1=d1, Data2=panel)
ins_2 = InsertItems(List=ins, Item=merge, Indices=0, Wrap=True)
ins_3 = InsertItems(List=ins_2, Item=cluster_2, Indices=-1, Wrap=True)
num_2 = Number(cluster_2)
cluster_3 = Cluster_145(d1=d1, L=num_2)
cluster_4 = Cluster_146(I=cluster_3, T=ins_3)
R = ClusterOutput(cluster_4)

# ==== cluster Cluster_166
num = ClusterInput()
cluster = Cluster_144(num=num)
pisos = ClusterInput()
d1 = ClusterInput()
cluster_2 = Totales(pisos=pisos, areas=num)
ins = InsertItems(List=cluster, Item="Sup. Comun", Indices=0, Wrap=True)
merge = Merge(Data1=d1, Data2="I=E'+E''")
ins_2 = InsertItems(List=ins, Item=merge, Indices=0, Wrap=True)
num_2 = Number(cluster_2)
ins_3 = InsertItems(List=ins_2, Item=cluster_2, Indices=-1, Wrap=True)
cluster_3 = Cluster_145(d1=d1, L=num_2)
cluster_4 = Cluster_146(I=cluster_3, T=ins_3)
R = ClusterOutput(cluster_4)

# ==== cluster Cluster_167
num = ClusterInput()
cluster = Cluster_144(num=num)
pisos = ClusterInput()
d1 = ClusterInput()
ins = InsertItems(List=cluster, Item="Sup. Util", Indices=0, Wrap=True)
cluster_2 = Totales(pisos=pisos, areas=num)
merge = Merge(Data1=d1, Data2="J=H-I")
ins_2 = InsertItems(List=ins, Item=merge, Indices=0, Wrap=True)
num_2 = Number(cluster_2)
ins_3 = InsertItems(List=ins_2, Item=cluster_2, Indices=-1, Wrap=True)
cluster_3 = Cluster_145(d1=d1, L=num_2)
cluster_4 = Cluster_146(I=cluster_3, T=ins_3)
R = ClusterOutput(cluster_4)

# ==== cluster Cluster_169
num = ClusterInput()
cluster = Cluster_144(num=num)
d1 = ClusterInput()
ins = InsertItems(List=cluster, Item="Niveles", Indices=0, Wrap=True)
pisos = ClusterInput()
cluster_2 = Totales(pisos=pisos, areas=num)
merge = Merge(Data1=d1)
ins_2 = InsertItems(List=ins, Item=merge, Indices=0, Wrap=True)
num_2 = Number(cluster_2)
cluster_3 = Cluster_168(d1=d1, L=num_2)
ins_3 = InsertItems(List=ins_2, Indices=-1, Wrap=True)
cluster_4 = Cluster_146(I=cluster_3, T=ins_3)
panel = Panel(cluster_4)
R = ClusterOutput(cluster_4)

# ==== cluster Cluster_170
num = ClusterInput()
cluster = Cluster_144(num=num)
pisos = ClusterInput()
d1 = ClusterInput()
ins = InsertItems(List=cluster, Item="Interior", Indices=0, Wrap=True)
cluster_2 = Totales(pisos=pisos, areas=num)
merge = Merge(Data1=d1, Data2="GBA")
ins_2 = InsertItems(List=ins, Item=merge, Indices=0, Wrap=True)
num_2 = Number(cluster_2)
ins_3 = InsertItems(List=ins_2, Item=cluster_2, Indices=-1, Wrap=True)
cluster_3 = Cluster_145(d1=d1, L=num_2)
cluster_4 = Cluster_146(I=cluster_3, T=ins_3)
R = ClusterOutput(cluster_4)

# ==== cluster Cluster_171
num = ClusterInput()
cluster = Cluster_144(num=num)
pisos = ClusterInput()
d1 = ClusterInput()
ins = InsertItems(List=cluster, Item="Terrazas", Indices=0, Wrap=True)
merge = Merge(Data1=d1)
ins_2 = InsertItems(List=ins, Item=merge, Indices=0, Wrap=True)
cluster_2 = Totales(pisos=pisos, areas=num)
num_2 = Number(cluster_2)
ins_3 = InsertItems(List=ins_2, Item=cluster_2, Indices=-1, Wrap=True)
cluster_3 = Cluster_145(d1=d1, L=num_2)
cluster_4 = Cluster_146(I=cluster_3, T=ins_3)
R = ClusterOutput(cluster_4)

# ==== cluster Cluster_172
num = ClusterInput()
cluster = Cluster_144(num=num)
d1 = ClusterInput()
pisos = ClusterInput()
ins = InsertItems(List=cluster, Item="Total", Indices=0, Wrap=True)
merge = Merge(Data1=d1)
cluster_2 = Totales(pisos=pisos, areas=num)
ins_2 = InsertItems(List=ins, Item=merge, Indices=0, Wrap=True)
num_2 = Number(cluster_2)
ins_3 = InsertItems(List=ins_2, Item=cluster_2, Indices=-1, Wrap=True)
cluster_3 = Cluster_145(d1=d1, L=num_2)
cluster_4 = Cluster_146(I=cluster_3, T=ins_3)
R = ClusterOutput(cluster_4)

# ==== cluster Cluster_173
num = ClusterInput()
cluster = Cluster_144(num=num)
d1 = ClusterInput()
pisos = ClusterInput()
ins = InsertItems(List=cluster, Item="Interior", Indices=0, Wrap=True)
merge = Merge(Data1=d1, Data2="GLA")
cluster_2 = Totales(pisos=pisos, areas=num)
ins_2 = InsertItems(List=ins, Item=merge, Indices=0, Wrap=True)
ins_3 = InsertItems(List=ins_2, Item=cluster_2, Indices=-1, Wrap=True)
num_2 = Number(cluster_2)
cluster_3 = Cluster_145(d1=d1, L=num_2)
cluster_4 = Cluster_146(I=cluster_3, T=ins_3)
R = ClusterOutput(cluster_4)

# ==== cluster Cluster_174
num = ClusterInput()
num_2 = ClusterInput()
num_3 = ClusterInput()
num_4 = Number(num_2)
num_5 = Number(num)
num_6 = Number(num_3)
panel = Panel("""-1
0
1
2
3
4""")
panel_2 = Panel(num_5)
item = ListItem(List=num_6, Index=0, Wrap=True)  # -> Item, Item1, Item2, Item3
num_7 = Number(num_5)
branch = TreeBranch(Tree=num_6, Path=panel, MaintainPaths=True)
branch_2 = TreeBranch(Tree=item.Item3, Path="{-2}", MaintainPaths=True)
branch_3 = TreeBranch(Tree=num_5, Path=panel, MaintainPaths=True)
clean = CleanTree(RemoveNulls=True, RemoveInvalid=True, RemoveEmpty=True, Tree=branch)
branch_4 = TreeBranch(Tree=num_4, Path=panel, MaintainPaths=True)
item_2 = ListItem(List=clean, Index=0, Wrap=True)  # -> Item, Item1, Item2, Item3
num_8 = Number(branch_3)
num_9 = Number(branch_4)
cset = CreateSet(List=item_2.Item)  # -> Set, Map
cset_2 = CreateSet(List=item_2.Item1)  # -> Set, Map
cset_3 = CreateSet(List=item_2.Item2)  # -> Set, Map
cset_4 = CreateSet(List=branch_2)  # -> Set, Map
num_10 = Number(num_7)
mindex = MemberIndex(Set=cset_4.Set, Member=num_10)  # -> Index, Count
mindex_2 = MemberIndex(Set=cset.Set, Member=num_8)  # -> Index, Count
mindex_3 = MemberIndex(Set=cset_2.Set, Member=num_8)  # -> Index, Count
mindex_4 = MemberIndex(Set=cset_3.Set, Member=num_8)  # -> Index, Count
mindex_5 = MemberIndex(Set=mindex_2.Count, Member=1)  # -> Index, Count
mindex_6 = MemberIndex(Set=mindex_3.Count, Member=1)  # -> Index, Count
mindex_7 = MemberIndex(Set=mindex_4.Count, Member=1)  # -> Index, Count
mindex_8 = MemberIndex(Set=mindex.Count, Member=1)  # -> Index, Count
num_11 = Number(num_2)
item_3 = ListItem(List=num_9, Index=mindex_5.Index, Wrap=True)  # -> simplify(Item)
item_4 = ListItem(List=num_9, Index=mindex_6.Index, Wrap=True)  # -> simplify(Item)
item_5 = ListItem(List=num_11, Index=mindex_8.Index, Wrap=True)  # -> simplify(Item)
item_6 = ListItem(List=num_9, Index=mindex_7.Index, Wrap=True)  # -> simplify(Item)
clean_2 = CleanTree(RemoveNulls=True, RemoveInvalid=True, RemoveEmpty=False, Tree=item_3)  # -> flatten(Tree)
clean_3 = CleanTree(RemoveNulls=True, RemoveInvalid=True, RemoveEmpty=False, Tree=item_5)  # -> flatten(Tree)
clean_4 = CleanTree(RemoveNulls=True, RemoveInvalid=True, RemoveEmpty=False, Tree=item_6)  # -> flatten(Tree)
clean_5 = CleanTree(RemoveNulls=True, RemoveInvalid=True, RemoveEmpty=False, Tree=item_4)  # -> flatten(Tree)
ma = MassAddition(Input=clean_5)  # -> flatten(Result), PartialResults
ma_2 = MassAddition(Input=clean_4)  # -> flatten(Result), PartialResults
ma_3 = MassAddition(Input=clean_3)  # -> flatten(Result), PartialResults
ma_4 = MassAddition(Input=clean_2)  # -> flatten(Result), PartialResults
panel_3 = Panel(ma_2.Result)
num_12 = Number(ma_2.Result)
num_13 = Number(ma_4.Result)
num_14 = Number(ma.Result)
num_15 = Number(ma_3.Result)
I = ClusterOutput(mindex_5.Index)
num_16 = ClusterOutput(num_13)
I_2 = ClusterOutput(mindex_6.Index)
num_17 = ClusterOutput(num_14)
I_3 = ClusterOutput(mindex_7.Index)
num_18 = ClusterOutput(num_12)
I_4 = ClusterOutput(mindex_8.Index)
num_19 = ClusterOutput(num_15)

# ==== cluster FormatoEPI_2
relay = ClusterInput()
panel = Panel("""1
2
3
4""")
panel_2 = Panel("""-2
-1
0""")
branch = TreeBranch(Superficie=relay, Torres=panel, MaintainPaths=True)
clean = CleanTree(RemoveNulls=True, RemoveInvalid=True, RemoveEmpty=True, Superficie=branch)
pisos = ClusterInput()
branch_2 = TreeBranch(Superficie=pisos, Path="{-2}", MaintainPaths=True)
num = Number(clean)
pisos_2 = Number(flatten(pisos))
listdexs = ListIndices(List=pisos_2)
listdexs_2 = ListIndices(List=num)
listdexs_3 = ListIndices(List=branch_2)
replace = ReplaceItems(List=pisos_2, Indices=listdexs, Wrap=False)  # -> simplify(List)
addition = Addition(B=listdexs_2)
i = ClusterOutput(listdexs_3)
replace_2 = ReplaceItems(List=replace, Item=num, Indices=addition, Wrap=False)  # -> simplify(List)
listdexs_4 = ListIndices(List=replace_2)
replace_3 = ReplaceItems(List=replace, Item=pisos_2, Indices=listdexs_4, Wrap=False)  # -> simplify(List)
cluster = Cluster_140(relay=replace_3, T=num)
D = ClusterOutput(cluster)

# ==== cluster Cluster_175
num = ClusterInput()
cluster = Cluster_144(num=num)
d1 = ClusterInput()
pisos = ClusterInput()
ins = InsertItems(List=cluster, Item="Terraza", Indices=0, Wrap=True)
merge = Merge(Data1=d1)
cluster_2 = Totales(pisos=pisos, areas=num)
ins_2 = InsertItems(List=ins, Item=merge, Indices=0, Wrap=True)
num_2 = Number(cluster_2)
ins_3 = InsertItems(List=ins_2, Item=cluster_2, Indices=-1, Wrap=True)
cluster_3 = Cluster_145(d1=d1, L=num_2)
cluster_4 = Cluster_146(I=cluster_3, T=ins_3)
R = ClusterOutput(cluster_4)

# ==== cluster FormatoEPI_3
relay = ClusterInput()
panel = Panel("""1
2
3
4""")
panel_2 = Panel("""-2
-1
0""")
branch = TreeBranch(Superficie=relay, Torres=panel, MaintainPaths=True)
branch_2 = TreeBranch(Superficie=relay, Torres=panel_2, MaintainPaths=True)
panel_3 = Panel("""-2
-1""")
clean = CleanTree(RemoveNulls=False, RemoveInvalid=True, RemoveEmpty=True, Superficie=branch_2)
branch_3 = TreeBranch(Superficie=relay, Subtes=panel_3, MaintainPaths=True)
branch_4 = TreeBranch(Superficie=relay, Podio="{0}", MaintainPaths=True)
clean_2 = CleanTree(RemoveNulls=True, RemoveInvalid=True, RemoveEmpty=True, Superficie=branch)
pisos = ClusterInput()
branch_5 = TreeBranch(Superficie=pisos, Path="{-2}", MaintainPaths=True)
txt = Text(clean_2)
lng = ListLength(BackcountSub=flatten(clean))
clean_3 = CleanTree(RemoveNulls=False, RemoveInvalid=True, RemoveEmpty=True, Superficie=branch_3)  # -> flatten(Tree)
pisos_2 = Number(flatten(pisos))
listdexs = ListIndices(List=pisos_2)
listdexs_2 = ListIndices(List=branch_4)
listdexs_3 = ListIndices(List=txt)
addition = Addition(BackcountPodio=lng, B=listdexs_3)
txt_2 = Text(txt)
null = NullItem(Item=branch_4)  # -> NullFlags, InvalidFlags, Description
listdexs_4 = ListIndices(List=branch_5)
replace = ReplaceItems(List=pisos_2, Indices=listdexs, Wrap=False)  # -> simplify(List)
listdexs_5 = ListIndices(List=clean_3)
lng_2 = ListLength(List=listdexs_5)
addition_2 = Addition(A=lng_2, B=listdexs_2)
i = ClusterOutput(listdexs_4)
replace_2 = ReplaceItems(List=replace, Item=txt, Indices=addition, Wrap=False)  # -> simplify(List)
filter = StreamFilter(Gate=null.NullFlags, Stream0=addition_2)
cluster = Cluster_140(relay=replace_2, T=txt)
replace_3 = ReplaceItems(List=replace, Item=clean_3, Indices=listdexs_5, Wrap=False)  # -> simplify(List)
merge = Merge(Data1=clean_3, Data2=branch_4)
cluster_2 = Cluster_140(relay=listdexs_5, T=txt_2)
cluster_3 = Cluster_140(relay=branch_4, T=txt)
cluster_4 = Cluster_140(relay=filter, T=txt_2)
cluster_5 = Cluster_141(relay=cluster)
cluster_6 = Cluster_140(relay=clean_3, T=txt_2)
clean_4 = CleanTree(RemoveNulls=True, RemoveInvalid=True, RemoveEmpty=True, Tree=replace_3)  # -> simplify(Tree)
merge_2 = Merge(Data1=cluster_2, Data2=cluster_4, Data3=cluster_5)
clean_5 = CleanTree(RemoveNulls=True, RemoveInvalid=True, RemoveEmpty=True, Tree=cluster)  # -> simplify(Tree)
merge_3 = Merge(Data1=cluster_6, Data2=cluster_5)
replace_4 = ReplaceItems(List=cluster, Item=merge, Indices=merge_2, Wrap=False)  # -> simplify(AreasFormatoNaked)
tstat = TreeStatistics(Tree=merge_2)  # -> Paths, Length, Count
tstat_2 = TreeStatistics(Tree=replace_4)  # -> Paths, Length, Count
merge_4 = Merge(Data1=merge_3, Data2=clean_5)
replace_5 = ReplacePaths(Data=replace_4, Search=tstat_2.Paths, Replace=tstat.Paths)
null_2 = NullItem(Item=replace_5)  # -> NullFlags, InvalidFlags, Description
expression = Expression(x=null_2.NullFlags, y=replace_5, Expression="if(x=True, 0,y)")
listdexs_6 = ListIndices(List=merge_4)
ins = InsertItems(List=replace_5, Item=merge_4, Indices=-1, Wrap=True)
replace_6 = ReplaceItems(List=merge_4, Indices=listdexs_6, Wrap=False)
replace_7 = ReplaceItems(List=replace_2, Item=pisos_2, Indices=listdexs, Wrap=False)  # -> simplify(List)
ins_2 = InsertItems(List=replace_7, Item=replace_6, Indices=-1, Wrap=True)  # -> simplify(PisosFormato)
L = ClusterOutput(replace_5)
panel_4 = Panel(expression)

# ==== cluster GBA
programas = ClusterInput()
programas_2 = Text(programas)
bang = ExplodeTree(Data=programas_2)  # -> Branch0, Branch1, Branch2, Branch3
tstat = TreeStatistics(Tree=programas_2)  # -> Paths, Length, Count
format = ClusterInput()
prog_total = ClusterInput()
item = ListItem(List=tstat.Paths, Index=0, Wrap=True)  # -> Item1, Item
ret = Text(bang.Branch2)
res = Text(bang.Branch3)
est = Text(bang.Branch0)
ofi = Text(bang.Branch1)
format_2 = Text(format)
prog_total_2 = Text(prog_total)
gross_area = ClusterInput()
dpath = DeconstructPath(Branch=item.Item1)  # -> expr("x+1", Indices)
series = Series(Start=dpath, Step=1, Count=tstat.Count)
gross_area_2 = Number(gross_area)
mindex = MemberIndex(Set=prog_total_2, Member=res)  # -> simplify(Index), Count
mindex_2 = MemberIndex(Set=prog_total_2, Member=ret)  # -> simplify(Index), Count
mindex_3 = MemberIndex(Set=prog_total_2, Member=ofi)  # -> simplify(Index), Count
mindex_4 = MemberIndex(Set=prog_total_2, Member=est)  # -> simplify(Index), Count
pisos = ClusterInput()
replace = ReplacePaths(Data=programas_2, Search=tstat.Paths, Replace=series)
item_2 = ListItem(List=gross_area_2, Index=mindex_4.Index, Wrap=True)  # -> simplify(Item)
item_3 = ListItem(List=gross_area_2, Index=mindex_3.Index, Wrap=True)  # -> simplify(Item)
item_4 = ListItem(List=gross_area_2, Index=mindex_2.Index, Wrap=True)  # -> simplify(Item)
item_5 = ListItem(List=gross_area_2, Index=mindex.Index, Wrap=True)  # -> simplify(Item)
concat = Concatenate(FragmentA="TERRAZA ", FragmentB=replace)
replace_2 = ReplaceItems(List=format_2, Item=item_2, Indices=mindex_4.Index, Wrap=False)  # -> simplify(List)
replace_3 = ReplaceItems(List=format_2, Item=item_3, Indices=mindex_3.Index, Wrap=False)  # -> simplify(List)
replace_4 = ReplaceItems(List=format_2, Item=item_4, Indices=mindex_2.Index, Wrap=False)  # -> simplify(List)
replace_5 = ReplaceItems(List=format_2, Item=item_5, Indices=mindex.Index, Wrap=False)  # -> simplify(List)
D = ClusterOutput(replace)
cluster = Cluster_179(pisos=pisos, num=replace_2)
cluster_2 = Cluster_179(pisos=pisos, num=replace_3)
cluster_3 = Cluster_179(pisos=pisos, num=replace_4)
cluster_4 = Cluster_179(pisos=pisos, num=replace_5)
# Superficie por programa - GA
cluster_5 = Cluster_178(L=cluster, I=est)
cluster_6 = Cluster_176(L=cluster_2, I=ofi)
cluster_7 = Cluster_176(L=cluster_3, I=ret)
cluster_8 = Cluster_176(L=cluster_4, I=res)
cluster_9 = Cluster_177(T=est, relay=cluster_5)
cluster_10 = Cluster_177(T=ofi, relay=cluster_6)
cluster_11 = Cluster_177(T=ret, relay=cluster_7)
cluster_12 = Cluster_177(T=res, relay=cluster_8)
D_2 = ClusterOutput(cluster_9)
D_3 = ClusterOutput(cluster_10)
D_4 = ClusterOutput(cluster_11)
D_5 = ClusterOutput(cluster_12)

# ==== cluster GBA_2
programas = ClusterInput()
programas_2 = Text(programas)
bang = ExplodeTree(Data=programas_2)  # -> Branch0, Branch1, Branch2, Branch3
tstat = TreeStatistics(Tree=programas_2)  # -> Paths, Length, Count
format = ClusterInput()
prog_total = ClusterInput()
item = ListItem(List=tstat.Paths, Index=0, Wrap=True)  # -> Item1, Item
ret = Text(bang.Branch2)
res = Text(bang.Branch3)
est = Text(bang.Branch0)
ofi = Text(bang.Branch1)
format_2 = Text(format)
prog_total_2 = Text(prog_total)
gross_area = ClusterInput()
dpath = DeconstructPath(Branch=item.Item1)  # -> expr("x+1", Indices)
series = Series(Start=dpath, Step=1, Count=tstat.Count)
gross_area_2 = Number(gross_area)
mindex = MemberIndex(Set=prog_total_2, Member=res)  # -> simplify(Index), Count
mindex_2 = MemberIndex(Set=prog_total_2, Member=ret)  # -> simplify(Index), Count
mindex_3 = MemberIndex(Set=prog_total_2, Member=ofi)  # -> simplify(Index), Count
mindex_4 = MemberIndex(Set=prog_total_2, Member=est)  # -> simplify(Index), Count
pisos = ClusterInput()
replace = ReplacePaths(Data=programas_2, Search=tstat.Paths, Replace=series)
item_2 = ListItem(List=gross_area_2, Index=mindex_4.Index, Wrap=True)  # -> simplify(Item)
item_3 = ListItem(List=gross_area_2, Index=mindex_3.Index, Wrap=True)  # -> simplify(Item)
item_4 = ListItem(List=gross_area_2, Index=mindex_2.Index, Wrap=True)  # -> simplify(Item)
item_5 = ListItem(List=gross_area_2, Index=mindex.Index, Wrap=True)  # -> simplify(Item)
concat = Concatenate(FragmentA="TERRAZA ", FragmentB=replace)
# Superficie por programa - GA
replace_2 = ReplaceItems(List=format_2, Item=item_2, Indices=mindex_4.Index, Wrap=False)  # -> simplify(List)
replace_3 = ReplaceItems(List=format_2, Item=item_3, Indices=mindex_3.Index, Wrap=False)  # -> simplify(List)
replace_4 = ReplaceItems(List=format_2, Item=item_4, Indices=mindex_2.Index, Wrap=False)  # -> simplify(List)
replace_5 = ReplaceItems(List=format_2, Item=item_5, Indices=mindex.Index, Wrap=False)  # -> simplify(List)
panel = Panel(concat)
D = ClusterOutput(replace)
cluster = Cluster_179(pisos=pisos, num=replace_2)
cluster_2 = Cluster_179(pisos=pisos, num=replace_3)
cluster_3 = Cluster_179(pisos=pisos, num=replace_4)
cluster_4 = Cluster_179(pisos=pisos, num=replace_5)
cluster_5 = Cluster_181(L=cluster, I=est)
cluster_6 = Cluster_180(L=cluster_2, I=ofi)
cluster_7 = Cluster_180(L=cluster_3, I=ret)
cluster_8 = Cluster_180(L=cluster_4, I=res)
cluster_9 = Cluster_177(T=est, relay=cluster_5)
cluster_10 = Cluster_177(T=ofi, relay=cluster_6)
cluster_11 = Cluster_177(T=ret, relay=cluster_7)
cluster_12 = Cluster_177(T=res, relay=cluster_8)
panel_2 = Panel(cluster)
D_2 = ClusterOutput(cluster_9)
D_3 = ClusterOutput(cluster_10)
D_4 = ClusterOutput(cluster_11)
D_5 = ClusterOutput(cluster_12)

# ==== cluster Cluster_182
d1 = ClusterInput()
d2 = ClusterInput()
merge = Merge(Data1=d1, Data2=d2)
total = ClusterInput()
tstat = TreeStatistics(Tree=merge)  # -> Paths, Length, Count
total_2 = Text(total)
item = ListItem(List=tstat.Paths, Index=0, Wrap=True)  # -> Item1, Item
tstat_2 = TreeStatistics(Tree=flatten(total_2))  # -> Paths, Length, Count
item_2 = ListItem(List=tstat_2.Paths, Index=0, Wrap=True)
dpath = DeconstructPath(Branch=item.Item1)  # -> expr("x+1", Indices)
branch = TreeBranch(Tree=flatten(total_2), Path=item_2, MaintainPaths=True)
listdexs = ListIndices(List=branch)
num = Number(expr("x+1", dpath))
replace = ReplaceItems(List=branch, Indices=listdexs, Wrap=False)
num_2 = Number(expr("x+2", dpath))
replace_2 = ReplacePaths(Total=flatten(total_2), Search=tstat_2.Paths, Replace=dpath)
tstat_3 = TreeStatistics(Tree=flatten(replace))  # -> Paths, Length, Count
replace_3 = ReplacePaths(Total=flatten(replace), Search=tstat_3.Paths, Replace=num)
D = ClusterOutput(replace_2)
num_3 = ClusterOutput(num_2)
D_2 = ClusterOutput(replace_3)

# ==== cluster Cluster_183

# ==== cluster Negative0
A = ClusterInput()
_0 = ClusterInput()
smaller = SmallerThan(FirstNumber=A, SecondNumber=0)  # -> SmallerThan, OrEqualTo
cull = CullPattern(List=_0, CullPattern=invert(smaller.SmallerThan))
filter = StreamFilter(Gate=smaller.SmallerThan, Stream0=_0, Stream1=0)
L = ClusterOutput(cull)

# ==== cluster REMAP
D = ClusterInput()
tstat = TreeStatistics(Tree=D)  # -> Paths, Length, Count
R = ClusterInput()
replace = ReplacePaths(Data=D, Search=tstat.Paths, Replace=R)
D_2 = ClusterOutput(replace)

# ==== cluster Cluster_2
B = ClusterInput()
debrep = DeconstructBrep(Brep=B)  # -> Faces, Edges, Vertices
area = Area(Geometry=debrep.Faces)  # -> Area, Centroid
pdecon = Deconstruct(Point=area.Centroid)  # -> XComponent, YComponent, ZComponent
sort = SortList(Keys=pdecon.ZComponent, ValuesA=debrep.Faces)  # -> Keys, ValuesA
item = ListItem(List=sort.ValuesA, Index=-1, Wrap=True)
area_2 = Area(Geometry=item)  # -> Area, Centroid
pdecon_2 = Deconstruct(Point=area_2.Centroid)  # -> XComponent, YComponent, ZComponent
Z = ClusterOutput(pdecon_2.ZComponent)

# ==== cluster Cluster_4
crv = ClusterInput()
crv_2 = Curve(crv)
explode = Explode(Curve=crv_2, Recursive=True)  # -> Segments, Vertices
end = EndPoints(Curve=crv_2)  # -> Start, End
item = ListItem(List=explode.Segments, Index=[0, -1], Wrap=True)
end_2 = EndPoints(Curve=item)  # -> Start, End
vec2pt = Vector2Pt(PointA=end_2.Start, PointB=end_2.End, Unitize=False)  # -> Vector, Length
bang = ExplodeTree(Data=graft(vec2pt.Vector))  # -> _000000, _000001
rev = Reverse(Vector=bang._000000)
line = LineSDL(Start=end.End, Direction=bang._000001, Length=6)
line_2 = LineSDL(Start=end.Start, Direction=rev, Length=6)
merge = Merge(Data1=line_2, Data2=line)  # -> flatten(Result)
join = JoinCurves(Curves=[merge, crv_2], Preserve=False)
C = ClusterOutput(join)

# ==== cluster Cluster_6
A = ClusterInput()
relay = ClusterInput()
T = ClusterInput()
E = ClusterInput()
A_2 = ClusterInput()
boundary = BoundarySurfaces(Edges=E)
splitatcorners = SplitAtCorners(Poly=relay, Angle=1)  # -> Corners, Parts
pt = Point(splitatcorners.Corners)
crv_cp = CurveClosestPoint(Point=pt, Curve=relay)  # -> Point, Parameter, Distance
shatter = Shatter(Curve=relay, Parameters=crv_cp.Parameter)  # -> simplify(Segments)
ext = ExtendCurve(Curve=relay, Type=0, Start="40", End="40")
number_slider = Slider(150, range=0..1000)
ext_2 = ExtendCurve(Curve=shatter, Type=0, Start="1", End="1")
offset = OffsetCurve(Curve=ext_2, Distance=-1, Corners=1)
offset_2 = OffsetCurve(Curve=ext_2, Distance=1, Corners=1)
pframes = PerpFrames(Curve=ext, Count=number_slider, Align=True)  # -> simplify(Frames), Parameters
midpt = CurveMiddle(Curve=offset_2)
midpt_2 = CurveMiddle(Curve=offset)
item = ListItem(List=pframes.Frames, Index=0, Wrap=True)
end = EndPoints(Curve=ext)  # -> Start, End
incurve = PointInCurve(Point=midpt, Curve=boundary)  # -> Relationship, Point
incurve_2 = PointInCurve(Point=midpt_2, Curve=boundary)  # -> Relationship, Point
line = LineSDL(Start=end.Start, Direction=Vector(0, 0, 1), Length=150)
equals = Equality(FirstNumber=incurve.Relationship, SecondNumber=2)  # -> Equality, Inequality
equals_2 = Equality(FirstNumber=incurve_2.Relationship, SecondNumber=2)  # -> Equality, Inequality
rotate = Rotate(Geometry=line, Angle=expr("90-x", degrees(A)), Plane=item)  # -> Geometry, Transform
rotate_2 = Rotate(Geometry=line, Angle=expr("-(90-x)", degrees(A)), Plane=item)  # -> Geometry, Transform
divide = DivideCurve(Curve=ext_2, Count=10, Kinks=False)  # -> Points, Tangents, Parameters
cull = CullPattern(List=offset_2, CullPattern=equals.Equality)
cull_2 = CullPattern(List=offset, CullPattern=equals_2.Equality)
end_2 = EndPoints(Curve=rotate.Geometry)  # -> Start, End
end_3 = EndPoints(Curve=rotate_2.Geometry)  # -> Start, End
merge = Merge(Data1=cull, Data2=cull_2)  # -> simplify(Result)
ln = Line(StartPoint=end_2.End, EndPoint=end_3.End)
crv_cp_2 = CurveClosestPoint(Point=divide.Points, Curve=merge)  # -> Point, Parameter, Distance
join = JoinCurves(Curves=[rotate.Geometry, rotate_2.Geometry, ln], Preserve=False)
line_2 = LineSDL(Start=divide.Points, Direction=Vector(0, 0, 1), Length=150)
rebcrv = RebuildCurve(Curve=join, Count=number_slider, EndTangents=False)
ln_2 = Line(StartPoint=divide.Points, EndPoint=crv_cp_2.Point)
end_4 = EndPoints(Curve=ln_2)  # -> Start, End
end_5 = EndPoints(Curve=line_2)  # -> Start, End
simplify = SimplifyCurve(Curve=rebcrv)  # -> Curve, Simplified
orient = Orient(Geometry=simplify.Curve, Source=item, Target=pframes.Frames)  # -> Geometry, Transform
pt_2 = Point(crv_cp_2.Point)
pt_3 = Point(end_5.End)
pt_4 = Point(end_4.Start)
item_2 = ListItem(List=line_2, Index=0, Wrap=True)
loft = Loft(Curves=orient.Geometry, Options={Adjust=False, Closed=False, LoftEnds=0, LoftSimp=0, LoftType=3, Rebuild=10, Refit=0.01})
pl_3pt = Plane3Pt(PointA=pt_4, PointB=pt_3, PointC=pt_2)  # -> simplify(Plane)
cap = CapHoles(Brep=loft)
item_3 = ListItem(List=pl_3pt, Index=0, Wrap=True)
rotate_3 = Rotate(Geometry=item_2, Angle=expr("(90-x)", degrees(A_2)), Plane=item_3)  # -> Geometry, Transform
cap_2 = CapHoles(Brep=loft)  # -> simplify(Brep)
end_6 = EndPoints(Curve=ext_2)  # -> Start, End
end_7 = EndPoints(Curve=rotate_3.Geometry)  # -> Start, End
cluster = Cluster_5(pt=end_6.Start, crv=rotate_3.Geometry, crv_3=relay)  # -> L, hipotenusa, L_2
crv_cp_3 = CurveClosestPoint(Point=end_7.End, Curve=item_2)  # -> Point, Parameter, Distance
ln_3 = Line(StartPoint=end_7.End, EndPoint=crv_cp_3.Point)
mesh = MeshBrep(Settings={GridMaxCount=0, GridMinCount=16, JaggedSeams=False, MaxEdgeLength=0, MinEdgeLength=0.0001, MinTolerance=0, Refine=True, RefineAngle=0, RelativeTolerance=0.65, SimplePlanes=True, Tolerance=0})
join_2 = JoinCurves(Curves=[cluster.L, cluster.L_2, cluster.hipotenusa], Preserve=False)
boundary_2 = BoundarySurfaces(Edges=join_2)
weld = WeldMesh(Mesh=mesh, Angle=3.141592654)
orient_2 = Orient(Geometry=boundary_2, Source=item_3, Target=pl_3pt)  # -> Geometry, Transform
orient_3 = Orient(Geometry=cluster.hipotenusa, Source=item_3, Target=pl_3pt)  # -> Geometry, Transform
loft_2 = Loft(
    Curves=orient_2.Geometry,
    Options={Adjust=False, Closed=False, LoftEnds=0, LoftSimp=0, LoftType=3, Rebuild=10, Refit=0.01})
loft_3 = Loft(
    Curves=orient_3.Geometry,
    Options={Adjust=False, Closed=False, LoftEnds=0, LoftSimp=0, LoftType=3, Rebuild=10, Refit=0.01})
cap_3 = CapHoles(Brep=loft_2)  # -> simplify(Brep)
rasante = ClusterOutput(loft_3)
B = ClusterOutput(cap_3)
B_2 = ClusterOutput()

# ==== cluster Cluster_9
D = ClusterInput()
crv = ClusterInput()
T = ClusterInput()
T_2 = ClusterInput()
offset = OffsetCurve(Curve=graft(crv), Distance=expr("-X", D), Corners=1)
neg = Negative(Value=D)
crv_2 = Curve(crv)
offset_2 = OffsetCurve(Curve=graft(crv), Distance=D, Corners=1)
neg_2 = Negative(Value=D)
crv_3 = Curve(crv)
move = Move(Geometry=offset, Motion=T)  # -> Geometry, Transform
move_2 = Move(Geometry=crv_2, Motion=T_2)  # -> Geometry, Transform
cluster = Cluster_7(relay=crv, x=D, F=T)  # -> B, S, S_2
cluster_2 = Cluster_7(relay=crv, x=neg_2, F=T)  # -> B, S, S_2
move_3 = Move(Geometry=offset_2, Motion=T)  # -> Geometry, Transform
move_4 = Move(Geometry=crv_3, Motion=T_2)  # -> Geometry, Transform
end = EndPoints(Curve=move.Geometry)  # -> Start, End
end_2 = EndPoints(Curve=crv_2)  # -> Start, End
end_3 = EndPoints(Curve=move_2.Geometry)  # -> Start, End
end_4 = EndPoints(Curve=crv_2)  # -> Start, End
end_5 = EndPoints(Curve=move_3.Geometry)  # -> Start, End
end_6 = EndPoints(Curve=crv_3)  # -> Start, End
end_7 = EndPoints(Curve=move_4.Geometry)  # -> Start, End
end_8 = EndPoints(Curve=crv_3)  # -> Start, End
ln = Line(StartPoint=end_3.Start, EndPoint=end_4.Start)
ln_2 = Line(StartPoint=end_2.Start, EndPoint=end.Start)
pt = Point(end_2.Start)
ln_3 = Line(StartPoint=end_3.Start, EndPoint=end.Start)
ln_4 = Line(StartPoint=end_7.Start, EndPoint=end_8.Start)
ln_5 = Line(StartPoint=end_6.Start, EndPoint=end_5.Start)
pt_2 = Point(end_6.Start)
ln_6 = Line(StartPoint=end_7.Start, EndPoint=end_5.Start)
cluster_3 = Cluster_8(pt=pt, crv=ln_2, crv_3=crv)  # -> cateto_horiz, cateto_vert, hipotenusa, r1, C
cluster_4 = Cluster_8(pt=pt_2, crv=ln_5, crv_3=crv)  # -> cateto_horiz, cateto_vert, hipotenusa, r1, C
swp2 = Sweep2(Rail1=cluster_3.r1, Rail2=cluster_3.C, Sections=cluster_3.cateto_vert, SameHeight=False)
swp2_2 = Sweep2(Rail1=cluster_3.r1, Rail2=cluster_3.C, Sections=cluster_3.hipotenusa, SameHeight=False)
swp2_3 = Sweep2(Rail1=cluster_3.r1, Rail2=cluster_3.C, Sections=cluster_3.cateto_horiz, SameHeight=False)
swp2_4 = Sweep2(Rail1=cluster_4.r1, Rail2=cluster_4.C, Sections=cluster_4.cateto_vert, SameHeight=False)
swp2_5 = Sweep2(Rail1=cluster_4.r1, Rail2=cluster_4.C, Sections=cluster_4.hipotenusa, SameHeight=False)
swp2_6 = Sweep2(Rail1=cluster_4.r1, Rail2=cluster_4.C, Sections=cluster_4.cateto_horiz, SameHeight=False)
merge = Merge(Data1=swp2, Data2=swp2_2, Data3=swp2_3)  # -> flatten(Result)
merge_2 = Merge(Data1=swp2_4, Data2=swp2_5, Data3=swp2_6)  # -> flatten(Result)
merge_3 = Merge()  # -> flatten(Result)
R = ClusterOutput(merge_2)
R_2 = ClusterOutput(merge)

# ==== cluster Cluster_11
L = ClusterInput()
L_2 = ClusterInput()
L_3 = ClusterInput()
txt = Text("Altura")
txt_2 = Text("Tangente")
txt_3 = Text("Distancia")
ins = InsertItems(List=L, Item=txt, Indices=0, Wrap=True)
ins_2 = InsertItems(List=L_2, Item=txt_2, Indices=0, Wrap=True)
ins_3 = InsertItems(List=L_3, Item=txt_3, Indices=0, Wrap=True)
L_4 = ClusterOutput(ins)
L_5 = ClusterOutput(ins_2)
L_6 = ClusterOutput(ins_3)

# ==== cluster Cluster_12
L = ClusterInput()
L_2 = ClusterInput()
L_3 = ClusterInput()
txt = Text("Sombra Poniente")
txt_2 = Text("Sombra Sur")
txt_3 = Text("Sombra Oriente")
ins = InsertItems(List=L, Item=txt, Indices=0, Wrap=True)
ins_2 = InsertItems(List=L_2, Item=txt_2, Indices=0, Wrap=True)
ins_3 = InsertItems(List=L_3, Item=txt_3, Indices=0, Wrap=True)
L_4 = ClusterOutput(ins)
L_5 = ClusterOutput(ins_2)
L_6 = ClusterOutput(ins_3)

# ==== cluster Cluster_17
relay = ClusterInput()
relay_2 = ClusterInput()
relay_3 = ClusterInput()
relay_4 = ClusterInput()
crv = ClusterInput()
offset = OffsetCurve(Curve=relay, Distance=relay_2, Corners=1)
crv_2 = Curve(crv)
crv_3 = Curve(relay_3)
boundary = BoundarySurfaces(Edges=crv_2)
cluster = Cluster_16(C=relay_3, relay_2=boundary, relay=relay_4)
explode = Explode(Curve=offset, Recursive=True)  # -> Segments, Vertices
cluster_2 = Cluster_16(C=relay, relay_2=boundary, relay=relay_2)
end = EndPoints(Curve=crv_3)  # -> flatten(Start), flatten(End)
end_2 = EndPoints(Curve=cluster)  # -> flatten(Start), flatten(End)
item = ListItem(List=explode.Segments, Index=[0, -1], Wrap=True)
end_3 = EndPoints(Curve=offset)  # -> Start, End
end_4 = EndPoints(Curve=item)  # -> Start, End
crv_4 = Curve(relay)
ln = Line(StartPoint=end_2.Start, EndPoint=end.Start)
ln_2 = Line(StartPoint=end_2.End, EndPoint=end.End)
vec2pt = Vector2Pt(PointA=end_4.Start, PointB=end_4.End, Unitize=False)  # -> Vector, Length
end_5 = EndPoints(Curve=crv_4)  # -> flatten(Start), flatten(End)
end_6 = EndPoints(Curve=cluster_2)  # -> flatten(Start), flatten(End)
join = JoinCurves(Curves=[ln, ln_2, cluster, crv_3], Preserve=False)  # -> flatten(Curves)
bang = ExplodeTree(Data=graft(vec2pt.Vector))  # -> _00000, _00001
crv_5 = Curve(cluster)
ln_3 = Line(StartPoint=end_6.Start, EndPoint=end_5.Start)
ln_4 = Line(StartPoint=end_6.End, EndPoint=end_5.End)
boundary_2 = BoundarySurfaces(Edges=join)
rev = Reverse(Vector=bang._00000)
line = LineSDL(Start=end_3.End, Direction=bang._00001, Length=6)
join_2 = JoinCurves(Curves=[ln_4, ln_3, crv_4, cluster_2], Preserve=False)  # -> flatten(Curves)
rdiff = RegionDifference(CurvesA=boundary, CurvesB=boundary_2)
line_2 = LineSDL(Start=end_3.Start, Direction=rev, Length=6)
merge = Merge(Data1=line_2, Data2=line)  # -> flatten(Result)
boundary_3 = BoundarySurfaces(Edges=join_2)
null = NullItem(Item=crv_5)  # -> NullFlags, InvalidFlags, Description
join_3 = JoinCurves(Curves=flatten([cluster_2, merge]), Preserve=False)
runion = RegionUnion(Curves=[boundary_3, boundary_2])
N = ClusterOutput(null.NullFlags)
gate = StreamGate(Stream=offset, Gate=null.NullFlags)  # -> Target0, Target1
cluster_3 = Cluster_15(relay=crv_5, relay_2=join_3)
filter = StreamFilter(Gate=0, Stream1=crv_5)
item_2 = ListItem(List=runion, Index=1, Wrap=True)
_1 = ClusterOutput(gate.Target1)
i = ClusterOutput(item_2)

# ==== cluster Cluster_18
relay = ClusterInput()
relay_2 = ClusterInput()
neg = Negative(Value=relay)
relay_3 = ClusterInput()
offset = OffsetCurve(Curve=relay_2, Distance=relay, Corners=1)
offset_2 = OffsetCurve(Curve=relay_2, Distance=neg, Corners=1)
midpt = CurveMiddle(Curve=offset)
midpt_2 = CurveMiddle(Curve=offset_2)
incurve = PointInCurve(Point=midpt, Curve=relay_3)  # -> Relationship, Point
incurve_2 = PointInCurve(Point=midpt_2, Curve=relay_3)  # -> Relationship, Point
equals = Equality(FirstNumber=incurve.Relationship, SecondNumber=0)  # -> Equality, Inequality
equals_2 = Equality(FirstNumber=incurve_2.Relationship, SecondNumber=0)  # -> Equality, Inequality
merge = Merge(Data1=offset, Data2=offset_2)
merge_2 = Merge(Data1=equals.Inequality, Data2=equals_2.Inequality)
dispatch = Dispatch(List=merge, DispatchPattern=merge_2)  # -> ListA, ListB
A = ClusterOutput(dispatch.ListA)

# ==== cluster Cluster_23
relay = ClusterInput()
relay_2 = ClusterInput()
relay_3 = ClusterInput()
relay_4 = ClusterInput()
crv = ClusterInput()
offset = OffsetCurve(Curve=relay, Distance=relay_2, Corners=1)
crv_2 = Curve(crv)
crv_3 = Curve(relay_3)
boundary = BoundarySurfaces(Edges=crv_2)
cluster = Cluster_22(relay_2=boundary, C=relay_3, relay=relay_4)
explode = Explode(Curve=offset, Recursive=True)  # -> Segments, Vertices
cluster_2 = Cluster_22(relay_2=boundary, C=relay, relay=relay_2)
end = EndPoints(Curve=crv_3)  # -> flatten(Start), flatten(End)
end_2 = EndPoints(Curve=cluster)  # -> flatten(Start), flatten(End)
item = ListItem(List=explode.Segments, Index=[0, -1], Wrap=True)
end_3 = EndPoints(Curve=offset)  # -> Start, End
end_4 = EndPoints(Curve=item)  # -> Start, End
crv_4 = Curve(relay)
ln = Line(StartPoint=end_2.Start, EndPoint=end.Start)
ln_2 = Line(StartPoint=end_2.End, EndPoint=end.End)
vec2pt = Vector2Pt(PointA=end_4.Start, PointB=end_4.End, Unitize=False)  # -> Vector, Length
end_5 = EndPoints(Curve=crv_4)  # -> flatten(Start), flatten(End)
end_6 = EndPoints(Curve=cluster_2)  # -> flatten(Start), flatten(End)
join = JoinCurves(Curves=[ln, ln_2, cluster, crv_3], Preserve=False)  # -> flatten(Curves)
bang = ExplodeTree(Data=graft(vec2pt.Vector))  # -> _00000, _00001
crv_5 = Curve(cluster)
ln_3 = Line(StartPoint=end_6.End, EndPoint=end_5.End)
ln_4 = Line(StartPoint=end_6.Start, EndPoint=end_5.Start)
boundary_2 = BoundarySurfaces(Edges=join)
rev = Reverse(Vector=bang._00000)
line = LineSDL(Start=end_3.End, Direction=bang._00001, Length=6)
join_2 = JoinCurves(Curves=[ln_3, ln_4, crv_4, cluster_2], Preserve=False)  # -> flatten(Curves)
line_2 = LineSDL(Start=end_3.Start, Direction=rev, Length=6)
merge = Merge(Data1=line_2, Data2=line)  # -> flatten(Result)
null = NullItem(Item=crv_5)  # -> NullFlags, InvalidFlags, Description
boundary_3 = BoundarySurfaces(Edges=join_2)
join_3 = JoinCurves(Curves=flatten([cluster_2, merge]), Preserve=False)
boundary_4 = BoundarySurfaces(Edges=join_3)
runion = RegionUnion(Curves=[boundary_3, boundary_2])
N = ClusterOutput(null.NullFlags)
explode_2 = Explode(Curve=boundary_4, Recursive=True)  # -> Segments, Vertices
item_2 = ListItem(List=runion, Index=1, Wrap=True)
join_4 = JoinCurves(Curves=explode_2.Segments, Preserve=False)
gate = StreamGate(Stream=offset, Gate=null.NullFlags)  # -> Target0, Target1
filter = StreamFilter(Gate=null.NullFlags, Stream0=item_2, Stream1=join_4)
cluster_3 = Cluster_15(relay=crv_5, relay_2=join_3)
stream = ClusterOutput(filter)
_1 = ClusterOutput(gate.Target1)

# ==== cluster Cluster_26
B = ClusterInput()
debrep = DeconstructBrep(Brep=B)  # -> Faces, Edges, Vertices
area = Area(Geometry=debrep.Faces)  # -> Area, Centroid
pdecon = Deconstruct(Point=area.Centroid)  # -> XComponent, YComponent, ZComponent
sort = SortList(Keys=pdecon.ZComponent, ValuesA=debrep.Faces)  # -> Keys, ValuesA
A = ClusterOutput(sort.ValuesA)

# ==== cluster Cluster_35
R = ClusterInput()
E = ClusterInput()
D = ClusterInput()
boundary = BoundarySurfaces(Edges=E)
item = ListItem(List=boundary, Index=-1, Wrap=True)
item_2 = ListItem(List=boundary, Index=0, Wrap=True)
cull_i = CullIndex(List=boundary, Indices=-1, Wrap=True)
area = Area(Geometry=item)  # -> Area, Centroid
extr = Extrude(Base=item_2, Direction=D)
pdecon = Deconstruct(Point=area.Centroid)  # -> XComponent, YComponent, ZComponent
cap = CapHoles(Brep=extr)
cluster = Cluster_34(R=R, D=cull_i)
cluster_2 = Cluster_34(R=R, D=cap)
cluster_3 = Cluster_34(R=R, D=pdecon.ZComponent)
area_2 = Area(Geometry=cluster)  # -> Area, Centroid
D_2 = ClusterOutput(cluster_2)
A = ClusterOutput(area_2.Area)
C = ClusterOutput(area_2.Centroid)
D_3 = ClusterOutput(cluster)
D_4 = ClusterOutput(cluster_3)

# ==== cluster Cluster_36
I = ClusterInput()
ma = MassAddition(Input=I)  # -> Result, PartialResults
R = ClusterInput()
tstat = TreeStatistics(Tree=ma.Result)  # -> Paths, Length, Count
replace = ReplacePaths(Data=ma.Result, Search=tstat.Paths, Replace=R)
D = ClusterOutput(replace)

# ==== cluster Cluster_37
crv = ClusterInput()
crv_2 = Curve(crv)
area = Area(Geometry=crv_2)  # -> Area, Centroid
pdecon = Deconstruct(Point=area.Centroid)  # -> XComponent, YComponent, ZComponent
sort = SortList(Keys=pdecon.ZComponent, ValuesA=crv_2)  # -> Keys, ValuesA
item = ListItem(List=sort.ValuesA, Index=0, Wrap=True)  # -> Item, Item1
area_2 = Area(Geometry=item.Item)  # -> Area, Centroid
area_3 = Area(Geometry=item.Item1)  # -> Area, Centroid
ln = Line(StartPoint=area_2.Centroid, EndPoint=area_3.Centroid)
L = ClusterOutput(ln)

# ==== cluster Cluster_38
B = ClusterInput()
debrep = DeconstructBrep(Brep=B)  # -> Faces, Edges, Vertices
area = Area(Geometry=debrep.Faces)  # -> Area, Centroid
pdecon = Deconstruct(Point=area.Centroid)  # -> XComponent, YComponent, ZComponent
sort = SortList(Keys=pdecon.ZComponent, ValuesA=debrep.Faces)  # -> Keys, ValuesA
item = ListItem(List=sort.ValuesA, Index=-1, Wrap=True)
area_2 = Area(Geometry=item)  # -> Area, Centroid
pdecon_2 = Deconstruct(Point=area_2.Centroid)  # -> XComponent, YComponent, ZComponent

# ==== cluster Cluster_39
num = ClusterInput()
num_2 = Number(flatten(num))
T = ClusterInput()
panel = Panel(num_2)
tstat = TreeStatistics(Tree=T)  # -> Paths, Length, Count
sort = SortList(Keys=panel, ValuesA=panel)  # -> Keys, ValuesA
item = ListItem(List=sort.ValuesA, Index=0, Wrap=True)
num_3 = Number(panel)
num_4 = Number(item)
i = ClusterOutput(item)
mindex = MemberIndex(Set=num_3, Member=num_4)  # -> Index, Count
item_2 = ListItem(List=tstat.Paths, Index=mindex.Index, Wrap=True)
cull_i = CullIndex(List=tstat.Paths, Indices=mindex.Index, Wrap=True)
lng = ListLength(List=cull_i)
equals = Equality(FirstNumber=lng, SecondNumber=0)  # -> Equality, Inequality
i_2 = ClusterOutput(item_2)
filter = StreamFilter(Gate=equals.Equality, Stream0=cull_i, Stream1=item_2)
s_0 = ClusterOutput(filter)

# ==== cluster Cluster_40
I = ClusterInput()
cc = ClusterInput()
ma = MassAddition(Input=flatten(I))  # -> Result, PartialResults
subtraction = Subtraction(CC=cc, B=ma.Result)
B = ClusterInput()
division = Division(A=subtraction, B=B)
R = ClusterInput()
round = Round(Number=division)  # -> Nearest, Floor, Ceiling
tstat = TreeStatistics(Tree=round.Floor)  # -> Paths, Length, Count
replace = ReplacePaths(Data=round.Floor, Search=tstat.Paths, Replace=R)
D = ClusterOutput(replace)

# ==== cluster Negative0_2
A = ClusterInput()
_0 = ClusterInput()
smaller = SmallerThan(FirstNumber=A, SecondNumber=0)  # -> SmallerThan, OrEqualTo
cull = CullPattern(List=_0, CullPattern=invert(smaller.SmallerThan))
panel = Panel(cull)
L = ClusterOutput(cull)
filter = StreamFilter(Gate=smaller.SmallerThan, Stream0=_0, Stream1=0)

# ==== cluster Cluster_41
T = ClusterInput()
T_2 = ClusterInput()
tstat = TreeStatistics(Tree=T)  # -> Paths, Length, Count
D = ClusterInput()
tstat_2 = TreeStatistics(Tree=T_2)  # -> Paths, Length, Count
P = ClusterOutput(tstat.Paths)
replace = ReplacePaths(Data=D, Search=tstat_2.Paths, Replace=tstat.Paths)
D_2 = ClusterOutput(replace)

# ==== cluster Cluster_47
E = ClusterInput()
boundary = BoundarySurfaces(Edges=E)
D = ClusterInput()
item = ListItem(List=boundary, Index=-1, Wrap=True)
item_2 = ListItem(List=boundary, Index=0, Wrap=True)
cull_i = CullIndex(List=boundary, Indices=0, Wrap=True)
area = Area(Geometry=item)  # -> Area, Centroid
extr = Extrude(Base=item_2, Direction=D)
area_2 = Area(Geometry=cull_i)  # -> Area, Centroid
pdecon = Deconstruct(Point=area.Centroid)  # -> XComponent, YComponent, ZComponent
cap = CapHoles(Brep=extr)
Z = ClusterOutput(pdecon.ZComponent)
B = ClusterOutput(cap)
A = ClusterOutput(area_2.Area)
L = ClusterOutput(cull_i)

# ==== cluster Cluster_49
E = ClusterInput()
D = ClusterInput()
boundary = BoundarySurfaces(Edges=E)
item = ListItem(List=boundary, Index=-1, Wrap=True)
item_2 = ListItem(List=boundary, Index=0, Wrap=True)
cull_i = CullIndex(List=boundary, Indices=-1, Wrap=True)
area = Area(Geometry=item)  # -> Area, Centroid
extr = Extrude(Base=flatten(item_2), Direction=D)
area_2 = Area(Geometry=cull_i)  # -> Area, Centroid
pdecon = Deconstruct(Point=area.Centroid)  # -> XComponent, YComponent, ZComponent
cap = CapHoles(Brep=extr)
Z = ClusterOutput(pdecon.ZComponent)
A = ClusterOutput(area_2.Area)
L = ClusterOutput(cull_i)
sunion = SolidUnion(Breps=flatten(cap))
B = ClusterOutput(cap)

# ==== cluster Cluster_50
D = ClusterInput()
tstat = TreeStatistics(Tree=D)  # -> Paths, Length, Count
R = ClusterInput()
replace = ReplacePaths(Data=flatten(D), Search=tstat.Paths, Replace=R)
D_2 = ClusterOutput(replace)

# ==== cluster Cluster_55
G = ClusterInput()
debrep = DeconstructBrep()  # -> Faces, Edges, Vertices
area = Area(Geometry=G)  # -> Area, Centroid
pdecon = Deconstruct(Point=area.Centroid)  # -> XComponent, YComponent, ZComponent
sort = SortList(Keys=pdecon.ZComponent, ValuesA=G)  # -> Keys, ValuesA
item = ListItem(List=sort.ValuesA, Index=0, Wrap=True)
i = ClusterOutput(item)

# ==== cluster Cluster_56
G = ClusterInput()
debrep = DeconstructBrep()  # -> Faces, Edges, Vertices
area = Area(Geometry=G)  # -> Area, Centroid
pdecon = Deconstruct(Point=area.Centroid)  # -> XComponent, YComponent, ZComponent
sort = SortList(Keys=pdecon.ZComponent, ValuesA=G)  # -> Keys, ValuesA
item = ListItem(List=sort.ValuesA, Index=-1, Wrap=True)
item_2 = ListItem(List=sort.ValuesA, Index=-2, Wrap=True)
area_2 = Area(Geometry=item_2)  # -> Area, Centroid
area_3 = Area(Geometry=item)  # -> Area, Centroid
ln = Line(StartPoint=area_3.Centroid, EndPoint=area_2.Centroid)
len = Length(Curve=ln)
Z = UnitZ(Factor=len)
move = Move(Geometry=item, Motion=Z)  # -> Geometry, Transform
i = ClusterOutput(item)

# ==== cluster Cluster_57
B = ClusterInput()
debrep = DeconstructBrep(Brep=B)  # -> Faces, Edges, Vertices
area = Area(Geometry=debrep.Faces)  # -> Area, Centroid
pdecon = Deconstruct(Point=area.Centroid)  # -> XComponent, YComponent, ZComponent
sort = SortList(Keys=pdecon.ZComponent, ValuesA=debrep.Faces)  # -> Keys, ValuesA
item = ListItem(List=sort.ValuesA, Index=0, Wrap=True)
i = ClusterOutput(item)

# ==== cluster Cluster_58
pt = ClusterInput()
C = ClusterInput()
pt_2 = Point(pt)
crv = Curve(C)
crv_cp = CurveClosestPoint(Point=pt_2, Curve=reparameterize(C))  # -> Point, Parameter, Distance
ln = Line(StartPoint=pt_2, EndPoint=crv_cp.Point)
pln = Plane(crv)
pln_2 = Plane(pt_2)
pln_3 = Plane(ln)
deplane = DeconstructPlane(Plane=pln_3)  # -> Origin, XAxis, YAxis, ZAxis
G = ClusterInput()
pl = ConstructPlane(Origin=deplane.Origin, XAxis=deplane.XAxis, YAxis=Vector(0, 1, 0))
orient = Orient(Geometry=G, Source=pln_2, Target=pl)  # -> Geometry, Transform
G_2 = ClusterOutput(orient.Geometry)

# ==== cluster Cluster_61
relay = ClusterInput()
T = ClusterInput()
tstat = TreeStatistics(Tree=T)  # -> Paths, Length, Count
tstat_2 = TreeStatistics(Tree=relay)  # -> Paths, Length, Count
replace = ReplacePaths(Data=relay, Search=tstat_2.Paths, Replace=tstat.Paths)
D = ClusterOutput(replace)

# ==== cluster Cluster_62
relay = ClusterInput()
T = ClusterInput()
tstat = TreeStatistics(Tree=relay)  # -> Paths, Length, Count
tstat_2 = TreeStatistics(Tree=T)  # -> Paths, Length, Count
replace = ReplacePaths(Data=relay, Search=tstat.Paths, Replace=tstat_2.Paths)
D = ClusterOutput(replace)

# ==== cluster Cluster_69
G = ClusterInput()
pt = ClusterInput()
C = ClusterInput()
area = Area(Geometry=G)  # -> Area, Centroid
pt_2 = Point(pt)
deplane = DeconstructPlane(Plane=pt_2)  # -> Origin, XAxis, YAxis, ZAxis
deplane_2 = DeconstructPlane(Plane=area.Centroid)  # -> Origin, XAxis, YAxis, ZAxis
crv_cp = CurveClosestPoint(Point=pt_2, Curve=C)  # -> Point, Parameter, Distance
ln = Line(StartPoint=pt_2, EndPoint=crv_cp.Point)
pln = Plane(pt_2)
pln_2 = Plane(ln)
item = ListItem(List=pt_2, Index=0, Wrap=True)
deplane_3 = DeconstructPlane(Plane=pln_2)  # -> Origin, XAxis, YAxis, ZAxis
abs = Absolute(Value=deplane_3.ZAxis)
smaller = SmallerThan(SecondNumber=0)  # -> SmallerThan, OrEqualTo
pl = ConstructPlane(Origin=deplane_3.Origin, XAxis=deplane_3.ZAxis, YAxis=deplane_3.XAxis)
dispatch = Dispatch(DispatchPattern=[True, False])  # -> ListA, ListB
orient = Orient(Geometry=G, Source=pln, Target=pl)  # -> Geometry, Transform
crv = Curve(G)
area_2 = Area(Geometry=crv)  # -> Area, Centroid
area_3 = Area(Geometry=orient.Geometry)  # -> Area, Centroid
move2pt = MoveToPoint(Geometry=orient.Geometry, PointA=area_3.Centroid, PointB=area_2.Centroid)  # -> Moved, Vector, Transform
M = ClusterOutput(move2pt.Moved)

# ==== cluster Cluster_74
relay = ClusterInput()
srf = ClusterInput()
D = ClusterInput()
srf_2 = Surface(srf)
item = ListItem(List=srf_2, Index=-1, Wrap=True)
item_2 = ListItem(List=srf_2, Index=0, Wrap=True)
cull_i = CullIndex(List=srf_2, Indices=-1, Wrap=True)
tstat = TreeStatistics(Tree=relay)  # -> Paths, Length, Count
area = Area(Geometry=item)  # -> Area, Centroid
extr = Extrude(Base=item_2, Direction=D)
tstat_2 = TreeStatistics(Tree=cull_i)  # -> Paths, Length, Count
pdecon = Deconstruct(Point=area.Centroid)  # -> XComponent, YComponent, ZComponent
cap = CapHoles(Brep=extr)
replace = ReplacePaths(Data=cull_i, Search=tstat_2.Paths, Replace=tstat.Paths)
area_2 = Area(Geometry=replace)  # -> Area, Centroid
Z = ClusterOutput(pdecon.ZComponent)
B = ClusterOutput(cap)
A = ClusterOutput(area_2.Area)
D_2 = ClusterOutput(replace)

# ==== cluster Cluster_75
D = ClusterInput()
tstat = TreeStatistics(Tree=D)  # -> Paths, Length, Count
R = ClusterInput()
panel = Panel(D)
replace = ReplacePaths(Data=D, Search=tstat.Paths, Replace=R)
D_2 = ClusterOutput(replace)

# ==== cluster Cluster_76
relay = ClusterInput()
tstat = TreeStatistics(Tree=relay)  # -> Paths, Length, Count
lng = ListLength(List=tstat.Paths)
equals = Equality(FirstNumber=lng, SecondNumber=1)  # -> Equality, Inequality
cull = CullPattern(List=relay, CullPattern=equals.Inequality)
filter = StreamFilter(Gate=equals.Inequality, Stream0=relay, Stream1=flatten(cull))
clean = CleanTree(RemoveNulls=True, RemoveInvalid=True, RemoveEmpty=True, Tree=cull)
panel = Panel(relay)
T = ClusterOutput(clean)

# ==== cluster Cluster_77
D = ClusterInput()
T = ClusterInput()
tstat = TreeStatistics(Tree=D)  # -> Paths, Length, Count
tstat_2 = TreeStatistics(Tree=T)  # -> Paths, Length, Count
panel = Panel(D)
replace = ReplacePaths(Data=D, Search=tstat.Paths, Replace=tstat_2.Paths)
D_2 = ClusterOutput(replace)

# ==== cluster Cluster_79
B = ClusterInput()
debrep = DeconstructBrep(Brep=B)  # -> Faces, Edges, Vertices
area = Area(Geometry=debrep.Faces)  # -> Area, Centroid
pdecon = Deconstruct(Point=area.Centroid)  # -> XComponent, YComponent, ZComponent
sort = SortList(Keys=pdecon.ZComponent, ValuesA=debrep.Faces)  # -> Keys, ValuesA
item = ListItem(List=sort.ValuesA, Index=-1, Wrap=True)
item_2 = ListItem(List=sort.ValuesA, Index=0, Wrap=True)
i = ClusterInput()
area_2 = Area(Geometry=item)  # -> Area, Centroid
explode = Explode(Curve=item_2, Recursive=True)  # -> Segments, Vertices
pdecon_2 = Deconstruct(Point=area_2.Centroid)  # -> XComponent, YComponent, ZComponent
join = JoinCurves(Curves=explode.Segments, Preserve=False)  # -> flatten(Curves)
item_3 = ListItem(List=join, Index=i, Wrap=True)

# ---- group: Cluster Output
Z = ClusterOutput(pdecon_2.ZComponent)

# ----
i_2 = ClusterOutput(item_3)

# ==== cluster Cluster_80
B = ClusterInput()
debrep = DeconstructBrep(Brep=B)  # -> Faces, Edges, Vertices
debrep_2 = DeconstructBrep(Brep=B)  # -> Faces, Edges, Vertices
area = Area(Geometry=debrep_2.Faces)  # -> Area, Centroid
pdecon = Deconstruct(Point=area.Centroid)  # -> XComponent, YComponent, ZComponent
sort = SortList(Keys=pdecon.ZComponent, ValuesA=debrep_2.Faces)  # -> Keys, ValuesA
item = ListItem(List=sort.ValuesA, Index=-1, Wrap=True)
item_2 = ListItem(List=sort.ValuesA, Index=0, Wrap=True)
explode = Explode(Curve=item_2, Recursive=True)  # -> Segments, Vertices
area_2 = Area(Geometry=item)  # -> Area, Centroid
pdecon_2 = Deconstruct(Point=area_2.Centroid)  # -> XComponent, YComponent, ZComponent
join = JoinCurves(Curves=explode.Segments, Preserve=False)
Z = ClusterOutput(pdecon_2.ZComponent)
S = ClusterOutput(explode.Segments)

# ==== cluster Cluster_83
crv = ClusterInput()
E = ClusterInput()
A = ClusterInput()
boundary = BoundarySurfaces(Edges=E)
division = Division(A=A, B=3)
crv_2 = Curve(crv)
area = Area(Geometry=boundary)  # -> Area, Centroid
offset = OffsetCurve(Curve=crv_2, Distance=division, Corners=1)
explode = Explode(Curve=crv_2, Recursive=True)  # -> graft(Segments), Vertices
neg = Negative(Value=area.Centroid)
num = Number()
splitatcorners = SplitAtCorners(Poly=boundary, Angle=1)  # -> Corners, Parts
splitatcorners_2 = SplitAtCorners(Poly=boundary, Angle=1)  # -> Corners, Parts
neg_2 = Negative(Value=division)
cluster = Cluster_82(crv=explode.Segments, C=explode.Segments, D=expr("-x", division), P=boundary)
cluster_2 = Cluster_82(crv=explode.Segments, C=explode.Segments, D=division, P=boundary)
boundary_2 = BoundarySurfaces(Edges=crv_2)
cluster_3 = Cluster_81(pt=splitatcorners.Corners, U=division, crv=crv_2)  # -> L, pt_5
boundary_3 = BoundarySurfaces(Edges=cluster_2)
boundary_4 = BoundarySurfaces(Edges=cluster)
offset_2 = OffsetCurve(Curve=splitatcorners_2.Parts, Distance=neg_2, Corners=1)
merge = Merge(Data1=boundary_3, Data2=boundary_4)
item = ListItem(List=boundary_2, Index=0, Wrap=True)
project = Project(Geometry=boundary_3, Plane=PlaneXY(0, 0, 0))  # -> Geometry, Transform
explode_2 = Explode(Curve=offset_2, Recursive=True)  # -> Segments, Vertices
area_2 = Area(Geometry=merge)  # -> Area, Centroid
debrep = DeconstructBrep(Brep=project.Geometry)  # -> Faces, Edges, Vertices
end = EndPoints(Curve=explode_2.Segments)  # -> Start, End
pt = Point(cluster_3.pt_5)
incurve = PointInCurve(Point=area_2.Centroid, Curve=boundary_2)  # -> Relationship, Point
runion = RegionUnion(Curves=flatten(debrep.Faces))
merge_2 = Merge(Data1=pt, Data2=end.Start, Data3=end.End)  # -> flatten(Result)
equals = Equality(FirstNumber=incurve.Relationship, SecondNumber=0)  # -> flatten(Equality), flatten(Inequality)
cullpt = CullDuplicates(Points=merge_2, Tolerance=0.1, CullMode=1)  # -> Points, Indices, Valence
boundary_5 = BoundarySurfaces(Edges=offset)
dispatch = Dispatch(List=merge, DispatchPattern=equals.Equality)  # -> ListA, ListB
alongcrv = SortAlongCurve(Points=cullpt.Points, Curve=boundary_5)  # -> Points, Indices
boundary_6 = BoundarySurfaces(Edges=boundary_3)
pline = PolyLine(Vertices=alongcrv.Points, Closed=True)
points = PointList(Points=alongcrv.Points, Size=4)
boundary_7 = BoundarySurfaces(Edges=pline)
R = ClusterOutput(runion)

# ==== cluster Cluster_84
B = ClusterInput()
sunion = SolidUnion(Breps=B)
fmerge = MergeFaces(Brep=sunion)  # -> Breps, Before, After
debrep = DeconstructBrep(Brep=fmerge.Breps)  # -> Faces, Edges, Vertices
fmerge_2 = MergeFaces(Brep=debrep.Faces)  # -> Breps, Before, After
srf = Surface(reparameterize(graft(fmerge_2.Breps)))
facen = FaceNormals(Mesh=srf)  # -> Centers, unitize(Normals)
area = Area(Geometry=debrep.Faces)  # -> Area, Centroid
devec = DeconstructVector(Vector=facen.Normals)  # -> XComponent, YComponent, ZComponent
pdecon = Deconstruct(Point=area.Centroid)  # -> XComponent, YComponent, ZComponent
sort = SortList(Keys=pdecon.ZComponent, ValuesA=debrep.Faces)  # -> Keys, ValuesA
equals = Equality(FirstNumber=devec.YComponent, SecondNumber=0)  # -> Equality, Inequality
equals_2 = Equality(FirstNumber=devec.XComponent, SecondNumber=0)  # -> Equality, Inequality
item = ListItem(List=sort.ValuesA, Index=-1, Wrap=True)
and = GateAnd(A=equals_2.Inequality, B=equals.Inequality)
item_2 = ListItem(List=sort.ValuesA, Index=0, Wrap=True)
explode = Explode(Curve=item_2, Recursive=True)  # -> Segments, Vertices
cull = CullPattern(List=srf, CullPattern=and)
area_2 = Area(Geometry=item)  # -> Area, Centroid
facen_2 = FaceNormals(Mesh=cull)  # -> Centers, unitize(Normals)
pdecon_2 = Deconstruct(Point=area_2.Centroid)  # -> XComponent, YComponent, ZComponent
join = JoinCurves(Curves=explode.Segments, Preserve=False)
area_3 = Area(Geometry=cull)  # -> Area, Centroid
cullpt = CullDuplicates(Points=facen_2.Normals, Tolerance=0.1, CullMode=3)  # -> Points, Indices, Valence
L = ClusterInput()
Z = ClusterOutput(pdecon_2.ZComponent)
line = LineSDL(Start=area_3.Centroid, Direction=cullpt.Points, Length=expr("x/3", L))
S = ClusterOutput(explode.Segments)
extr = Extrude(Base=cull, Direction=line)  # -> flatten(Extrusion)
join_2 = BrepJoin(Breps=flatten(extr))  # -> Breps, Closed
B_2 = ClusterOutput(join_2.Breps)

# ==== cluster Cluster_87
srf = ClusterInput()
srf_2 = Surface(srf)
area = Area(Geometry=srf_2)  # -> Area, Centroid
tstat = TreeStatistics(Tree=srf_2)  # -> Paths, Length, Count
listdexs = ListIndices(List=tstat.Paths)
pisos = ClusterInput()
replace = ReplaceItems(List=tstat.Paths, Indices=listdexs, Wrap=False)
cluster = Cluster_86(T=srf_2, num=area.Area)  # -> i_2, L, i
multiplication = Multiplication(PISOS=pisos, AREA=area.Area)
addition = Addition(A=replace, B=pisos)  # -> simplify(graft(Result))
ma = MassAddition(Input=flatten(multiplication))  # -> Result, PartialResults
cc = ClusterInput()
tstat_2 = TreeStatistics(Tree=addition)  # -> Paths, Length, Count
subtraction = Subtraction(CC=cc, B=ma.Result)
replace_2 = ReplacePaths(Data=addition, Search=tstat_2.Paths, Replace=tstat.Paths)
division = Division(A=subtraction, B=cluster.i)
round = Round(Number=division)  # -> Nearest, Floor, Ceiling
branch = TreeBranch(Tree=replace_2, Path=cluster.L, MaintainPaths=True)
branch_2 = TreeBranch(Tree=replace_2, Path=cluster.i_2, MaintainPaths=True)
num = Number(round.Floor)
tstat_3 = TreeStatistics(Tree=num)  # -> Paths, Length, Count
replace_3 = ReplacePaths(Data=num, Search=tstat_3.Paths, Replace=cluster.i_2)
addition_2 = Addition(A=branch_2, B=replace_3)
smaller = SmallerThan(FirstNumber=addition_2, SecondNumber=0)  # -> SmallerThan, OrEqualTo
panel = Panel(addition_2)
filter = StreamFilter(Gate=smaller.SmallerThan, Stream0=addition_2, Stream1=0)
merge = Merge(Data1=branch, Data2=filter)
R = ClusterOutput(merge)

# ==== cluster Cluster_88
T = ClusterInput()
tstat = TreeStatistics(Tree=T)  # -> Paths, Length, Count
listdexs = ListIndices(List=tstat.Paths)
replace = ReplaceItems(List=tstat.Paths, Item=0, Indices=listdexs, Wrap=False)  # -> simplify(graft(List))
tstat_2 = TreeStatistics(Tree=replace)  # -> Paths, Length, Count
replace_2 = ReplacePaths(Data=replace, Search=tstat_2.Paths, Replace=tstat.Paths)
D = ClusterOutput(replace_2)

# ==== cluster Cluster_90
srf = ClusterInput()
T = ClusterInput()
D = ClusterInput()
srf_2 = Surface(srf)
item = ListItem(List=srf_2, Index=-1, Wrap=True)
item_2 = ListItem(List=srf_2, Index=0, Wrap=True)
cull_i = CullIndex(List=srf_2, Indices=-1, Wrap=True)
tstat = TreeStatistics(Tree=T)  # -> Paths, Length, Count
area = Area(Geometry=item)  # -> Area, Centroid
extr = Extrude(Base=item_2, Direction=D)
tstat_2 = TreeStatistics(Tree=cull_i)  # -> Paths, Length, Count
pdecon = Deconstruct(Point=area.Centroid)  # -> XComponent, YComponent, ZComponent
cap = CapHoles(Brep=extr)
panel = Panel(srf_2)
replace = ReplacePaths(Data=cull_i, Search=tstat_2.Paths, Replace=tstat.Paths)
area_2 = Area(Geometry=replace)  # -> Area, Centroid
Z = ClusterOutput(pdecon.ZComponent)
B = ClusterOutput(cap)
A = ClusterOutput(area_2.Area)
D_2 = ClusterOutput(replace)

# ==== cluster Cluster_91
relay = ClusterInput()
lng = ListLength(List=relay)
equals = Equality(FirstNumber=lng, SecondNumber=1)  # -> Equality, Inequality
cull = CullPattern(List=relay, CullPattern=equals.Inequality)
clean = CleanTree(RemoveNulls=True, RemoveInvalid=True, RemoveEmpty=True, Tree=cull)
panel = Panel(cull)
T = ClusterOutput(clean)

# ==== cluster Cluster_93
B = ClusterInput()
debrep = DeconstructBrep(Brep=simplify(B))  # -> Faces, Edges, Vertices
area = Area(Geometry=debrep.Faces)  # -> Area, Centroid
pdecon = Deconstruct(Point=area.Centroid)  # -> XComponent, YComponent, ZComponent
sort = SortList(Keys=pdecon.ZComponent, ValuesA=debrep.Faces)  # -> Keys, ValuesA
item = ListItem(List=sort.ValuesA, Index=-1, Wrap=True)
A = ClusterOutput(sort.ValuesA)
i = ClusterOutput(item)

# ==== cluster Cluster_101
txt = ClusterInput()
txt_2 = Text(txt)
txt_3 = Text(txt_2)
cset = CreateSet(List=txt_3)  # -> Set, Map
mindex = MemberIndex(Set=txt_3, Member=cset.Set)  # -> Index, Count
N = ClusterOutput(mindex.Count)
partition = PartitionList(List=txt_2, Size=mindex.Count)
subtotales = ClusterOutput(partition)

# ==== cluster Cluster_102
num = ClusterInput()
num_2 = Number(num)
num_3 = Number(num_2)
cset = CreateSet(List=num_3)  # -> Set, Map
mindex = MemberIndex(Set=num_3, Member=cset.Set)  # -> Index, Count
partition = PartitionList(List=num_2, Size=mindex.Count)
subtotales = ClusterOutput(partition)

# ==== cluster Cluster_105
d1 = ClusterInput()
txt = Text("Altura")
txt_2 = Text("Tangente")
txt_3 = Text("Distancia")
merge = Merge(Data1=d1, Data2=txt)
merge_2 = Merge(Data1=" ", Data2=txt_2)
merge_3 = Merge(Data1=" ", Data2=txt_3)
L = ClusterInput()
L_2 = ClusterInput()
L_3 = ClusterInput()
ins = InsertItems(List=L, Item=merge, Indices=0, Wrap=True)
ins_2 = InsertItems(List=L_2, Item=merge_2, Indices=0, Wrap=True)
ins_3 = InsertItems(List=L_3, Item=merge_3, Indices=0, Wrap=True)
L_4 = ClusterOutput(ins)
L_5 = ClusterOutput(ins_2)
L_6 = ClusterOutput(ins_3)

# ==== cluster Cluster_106
txt = ClusterInput()
txt_2 = Text(txt)
txt_3 = Text("Sombra Poniente")
txt_4 = Text("Sombra Sur")
txt_5 = Text("Sombra Oriente")
merge = Merge(Data1=txt_2, Data2=txt_3)
merge_2 = Merge(Data1=" ", Data2=txt_4)
merge_3 = Merge(Data1=" ", Data2=txt_5)
L = ClusterInput()
L_2 = ClusterInput()
L_3 = ClusterInput()
ins = InsertItems(List=L, Item=merge, Indices=0, Wrap=True)
ins_2 = InsertItems(List=L_2, Item=merge_2, Indices=0, Wrap=True)
ins_3 = InsertItems(List=L_3, Item=merge_3, Indices=0, Wrap=True)
L_4 = ClusterOutput(ins)
L_5 = ClusterOutput(ins_2)
L_6 = ClusterOutput(ins_3)

# ==== cluster Cluster_107
txt = Text()
txt_2 = ClusterInput()
txt_3 = Text(txt_2)
txt_4 = Text("Sombra Poniente")
txt_5 = Text("Sombra Sur")
txt_6 = Text("Sombra Oriente")
merge = Merge(Data1=txt_3, Data2=txt_4)
merge_2 = Merge(Data2=txt_5)
merge_3 = Merge(Data2=txt_6)
L = ClusterInput()
L_2 = ClusterInput()
L_3 = ClusterInput()
ins = InsertItems(List=L, Item=merge, Indices=0, Wrap=True)
ins_2 = InsertItems(List=L_2, Item=merge_2, Indices=0, Wrap=True)
ins_3 = InsertItems(List=L_3, Item=merge_3, Indices=0, Wrap=True)
panel = Panel(ins)
L_4 = ClusterOutput(ins)
L_5 = ClusterOutput(ins_2)
L_6 = ClusterOutput(ins_3)

# ==== cluster Cluster_108
d2 = ClusterInput()
txt = Text("Altura")
txt_2 = Text("Tangente")
txt_3 = Text("Distancia")
merge = Merge(Data1=" ", Data2=d2, Data3=txt)
merge_2 = Merge(Data1=" ", Data2=txt_2)
merge_3 = Merge(Data1=" ", Data2=txt_3)
L = ClusterInput()
L_2 = ClusterInput()
L_3 = ClusterInput()
ins = InsertItems(List=L, Item=merge, Indices=0, Wrap=True)
ins_2 = InsertItems(List=L_2, Item=merge_2, Indices=0, Wrap=True)
ins_3 = InsertItems(List=L_3, Item=merge_3, Indices=0, Wrap=True)
panel = Panel(merge)
L_4 = ClusterOutput(ins)
L_5 = ClusterOutput(ins_2)
L_6 = ClusterOutput(ins_3)

# ==== cluster Cluster_109
num = ClusterInput()
num_2 = Number(num)
L = ClusterInput()
replace = ReplaceItems(List=num_2, Indices=num_2, Wrap=False)
ins = InsertItems(List=L, Item=replace, Indices=-1, Wrap=True)
I = ClusterInput()
ins_2 = InsertItems(List=ins, Item=I, Indices=-1, Wrap=True)
L_2 = ClusterOutput(ins_2)

# ==== cluster Cluster_111
L = ClusterInput()
d2 = ClusterInput()
I = ClusterInput()
d2_2 = ClusterInput()
L_2 = ClusterInput()
d2_3 = ClusterInput()
listdexs = ListIndices(List=L_2)
replace = ReplaceItems(List=listdexs, Indices=listdexs, Wrap=False)
replace_2 = ReplaceItems(List=replace, Item=I, Indices=0, Wrap=False)
cluster = Cluster_110(L=L, d2=d2)
cluster_2 = Cluster_110(L=replace_2, d2=d2_2)
cluster_3 = Cluster_110(L=L_2, d2=d2_3)
L_3 = ClusterOutput(cluster)
L_4 = ClusterOutput(cluster_2)
L_5 = ClusterOutput(cluster_3)

# ==== cluster Cluster_113
T = ClusterInput()
T_2 = ClusterInput()
tstat = TreeStatistics(Tree=T)  # -> Paths, Length, Count
tstat_2 = TreeStatistics(Tree=T_2)  # -> Paths, Length, Count
replace = ReplacePaths(Data=T_2, Search=tstat_2.Paths, Replace=tstat.Paths)
D = ClusterOutput(replace)

# ==== cluster Cluster_125
A = ClusterInput()
B = ClusterInput()
subtraction = Subtraction(A=A, B=B)
division = Division(A=subtraction, B=B)
max = Maximum(A=division, B=0)
abs = Absolute(Value=division)
sqr = Square(Value=abs)
y = ClusterOutput(sqr)

# ==== cluster Cluster_126
C = ClusterInput()
relay = ClusterInput()
explode = Explode(Curve=C, Recursive=True)  # -> Segments, Vertices
pline = PolyLine(Vertices=explode.Vertices, Closed=True)
relay_2 = ClusterInput()
boundary = BoundarySurfaces(Edges=relay)  # -> reparameterize(Surfaces)
join = JoinCurves(Curves=C, Preserve=False)
offset = OffsetCurve(Curve=boundary, Distance=expr("x/2", relay_2), Corners=1)
offset_2 = OffsetCurve(Curve=join, Distance=relay_2, Corners=1)
boundary_2 = BoundarySurfaces(Edges=offset_2)
C_2 = ClusterOutput(offset)
t = ClusterInput()
rdiff = RegionDifference(CurvesA=boundary, CurvesB=boundary_2)
boundary_3 = BoundarySurfaces(Edges=reparameterize(rdiff))
eval = EvaluateCurve(Curve=reparameterize(relay), Parameter=t)  # -> Point, Tangent, Angle
alongcrv = SortAlongCurve(Points=eval.Point, Curve=relay)  # -> Points, Indices
crv_cp = CurveClosestPoint(Point=alongcrv.Points, Curve=offset_2)  # -> Point, Parameter, Distance
ln = Line(StartPoint=crv_cp.Point, EndPoint=alongcrv.Points)
srfsplit = SurfaceSplit(Surface=boundary_3, Curves=ln)
F = ClusterOutput(srfsplit)

# ==== cluster Cluster_132
num = ClusterInput()
T = ClusterInput()
num_2 = Number(num)
L = ClusterInput()
L_2 = ClusterInput()
L_3 = ClusterInput()
branch = TreeBranch(Tree=T, Path="{-2}", MaintainPaths=True)
num_3 = ClusterOutput(num_2)
cset = CreateSet(List=L)  # -> Set, Map
cset_2 = CreateSet(List=L_2)  # -> Set, Map
cset_3 = CreateSet(List=L_3)  # -> Set, Map
cset_4 = CreateSet(List=branch)  # -> Set, Map
mindex = MemberIndex(Set=cset_4.Set, Member=num_2)  # -> Index, Count
mindex_2 = MemberIndex(Set=cset.Set, Member=num_2)  # -> Index, Count
mindex_3 = MemberIndex(Set=cset_2.Set, Member=num_2)  # -> Index, Count
mindex_4 = MemberIndex(Set=cset_3.Set, Member=num_2)  # -> Index, Count
mindex_5 = MemberIndex(Set=mindex_2.Count, Member=1)  # -> Index, Count
mindex_6 = MemberIndex(Set=mindex_3.Count, Member=1)  # -> Index, Count
mindex_7 = MemberIndex(Set=mindex_4.Count, Member=1)  # -> Index, Count
mindex_8 = MemberIndex(Set=mindex.Count, Member=1)  # -> Index, Count
I = ClusterOutput(mindex_5.Index)
I_2 = ClusterOutput(mindex_6.Index)
I_3 = ClusterOutput(mindex_7.Index)
I_4 = ClusterOutput(mindex_8.Index)

# ==== cluster Cluster_140
T = ClusterInput()
relay = ClusterInput()
tstat = TreeStatistics(Tree=relay)  # -> Paths, Length, Count
tstat_2 = TreeStatistics(Tree=T)  # -> Paths, Length, Count
replace = ReplacePaths(Data=relay, Search=tstat.Paths, Replace=tstat_2.Paths)
D = ClusterOutput(replace)

# ==== cluster Cluster_141
relay = ClusterInput()
listdexs = ListIndices(List=relay)
cull_i = CullIndex(List=relay, Indices=listdexs, Wrap=True)  # -> simplify(List)
cluster = Cluster_140(relay=cull_i, T=relay)
panel = Panel(cluster)
D = ClusterOutput(cluster)

# ==== cluster Cluster_143
relay = ClusterInput()
null = NullItem(Item=relay)  # -> NullFlags, InvalidFlags, Description
expression = Expression(x=null.NullFlags, y=relay, Expression="if(x=True, 0,y)")
R = ClusterOutput(expression)

# ==== cluster Cluster_144
num = ClusterInput()
num_2 = Number(num)
equals = Equality(FirstNumber=num_2, SecondNumber=0)  # -> Equality, Inequality
bool = Boolean(True)
mindex = MemberIndex(Set=equals.Equality, Member=bool)  # -> Index, Count
replace = ReplaceItems(List=num_2, Item="-", Indices=mindex.Index, Wrap=False)
L = ClusterOutput(replace)

# ==== cluster Totales
pisos = ClusterInput()
areas = ClusterInput()
pisos_2 = Number(simplify(flatten(pisos)))
areas_2 = Number(simplify(areas))
smaller = SmallerThan(FirstNumber=pisos_2, SecondNumber=0)  # -> SmallerThan, OrEqualTo
dispatch = Dispatch(List=areas_2, DispatchPattern=smaller.SmallerThan)  # -> ListA, ListB
ma = MassAddition(Input=dispatch.ListA)  # -> Bajo000, PartialResults
ma_2 = MassAddition(Input=dispatch.ListB)  # -> Sobre000, PartialResults
relay = Relay([ma.Bajo000, ma_2.Sobre000])
ma_3 = MassAddition(Input=relay)  # -> Result, PartialResults
merge = Merge(Data1=ma.Bajo000, Data2=ma_2.Sobre000, Data3=ma_3.Result)
totales = ClusterOutput(merge)

# ==== cluster Cluster_145
L = ClusterInput()
item = ListItem(List=L, Index=0, Wrap=True)  # -> Item, Item1, Item2
ma = MassAddition(Input=flatten(item.Item))  # -> Result, PartialResults
ma_2 = MassAddition(Input=flatten(item.Item1))  # -> Result, PartialResults
ma_3 = MassAddition(Input=flatten(item.Item2))  # -> Result, PartialResults
d1 = ClusterInput()
merge = Merge(Data1=d1, Data2=ma.Result, Data3=ma_2.Result, Data4=ma_3.Result)
R = ClusterOutput(merge)

# ==== cluster Cluster_146
T = ClusterInput()
simplify = SimplifyTree(Tree=T, Front=False)
tstat = TreeStatistics(Tree=simplify)  # -> Paths, Length, Count
cull_i = CullIndex(List=tstat.Paths, Indices=0, Wrap=True)
item = ListItem(List=tstat.Paths, Index=0, Wrap=True)
I = ClusterInput()
branch = TreeBranch(Tree=simplify, Path=item, MaintainPaths=True)
branch_2 = TreeBranch(Tree=simplify, Path=cull_i, MaintainPaths=True)
ins = InsertItems(List=branch, Item=I, Indices=1, Wrap=True)
merge = Merge(Data1=ins, Data2=branch_2)
R = ClusterOutput(merge)

# ==== cluster Cluster_168
L = ClusterInput()
item = ListItem(List=L, Index=0, Wrap=True)  # -> Item, Item1, Item2
ma = MassAddition(Input=flatten(item.Item))  # -> Result, PartialResults
ma_2 = MassAddition(Input=flatten(item.Item1))  # -> Result, PartialResults
ma_3 = MassAddition(Input=flatten(item.Item2))  # -> Result, PartialResults
d1 = ClusterInput()
merge = Merge(Data1=d1, Data2=ma.Result, Data3=ma_2.Result, Data4=ma_3.Result)
listdexs = ListIndices(List=merge)
replace = ReplaceItems(List=merge, Indices=listdexs, Wrap=False)
L_2 = ClusterOutput(replace)

# ==== cluster Cluster_176
L = ClusterInput()
I = ClusterInput()
merge = Merge()
ins = InsertItems(List=L, Item=I, Indices=0, Wrap=True)
ins_2 = InsertItems(List=ins, Item=merge, Indices=0, Wrap=True)
L_2 = ClusterOutput(ins_2)

# ==== cluster Cluster_177
relay = ClusterInput()
T = ClusterInput()
tstat = TreeStatistics(Tree=T)  # -> Paths, Length, Count
tstat_2 = TreeStatistics(Tree=flatten(relay))  # -> Paths, Length, Count
replace = ReplacePaths(Data=flatten(relay), Search=tstat_2.Paths, Replace=tstat.Paths)
D = ClusterOutput(replace)

# ==== cluster Cluster_178
panel = Panel("""Superficie a Construir 
(GBA)""")
L = ClusterInput()
I = ClusterInput()
merge = Merge(Data2=panel)
ins = InsertItems(List=L, Item=I, Indices=0, Wrap=True)
ins_2 = InsertItems(List=ins, Item=merge, Indices=0, Wrap=True)
L_2 = ClusterOutput(ins_2)

# ==== cluster Cluster_179
num = ClusterInput()
pisos = ClusterInput()
num_2 = Number(num)
cluster = Totales(pisos=pisos, areas=num_2)
ins = InsertItems(List=num_2, Item=cluster, Indices=-1, Wrap=True)
L = ClusterOutput(ins)

# ==== cluster Cluster_180
input = ClusterInput()
L = ClusterInput()
I = ClusterInput()
merge = Merge()
ins = InsertItems(List=L, Item=I, Indices=0, Wrap=True)
ins_2 = InsertItems(List=ins, Item=merge, Indices=0, Wrap=True)
L_2 = ClusterOutput(ins_2)

# ==== cluster Cluster_181
input = ClusterInput()
L = ClusterInput()
I = ClusterInput()
merge = Merge(Data2="Terrazas")
ins = InsertItems(List=L, Item=I, Indices=0, Wrap=True)
ins_2 = InsertItems(List=ins, Item=merge, Indices=0, Wrap=True)
L_2 = ClusterOutput(ins_2)

# ==== cluster Cluster_5
pt = ClusterInput()
crv = ClusterInput()
pt_2 = Point(pt)
crv_2 = Curve(crv)
ext = ExtendCurve(Curve=crv_2, Type=0, Start=0, End=200)
end = EndPoints(Curve=ext)  # -> Start, End
crv_3 = ClusterInput()
pdecon = Deconstruct(Point=end.End)  # -> XComponent, YComponent, ZComponent
crv_4 = Curve(crv_3)
line = LineSDL(Start=end.Start, Direction=Vector(0, 0, 1), Length=pdecon.ZComponent)
hipotenusa = ClusterOutput(ext)
end_2 = EndPoints(Curve=line)  # -> Start, End
ln = Line(StartPoint=end.End, EndPoint=end_2.End)
L = ClusterOutput(ln)
L_2 = ClusterOutput(line)

# ==== cluster Cluster_7
relay = ClusterInput()
crv = Curve(relay)
offset = OffsetCurve(Curve=relay, Distance=1, Corners=1)
explode = Explode(Curve=offset, Recursive=True)  # -> Segments, Vertices
explode_2 = Explode(Curve=relay, Recursive=True)  # -> Segments, Vertices
F = ClusterInput()
x = ClusterInput()
ln = Line(StartPoint=explode_2.Vertices, EndPoint=explode.Vertices)
neg = Negative(Value=x)
Z = UnitZ(Factor=F)
line = LineSDL(Start=explode_2.Vertices, Direction=ln, Length=neg)
offset_2 = OffsetCurve(Curve=explode_2.Segments, Distance=expr("-x", neg), Corners=1)
move = Move(Geometry=line, Motion=Z)  # -> Geometry, Transform
end = EndPoints(Curve=move.Geometry)  # -> Start, End
end_2 = EndPoints(Curve=line)  # -> Start, End
ln_2 = Line(StartPoint=end_2.Start, EndPoint=end.End)
ln_3 = Line(StartPoint=end.Start, EndPoint=end.End)
ln_4 = Line(StartPoint=end_2.Start, EndPoint=end.Start)
join = JoinCurves(Curves=[ln_3, ln_2, ln_4], Preserve=False)
boundary = BoundarySurfaces(Edges=join)
item = ListItem(List=boundary, Index=[0, -1], Wrap=True)
swp1 = Sweep1(Rail=crv, Sections=ln_2, Miter=1)
swp1_2 = Sweep1(Rail=crv, Sections=ln_4, Miter=1)
join_2 = BrepJoin(Breps=[item, swp1, swp1_2])  # -> Breps, Closed
cap = CapHoles(Brep=join_2.Breps)
S = ClusterOutput(swp1)
B = ClusterOutput(cap)
S_2 = ClusterOutput()

# ==== cluster Cluster_8
pt = ClusterInput()
crv = ClusterInput()
pt_2 = Point(pt)
crv_2 = Curve(crv)
ext = ExtendCurve(Curve=crv_2, Type=0, Start=0, End=200)
end = EndPoints(Curve=ext)  # -> Start, End
pdecon = Deconstruct(Point=pt_2)  # -> XComponent, YComponent, ZComponent
crv_3 = ClusterInput()
pdecon_2 = Deconstruct(Point=end.End)  # -> XComponent, YComponent, ZComponent
pt_3 = Point(end.End)
pt_4 = ConstructPoint(XCoordinate=pdecon.XComponent, YCoordinate=pdecon.YComponent, ZCoordinate=pdecon_2.ZComponent)
crv_4 = Curve(crv_3)
ln = Line(StartPoint=pt_3, EndPoint=pt_4)
len = Length(Curve=ln)
ln_2 = Line(StartPoint=pt_2, EndPoint=pt_4)
move = Move(Geometry=crv_4, Motion=ln_2)  # -> Geometry, Transform
offset = OffsetCurve(Curve=move.Geometry, Distance=len, Corners=1)
cateto_vert = ClusterOutput(ln_2)
hipotenusa = ClusterOutput(ext)
cateto_horiz = ClusterOutput(ln)
C = ClusterOutput(offset)
r1 = ClusterOutput(move.Geometry)

# ==== cluster Cluster_15
relay = ClusterInput()
relay_2 = ClusterInput()
ccx = CurveCurve(CurveA=relay, CurveB=relay_2)  # -> flatten(Points), ParamsA, ParamsB
ptstrimcrv = PointsTrimCurve(Curve=relay_2, Points=ccx.Points, Flip=True)  # -> Trimmed, SubDomains, Intersected
ptstrimcrv_2 = PointsTrimCurve(Curve=relay, Points=ccx.Points, Flip=True)  # -> Trimmed, SubDomains, Intersected
join = JoinCurves(Curves=[ptstrimcrv.Trimmed, ptstrimcrv_2.Trimmed], Preserve=False)
C = ClusterOutput(join)

# ==== cluster Cluster_16
relay = ClusterInput()
C = ClusterInput()
join = JoinCurves(Curves=C, Preserve=False)
neg = Negative(Value=relay)
offset = OffsetCurve(Curve=join, Distance=relay, Corners=1)
offset_2 = OffsetCurve(Curve=join, Distance=neg, Corners=1)
relay_2 = ClusterInput()
midpt = CurveMiddle(Curve=offset)
midpt_2 = CurveMiddle(Curve=offset_2)
incurve = PointInCurve(Point=midpt, Curve=relay_2)  # -> Relationship, Point
incurve_2 = PointInCurve(Point=midpt_2, Curve=relay_2)  # -> Relationship, Point
equals = Equality(FirstNumber=incurve.Relationship, SecondNumber=0)  # -> Equality, Inequality
equals_2 = Equality(FirstNumber=incurve_2.Relationship, SecondNumber=0)  # -> Equality, Inequality
merge = Merge(Data1=offset, Data2=offset_2)
merge_2 = Merge(Data1=equals.Inequality, Data2=equals_2.Inequality)
dispatch = Dispatch(List=merge, DispatchPattern=merge_2)  # -> ListA, ListB
A = ClusterOutput(dispatch.ListA)

# ==== cluster Cluster_22
relay = ClusterInput()
C = ClusterInput()
join = JoinCurves(Curves=C, Preserve=False)
neg = Negative(Value=relay)
offset = OffsetCurve(Curve=join, Distance=neg, Corners=1)
relay_2 = ClusterInput()
offset_2 = OffsetCurve(Curve=join, Distance=relay, Corners=1)
cluster = Cluster_21(C=offset_2, R=relay)
cluster_2 = Cluster_20(C=offset, R=neg)
midpt = CurveMiddle(Curve=offset_2)
midpt_2 = CurveMiddle(Curve=offset)
incurve = PointInCurve(Point=midpt, Curve=relay_2)  # -> Relationship, Point
incurve_2 = PointInCurve(Point=midpt_2, Curve=relay_2)  # -> Relationship, Point
equals = Equality(FirstNumber=incurve.Relationship, SecondNumber=0)  # -> Equality, Inequality
equals_2 = Equality(FirstNumber=incurve_2.Relationship, SecondNumber=0)  # -> Equality, Inequality
merge = Merge(Data1=offset_2, Data2=offset)
merge_2 = Merge(Data1=equals.Inequality, Data2=equals_2.Inequality)
dispatch = Dispatch(List=merge, DispatchPattern=merge_2)  # -> ListA, ListB
A = ClusterOutput(dispatch.ListA)

# ==== cluster Cluster_34
D = ClusterInput()
R = ClusterInput()
tstat = TreeStatistics(Tree=D)  # -> Paths, Length, Count
replace = ReplacePaths(Data=D, Search=tstat.Paths, Replace=R)
D_2 = ClusterOutput(replace)

# ==== cluster Cluster_81
crv = ClusterInput()
pt = ClusterInput()
crv_2 = Curve(crv)
pt_2 = Point(pt)
cullpt = CullDuplicates(Points=pt_2, Tolerance=0.1, CullMode=1)  # -> Points, Indices, Valence
join = JoinCurves(Curves=crv_2, Preserve=False)
planar = Planar(Curve=crv_2)  # -> Planar, Plane, Deviation
crv_cp = CurveClosestPoint(Point=cullpt.Points, Curve=reparameterize(join))  # -> Point, Parameter, Distance
Z = UnitZ(Factor=1)
dprod = DotProduct(VectorA=Z, VectorB=planar.Plane, Unitize=False)
eval = EvaluateCurve(Curve=reparameterize(crv_2), Parameter=crv_cp.Parameter)  # -> Point, Tangent, Angle
Z_2 = UnitZ(Factor=dprod)
expression = Expression(x=eval.Angle, Expression="(pi-x)/-2")
xprod = CrossProduct(VectorA=eval.Tangent, VectorB=Z_2, Unitize=False)  # -> Vector, Length
pl = ConstructPlane(Origin=crv_cp.Point, XAxis=eval.Tangent, YAxis=xprod.Vector)
U = ClusterInput()
prot = RotatePlane(Plane=pl, Angle=expression)
pt_3 = PointOriented(BasePlane=prot, UComponent=expr("-x", U), VComponent=0, WComponent=0)
ln = Line(StartPoint=prot, EndPoint=pt_3)
end = EndPoints(Curve=ln)  # -> Start, End
pt_4 = Point(end.End)
L = ClusterOutput(ln)
pt_5 = ClusterOutput(pt_4)

# ==== cluster Cluster_82
crv = ClusterInput()
D = ClusterInput()
P = ClusterInput()
crv_2 = Curve(crv)
C = ClusterInput()
offset = OffsetCurve(Curve=crv_2, Distance=D, Plane=P, Corners=1)
end = EndPoints(Curve=C)  # -> Start, End
end_2 = EndPoints(Curve=offset)  # -> Start, End
ln = Line(StartPoint=end.Start, EndPoint=end_2.Start)
ln_2 = Line(StartPoint=end.End, EndPoint=end_2.End)
end_3 = EndPoints(Curve=ln)  # -> Start, End
end_4 = EndPoints(Curve=ln_2)  # -> Start, End
ln_3 = Line(StartPoint=end_3.End, EndPoint=end_4.End)
join = JoinCurves(Curves=[ln_3, ln, ln_2, crv_2], Preserve=False)
C_2 = ClusterOutput(join)

# ==== cluster Cluster_86
num = ClusterInput()
num_2 = Number(flatten(num))
T = ClusterInput()
panel = Panel(num_2)
tstat = TreeStatistics(Tree=T)  # -> Paths, Length, Count
sort = SortList(Keys=panel, ValuesA=panel)  # -> Keys, ValuesA
item = ListItem(List=sort.ValuesA, Index=0, Wrap=True)
num_3 = Number(panel)
num_4 = Number(item)
mindex = MemberIndex(Set=num_3, Member=num_4)  # -> Index, Count
i = ClusterOutput(item)
item_2 = ListItem(List=tstat.Paths, Index=mindex.Index, Wrap=True)
cull_i = CullIndex(List=tstat.Paths, Indices=mindex.Index, Wrap=True)
L = ClusterOutput(cull_i)
i_2 = ClusterOutput(item_2)

# ==== cluster Cluster_110
d2 = ClusterInput()
merge = Merge(Data2=d2)  # -> flatten(Result)
L = ClusterInput()
ins = InsertItems(List=L, Item=merge, Indices=-1, Wrap=True)
L_2 = ClusterOutput(ins)

# ==== cluster Cluster_20
C = ClusterInput()
explode = Explode(Curve=C, Recursive=True)  # -> Segments, Vertices
lng = ListLength(List=explode.Segments)
equals = Equality(FirstNumber=lng, SecondNumber=1)  # -> Equality, Inequality
cull = CullPattern(List=explode.Segments, CullPattern=equals.Inequality)
cull_2 = CullPattern(List=explode.Segments, CullPattern=equals.Equality)
clean = CleanTree(RemoveNulls=True, RemoveInvalid=True, RemoveEmpty=True, Tree=cull)
join = JoinCurves(Curves=clean, Preserve=False)
R = ClusterInput()
clean_2 = CleanTree(RemoveNulls=True, RemoveInvalid=True, RemoveEmpty=True, Tree=cull_2)  # -> simplify(Tree)
fillet = Fillet(Curve=join, Radius=expr("x", R))  # -> simplify(Curve)
merge = Merge(Data1=fillet, Data2=clean_2)
R_2 = ClusterOutput(merge)

# ==== cluster Cluster_21
C = ClusterInput()
explode = Explode(Curve=C, Recursive=True)  # -> Segments, Vertices
lng = ListLength(List=explode.Segments)
equals = Equality(FirstNumber=lng, SecondNumber=1)  # -> Equality, Inequality
cull = CullPattern(List=explode.Segments, CullPattern=equals.Inequality)
cull_2 = CullPattern(List=explode.Segments, CullPattern=equals.Equality)
clean = CleanTree(RemoveNulls=True, RemoveInvalid=True, RemoveEmpty=True, Tree=cull)
join = JoinCurves(Curves=clean, Preserve=False)
R = ClusterInput()
clean_2 = CleanTree(RemoveNulls=True, RemoveInvalid=True, RemoveEmpty=True, Tree=cull_2)  # -> simplify(Tree)
fillet = Fillet(Curve=join, Radius=R)  # -> simplify(Curve)
merge = Merge(Data1=fillet, Data2=clean_2)
R_2 = ClusterOutput(merge)
